# Grasshopper definition SimpleRain Example.gh (Grasshopper 0.9.76)
# plug-ins: Python Interpreter

panel = Panel("https://www.energyplus.net/weather-download/north_and_central_america_wmo_region_4/USA/NY/USA_NY_New.York-J.F.Kennedy.Intl.AP.744860_TMY3/all")
epw_stat = Ladybug_OpenEPWAndSTATWeatherFiles(weatherFileURL=panel)  # -> epwFile, statFile; plug-in component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

update = LivestockUpdate(Update=Toggle(False))  # -> out
# ---------- update: Python ----------
#------------------------------------------------------------------------------#
# IMPORTS

import sys
import os
import shutil
import zipfile
import time
import urllib
import System

n = 20
ghenv.Component.Name = "Livestock Update"
ghenv.Component.NickName = "Update"
ghenv.Component.Message = "VER 0.0.1 | May 2017"
ghenv.Component.IconDisplayMode = ghenv.Component.IconDisplayMode.application
ghenv.Component.Category = "Livestock"
ghenv.Component.SubCategory = "0 | Miscellaneous"
ghenv.Component.Description = "Update Livestock"
	
#------------------------------------------------------------------------------#
# COMPONENT

def downloadSourceAndUnzip():
    """
    Download the source code from github and unzip it in temp folder
    """

    url = "https://github.com/ocni-dtu/livestock_gh/archive/master.zip"
    targetDirectory = r'C:\livestock'

    # download the zip file
    print("Downloading the source code...")
    zipFile = os.path.join(targetDirectory, os.path.basename(url))
    
    # if the source file is just downloded then just use the available file
    if os.path.isfile(zipFile) and time.time() - os.stat(zipFile).st_mtime < 1000:
        download = False
    else:
        download = True

        # remove the old version
        try:
            shutil.rmtree(targetDirectory)
        except:
            pass

    # create the target directory
    if not os.path.isdir(targetDirectory): os.mkdir(targetDirectory)

    if download:
        try:
            client = System.Net.WebClient()
            client.DownloadFile(url, zipFile)
            if not os.path.isfile(zipFile):
                print("Download failed! Try to download and unzip the file manually form:\n" + url)
                return
        except Exception, e:
            print(`e` + "\nDownload failed! Try to download and unzip the file manually form:\n" + url)
            return

    # unzip the file
    with zipfile.ZipFile(zipFile) as zf:
        for f in zf.namelist():
            folder = f.replace('livestock_gh-master/','C:/livestock/')
            if f.endswith('/'):
                try:
                    os.makedirs(folder)
                    os.makedirs(f)
                except:
                    pass
            else:
                zf.extract(f, targetDirectory)
                file = f.replace('livestock_gh-master/','C:/livestock/')
                shutil.move('C:/livestock/'+f,file)
                
    shutil.rmtree('C:/livestock/livestock_gh-master')
    
    # Create SSH folder
    if not os.path.isdir('C:/livestock/python/ssh'):
        os.mkdir('C:/livestock/python/ssh')
    
    #Move GH components
    userObjectsFolder = os.getenv('APPDATA') + '/Grasshopper/UserObjects/'
    componentsFolder = 'C:/livestock/grasshopper/components/'
    for obj in os.listdir(componentsFolder):
        shutil.move(componentsFolder+obj,userObjectsFolder+obj)
    shutil.rmtree('C:/livestock/grasshopper')
    
    return True

    
#------------------------------------------------------------------------------#
# OUTPUTS

if Update:
    downloadSourceAndUnzip()
    print('Download done')
# ---------- end update ----------
ladybug = Ladybug_Ladybug()  # -> Vviiiiiiiiiizzz; plug-in component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

# ----
# Initial geometry
X = Slider(13, range=1..20)
Y = Slider(2, range=1..10)
canopy = Canopy(B=X, B_2=Y)
building = Brep(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)

# ----
# Rotation
number_slider = Slider(43, range=0..360)
rad = Radians(Degrees=number_slider)

# ----
# Import of weather data
importepw = Ladybug_ImportEpw(epwFile=epw_stat.epwFile)  # -> readMe, latitude, location, dryBulbTemperature, dewPointTemperature, relativeHumidity, windSpeed, windDirection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; plug-in component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
separatedata = Ladybug_SeparateData(inputList=flatten(importepw.dryBulbTemperature))  # -> numbers, strings; plug-in component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
separatedata_2 = Ladybug_SeparateData(inputList=flatten(importepw.windSpeed))  # -> numbers, strings; plug-in component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
separatedata_3 = Ladybug_SeparateData(inputList=flatten(importepw.windDirection))  # -> numbers, strings; plug-in component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
separatedata_4 = Ladybug_SeparateData(inputList=flatten(importepw.liquidPrecipitationDepth))  # -> numbers, strings; plug-in component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

# ----
# Modified geometry
rotate = Rotate(Geometry=canopy, Angle=rad, Plane=PlaneXY(0, 0, 0))  # -> Geometry, Transform
rotate_2 = Rotate(Geometry=building, Angle=rad, Plane=PlaneXY(0, 0, 0))  # -> Geometry, Transform
debrep = DeconstructBrep(Brep=rotate_2.Geometry)  # -> Faces, Edges, Vertices
wires = BrepWireframe(Brep=[rotate_2.Geometry, rotate.Geometry], Density=-1)
item = ListItem(List=debrep.Faces, Index=Slider(3, range=0..5), Wrap=True)

# ----
# Preview
swatch = ColourSwatch(SwatchColor=RGB(0, 0, 0))
preview = CustomPreview(Geometry=wires, Shader=swatch)
preview_2 = CustomPreview(Geometry=rotate.Geometry, Shader=ColourSwatch(SwatchColor=RGBA(201, 36, 36, 142)))

# ----
# Test points and mesh
number_slider_2 = Slider(0, range=0..2)
gentestpts = Honeybee_GenerateTestPoints(testGeometry=item, gridSize=Slider(1, range=0..2), distBaseSrf=number_slider_2, moveTestMesh=Toggle(False))  # -> readMe, simplify(testPoints), simplify(ptsVectors), simplify(facesArea), simplify(mesh); plug-in component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

# ----
# Calculate Rain
number_slider_3 = Slider(0, range=0..0.5)
number_slider_4 = Slider(200, range=0..8760)
merge = Merge(Data1=Slider(0.5, range=0..0.5), Data2=number_slider_3)
split = SplitList(List=separatedata_4.numbers, Index=number_slider_4)  # -> ListA, ListB
split_2 = SplitList(List=separatedata_3.numbers, Index=number_slider_4)  # -> ListA, ListB
split_3 = SplitList(List=separatedata_2.numbers, Index=number_slider_4)  # -> ListA, ListB
split_4 = SplitList(List=separatedata.numbers, Index=number_slider_4)  # -> ListA, ListB
simple_rain = LivestockSimpleRain(
    Precipitation=split.ListA,
    WindDirection=split_2.ListA,
    WindSpeed=split_3.ListA,
    Obstacles=flatten(rotate.Geometry),
    Temperature=split_4.ListA,
    KFactors=merge,
    TestPoints=gentestpts.testPoints,
    TestVectors=gentestpts.ptsVectors,
    CPUs=Slider(3, range=1..4),
    Run=Toggle(False))  # -> Readme, Vectors, Hits, DrivingRain; inputs Precipitation: list, WindDirection: list, WindSpeed: list, Obstacles: list, Temperature: list, KFactors: list, TestPoints: list of Point3d, TestVectors: list, CPUs: Int32
# ---------- simple_rain: Python ----------
"""
    Args:
        Precipitation: Precipitation rate in mm/h. Import from e.g. epw data
        Wind_speed: Hourly wind speed in m/s
        Wind_direction: Hourly wind direction. 0° = North, 90° = East
        Obstacles: Canopy or other buildings that "shades" the investigated surface(s)
        Temperature: Hourly temperature values in °C. Import from e.g. epw data
        Test_points: Test points on surface. Can be created by Honeybee_Generate Test Points
        TestVectors: Test vectors on surface. Can be created by Honeybee_Generate Test Points
        KFactors: List. KFactors[0] in case the view vectors don't hit an obstruction and KFactors[1] in case the view vectors hit an obstruction 
        CPUs: Number of cpus you which to compute with
        Run: Set boolean to True to run the simulation
    Returns:
        Readme!: In case of any errors, it will be shown here
        Vectors: Vector for every hour of the year, that is the reversed vector of the incoming rain.
        Hits: Returns hourly results for each calculation point
        DrivingRain: Returns hourly results for each calculation point in mm/h
"""

        
#------------------------------------------------------------------------------#
# IMPORTS

import sys
sys.path.insert(0, r'C:\livestock\python\classes')
import LivestockGH as ls
from RainClasses import simpleRain
import Rhino as rc
import os
import scriptcontext as sc

n = 21
ghenv.Component.Name = ls.ComponentData[n][0]
ghenv.Component.NickName = ls.ComponentData[n][1]
ghenv.Component.Message = ls.ComponentData[n][2]
ghenv.Component.IconDisplayMode = ghenv.Component.IconDisplayMode.application
ghenv.Component.Category = ls.ComponentData[n][3]
ghenv.Component.SubCategory = ls.ComponentData[n][4]
ghenv.Component.Description = ls.ComponentData[n][5]
#ghenv.Component.Icon = ls.ComponentData[n][6]


#------------------------------------------------------------------------------#
# COMPONENT

# A failed attampt to use mesh instead of brep so the component could work with trimmed surfaces
if len(Obstacles) != 0:
    ## clean the geometry and bring them to rhinoCommon separated as mesh and Brep
    contextMesh, contextBrep = ls.cleanAndCoerceList(Obstacles)
    ## mesh Brep
    contextMeshedBrep = ls.parallel_makeContextMesh(contextBrep)

    ## Flatten the list of surfaces
    contextMeshedBrep = ls.flattenList(contextMeshedBrep)
    contextSrfs = contextMesh + contextMeshedBrep
    joinedContext = ls.joinMesh(contextSrfs)

    # Get rid of trimmed parts
    Obstacles = rc.Geometry.Brep.CreateFromMesh(joinedContext, False)

#------------------------------------------------------------------------------#
# OUTPUTS

if Run:
    rain = simpleRain(CPUs, Precipitation, WindSpeed, WindDirection,  TestPoints, TestVectors, Obstacles, Temperature, KFactors)
    rain.computeAngles()
    rain.rainHits()
    Vectors = rain.dirVec
    Hits = ls.list_to_tree(rain.hourlyResult)
    DrivingRain = ls.list_to_tree(rain.wdr)
# ---------- end simple_rain ----------

# ----
# Yearly values
# Max and Min
flip = FlipMatrix(Data=simple_rain.DrivingRain)
ma = MassAddition(Input=flip)  # -> flatten(Result), PartialResults
bnd = Bounds(Numbers=ma.Result)
panel_2 = Panel(bnd)

panel_3 = Panel(simple_rain.Readme)

# ----
# Visualize result
number_slider_5 = Slider(15, range=0..21)
gradientlibrary = Ladybug_GradientLibrary(gradIndex=number_slider_5)  # -> customColors; plug-in component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
legendpar = Ladybug_LegendParameters(customColors=flatten(gradientlibrary))  # -> legendPar; plug-in component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
recolormesh = Ladybug_RecolorMesh(
    analysisResult=ma.Result,
    inputMesh=gentestpts.mesh,
    legendPar=legendpar,
    analysisTitle="Wind Driven Rain",
    legendTitle="mm/year")  # -> readMe, newMesh, newLegend, legendBasePt, meshColors, legendColors; plug-in component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
preview_3 = CustomPreview(Geometry=recolormesh.newMesh, Shader=recolormesh.meshColors)

origin_planes = OriginPlanes(B=item, P=recolormesh.legendBasePt, B_2=Slider(-8, range=-10..10), B_3=Slider(-10.5, range=-20..0))  # -> pl_2, P_2
orient = Orient(Geometry=recolormesh.newLegend, Source=origin_planes.P_2, Target=origin_planes.pl_2)  # -> Geometry, Transform
preview_4 = CustomPreview(Geometry=orient.Geometry, Shader=ColourSwatch(SwatchColor=RGB(0, 0, 0)))

# ==== cluster Canopy
B = ClusterInput()
B_2 = ClusterInput()
pt = Point(Point(-7.41547637, 0, 6.542180394))
pdecon = Deconstruct(Point=pt)  # -> XComponent, YComponent, ZComponent
addition = Addition(A=pdecon.XComponent, B=B)
addition_2 = Addition(A=pdecon.YComponent, B=B_2)
pt_2 = ConstructPoint(XCoordinate=addition, YCoordinate=0, ZCoordinate=pdecon.ZComponent)
pt_3 = ConstructPoint(XCoordinate=0, YCoordinate=addition_2, ZCoordinate=pdecon.ZComponent)
rec_3pt = Rectangle3Pt(PointA=pt, PointB=pt_2, PointC=pt_3)  # -> Rectangle, Length
boundary = BoundarySurfaces(Edges=rec_3pt.Rectangle)
S = ClusterOutput(boundary)

# ==== cluster OriginPlanes
B = ClusterInput()
debrep = DeconstructBrep(Brep=B)  # -> Faces, Edges, Vertices
item = ListItem(List=debrep.Vertices, Index=Slider(0, range=0..3), Wrap=True)
item_2 = ListItem(List=debrep.Vertices, Index=Slider(2, range=0..3), Wrap=True)
vec2pt = Vector2Pt(PointA=item_2, PointB=item, Unitize=False)  # -> Vector, Length
Z = UnitZ(Factor=1)
P = ClusterInput()
pl = ConstructPlane(Origin=Point(0, 0, 0), XAxis=vec2pt.Vector, YAxis=Z)
B_2 = ClusterInput()
B_3 = ClusterInput()
pdecon = Deconstruct(Point=P)  # -> XComponent, YComponent, ZComponent
pl_2 = ClusterOutput(pl)
addition = Addition(A=pdecon.XComponent, B=B_2)
addition_2 = Addition(A=pdecon.XComponent, B=B_3)
pt = ConstructPoint(XCoordinate=addition, YCoordinate=addition_2, ZCoordinate=0)
xy = XYPlane(Origin=pt)
P_2 = ClusterOutput(xy)
