# Grasshopper definition RainFlow Example.gh (Grasshopper 0.9.76)
# plug-ins: Python Interpreter

# ----
# Åben Bash og kør:
# sudo service ssh --full-restart
panel = Panel("")
python_executor = LivestockPythonExecutor(PythonPath="C:\Program Files\Anaconda3\envs\livestock\python.exe")  # -> out
# ---------- python_executor: Python ----------
#------------------------------------------------------------------------------#
# IMPORTS

import sys
sys.path.insert(0, r'C:\livestock\python\classes')
import LivestockGH as ls
import Rhino as rc
import scriptcontext as sc

n = 16
ghenv.Component.Name = ls.ComponentData[n][0]
ghenv.Component.NickName = ls.ComponentData[n][1]
ghenv.Component.Message = ls.ComponentData[n][2]
ghenv.Component.IconDisplayMode = ghenv.Component.IconDisplayMode.application
ghenv.Component.Category = ls.ComponentData[n][3]
ghenv.Component.SubCategory = ls.ComponentData[n][4]
ghenv.Component.Description = ls.ComponentData[n][5]
#ghenv.Component.Icon = dgh.ComponentData[n][6]

#------------------------------------------------------------------------------#
# COMPONENT

sc.sticky['PythonExe'] = PythonPath

#------------------------------------------------------------------------------#
# OUTPUTS

print('Python Executor is set to: ' + PythonPath)
# ---------- end python_executor ----------
update = LivestockUpdate(Update=Toggle(False))  # -> out
# ---------- update: Python ----------
#------------------------------------------------------------------------------#
# IMPORTS

import sys
import os
import shutil
import zipfile
import time
import urllib
import System

n = 20
ghenv.Component.Name = "Livestock Update"
ghenv.Component.NickName = "Update"
ghenv.Component.Message = "VER 0.0.1 | May 2017"
ghenv.Component.IconDisplayMode = ghenv.Component.IconDisplayMode.application
ghenv.Component.Category = "Livestock"
ghenv.Component.SubCategory = "0 | Miscellaneous"
ghenv.Component.Description = "Update Livestock"
	
#------------------------------------------------------------------------------#
# COMPONENT

def downloadSourceAndUnzip():
    """
    Download the source code from github and unzip it in temp folder
    """

    url = "https://github.com/livestock3d/livestock_gh/archive/master.zip"
    targetDirectory = r'C:\livestock'

    # download the zip file
    print("Downloading the source code...")
    zipFile = os.path.join(targetDirectory, os.path.basename(url))
    
    # if the source file is just downloded then just use the available file
    if os.path.isfile(zipFile) and time.time() - os.stat(zipFile).st_mtime < 1000:
        download = False
    else:
        download = True

        # remove the old version
        try:
            shutil.rmtree(targetDirectory)
        except:
            pass

    # create the target directory
    if not os.path.isdir(targetDirectory): os.mkdir(targetDirectory)

    if download:
        try:
            client = System.Net.WebClient()
            client.DownloadFile(url, zipFile)
            if not os.path.isfile(zipFile):
                print("Download failed! Try to download and unzip the file manually form:\n" + url)
                return
        except Exception, e:
            print(`e` + "\nDownload failed! Try to download and unzip the file manually form:\n" + url)
            return

    # unzip the file
    with zipfile.ZipFile(zipFile) as zf:
        for f in zf.namelist():
            folder = f.replace('livestock_gh-master/','C:/livestock/')
            if f.endswith('/'):
                try:
                    os.makedirs(folder)
                    os.makedirs(f)
                except:
                    pass
            else:
                zf.extract(f, targetDirectory)
                file = f.replace('livestock_gh-master/','C:/livestock/')
                shutil.move('C:/livestock/'+f,file)
                
    shutil.rmtree('C:/livestock/livestock_gh-master')
    
    #Move GH components
    userObjectsFolder = os.getenv('APPDATA') + '/Grasshopper/UserObjects/'
    componentsFolder = 'C:/livestock/grasshopper/components/'
    for obj in os.listdir(componentsFolder):
        shutil.move(componentsFolder+obj,userObjectsFolder+obj)
    shutil.rmtree('C:/livestock/grasshopper')
    
    return True

    
#------------------------------------------------------------------------------#
# OUTPUTS

if Update:
    downloadSourceAndUnzip()
    print('Download done')
# ---------- end update ----------
ssh_connection = LivestockSSHConnection(Username=panel)  # -> out
# ---------- ssh_connection: Python ----------
#------------------------------------------------------------------------------#
# IMPORTS

import sys
sys.path.insert(0, r'C:\livestock\python\classes')
import LivestockGH as ls
import Rhino as rc
import scriptcontext as sc
import subprocess

n = 17
ghenv.Component.Name = ls.ComponentData[n][0]
ghenv.Component.NickName = ls.ComponentData[n][1]
ghenv.Component.Message = ls.ComponentData[n][2]
ghenv.Component.IconDisplayMode = ghenv.Component.IconDisplayMode.application
ghenv.Component.Category = ls.ComponentData[n][3]
ghenv.Component.SubCategory = ls.ComponentData[n][4]
ghenv.Component.Description = ls.ComponentData[n][5]
#ghenv.Component.Icon = dgh.ComponentData[n][6]

#------------------------------------------------------------------------------#
# COMPONENT

sc.sticky['SSH'] = {'ip':IpAddress,'port':Port,'user':Username,'password':Password}

#------------------------------------------------------------------------------#
# OUTPUTS

print('SSH connection is set to:\nIP Address: ' + str(IpAddress) + '\nPort: ' + str(Port) + '\nUser: ' + Username)
# ---------- end ssh_connection ----------
panel_2 = Panel(update)
panel_3 = Panel(python_executor)
panel_4 = Panel(ssh_connection)

brep = Brep(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)
brep_2 = Brep(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)
mesh = MeshBrep(
    Brep=brep,
    Settings={GridMaxCount=0, GridMinCount=16, JaggedSeams=False, MaxEdgeLength=0, MinEdgeLength=0.0001, MinTolerance=0, Refine=True, RefineAngle=0, RelativeTolerance=0.65, SimplePlanes=True, Tolerance=0})
mesh_2 = MeshBrep(
    Brep=brep_2,
    Settings={GridMaxCount=0, GridMinCount=16, JaggedSeams=False, MaxEdgeLength=0, MinEdgeLength=0.0001, MinTolerance=0, Refine=True, RefineAngle=0, RelativeTolerance=0.65, SimplePlanes=True, Tolerance=0})
mesh_3 = Mesh(mesh)
mesh_4 = Mesh(mesh_2)
mesh_5 = Mesh(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)
pt = Point([Point(2.038921197, 2.021107276, -0.9961340229), Point(2.038921197, 2.021107276, -0.9961340229), Point(2.038921197, 2.021107276, -0.9961340229), Point(2.038921197, 2.021107276, -0.9961340229), Point(2.038921197, 2.021107276, -0.9961340229), Point(2.038921197, 2.021107276, -0.9961340229)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])
mesh_pools = LivestockMeshPools(Mesh=mesh_5, EndPoints=pt, VolumePoints="0.001", Run=Toggle(False))  # -> out, Pools; inputs EndPoints: list of Point3d, VolumePoints: list
# ---------- mesh_pools: Python ----------
#------------------------------------------------------------------------------#
# IMPORTS

import sys
sys.path.insert(0, r'C:\livestock\python\classes')
import LivestockGH as ls
import Rhino as rc
import subprocess
import os
import scriptcontext as sc
from shutil import copyfile

n = 19
ghenv.Component.Name = ls.ComponentData[n][0]
ghenv.Component.NickName = ls.ComponentData[n][1]
ghenv.Component.Message = ls.ComponentData[n][2]
ghenv.Component.IconDisplayMode = ghenv.Component.IconDisplayMode.application
ghenv.Component.Category = ls.ComponentData[n][3]
ghenv.Component.SubCategory = ls.ComponentData[n][4]
ghenv.Component.Description = ls.ComponentData[n][5]
#ghenv.Component.Icon = ls.ComponentData[n][6]


#------------------------------------------------------------------------------#
# COMPONENT
sshPath = r'C:\livestock\python\ssh'
templatePath = r'C:\livestock\python\templates'
meshName = 'drainMesh'
meshType = '.obj'
pointName = 'EndPoints'
volumeName = 'VolumePoints'

# SSH and commands
ip = str(sc.sticky["SSH"]['ip'])
port = str(sc.sticky["SSH"]['port'])
user = str(sc.sticky["SSH"]['user'])
pw = str(sc.sticky["SSH"]['password'])

fTrans = 'user.txt,' + meshName+meshType + ',' + pointName + '.txt,' + volumeName + '.txt'
fRun = 'DrainPoolsTemplate.py'
fReturn = ' '

inData = 'InData'
py_template = templatePath + '\\SSHTemplate.py'
pyfile = templatePath + '\\sshrun.py'
py = sc.sticky['PythonExe']


# Organize inputs 
pts = []
for p in EndPoints:
    pts.append(str(p.X)+','+str(p.Y)+','+str(p.Z))

if len(VolumePoints) != len(EndPoints):
    if len(VolumePoints) == 1:
        VolumePoints = VolumePoints*len(EndPoints)
    else:
        print('Length of VolumePoints has to be either be 1 or the same length as EndPoints!')
        exit()

def export():
    # Export mesh
    doc = ghdoc
    ls.bakeExportDelete(Mesh, sshPath, meshName, meshType, doc)
    
    # Export end points file
    ls.writeFile(pts, sshPath, pointName)
    
    # Write user file
    ls.writeFile([user,], sshPath, 'user')
    
    # Export volume file
    ls.writeFile(VolumePoints, sshPath, volumeName)
    
    # Write SSH commands
    ls.writeFile([ip,port,user,pw,fTrans,fRun,fReturn],sshPath,inData)
    
    #Copy Template
    copyfile(py_template,pyfile)

def importResults():
    
    # Read mesh names
    file_obj = open(sshPath + "\\meshNames.txt",'r')
    data = file_obj.readline().split(',')
    names = []
    for n in data:
        names.append(n)
    file_obj.close()
    names = names[1:]
    
    # Import meshes
    pools = []
    for n in names:
        pools.append(ls.importObj(sshPath + '\\' + n))
        os.remove(sshPath + '\\' + n)
    
    return pools
    
#------------------------------------------------------------------------------#
# OUTPUTS

if Mesh and EndPoints and VolumePoints and Run:
    # Export data
    export()
    
    # Run template
    thread = subprocess.Popen([py, pyfile])
    thread.wait()
    thread.kill()
    
    # Import results
    Pools = importResults()
    
    # Clean up
    if Pools:
        os.remove(sshPath + "\\meshNames.txt")
        os.remove(sshPath + '\\' + inData+'.txt')
        os.remove(sshPath + '\\' + pointName + '.txt')
        os.remove(sshPath + '\\' + volumeName + '.txt')
        os.remove(sshPath + '\\user.txt')
        os.remove(pyfile)
        os.remove(sshPath+'\\'+meshName+meshType)
# ---------- end mesh_pools ----------
mesh_drainage = LivestockMeshDrainage(Run=Toggle(False), Mesh=mesh_3, Cpu=Slider(2, range=1..4))  # -> Readme, NewMesh, DrainCurves, EndPoints
# ---------- mesh_drainage: Python ----------
"""
Simulates drainage in order to analyse a mesh for local pooling of rain water.
Copyright: Creative Commons - Attribution 4.0 International
Contact: ocni@dtu.dk
-
Provided by Livestock 0.1, made by Christian Kongsgaard. 
    Args:
        Toggle: Activates the component.
        Mesh: The mesh to analyse.
        Tolerance: The precision with which the particles are moved.
    Returns:
        Readme!: In case of any errors, it will be shown here
        DrainCurves: Curves constructed through the drain positions of each particle.
        EndPoints: The final position of the particles.
"""
#------------------------------------------------------------------------------#
# IMPORTS

import sys
sys.path.insert(0, r'C:\livestock\python\classes')
import LivestockGH as ls
import Rhino as rc
import subprocess
import os
import scriptcontext as sc
from shutil import copyfile

n = 18
ghenv.Component.Name = ls.ComponentData[n][0]
ghenv.Component.NickName = ls.ComponentData[n][1]
ghenv.Component.Message = ls.ComponentData[n][2]
ghenv.Component.IconDisplayMode = ghenv.Component.IconDisplayMode.application
ghenv.Component.Category = ls.ComponentData[n][3]
ghenv.Component.SubCategory = ls.ComponentData[n][4]
ghenv.Component.Description = ls.ComponentData[n][5]
#ghenv.Component.Icon = ls.ComponentData[n][6]

#------------------------------------------------------------------------------#
# COMPONENT

# Paths
sshPath = r'C:\livestock\python\ssh'
templatePath = r'C:\livestock\python\templates'
meshName = 'drainMesh'
meshType = '.obj'
doc = ghdoc

# SSH and commands
ip = str(sc.sticky["SSH"]['ip'])
port = str(sc.sticky["SSH"]['port'])
user = str(sc.sticky["SSH"]['user'])
pw = str(sc.sticky["SSH"]['password'])

fTrans = 'user.txt,cpu.txt,' + meshName+meshType
fRun = 'DrainMeshTemplate.py'
fReturn = 'newDrainMesh.obj,drainPoints.txt'

inData = 'InData'
py_template = templatePath + '\\SSHTemplate.py'
pyfile = templatePath + '\\sshrun.py'
py = sc.sticky['PythonExe']


#------------------------------------------------------------------------------#
# OUTPUTS

if Run:
    # Export mesh
    ls.bakeExportDelete(Mesh, sshPath, meshName, meshType, doc)
    
    # Write Cpu file
    ls.writeFile(int(Cpu),sshPath,'cpu')
    
    # Write user file
    ls.writeFile([user,], sshPath, 'user')
    
    # Write SSH commands
    ls.writeFile([ip,port,user,pw,fTrans,fRun,fReturn],sshPath,inData)
    
    #Copy Template
    copyfile(py_template,pyfile)
    
    # Run template
    thread = subprocess.Popen([py, pyfile])
    thread.wait()
    thread.kill()
    
    # Load results
    NewMesh = ls.importObj(sshPath+'\\newDrainMesh'+meshType)
    pts = ls.loadPoints(sshPath+'\\drainPoints.txt')
    DrainCurves = ls.makeCurvesFromPoints(pts)
    EndPoints = [crv.PointAtEnd for crv in DrainCurves]
    
    # File clean up
    if NewMesh and pts:
        os.remove(sshPath + '\\user.txt')
        os.remove(sshPath + '\\' + inData+'.txt')
        os.remove(pyfile)
        os.remove(sshPath+'\\'+meshName+meshType)
        os.remove(sshPath + '\\cpu.txt')
        os.remove(sshPath + '\\newDrainMesh.obj')
# ---------- end mesh_drainage ----------
geo = Geometry(mesh_pools.Pools)
mesh_6 = Mesh(mesh_drainage.NewMesh)
crv = Curve(mesh_drainage.DrainCurves)
pt_2 = Point(mesh_drainage.EndPoints)
panel_5 = Panel(mesh_pools.out)
medges = MeshEdges(Mesh=mesh_drainage.NewMesh)  # -> NakedEdges, InteriorEdges, NonManifoldEdges
panel_6 = Panel(mesh_drainage.Readme)
preview = CustomPreview(Geometry=mesh_drainage.NewMesh, Shader=ColourSwatch(SwatchColor=RGBA(88, 114, 120, 110)))
preview_2 = CustomPreview(Geometry=[medges.NakedEdges, medges.InteriorEdges], Shader=ColourSwatch(SwatchColor=RGB(0, 0, 83)))
preview_3 = CustomPreview(Geometry=mesh_drainage.DrainCurves, Shader=ColourSwatch(SwatchColor=RGB(0, 0, 0)))
preview_4 = CustomPreview(Geometry=mesh_drainage.EndPoints, Shader=ColourSwatch(SwatchColor=RGB(184, 7, 7)))
