# Grasshopper definition Air Conditions.gh (Grasshopper 0.9.76)
# plug-ins: Python Interpreter

# ----
# Livestock Setup
# Python and SSH
panel = Panel("C:\Users\Christian\Anaconda3\envs\livestock-env\python.exe")
ssh_machine = PythonScript(x=Toggle(False))  # -> out, a, b, c, d
# ---------- ssh_machine: Python ----------
machine = {0: {'name': 'Bash',
               'ip': '127.0.0.1',
               'port': 2222,
               'user': 'ocni',
               'pw': '4320lejre'
               },
           1: {'name': 'Livestock_Ubuntu',
               'ip': '10.61.0.140',
               'port': 22,
               'user': 'livestock',
               'pw': 'stable'
               }}
               
print(machine[x]['name'])
a = machine[x]['ip']
b = machine[x]['port']
c = machine[x]['user']
d = machine[x]['pw']
# ---------- end ssh_machine ----------
panel_2 = Panel(ssh_machine.out)
ssh_connection = LivestockSSHConnection(IP=ssh_machine.a, Port=ssh_machine.b, Username=ssh_machine.c, Password=ssh_machine.d)  # -> readMe
#   port IP: IP Address to connection
#   port Port: Port for connection
#   port Username: Username for connection
#   port Password: Password for connection
#   port readMe: In case of any errors, it will be shown here.
# ---------- ssh_connection: Python ----------
from livestock.components.misc import SSHConnection

comp = SSHConnection(ghenv)
comp.config()
comp.run_checks(str(IP), str(Port), str(Username), str(Password))
comp.run()
# ---------- end ssh_connection ----------
python_executor = LivestockPythonExecutor(PythonPath=panel)  # -> readMe
#   port PythonPath: Path to python.exe
#   port readMe: In case of any errors, it will be shown here.
# ---------- python_executor: Python ----------
from livestock.components.misc import PythonExecutor

comp = PythonExecutor(ghenv)
comp.config()
comp.run_checks(str(PythonPath))
comp.run()
# ---------- end python_executor ----------
panel_3 = Panel(ssh_connection)
panel_4 = Panel(python_executor)

folder = Panel("C:\Users\Christian\Desktop\Livestock\Air_Conditions")

# ----
# LOAD RESULTS
number_slider = Slider(0, range=0..9)
toggle = BooleanToggle(False)
cmf_results = LivestockCMFResults(ResultFilePath=folder, FetchResult=number_slider, Run=toggle)  # -> readMe, Units, Values, CSVPath
#   port ResultFilePath: Path to result file. Accepts output from Livestock Solve
#   port FetchResult: Choose which result should be loaded: 0 - Evapotranspiration 1 - Surface water volume 2 - Surface water flux 3 - Heat flux 4 - Aerodynamic resistance 5 - Soil layer water flux 6 - Soil layer potential 7 - Soil layer theta 8 - Soil layer volume 9 - Soil layer wetness
#   port SaveCSV: Save the values as a csv file - Default is set to False
#   port Run: Run component
#   port readMe: In case of any errors, it will be shown here.
#   port Units: Shows the units of the results
#   port Values: List with chosen result values
#   port CSVPath: Path to csv file.
# ---------- cmf_results: Python ----------
from livestock.components.comp_cmf import CMFResults

comp = CMFResults(ghenv)
comp.config()
comp.run_checks(ResultFilePath, FetchResult, SaveCSV, Run)
comp.run()

Units = comp.unit
Values = comp.results
# ---------- end cmf_results ----------
cmf_results_2 = LivestockCMFResults(ResultFilePath=folder, FetchResult=Slider(3, range=0..9), Run=toggle)  # -> readMe, Units, Values, CSVPath; same code as cmf_results
flip = FlipMatrix(Data=cmf_results_2.Values)
flip_2 = FlipMatrix(Data=cmf_results.Values)

# ----
# LOAD WEATHER
panel_5 = Panel("""\weather\temp.txt
\weather\relhum.txt""")
concat = Concatenate(FragmentA=folder, FragmentB=panel_5)
file = ReadFile(File=concat, PerLineParse=True)  # -> simplify(Content)
bang = ExplodeTree(Data=file)  # -> Branch0, Branch1

# ----
# 1. GEOMETRY
panel_6 = Panel("\mesh.obj")
concat_2 = Concatenate(FragmentA=folder, FragmentB=panel_6)
load_mesh = LivestockLoadMesh(Filename=concat_2, Load=Toggle(True))  # -> readMe, Mesh, MeshData
#   port Filename: Directory and file name of mesh
#   port Load: Activates the component
#   port readMe: In case of any errors, it will be shown here.
#   port MeshData: Additional data if any
# ---------- load_mesh: Python ----------
from livestock.components.geometry import LoadMesh

comp = LoadMesh(ghenv)
comp.config()
comp.run_checks(Filename, Load)
comp.run()

Mesh = comp.mesh
MeshData = comp.data
# ---------- end load_mesh ----------
mesh = Mesh(load_mesh.Mesh)

# ----
# VISUALIZE
# Mesh
swatch = ColourSwatch(SwatchColor=RGB(87, 199, 162))
preview = CustomPreview(Geometry=mesh, Shader=swatch)

number_slider_2 = Slider(1.1, range=0..2)

# ----
# Volume Slice
Z = UnitZ(Factor=number_slider_2)
move = Move(Geometry=mesh, Motion=Z)  # -> Geometry, Transform
preview_2 = CustomPreview(Geometry=move.Geometry, Shader=ColourSwatch(SwatchColor=RGB(65, 150, 255)))

number_slider_3 = Slider(10, range=0..10)

# ----
# Air Volumes
faceb = FaceBoundaries(Mesh=mesh)
Z_2 = UnitZ(Factor=number_slider_3)
extr = Extrude(Base=faceb, Direction=Z_2)
cap = CapHoles(Brep=extr)
wires = BrepWireframe(Brep=cap, Density=-1)
preview_3 = CustomPreview(Geometry=wires, Shader=ColourSwatch(SwatchColor=RGB(0, 0, 0)))

new_air_conditions = LivestockNewAirConditions(
    Mesh=mesh,
    Evapotranspiration=flip_2,
    HeatFlux=flip,
    AirTemperature=bang.Branch0,
    AirRelativeHumidity=bang.Branch1,
    AirBoundaryHeight=number_slider_3,
    InvestigationHeight=number_slider_2,
    Run=Toggle(False))  # -> readMe, NewTemperature, NewRelativeHumidity; inputs Evapotranspiration: tree, HeatFlux: tree, AirTemperature: list, AirRelativeHumidity: list
#   port Evapotranspiration: Evapotranspiration in m^3/day. Each tree branch should represent one time unit, with all the cell values to that time.
#   port HeatFlux: HeatFlux in MJ/m^2day. Each tree branch should represent one time unit, with all the cell values to that time.
#   port AirTemperature: Air temperature in C
#   port AirRelativeHumidity: Relative Humidity in -
#   port AirBoundaryHeight: Top of the air column in m. Default is set to 10m
#   port InvestigationHeight: Height at which the new air temperature and relative humidity should be calculated. Default is set to 1.1m
#   port CPUs: Number of cpus to perform the computation on. Default is set to 2
#   port ThroughSSH: Number of cpus to perform the computation on. Default is set to False
#   port Run: Run the component
#   port readMe: In case of any errors, it will be shown here.
#   port NewTemperature: New temperature in C.
#   port NewRelativeHumidity: New relative humidity in -.
# ---------- new_air_conditions: Python ----------
from livestock.components.comfort import NewAirConditions

comp = NewAirConditions(ghenv)
comp.config()
comp.run_checks(Mesh, Evapotranspiration, HeatFlux, AirTemperature, 
                AirRelativeHumidity, AirBoundaryHeight, InvestigationHeight, 
                CPUs, ThroughSSH, Run)
comp.run()

NewTemperature = comp.results['temperature']
NewRelativeHumidity = comp.results['relative_humidity']
# ---------- end new_air_conditions ----------
panel_7 = Panel(new_air_conditions.readMe)
