# Grasshopper definition CFD Rain.gh (Grasshopper 0.9.76)
# plug-ins: Python Interpreter

ladybug = Ladybug_Ladybug()  # -> Vviiiiiiiiiizzz; plug-in component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

# ----
# Box Building
number_slider = Slider(10, range=0..10)
dom = ConstructDomain(DomainStart=0, DomainEnd=number_slider)
rectangle = Rectangle(Plane=PlaneXY(0, 0, 0), XSize=dom, YSize=dom, Radius=0)  # -> Rectangle, Length
boxrec = BoxRectangle(Rectangle=rectangle.Rectangle, Height=number_slider)

# ----
# Buildings
_10x10x25 = Brep(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)
_10x20x15 = Brep(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)
_10x30x10 = Brep(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)
merge = Merge(Data1=_10x10x25, Data2=_10x20x15, Data3=_10x30x10)

# ----
# Butterfly Buildings
brep = Brep(boxrec)
wall = Butterfly_WallBoundary()  # -> wallBoundary; plug-in component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
jagged = SettingsSpeed()
createbfgeometry = Butterfly_CreateButterflyGeometry(name="Buildings", geo=flatten(brep), boundary=wall, refineLevels="(4, 4)", meshSet=jagged)  # -> readMe, BFGeometries; plug-in component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

# ----
# Refinement Region
bbox = BoundingBox(Content=brep, Plane=PlaneXY(0, 0, 0))  # -> Box, Box_2
volume = Volume(Geometry=bbox.Box_2)  # -> Volume, Centroid
number_slider_2 = Slider(3, range=1..3)
project = Project(Geometry=volume.Centroid, Plane=PlaneXY(0, 0, 0))  # -> Geometry, Transform
xy = XYPlane(Origin=project.Geometry)
scale_nu = ScaleNU(Geometry=bbox.Box, Plane=xy, ScaleX=number_slider_2, ScaleY=number_slider_2, ScaleZ=Slider(2, range=1..3))  # -> Geometry, Transform
inoutrefmode = Butterfly_LocationRefinementMode(mode=0, level=Slider(3, range=1..5))  # -> locationRefMode; plug-in component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
refinementregion = Butterfly_RefinementRegion(name="Around_Buildings", geo=flatten(scale_nu.Geometry), refMode=inoutrefmode)  # -> readMe, refinementRegion; plug-in component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

# ----
# Mesh Parameters
panel = Panel("""20
60
20""")
panel_2 = Panel("""0.1
0.3
0.6""")
panel_3 = Panel("""0.5
0.5""")
panel_4 = Panel("""70
30""")
seggrading = Butterfly_SegmentGrading(percentageLength=panel_2, percentageCells=panel, expansionRatio=1)  # -> segmentGrading; plug-in component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
seggrading_2 = Butterfly_SegmentGrading(percentageLength=panel_3, percentageCells=panel_4, expansionRatio=1)  # -> segmentGrading; plug-in component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
multigrading = Butterfly_MultiGrading(segmentGradings=flatten(seggrading))  # -> grading; plug-in component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
multigrading_2 = Butterfly_MultiGrading(segmentGradings=flatten(seggrading_2))  # -> grading; plug-in component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
gradxyz = Butterfly_GradingXYZ(xGrading=1, yGrading=multigrading, zGrading=multigrading_2)  # -> gradXYZ; plug-in component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
meshparams = Butterfly_MeshingParameters(gradXYZ=gradxyz, globRefineLevel="(2, 4)")  # -> readMe, meshParams; plug-in component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

# ----
# Wind Direction
number_slider_3 = Slider(4, range=0..23, expression="x*15")
winddirection = Compass(WindDir=number_slider_3)  # -> out, Vector, c_dir2
# ---------- winddirection: Python ----------
# Compass direction calculation for wind direction
""" Write one of the following 16 wind directions:
N, NNE, NE, ENE, E, ESE, SE, SEE, S, SSW, SW, WSW, W, WNW, NW, NNW"""

ghenv.Component.Name = "Compass"
ghenv.Component.NickName = "windDirection"
ghenv.Component.Message = 'Version4.1\nJune_04_2017'
ghenv.Component.Category = "MyCompass"

import rhinoscriptsyntax as rs
import math
var = _WindDir_
BaseP = [0,0,0]
OF = math.pi/180

if  0 <= _WindDir_ and _WindDir_ <= 210:
    Vector = rs.VectorCreate([math.cos(_WindDir_*OF),math.sin(_WindDir_*OF),0],BaseP)
    print Vector
    c_dir2 = 0.8
    print c_dir2
elif  210 < _WindDir_ and _WindDir_ < 240:
    Vector = rs.VectorCreate([math.cos(_WindDir_*OF),math.sin(_WindDir_*OF),0],BaseP)
    print Vector
    c_dir2 = 0.85
    print c_dir2
elif  _WindDir_ == 240:
    Vector = rs.VectorCreate([math.cos(_WindDir_*OF),math.sin(_WindDir_*OF),0],BaseP)
    print Vector
    c_dir2 = 0.9
    print c_dir2
elif 240 < _WindDir_ and _WindDir_ < 270:
    Vector = rs.VectorCreate([math.cos(_WindDir_*OF),math.sin(_WindDir_*OF),0],BaseP)
    print Vector
    c_dir2 = 0.95
    print c_dir2
elif 270 <= _WindDir_ and _WindDir_ <= 300:
    Vector = rs.VectorCreate([math.cos(_WindDir_*OF),math.sin(_WindDir_*OF),0],BaseP)
    print Vector
    c_dir2 = 1.0
    print c_dir2
elif 300 < _WindDir_ and _WindDir_ < 330:
    Vector = rs.VectorCreate([math.cos(_WindDir_*OF),math.sin(_WindDir_*OF),0],BaseP)
    print Vector
    c_dir2 = 0.95
    print c_dir2
elif _WindDir_ == 330:
    Vector = rs.VectorCreate([math.cos(_WindDir_*OF),math.sin(_WindDir_*OF),0],BaseP)
    print Vector
    c_dir2 = 0.9
    print c_dir2
elif 330 < _WindDir_ and _WindDir_ <= 359:
    Vector = rs.VectorCreate([math.cos(_WindDir_*OF),math.sin(_WindDir_*OF),0],BaseP)
    print Vector
    c_dir2 = 0.85
    print c_dir2
elif var == "W":
    Vector = rs.VectorCreate([math.cos(270*OF),math.sin(270*OF),0],BaseP)
    c_dir2 = 1.0
    print Vector
    print c_dir2
elif var == "WSW":
    Vector = rs.VectorCreate([math.cos(247.5*OF),math.sin(247.5*OF),0],BaseP)
    c_dir2 = 0.9
    print Vector
    print c_dir2
elif var == "SW":
    Vector = rs.VectorCreate([math.cos(225*OF),math.sin(225*OF),0],BaseP)
    c_dir2 = 0.85
    print Vector
    print c_dir2
elif var == "SSW":
    Vector = rs.VectorCreate([math.cos(202.5*OF),math.sin(202.5*OF),0],BaseP)
    c_dir2 = 0.8
    print Vector
    print c_dir2
elif var == "S":
    Vector = rs.VectorCreate([math.cos(180*OF),math.sin(180*OF),0],BaseP)
    c_dir2 = 0.8
    print Vector
    print c_dir2
elif var == "SSE":
    Vector = rs.VectorCreate([math.cos(157.5*OF),math.sin(157.5*OF),0],BaseP)
    c_dir2 = 0.8
    print Vector
    print c_dir2
elif var == "SE":
    Vector = rs.VectorCreate([math.cos(135*OF),math.sin(135*OF),0],BaseP)
    c_dir2 = 0.8
    print Vector
    print c_dir2
elif var == "ESE":
    Vector = rs.VectorCreate([math.cos(112.5*OF),math.sin(112.5*OF),0],BaseP)
    c_dir2 = 0.8
    print Vector
    print c_dir2
elif var == "E":
    Vector = rs.VectorCreate([math.cos(90*OF),math.sin(90*OF),0],BaseP)
    c_dir2 = 0.8
    print Vector
    print c_dir2
elif var == "ENE":
    Vector = rs.VectorCreate([math.cos(67.5*OF),math.sin(67.5*OF),0],BaseP)
    c_dir2 = 0.8
    print Vector
    print c_dir2
elif var == "NE":
    Vector = rs.VectorCreate([math.cos(45*OF),math.sin(45*OF),0],BaseP)
    c_dir2 = 0.8
    print Vector
    print c_dir2
elif var == "NNE":
    Vector = rs.VectorCreate([math.cos(22.5*OF),math.sin(22.5*OF),0],BaseP)
    c_dir2 = 0.8
    print Vector
    print c_dir2
elif var == "N":
    Vector = rs.VectorCreate([math.cos(0*OF),math.sin(0*OF),0],BaseP)
    print Vector
    c_dir2 = 0.8
    print Vector
    print c_dir2
elif var == "NNW":
    Vector = rs.VectorCreate([math.cos(337.5*OF),math.sin(337.5*OF),0],BaseP)
    c_dir2 = 0.9
    print Vector
    print c_dir2
elif var == "NW":
    Vector = rs.VectorCreate([math.cos(315*OF),math.sin(315*OF),0],BaseP)
    c_dir2 = 0.95
    print Vector
    print c_dir2
elif var == "WNW":
    Vector = rs.VectorCreate([math.cos(292.5*OF),math.sin(292.5*OF),0],BaseP)
    c_dir2 = 1.0
    print Vector
    print c_dir2
else:
   print "Error in entered parameter value"
# ---------- end winddirection ----------
windvector = Butterfly_WindVector(windSpeed=Slider(2, range=0..10), windDirection=winddirection.Vector)  # -> windVector; plug-in component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

# ----
# Wind Direction Visualzation
number_slider_4 = Slider(2, range=1..5)
number_slider_5 = Slider(-20, range=-20..-10)
swatch = ColourSwatch(SwatchColor=RGB(0, 0, 0))
number_slider_6 = Slider(5, range=5..15)
pt = ConstructPoint(XCoordinate=number_slider_5, YCoordinate=number_slider_5, ZCoordinate=0)
tag = TextTag3D(Location=pt, Text="Wind Direction", Size=number_slider_4, Colour=swatch, Justification=7)
multiplication = Multiplication(A=windvector, B=number_slider_6)
vdisex = VectorDisplayEx(Point=pt, Vector=multiplication, Colour=swatch, Width=number_slider_6)

tunnelparams = Butterfly_WindTunnelParameters(windwardX=3, topX=3, sidesX=2, leewardX=15)  # -> readMe, tunnelParams; plug-in component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

# ----
# Setup Wind Tunnel Case
panel_5 = Panel("WindCase")
createcasefromtunnel = Butterfly_CreateCaseFromTunnel(
    name=panel_5,
    BFGeometries=flatten(createbfgeometry.BFGeometries),
    refRegions=refinementregion.refinementRegion,
    windVector=windvector,
    refWindHeight=10,
    landscape=6,
    meshParams=meshparams.meshParams,
    tunnelParams=tunnelparams.tunnelParams,
    run=Toggle(False))  # -> readMe, pts, case; plug-in component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

# ----
# Meshing
larger_than_90_to_get_the_hard_edges = Panel("castellatedMeshControls  {resolveFeatureAngle 95;}")
snappyhexmeshdict = Butterfly_snappyHexMeshDict(
    castellatedMesh=True,
    snap=Toggle(False),
    addLayers=False,
    nCellsBetweenLevels=3,
    maxGlobalCells=2000000,
    expansionRatio=1.1,
    finalLayerThickness=0.7,
    minThickness=0.1,
    nLayerIter=50,
    additionalParameters=larger_than_90_to_get_the_hard_edges)  # -> snappyHexMeshDict; plug-in component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
blockmesh = Butterfly_blockMesh(case=createcasefromtunnel.case, overwrite=True, run=Toggle(False))  # -> readMe, case; plug-in component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
snappyhexmesh = Butterfly_snappyHexMesh(case=blockmesh.case, snappyHexMeshDict=snappyhexmeshdict, run=Toggle(False))  # -> readMe, case; plug-in component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

# ----
# Purge Case
toggle = BooleanToggle(False)
purgecase = Butterfly_purgeCase(case=createcasefromtunnel.case, blockMesh=False, snappyHexMesh=False, results=toggle, postProcessing=toggle)  # -> readMe; plug-in component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
panel_6 = Panel(purgecase)

# ----
# Probes
number_slider_7 = Slider(4, range=0..5)
debrep = DeconstructBrep(Brep=scale_nu.Geometry)  # -> Faces, Edges, Vertices
item = ListItem(List=debrep.Faces, Index=number_slider_7, Wrap=True)
flip = Flip(Surface=item)  # -> Surface, Result
bbx = BrepBrep(BrepA=boxrec, BrepB=flip.Surface)  # -> Curves, Points
debrep_2 = DeconstructBrep(Brep=boxrec)  # -> Faces, Edges, Vertices
srfsplit = SurfaceSplit(Surface=flip.Surface, Curves=bbx.Curves)
item_2 = ListItem(List=debrep_2.Faces, Index=[Slider(0, range=0..5), Slider(3, range=0..5)], Wrap=True)
item_3 = ListItem(List=srfsplit, Index=0, Wrap=True)
gentestpts = Honeybee_GenerateTestPoints(testGeometry=item_2, gridSize=Slider(1, range=0.5..2), distBaseSrf=Slider(0.1, range=0.1..2), moveTestMesh=True)  # -> readMe, simplify(testPoints), simplify(ptsVectors), simplify(facesArea), simplify(mesh); plug-in component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
gentestpts_2 = Honeybee_GenerateTestPoints(testGeometry=item_3, gridSize=Slider(1, range=0.5..2), distBaseSrf=Slider(1, range=0.5..2), moveTestMesh=True)  # -> readMe, simplify(testPoints), simplify(ptsVectors), simplify(facesArea), simplify(mesh); plug-in component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
merge_2 = Merge(Data1=gentestpts_2.testPoints, Data2=gentestpts.testPoints)  # -> flatten(Result)
merge_3 = Merge(Data1=gentestpts_2.mesh, Data2=gentestpts.mesh)  # -> flatten(Result)
panel_7 = Panel("""p
U""")
mjoin = MeshJoin(Meshes=merge_3)
probes = Butterfly_probes(points=merge_2, fields=panel_7)  # -> probes; plug-in component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
preview = CustomPreview(Geometry=merge_2, Shader=ColourSwatch(SwatchColor=RGBA(48, 118, 145, 133)))

# ----
# Solution Parameters
number_slider_8 = Slider(6, range=0..10, expression="x*100")
controldict = Butterfly_controlDict(startTime=0, endTime=number_slider_8, writeInterval=100, writeCompression=False, purgeWrite=0)  # -> controlDict; plug-in component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
solutionparams = Butterfly_SolutionParameters(controlDict=controldict, probes=probes)  # -> solutionParams; plug-in component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

loadmesh = Butterfly_LoadMesh(case=snappyhexmesh.case, innerMesh=False, load=Toggle(False))  # -> mesh; plug-in component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

# ----
# Solution
steadyincomp = Butterfly_SteadyIncompressibleRecipe()  # -> readMe, recipe; plug-in component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
solution = Butterfly_Solution(
    case=snappyhexmesh.case,
    recipe=steadyincomp.recipe,
    solutionParams=solutionparams,
    interval=Slider(5, range=1..10),
    write=Toggle(False),
    run=Toggle(False))  # -> readMe, solution, isRunning, timestep, residualFields, residualValues, logFiles; plug-in component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

# ----
# Plot Residuals
number_slider_9 = Slider(35, range=15..60)
dom_2 = ConstructDomain(DomainStart=number_slider_9, DomainEnd=Slider(60, range=15..60))
dom_3 = ConstructDomain(DomainStart=Slider(-30, range=-60..15), DomainEnd=Slider(-20, range=-60..15))
rectangle_2 = Rectangle(Plane=PlaneXY(0, 0, 0), XSize=dom_2, YSize=dom_3, Radius=0)  # -> Rectangle, Length
plotresiduals = Butterfly_PlotResiduals(solution=solution.solution, rect=rectangle_2.Rectangle, targetRes=0.0001, port=0.1, method=0, load=Toggle(True))  # -> readMe, timeRange, curves, port, residualLine, colors; plug-in component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
preview_2 = CustomPreview(Geometry=plotresiduals.curves, Shader=plotresiduals.colors)
debrep_3 = DeconstructBrep(Brep=rectangle_2.Rectangle)  # -> Faces, Edges, Vertices
panel_8 = Panel(plotresiduals.readMe)
item_4 = ListItem(List=debrep_3.Vertices, Index=0, Wrap=True)
tag_2 = TextTag3D(
    Location=item_4,
    Text="Residuals",
    Size=Slider(2, range=1..5),
    Colour=ColourSwatch(SwatchColor=RGB(0, 0, 0)),
    Justification=1)

# ----
# Preview
merge_4 = Merge(Data1=brep, Data2=scale_nu.Geometry)
merge_5 = Merge(Data1=createcasefromtunnel.pts, Data2=loadmesh, Data3=rectangle_2.Rectangle)
wires = BrepWireframe(Brep=merge_4, Density=-1)
preview_3 = CustomPreview(Geometry=[wires, merge_5], Shader=ColourSwatch(SwatchColor=RGB(0, 0, 0)))

# ----
# Results
panel_9 = Panel("p")
panel_10 = Panel(solution.residualValues)
panel_11 = Panel(solution.residualFields)
loadprobes = Butterfly_LoadProbes(solution=solution.solution, field=panel_9)  # -> probes; plug-in component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
loadprobes_2 = Butterfly_LoadProbes(solution=solution.solution, field="U")  # -> probes; plug-in component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

# ---- group: vectors
vec = Vector(loadprobes_2)

# ----
# Velocity Visualization
pt_2 = Point(merge_2)
vlen = VectorLength(Vector=vec)
bnd = Bounds(Numbers=vlen)
dedomain = DeconstructDomain(Domain=bnd)  # -> Start, End
panel_12 = Panel(bnd)
gradient = Gradient(
    LowerLimit=dedomain.End,
    UpperLimit=dedomain.Start,
    Parameter=vlen,
    stops=[0: RGB(234, 38, 0), 0.25: RGB(234, 126, 0), 0.5: RGB(254, 244, 84), 0.75: RGB(173, 203, 249), 1: RGB(75, 107, 169)])
scale = Slider(0.1, range=0..1)
multiplication_2 = Multiplication(A=vec, B=scale)
vdisex_2 = VectorDisplayEx(Point=flatten(pt_2), Vector=flatten(multiplication_2), Colour=gradient, Width=Slider(2, range=0..5))

# ----
# Pressure Visualization
number_slider_10 = Slider(7, range=0..23)
gradientlibrary = Ladybug_GradientLibrary(gradIndex=number_slider_10)  # -> customColors; plug-in component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
legendpar = Ladybug_LegendParameters(customColors=flatten(gradientlibrary))  # -> legendPar; plug-in component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
recolormesh = Ladybug_RecolorMesh(analysisResult=loadprobes, inputMesh=mjoin, legendPar=legendpar, analysisTitle="Pressure", legendTitle="Pa")  # -> readMe, newMesh, newLegend, legendBasePt, meshColors, legendColors; plug-in component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
