# Grasshopper definition CMF Boundary Conditions.gh (Grasshopper 0.9.76)
# plug-ins: MeshEdit Components, Python Interpreter

# ----
# 1. GEOMETRY
number_slider = Slider(9, range=0..10000)
sqrt = SquareRoot(Value=number_slider)
dom = ConstructDomain(DomainStart=0, DomainEnd=sqrt)
dom_2 = ConstructDomain(DomainStart=0, DomainEnd=sqrt)
rectangle = Rectangle(Plane=PlaneXY(0, 0, 0), XSize=dom, YSize=dom_2, Radius=0)  # -> Rectangle, Length
rad = Radians(Degrees=Slider(15, range=0..180))
yz = YZPlane(Origin=Point(0, 0, 0))
tri = Triangulate(Mesh=rectangle.Rectangle)  # -> Mesh, Count
rotate = Rotate(Geometry=tri.Mesh, Angle=rad, Plane=yz)  # -> Geometry, Transform
mesh = Mesh(rotate.Geometry)

# ----
# Livestock Setup
# Python and SSH
toggle = BooleanToggle(True)
ssh_machine = PythonScript(x=toggle)  # -> out, a, b, c, d
# ---------- ssh_machine: Python ----------
machine = {0: {'name': 'Bash',
               'ip': '127.0.0.1',
               'port': 2222,
               'user': 'ocni',
               'pw': '4320lejre'
               },
           1: {'name': 'Livestock_Ubuntu',
               'ip': '10.61.0.140',
               'port': 22,
               'user': 'livestock',
               'pw': 'stable'
               }}
               
print(machine[x]['name'])
a = machine[x]['ip']
b = machine[x]['port']
c = machine[x]['user']
d = machine[x]['pw']
# ---------- end ssh_machine ----------
panel = Panel(ssh_machine.out)
ssh_connection = LivestockSSHConnection(IP=ssh_machine.a, Port=ssh_machine.b, Username=ssh_machine.c, Password=ssh_machine.d)  # -> readMe
#   port IP: IP Address for SSH connection
#   port Port: Port for SSH connection
#   port Username: Username for SSH connection
#   port Password: Password for SSH connection
#   port readMe: In case of any errors, it will be shown here.
# ---------- ssh_connection: Python ----------
from livestock.components.misc import SSHConnection

comp = SSHConnection(ghenv)
comp.config()
comp.run_checks(str(IP), str(Port), str(Username), str(Password))
comp.run()
# ---------- end ssh_connection ----------
python_executor = LivestockPythonExecutor(PythonPath="C:\Program Files\Anaconda3\envs\livestock\python.exe")  # -> readMe
#   port PythonPath: Path to python.exe
#   port readMe: In case of any errors, it will be shown here.
# ---------- python_executor: Python ----------
from livestock.components.misc import PythonExecutor

comp = PythonExecutor(ghenv)
comp.config()
comp.run_checks(str(PythonPath))
comp.run()
# ---------- end python_executor ----------
panel_2 = Panel(ssh_connection)
panel_3 = Panel(python_executor)

# ----
# Retention Curve
number_slider_2 = Slider(0, range=0..5)
cmf_retention_curve = LivestockCMFRetentionCurve(SoilIndex=number_slider_2, K_sat=Slider(0.1, range=0.1..1))  # -> readMe, Units, CurveValues, RetentionCurve
#   port SoilIndex: Index for choosing soil type. Index from 0-5. Default is set to 0, which is the default CMF retention curve.
#   port K_sat: Saturated conductivity in m/day
#   port Phi: Porosity in m3/m3
#   port Alpha: Inverse of water entry potential in 1/cm
#   port N: Pore size distribution parameter is unitless
#   port M: VanGenuchten m (if negative, 1-1/n is used) is unitless
#   port L: Mualem tortoisivity is unitless
#   port readMe: In case of any errors, it will be shown here.
#   port Units: Shows the units of the curve values
#   port CurveValues: Chosen curve properties values
#   port RetentionCurve: Livestock Retention Curve
# ---------- cmf_retention_curve: Python ----------
from livestock.components.comp_cmf import CMFRetentionCurve

comp = CMFRetentionCurve(ghenv)
comp.config()
comp.run_checks(SoilIndex, K_sat, Phi, Alpha, N, M, L)
comp.run()

Units = comp.units
CurveValues = comp.property.values()
RetentionCurve = comp.results
# ---------- end cmf_retention_curve ----------
panel_4 = Panel(cmf_retention_curve.CurveValues)
panel_5 = Panel(cmf_retention_curve.Units)

# ----
# Soil Layers
number_slider_3 = Slider(0, range=0..2)
series = Series(Start=Slider(0.1, range=0..1), Step=number_slider_3, Count=Slider(1, range=1..10))

# ----
# Surface Properties
number_slider_4 = Slider(2, range=0..5)
cmf_vegetation_properties = LivestockCMFVegetationProperties(Property=number_slider_4)  # -> readMe, Units, VegetationValues, VegetationProperties
#   port Property: 0-1 grasses. 2-6 soils
#   port readMe: In case of any errors, it will be shown here.
#   port Units: Shows the units of the surface values
#   port VegetationValues: Chosen surface properties values
#   port VegetationProperties: Livestock surface properties data
# ---------- cmf_vegetation_properties: Python ----------
from livestock.components.comp_cmf import CMFVegetationProperties

comp = CMFVegetationProperties(ghenv)
comp.config()
comp.run_checks(Property)
comp.run()

Units = comp.units
VegetationValues = comp.property.values()
VegetationProperties = comp.results
# ---------- end cmf_vegetation_properties ----------
panel_6 = Panel(cmf_vegetation_properties.VegetationValues)
panel_7 = Panel(cmf_vegetation_properties.Units)

number_slider_5 = Slider(0, range=0..100)
pt = ConstructPoint(XCoordinate=0, YCoordinate=0, ZCoordinate=0)

# ----
# Ladybug Tools - Location
number_slider_6 = Slider(12, range=0..100)
constructlocation = Ladybug_ConstructLocation(locationName="Copenhagen", latitude=number_slider_6, longitude=Slider(55, range=0..100), timeZone=0, elevation=0)  # -> location; plug-in component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

cmf_outlet = LivestockCMFOutlet(
    Location=pt,
    ConnectedCell=number_slider_5,
    ConnectedLayer=number_slider_5,
    OutletType=Slider(1, range=0..1),
    ConnectionParameter=Slider(1, range=0..1))  # -> readMe, BoundaryCondition
#   port Location: Location of the outlet in x, y and z coordinates. Default is 0,0,0
#   port ConnectedCell: Cell to connect to. Default is set to first cell
#   port ConnectedLayer: Layer of cell to connect to. 0 is surface water. 1 is first layer of cell and so on. Default is set to 0 - surface water
#   port OutletType: Set type of outlet connection. 1 - Richards. 2 - Kinematic wave. 3 - Technical Flux.
#   port ConnectionParameter: If Richards: Potential - Sets the potential of the outlet. The difference in potential is what drives the flux. If Kinematic wave: Residence Time - Linear flow parameter of travel time in days. If Technical Flux: Maximum Flux - The maximum flux is in m3/day.
#   port readMe: In case of any errors, it will be shown here.
#   port BoundaryCondition: Livestock Boundary Condition
# ---------- cmf_outlet: Python ----------
from livestock.components.comp_cmf import CMFOutlet

comp = CMFOutlet(ghenv)
comp.config()
comp.run_checks(Location, ConnectedCell, ConnectedLayer, OutletType, 
                ConnectionParameter)
comp.run()

BoundaryCondition = comp.results
# ---------- end cmf_outlet ----------
python = PythonScript(x=cmf_outlet.BoundaryCondition)  # -> out, a
# ---------- python: Python ----------
import pprint

pp = pprint.PrettyPrinter(indent=1, width=50)
pp.pprint(x.c)
# ---------- end python ----------
panel_8 = Panel(python.out)

# ----
# Face Indices
demesh = DeconstructMesh(Mesh=mesh)  # -> Vertices, Faces, Colours, Normals
lng = ListLength(List=demesh.Faces)
series_2 = Series(Start=0, Step=1, Count=lng)
panel_9 = Panel(series_2)

# ----
# 2. GROUND
number_slider_7 = Slider(5, range=1..10)
cmf_ground = LivestockCMFGround(
    Layers=series,
    RetentionCurve=cmf_retention_curve.RetentionCurve,
    VegetationProperties=cmf_vegetation_properties.VegetationProperties,
    SaturatedDepth=number_slider_7,
    SurfaceWaterVolume=panel_9,
    FaceIndices=Slider(0, range=0..2),
    Manning=Slider(0.002, range=0..0.01))  # -> readMe, Ground; inputs Layers: list, FaceIndices: list
#   port Layers: Soil layers to add to the mesh in m
#   port RetentionCurve: Livestock CMF Retention Curve
#   port VegetationProperties: Input from Livestock CMF Vegetation Properties
#   port SaturatedDepth: Initial saturated depth in m. It is depth where the groundwater is located - Default is set to 3m
#   port SurfaceWaterVolume: Initial surface water volume in m3. - Default is set to 0 m3
#   port FaceIndices: List of face indices, on where the ground properties are applied.
#   port ETMethod: Set method to calculate evapotranspiration. 0: No evapotranspiration 1: Penman-Monteith 2: Shuttleworth-Wallace Default is set to Shuttleworth-Wallace
#   port Manning: Set Manning roughness. If not set CMF calculates it from the above given values.
#   port readMe: In case of any errors, it will be shown here.
#   port Ground: Livestock Ground Data Class
# ---------- cmf_ground: Python ----------
from livestock.components.comp_cmf import CMFGround

comp = CMFGround(ghenv)
comp.config()
comp.run_checks(Layers, RetentionCurve, VegetationProperties, SaturatedDepth, 
                FaceIndices, ETMethod, Manning, PuddleDepth)
comp.run()

Ground = comp.results
# ---------- end cmf_ground ----------

# ----
# Solver Settings & Outputs
number_slider_8 = Slider(0, range=0..1)
number_slider_9 = Slider(20, range=1..8760)
toggle_2 = BooleanToggle(True)
cmf_outputs = LivestockCMFOutputs(Evapotranspiration=Toggle(False), SurfaceWaterVolume=toggle_2, Volume=toggle_2)  # -> readMe, ChosenOutputs, Outputs
#   port Evapotranspiration: Cell evaporation - default is set to True
#   port SurfaceWaterVolume: Cell surface water - default is set to False
#   port SurfaceWaterFlux: Cell surface water flux - default is set to False
#   port HeatFlux: Cell surface heat flux - default is set to False
#   port AerodynamicResistance: Cell aerodynamic resistance - default is set to False
#   port VolumetricFlux: Soil layer volumetric flux vectors - default is set to False
#   port Potential: Soil layer total potential (Psi_tot = Psi_M + Psi_G - default is set to False
#   port Theta: Soil layer volumetric water content of the layer - default is set to False
#   port Volume: Soil layer volume of water in the layer - default is set to False
#   port Wetness: Soil layer wetness of the soil (V_volume/V_pores) - default is set to False
#   port readMe: In case of any errors, it will be shown here.
#   port ChosenOutputs: Shows the chosen outputs
#   port Outputs: Livestock Output Data
# ---------- cmf_outputs: Python ----------
from livestock.components.comp_cmf import CMFOutputs

comp = CMFOutputs(ghenv)
comp.config()
comp.run_checks(Evapotranspiration, SurfaceWaterVolume, SurfaceWaterFlux, 
                HeatFlux, AerodynamicResistance, VolumetricFlux, Potential, 
                Theta, Volume, Wetness)
comp.run()

ChosenOutputs = comp.output_dict.items()
Outputs = comp.results
# ---------- end cmf_outputs ----------
cmf_solver_settings = LivestockCMFSolverSettings(AnalysisLength=number_slider_9, SolverTolerance="1e-04", Verbosity=number_slider_8)  # -> readMe, SolverSettings
#   port AnalysisLength: Total length of the simulation in hours - default is set to 24 hours.
#   port TimeStep: Size of each time step in hours - e.g. 1/60 equals time steps of 1 min and 24 is a time step of one day. Default is 1 hour
#   port SolverTolerance: Solver tolerance - Default is 1e-8
#   port Verbosity: Sets the verbosity of the print statement during runtime - Default is 1. 0 - Prints only at start and end of simulation. 1 - Prints at every time step.
#   port readMe: In case of any errors, it will be shown here.
#   port SolverSettings: Livestock Solver Settings
# ---------- cmf_solver_settings: Python ----------
from livestock.components.comp_cmf import CMFSolverSettings

comp = CMFSolverSettings(ghenv)
comp.config()
comp.run_checks(AnalysisLength, TimeStep, SolverTolerance, Verbosity)
comp.run()

SolverSettings = comp.results
# ---------- end cmf_solver_settings ----------

# ----
# Constant Weather Data
dup = DuplicateData(Data=0, Number=number_slider_9, Order=True)
expression = Expression(R=dup, Expression="1")
expression_2 = Expression(R=dup, Expression="0.65")
expression_3 = Expression(R=dup, Expression="20")
expression_4 = Expression(R=dup, Expression="0.8")
expression_5 = Expression(R=dup, Expression="0")
expression_6 = Expression(R=dup, Expression="20")
expression_7 = Expression(R=dup, Expression="1")

path_mapper = PathMapper(expression, source="{A;B}", target="{0;1}")
expression_8 = Expression(R=dup, Expression="0")
path_mapper_2 = PathMapper(expression_8, source="{A;B}", target="{0;2}")
merge = Merge(Data1=path_mapper, Data2=path_mapper_2)  # -> simplify(Result)

# ----
# 3. Weather
cmf_weather = LivestockCMFWeather(
    Temperature=expression_3,
    WindSpeed=expression_7,
    RelativeHumidity=expression_2,
    CloudCover=expression_4,
    GlobalRadiation=expression_5,
    Rain=expression_8,
    GroundTemperature=expression_6,
    Location=constructlocation,
    MeshFaceCount=lng)  # -> readMe, Weather; inputs Temperature: tree, WindSpeed: tree, RelativeHumidity: tree, CloudCover: tree, GlobalRadiation: tree, Rain: tree, GroundTemperature: tree
#   port Temperature: Temperature in C. Either a list or a tree where the number of branches is equal to the number of mesh faces.
#   port WindSpeed: Wind speed in m/s. Either a list or a tree where the number of branches is equal to the number of mesh faces.
#   port RelativeHumidity: Relative humidity in %. Either a list or a tree where the number of branches is equal to the number of mesh faces.
#   port CloudCover: Cloud cover, unitless between 0 and 1. Either a list or a tree where the number of branches is equal to the number of mesh faces.
#   port GlobalRadiation: Global Radiation in W/m2. Either a list or a tree where the number of branches is equal to the number of mesh faces.
#   port Rain: Horizontal precipitation in mm/h. Either a list or a tree where the number of branches is equal to the number of mesh faces.
#   port GroundTemperature: Ground temperature in C. Either a list or a tree where the number of branches is equal to the number of mesh faces.
#   port Location: A Ladybug Tools Location
#   port MeshFaceCount: Number of faces in the ground mesh
#   port readMe: In case of any errors, it will be shown here.
#   port Weather: Livestock Weather Data Class
# ---------- cmf_weather: Python ----------
from livestock.components.comp_cmf import CMFWeather

comp = CMFWeather(ghenv)
comp.config()
comp.run_checks(Temperature, WindSpeed, RelativeHumidity, CloudCover, GlobalRadiation, Rain, GroundTemperature, Location, MeshFaceCount)
comp.run()

Weather = comp.results
# ---------- end cmf_weather ----------
panel_10 = Panel(cmf_weather.readMe)

# ----
# Inlet
number_slider_10 = Slider(60, range=0..110)
dup_2 = DuplicateData(Data=number_slider_10, Number=number_slider_9, Order=True)
cmf_boundary_condition = LivestockCMFBoundaryCondition(
    InletOrOutlet=Slider(0, range=0..1),
    ConnectedCell=Slider(0, range=0..1),
    ConnectedLayer=Slider(0, range=0..1),
    InletFlux=dup_2)  # -> readMe, BoundaryCondition; inputs InletFlux: list, OutletLocation: list
#   port InletOrOutlet: 0 is inlet. 1 is outlet - default is set to 0
#   port ConnectedCell: Cell to connect to. Default is set to first cell
#   port ConnectedLayer: Layer of cell to connect to. 0 is surface water. 1 is first layer of cell and so on. Default is set to 0 - surface water
#   port InletFlux: If inlet, then set flux in m3/day
#   port FlowWidth: Width of the connection from cell to outlet in meters.
#   port OutletLocation: Location of the outlet in x, y and z coordinates.
#   port readMe: In case of any errors, it will be shown here.
#   port BoundaryCondition: Livestock Boundary Condition
# ---------- cmf_boundary_condition: Python ----------
from livestock.components.comp_cmf import CMFBoundaryCondition

comp = CMFBoundaryCondition(ghenv)
comp.config()
comp.run_checks(InletOrOutlet, ConnectedCell, ConnectedLayer, InletFlux,
                FlowWidth, OutletLocation)
comp.run()

BoundaryCondition = comp.results
# ---------- end cmf_boundary_condition ----------

# ----
# Outlet
number_slider_11 = Slider(0, range=0..4)
cmf_boundary_condition_2 = LivestockCMFBoundaryCondition(
    InletOrOutlet=Slider(1, range=0..1),
    ConnectedCell=Slider(31, range=0..31),
    ConnectedLayer=number_slider_11,
    FlowWidth=Slider(3, range=0..10))  # -> readMe, BoundaryCondition; inputs InletFlux: list, OutletLocation: list
#   port InletOrOutlet: 0 is inlet. 1 is outlet - default is set to 0
#   port ConnectedCell: Cell to connect to. Default is set to first cell
#   port ConnectedLayer: Layer of cell to connect to. 0 is surface water. 1 is first layer of cell and so on. Default is set to 0 - surface water
#   port InletFlux: If inlet, then set flux in m3/day
#   port FlowWidth: Width of the connection from cell to outlet in meters.
#   port OutletLocation: Location of the outlet in x, y and z coordinates.
#   port readMe: In case of any errors, it will be shown here.
#   port BoundaryCondition: Livestock Boundary Condition
# ---------- cmf_boundary_condition_2: Python ----------
from livestock.components.comp_cmf import CMFBoundaryCondition

comp = CMFBoundaryCondition(ghenv)
comp.config()
comp.run_checks(InletOrOutlet, ConnectedCell, ConnectedLayer, InletFlux, 
                FlowWidth, OutletLocation)
comp.run()

BoundaryCondition = comp.results
# ---------- end cmf_boundary_condition_2 ----------

# ----
# 4. SOLVE
panel_11 = Panel("C:\Users\Christian\Dropbox\Arbejde\DTU BYG\Livestock\livestock_gh\grasshopper\scripts\script_data")
cmf_solve = LivestockCMFSolve(
    Mesh=mesh,
    Ground=cmf_ground.Ground,
    Weather=cmf_weather.Weather,
    BoundaryConditions=cmf_boundary_condition.BoundaryCondition,
    SolverSettings=cmf_solver_settings.SolverSettings,
    Folder=panel_11,
    CaseName="CMF_Boundary_Conditions",
    Outputs=cmf_outputs.Outputs,
    Write=Toggle(False),
    Run=Toggle(False))  # -> readMe, ResultPath; inputs Ground: list, Trees: list, BoundaryConditions: list
#   port Mesh: Topography as a mesh
#   port Ground: Input from Livestock CMF Ground
#   port Weather: Input from Livestock CMF Weather
#   port Trees: Input from Livestock CMF Tree
#   port Stream: Input from Livestock CMF Stream
#   port BoundaryConditions: Input from Livestock CMF Boundary Condition
#   port SolverSettings: Input from Livestock CMF Solver Settings
#   port Folder: Path to folder. Default is Desktop
#   port CaseName: Case name as string. Default is CMF
#   port Outputs: Connect Livestock Outputs
#   port Write: Boolean to write files
#   port Overwrite: If True excising case will be overwritten. Default is set to True
#   port Run: Boolean to run analysis Analysis will be ran through SSH. Configure the connection with Livestock SSH
#   port readMe: In case of any errors, it will be shown here.
#   port ResultPath: Path to result files
# ---------- cmf_solve: Python ----------
from livestock.components.comp_cmf import CMFSolve

comp = CMFSolve(ghenv)
comp.config()
comp.run_checks(Mesh, Ground, Weather, Trees, Stream, BoundaryConditions, 
                SolverSettings, Folder, CaseName, Outputs, Write, Overwrite, Run)
comp.run(ghdoc)

ResultPath = comp.case_path
# ---------- end cmf_solve ----------
panel_12 = Panel(cmf_solve.readMe)

# ----
# 5. BOUNDARY CONDITIONS
merge_2 = Merge(Data2=cmf_boundary_condition_2.BoundaryCondition)  # -> flatten(Result)

faceb = FaceBoundaries(Mesh=mesh)
Z = UnitZ(Factor=series)
Z_2 = UnitZ(Factor=expr("-x", series))  # -> graft(UnitVector)
# Visualize Geometry
extr = Extrude(Base=faceb, Direction=Z)
move = Move(Geometry=extr, Motion=Z_2)  # -> Geometry, Transform
wires = BrepWireframe(Brep=move.Geometry, Density=-1)  # -> simplify(Wireframe)

# ----
# Cut slope
join = BrepJoin(Breps=flatten(move.Geometry))  # -> Breps, Closed
bbox = BoundingBox(Content=flatten(join.Breps), Plane=PlaneXY(0, 0, 0), UnionBox=False)  # -> Box, Box_2
debox = DeconstructBox(Box=bbox.Box)  # -> Plane, X, Y, Z
rectangle_2 = Rectangle(Plane=debox.Plane, XSize=debox.X, YSize=debox.Y, Radius=0)  # -> Rectangle, Length
debrep = DeconstructBrep(Brep=rectangle_2.Rectangle)  # -> Faces, Edges, Vertices
fcircle = CircleFit(Points=debrep.Vertices)  # -> Circle, Radius, Deviation

ladybug = Ladybug_Ladybug()  # -> Vviiiiiiiiiizzz; plug-in component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

preview = CustomPreview(Geometry=wires, Shader=ColourSwatch(SwatchColor=RGB(0, 0, 0)))
preview_2 = CustomPreview(Geometry=mesh, Shader=ColourSwatch(SwatchColor=RGB(203, 162, 125)))

# ----
# Time
number_slider_12 = Slider(100, range=0..100)

# ----
# 6b. VISUALIZE RESULTS
# SOIL LAYER FLUX
number_slider_13 = Slider(5, range=0..9)
flip = FlipMatrix(Data=move.Geometry)  # -> simplify(Data)
cmf_results = LivestockCMFResults(ResultFolder=cmf_solve.ResultPath, FetchResult=number_slider_13, Run=Toggle(False))  # -> readMe, Units, simplify(Values), CSVPath
#   port ResultFolder: Path to result folder. Accepts output from Livestock Solve
#   port FetchResult: Choose which result should be loaded: 0 - Evapotranspiration 1 - Surface water volume 2 - Surface water flux 3 - Heat flux 4 - Aerodynamic resistance 5 - Soil layer water flux 6 - Soil layer potential 7 - Soil layer theta 8 - Soil layer volume 9 - Soil layer wetness
#   port SaveCSV: Save the values as a csv file - Default is set to False
#   port Run: Run component
#   port readMe: In case of any errors, it will be shown here.
#   port Units: Shows the units of the results
#   port Values: List with chosen result values
#   port CSVPath: Path to csv file.
# ---------- cmf_results: Python ----------
from livestock.components.comp_cmf import CMFResults

comp = CMFResults(ghenv)
comp.config()
comp.run_checks(ResultFilePath, FetchResult, SaveCSV, Run)
comp.run()

Units = comp.unit
Values = comp.results
# ---------- end cmf_results ----------
int = Integer(number_slider_12)
graft = GraftTree(Tree=flip, IncludeEmptyLists=True, IncludeNullItems=True)  # -> flatten(Tree)
concat = Concatenate(FragmentA="{?}[", FragmentB=int, FragmentC="]")
volume = Volume(Geometry=graft)  # -> Volume, flatten(Centroid)
split = SplitTree(Data=cmf_results.Values, Masks=flatten(concat))  # -> Positive, Negative
clean = CleanTree(RemoveNulls=True, RemoveInvalid=True, RemoveEmpty=False, Tree=split.Positive)  # -> flatten(Tree)
multiplication = Multiplication(A=clean, B=Slider(20, range=0..100))
vdisex = VectorDisplayEx(Point=volume.Centroid, Vector=multiplication, Colour=RGB(0, 0, 0), Width=2)

# ----
# Time
number_slider_14 = Slider(9, range=0..100)

# ----
# 6c. VISUALIZE RESULTS
# SOIL LAYER VOLUME
number_slider_15 = Slider(8, range=0..9)
cmf_results_2 = LivestockCMFResults(ResultFolder=cmf_solve.ResultPath, FetchResult=number_slider_15, Run=Toggle(False))  # -> readMe, Units, simplify(Values), CSVPath; same code as cmf_results
int_2 = Integer(number_slider_14)
concat_2 = Concatenate(FragmentA="{?}[", FragmentB=int_2, FragmentC="]")
bnd = Bounds(Numbers=flatten(cmf_results_2.Values))
split_2 = SplitTree(Data=cmf_results_2.Values, Masks=flatten(concat_2))  # -> Positive, Negative
dedomain = DeconstructDomain(Domain=bnd)  # -> Start, End
clean_2 = CleanTree(RemoveNulls=True, RemoveInvalid=True, RemoveEmpty=False, Tree=split_2.Positive)  # -> flatten(Tree)
legendpar = Ladybug_LegendParameters(lowBound=dedomain.Start, highBound=dedomain.End, decimalPlaces=Slider(5, range=2..5))  # -> legendPar; plug-in component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
convert_geometry = ConvertGeometry(D=move.Geometry)  # -> B, M
recolormesh = Ladybug_RecolorMesh(analysisResult=clean_2, inputMesh=convert_geometry.M, legendPar=legendpar)  # -> readMe, newMesh, newLegend, legendBasePt, meshColors, legendColors; plug-in component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
preview_3 = CustomPreview(Geometry=flatten(convert_geometry.B), Shader=recolormesh.meshColors)

# ----
# Time
number_slider_16 = Slider(20, range=0..20)

# ----
# 6d. VISUALIZE RESULTS
# SURFACE WATER VOLUME
number_slider_17 = Slider(1, range=0..9)
cmf_results_3 = LivestockCMFResults(ResultFolder=cmf_solve.ResultPath, FetchResult=number_slider_17, Run=Toggle(False))  # -> readMe, Units, simplify(Values), CSVPath; same code as cmf_results
bnd_2 = Bounds(Numbers=flatten(cmf_results_3.Values))
item = ListItem(List=cmf_results_3.Values, Index=number_slider_16, Wrap=True)  # -> flatten(Item)
dedomain_2 = DeconstructDomain(Domain=bnd_2)  # -> Start, End
legendpar_2 = Ladybug_LegendParameters(lowBound=dedomain_2.Start, highBound=dedomain_2.End, decimalPlaces=Slider(5, range=2..5))  # -> legendPar; plug-in component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
recolormesh_2 = Ladybug_RecolorMesh(analysisResult=item, inputMesh=mesh, legendPar=legendpar_2)  # -> readMe, newMesh, newLegend, legendBasePt, meshColors, legendColors; plug-in component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
preview_4 = CustomPreview(Geometry=flatten(recolormesh_2.newMesh), Shader=recolormesh_2.meshColors)

# ----
# Time
number_slider_18 = Slider(100, range=0..100)

# ----
# 6a. VISUALIZE RESULTS
# SURFACE WATER FLUX
number_slider_19 = Slider(2, range=0..9)
cmf_results_4 = LivestockCMFResults(ResultFolder=cmf_solve.ResultPath, FetchResult=number_slider_19, Run=Toggle(False))  # -> readMe, Units, simplify(Values), CSVPath; same code as cmf_results
explode = MeshExplode(Interpolate=False)
item_2 = ListItem(List=cmf_results_4.Values, Index=number_slider_18, Wrap=True)  # -> flatten(Item)
area = Area(Geometry=explode)  # -> Area, Centroid
multiplication_2 = Multiplication(A=item_2, B=Slider(50, range=0..100))
vdisex_2 = VectorDisplayEx(Point=area.Centroid, Vector=multiplication_2, Colour=RGB(0, 0, 0), Width=2)

bang = ExplodeTree(Data=cmf_results_3.Values)  # -> Branch0, Branch1
bnd_3 = Bounds(Numbers=flatten(cmf_results_3.Values))
graph = QuickGraph(bang.Branch0)
graph_2 = QuickGraph(bang.Branch1)
panel_13 = Panel(bnd_3)

# ==== cluster ConvertGeometry
D = ClusterInput()
flip = FlipMatrix(Data=D)  # -> simplify(Data)
graft = GraftTree(Tree=flip, IncludeEmptyLists=True, IncludeNullItems=True)
mesh = MeshBrep(
    Brep=graft,
    Settings={GridMaxCount=0, GridMinCount=16, JaggedSeams=False, MaxEdgeLength=0, MinEdgeLength=0.0001, MinTolerance=0, Refine=True, RefineAngle=0, RelativeTolerance=0.65, SimplePlanes=True, Tolerance=0})
cap = CapHoles(Brep=graft)
explode = MeshExplode(Mesh=mesh, Interpolate=False)
B = ClusterOutput(cap)
item = ListItem(List=explode, Index=0, Wrap=True)  # -> flatten(Item)
mjoin = MeshJoin(Meshes=item)
M = ClusterOutput(mjoin)
