# Grasshopper definition CMF Slope.gh (Grasshopper 0.9.76)
# plug-ins: MeshEdit Components, Python Interpreter

# ----
# Slope Function
number_slider = Slider(0.25, range=0..1)
series = Series(Start="-3", Step=number_slider, Count=11)
sqr = Square(Value=series)

# ----
# Livestock Setup
# Python and SSH
toggle = BooleanToggle(True)
ssh_machine = PythonScript(x=toggle)  # -> out, a, b, c, d
# ---------- ssh_machine: Python ----------
machine = {0: {'name': 'Bash',
               'ip': '127.0.0.1',
               'port': 2222,
               'user': 'ocni',
               'pw': '4320lejre'
               },
           1: {'name': 'Livestock_Ubuntu',
               'ip': '10.61.0.140',
               'port': 22,
               'user': 'livestock',
               'pw': 'stable'
               }}
               
print(machine[x]['name'])
a = machine[x]['ip']
b = machine[x]['port']
c = machine[x]['user']
d = machine[x]['pw']
# ---------- end ssh_machine ----------
panel = Panel(ssh_machine.out)
ssh_connection = LivestockSSHConnection(IP=ssh_machine.a, Port=ssh_machine.b, Username=ssh_machine.c, Password=ssh_machine.d)  # -> readMe
#   port IP: IP Address for SSH connection
#   port Port: Port for SSH connection
#   port Username: Username for SSH connection
#   port Password: Password for SSH connection
#   port readMe: In case of any errors, it will be shown here.
# ---------- ssh_connection: Python ----------
from livestock.components.misc import SSHConnection

comp = SSHConnection(ghenv)
comp.config()
comp.run_checks(str(IP), str(Port), str(Username), str(Password))
comp.run()
# ---------- end ssh_connection ----------
python_executor = LivestockPythonExecutor(PythonPath="C:\Program Files\Anaconda3\envs\livestock\python.exe")  # -> readMe
#   port PythonPath: Path to python.exe
#   port readMe: In case of any errors, it will be shown here.
# ---------- python_executor: Python ----------
from livestock.components.misc import PythonExecutor

comp = PythonExecutor(ghenv)
comp.config()
comp.run_checks(str(PythonPath))
comp.run()
# ---------- end python_executor ----------
panel_2 = Panel(ssh_connection)
panel_3 = Panel(python_executor)

# ----
# X Direction
number_slider_2 = Slider(11, range=0..100)
series_2 = Series(Start=0, Step=Slider(2.5, range=0.5..5), Count=number_slider_2)

# ----
# 1. GEOMETRY
number_slider_3 = Slider(1, range=0..1)
pt = ConstructPoint(XCoordinate=series_2, YCoordinate=0, ZCoordinate=sqr)
pt_2 = ConstructPoint(XCoordinate=series_2, YCoordinate=number_slider_3, ZCoordinate=sqr)
weave = Weave(Pattern=[0, 1], Stream0=pt, Stream1=pt_2, NullGaps=False)
srfgrid = SurfaceFromPoints(Points=weave, UCount=number_slider_2, Interpolate=False)
mesh = MeshBrep(
    Brep=srfgrid,
    Settings={GridMaxCount=0, GridMinCount=16, JaggedSeams=False, MaxEdgeLength=0, MinEdgeLength=0.0001, MinTolerance=0, Refine=True, RefineAngle=0, RelativeTolerance=0.65, SimplePlanes=True, Tolerance=0})
tri = Triangulate(Mesh=mesh)  # -> Mesh, Count

# ----
# Pick Face on the Slope
explode = MeshExplode(Mesh=tri.Mesh, Interpolate=False)
lng = ListLength(List=explode)
division = Division(A=lng, B=2)
round = Round(Number=division)  # -> Nearest, Floor, Ceiling
item = ListItem(List=explode, Index=round.Floor, Wrap=True)

# ----
# Make HoneyBee Surface
panel_4 = Panel("context")
callfromlibrary = Honeybee_CallFromRadianceLibrary(keywords=panel_4)  # -> materials; plug-in component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
createhbsrfs = Honeybee_createHBSrfs(geometry=item, RADMaterial=callfromlibrary)  # -> readMe, simplify(HBSurface); plug-in component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

ladybug = Ladybug_Ladybug()  # -> Vviiiiiiiiiizzz; plug-in component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
honeybee = Honeybee_Honeybee()  # -> Vviiiiiiiiiizzz; plug-in component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

# ----
# Grid
number_slider_4 = Slider(0.25, range=0..1)
area = MeshArea(Mesh=item)  # -> Area, Centroid
Z = UnitZ(Factor=number_slider_4)
# 3a. Global Radiation
# With Ladybug Tools
move = Move(Geometry=area.Centroid, Motion=graft(Z))  # -> Geometry, Transform

# ----
# Daylight Recipe
number_slider_5 = Slider(1, range=1..2)
dsparameters = Honeybee_DSParameters(outputUnits=number_slider_5, dgp_imageSize=250, onlyRunGlareAnalysis=True)  # -> DSParameters; plug-in component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
radparameters = Honeybee_RADParameters(quality=0)  # -> readMe, radParameters; plug-in component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
path = FilePath("C:\Users\Christian\Dropbox\Uddannelse\DTU\Diverse\EPW_WeatherData\CPH_DRY_2013CST.epw")
annualdaylightsimulation = Honeybee_AnnualDaylightSimulation(
    epwWeatherFile=path,
    testPoints=move.Geometry,
    testMesh=item,
    radParameters=radparameters.radParameters,
    DSParameters=dsparameters)  # -> analysisRecipe; plug-in component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

# ----
# Retention Curve
number_slider_6 = Slider(0, range=0..5)
cmf_retention_curve = LivestockCMFRetentionCurve(SoilIndex=number_slider_6, K_sat=Slider(0.1, range=0.1..1))  # -> readMe, Units, CurveValues, RetentionCurve
#   port SoilIndex: Index for choosing soil type. Index from 0-5. Default is set to 0, which is the default CMF retention curve.
#   port K_sat: Saturated conductivity in m/day
#   port Phi: Porosity in m3/m3
#   port Alpha: Inverse of water entry potential in 1/cm
#   port N: Pore size distribution parameter is unitless
#   port M: VanGenuchten m (if negative, 1-1/n is used) is unitless
#   port L: Mualem tortoisivity is unitless
#   port readMe: In case of any errors, it will be shown here.
#   port Units: Shows the units of the curve values
#   port CurveValues: Chosen curve properties values
#   port RetentionCurve: Livestock Retention Curve
# ---------- cmf_retention_curve: Python ----------
from livestock.components.comp_cmf import CMFRetentionCurve

comp = CMFRetentionCurve(ghenv)
comp.config()
comp.run_checks(SoilIndex, K_sat, Phi, Alpha, N, M, L)
comp.run()

Units = comp.units
CurveValues = comp.property.values()
RetentionCurve = comp.results
# ---------- end cmf_retention_curve ----------
panel_5 = Panel(cmf_retention_curve.CurveValues)
panel_6 = Panel(cmf_retention_curve.Units)

# ----
# Soil Layers
number_slider_7 = Slider(0, range=0..2)
series_3 = Series(Start=Slider(0.1, range=0..1), Step=number_slider_7, Count=Slider(1, range=1..10))

# ----
# Surface Properties
number_slider_8 = Slider(3, range=0..5)
cmf_vegetation_properties = LivestockCMFVegetationProperties(Property=number_slider_8)  # -> readMe, Units, VegetationValues, VegetationProperties
#   port Property: 0-1 grasses. 2-6 soils
#   port readMe: In case of any errors, it will be shown here.
#   port Units: Shows the units of the surface values
#   port VegetationValues: Chosen surface properties values
#   port VegetationProperties: Livestock surface properties data
# ---------- cmf_vegetation_properties: Python ----------
from livestock.components.comp_cmf import CMFVegetationProperties

comp = CMFVegetationProperties(ghenv)
comp.config()
comp.run_checks(Property)
comp.run()

Units = comp.units
VegetationValues = comp.property.values()
VegetationProperties = comp.results
# ---------- end cmf_vegetation_properties ----------
panel_7 = Panel(cmf_vegetation_properties.VegetationValues)
panel_8 = Panel(cmf_vegetation_properties.Units)

# ----
# Ladybug Tools - Location
number_slider_9 = Slider(12, range=0..100)
constructlocation = Ladybug_ConstructLocation(locationName="Copenhagen", latitude=number_slider_9, longitude=Slider(55, range=0..100), timeZone=0, elevation=0)  # -> location; plug-in component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

# ----
# Face Indices
demesh = DeconstructMesh(Mesh=tri.Mesh)  # -> Vertices, Faces, Colours, Normals
lng_2 = ListLength(List=demesh.Faces)
series_4 = Series(Start=0, Step=1, Count=lng_2)
panel_9 = Panel(series_4)

# ----
# 2. GROUND
number_slider_10 = Slider(5, range=1..10)
cmf_ground = LivestockCMFGround(
    Layers=series_3,
    RetentionCurve=cmf_retention_curve.RetentionCurve,
    VegetationProperties=cmf_vegetation_properties.VegetationProperties,
    SaturatedDepth=number_slider_10,
    FaceIndices=panel_9,
    ETMethod=Slider(0, range=0..2))  # -> readMe, Ground; inputs Layers: list, FaceIndices: list
#   port Layers: Soil layers to add to the mesh in m
#   port RetentionCurve: Livestock CMF Retention Curve
#   port VegetationProperties: Input from Livestock CMF Vegetation Properties
#   port SaturatedDepth: Initial saturated depth in m. It is depth where the groundwater is located - Default is set to 3m
#   port FaceIndices: List of face indices, on where the ground properties are applied.
#   port ETMethod: Set method to calculate evapotranspiration. 0: No evapotranspiration 1: Penman-Monteith 2: Shuttleworth-Wallace Default is set to Shuttleworth-Wallace
#   port Manning: Set Manning roughness. If not set CMF calculates it from the above given values.
#   port PuddleDepth: Set puddle depth. Puddle depth is the height were run-off begins.
#   port readMe: In case of any errors, it will be shown here.
#   port Ground: Livestock Ground Data Class
# ---------- cmf_ground: Python ----------
from livestock.components.comp_cmf import CMFGround

comp = CMFGround(ghenv)
comp.config()
comp.run_checks(Layers, RetentionCurve, VegetationProperties, SaturatedDepth, 
                FaceIndices, ETMethod, Manning, PuddleDepth)
comp.run()

Ground = comp.results
# ---------- end cmf_ground ----------

# ----
# Solver Settings & Outputs
number_slider_11 = Slider(1, range=0..1)
number_slider_12 = Slider(100, range=1..8760)
toggle_2 = BooleanToggle(True)
cmf_outputs = LivestockCMFOutputs(Evapotranspiration=Toggle(False), SurfaceWaterVolume=toggle_2, SurfaceWaterFlux=toggle_2, VolumetricFlux=toggle_2)  # -> readMe, ChosenOutputs, Outputs
#   port Evapotranspiration: Cell evaporation - default is set to True
#   port SurfaceWaterVolume: Cell surface water - default is set to False
#   port SurfaceWaterFlux: Cell surface water flux - default is set to False
#   port HeatFlux: Cell surface heat flux - default is set to False
#   port AerodynamicResistance: Cell aerodynamic resistance - default is set to False
#   port VolumetricFlux: Soil layer volumetric flux vectors - default is set to False
#   port Potential: Soil layer total potential (Psi_tot = Psi_M + Psi_G - default is set to False
#   port Theta: Soil layer volumetric water content of the layer - default is set to False
#   port Volume: Soil layer volume of water in the layer - default is set to True
#   port Wetness: Soil layer wetness of the soil (V_volume/V_pores) - default is set to False
#   port readMe: In case of any errors, it will be shown here.
#   port ChosenOutputs: Shows the chosen outputs
#   port Outputs: Livestock Output Data
# ---------- cmf_outputs: Python ----------
from livestock.components.comp_cmf import CMFOutputs

comp = CMFOutputs(ghenv)
comp.config()
comp.run_checks(Evapotranspiration, SurfaceWaterVolume, SurfaceWaterFlux, 
                HeatFlux, AerodynamicResistance, VolumetricFlux, Potential, 
                Theta, Volume, Wetness)
comp.run()

ChosenOutputs = comp.output_dict.items()
Outputs = comp.results
# ---------- end cmf_outputs ----------
cmf_solver_settings = LivestockCMFSolverSettings(AnalysisLength=number_slider_12, SolverTolerance="1e-04", Verbosity=number_slider_11)  # -> readMe, SolverSettings
#   port AnalysisLength: Number of time steps to be taken - Default is 24
#   port TimeStep: Size of each time step in hours - e.g. 1/60 equals time steps of 1 min and 24 is a time step of one day. Default is 1 hour
#   port SolverTolerance: Solver tolerance - Default is 1e-8
#   port Verbosity: Sets the verbosity of the print statement during runtime - Default is 1. 0 - Prints only at start and end of simulation. 1 - Prints at every time step.
#   port readMe: In case of any errors, it will be shown here.
#   port SolverSettings: Livestock Solver Settings
# ---------- cmf_solver_settings: Python ----------
from livestock.components.comp_cmf import CMFSolverSettings

comp = CMFSolverSettings(ghenv)
comp.config()
comp.run_checks(AnalysisLength, TimeStep, SolverTolerance, Verbosity)
comp.run()

SolverSettings = comp.results
# ---------- end cmf_solver_settings ----------

explode_2 = MeshExplode(Mesh=tri.Mesh, Interpolate=False)
item_2 = ListItem(List=explode_2, Index=Slider(31, range=0..31), Wrap=True)
area_2 = MeshArea(Mesh=item_2)  # -> Area, Centroid

# ----
# Inlet
number_slider_13 = Slider(99, range=0..110)
dup = DuplicateData(Data=number_slider_13, Number=number_slider_12, Order=True)
cmf_boundary_condition = LivestockCMFBoundaryCondition(
    InletOrOutlet=Slider(0, range=0..1),
    ConnectedCell=Slider(0, range=0..100),
    ConnectedLayer=Slider(1, range=0..100),
    InletFlux=dup)  # -> readMe, BoundaryCondition; inputs InletFlux: list, OutletLocation: list
#   port InletOrOutlet: 0 is inlet. 1 is outlet - default is set to 0
#   port ConnectedCell: Cell to connect to. Default is set to first cell
#   port ConnectedLayer: Layer of cell to connect to. 0 is surface water. 1 is first layer of cell and so on. Default is set to 0 - surface water
#   port InletFlux: If inlet, then set flux in m3/day
#   port FlowWidth: Width of the connection from cell to outlet in meters.
#   port OutletLocation: Location of the outlet in x, y and z coordinates.
#   port readMe: In case of any errors, it will be shown here.
#   port BoundaryCondition: Livestock Boundary Condition
# ---------- cmf_boundary_condition: Python ----------
from livestock.components.comp_cmf import CMFBoundaryCondition

comp = CMFBoundaryCondition(ghenv)
comp.config()
comp.run_checks(InletOrOutlet, ConnectedCell, ConnectedLayer, InletFlux,
                FlowWidth, OutletLocation)
comp.run()

BoundaryCondition = comp.results
# ---------- end cmf_boundary_condition ----------

pt2num = PointsToNumbers(Points=area_2.Centroid, Mask=4)

# ----
# Outlet
number_slider_14 = Slider(0, range=0..4)
cmf_boundary_condition_2 = LivestockCMFBoundaryCondition(
    InletOrOutlet=Slider(1, range=0..1),
    ConnectedCell=Slider(31, range=0..31),
    ConnectedLayer=number_slider_14,
    FlowWidth=Slider(1, range=0..1),
    OutletLocation=pt2num)  # -> readMe, BoundaryCondition; inputs InletFlux: list, OutletLocation: list
#   port InletOrOutlet: 0 is inlet. 1 is outlet - default is set to 0
#   port ConnectedCell: Cell to connect to. Default is set to first cell
#   port ConnectedLayer: Layer of cell to connect to. 0 is surface water. 1 is first layer of cell and so on. Default is set to 0 - surface water
#   port InletFlux: If inlet, then set flux in m3/day
#   port FlowWidth: Width of the connection from cell to outlet in meters.
#   port OutletLocation: Location of the outlet in x, y and z coordinates.
#   port readMe: In case of any errors, it will be shown here.
#   port BoundaryCondition: Livestock Boundary Condition
# ---------- cmf_boundary_condition_2: Python ----------
from livestock.components.comp_cmf import CMFBoundaryCondition

comp = CMFBoundaryCondition(ghenv)
comp.config()
comp.run_checks(InletOrOutlet, ConnectedCell, ConnectedLayer, InletFlux, 
                FlowWidth, OutletLocation)
comp.run()

BoundaryCondition = comp.results
# ---------- end cmf_boundary_condition_2 ----------

panel_10 = Panel(pt2num)

# ----
# 5. BOUNDARY CONDITIONS
merge = Merge(Data2=cmf_boundary_condition_2.BoundaryCondition)  # -> flatten(Result)

faceb = FaceBoundaries(Mesh=tri.Mesh)
Z_2 = UnitZ(Factor=series_3)
Z_3 = UnitZ(Factor=expr("-x", series_3))  # -> graft(UnitVector)
# Visualize Geometry
extr = Extrude(Base=faceb, Direction=Z_2)
move_2 = Move(Geometry=extr, Motion=Z_3)  # -> Geometry, Transform
wires = BrepWireframe(Brep=move_2.Geometry, Density=-1)  # -> simplify(Wireframe)

# ----
# Cut slope
join = BrepJoin(Breps=flatten(move_2.Geometry))  # -> Breps, Closed
bbox = BoundingBox(Content=flatten(join.Breps), Plane=PlaneXY(0, 0, 0), UnionBox=False)  # -> Box, Box_2
debox = DeconstructBox(Box=bbox.Box)  # -> Plane, X, Y, Z
rectangle = Rectangle(Plane=debox.Plane, XSize=debox.X, YSize=debox.Y, Radius=0)  # -> Rectangle, Length
debrep = DeconstructBrep(Brep=rectangle.Rectangle)  # -> Faces, Edges, Vertices
fcircle = CircleFit(Points=debrep.Vertices)  # -> Circle, Radius, Deviation

preview = CustomPreview(Geometry=wires, Shader=ColourSwatch(SwatchColor=RGB(0, 0, 0)))
preview_2 = CustomPreview(Geometry=tri.Mesh, Shader=ColourSwatch(SwatchColor=RGB(203, 162, 125)))

# ----
# Time
number_slider_15 = Slider(100, range=0..100)

# ----
# Time
number_slider_16 = Slider(9, range=0..100)

# ----
# Time
number_slider_17 = Slider(100, range=0..100)

# ----
# Time
number_slider_18 = Slider(100, range=0..100)

# ----
# Load Weather Data
panel_11 = Panel("C:\Users\Christian\Dropbox\Uddannelse\DTU\11. semester - Speciale\Data\ProcessedData")
panel_12 = Panel("""/temp.txt
/windspeed.txt
/relhum.txt
/cloudcover.txt
/rain.txt
/groundtemp.txt""")
concat = Concatenate(FragmentA=panel_11, FragmentB=panel_12)
file = ReadFile(File=concat, PerLineParse=True)
cull_i = CullIndex(List=file, Indices=-1, Wrap=True)

split = SplitList(List=file, Index=number_slider_12)  # -> ListA, ListB

path_mapper = PathMapper(split.ListA, source="{A;B;C}", target="{A;B}")

# ----
# Lookup Results
panel_13 = Panel("\CMF_Slope")

# ----
# Run Daylight
number_slider_19 = Slider(4, range=1..8)

# ----
# 3. Weather
bang = ExplodeTree(Data=path_mapper)  # -> Branch0, Branch1, Branch2, Branch3, Branch4, Branch5

addition = Addition(A=bang.Branch4, B=Slider(10, range=0..100))
bnd = Bounds(Numbers=addition)
bang_2 = ExplodeTree(Data=addition)  # -> Branch0, Branch1

# ----
# Visualize Daylight Results
number_slider_20 = Slider(1, range=0..23)
gradientlibrary = Ladybug_GradientLibrary(gradIndex=number_slider_20)  # -> customColors; plug-in component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
hoy = LadybugPlus_CalculateHOY(month=Slider(4, range=1..12), day=Slider(1, range=1..31), hour=Slider(16, range=1..24), minute=0)  # -> hoy, doy, date; plug-in component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
legendpar = Ladybug_LegendParameters(customColors=flatten(gradientlibrary))  # -> legendPar; plug-in component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
concat_2 = Concatenate(FragmentA="Solar Radiation", FragmentB=hoy.date)

# ----
# 4. SOLVE
panel_14 = Panel("C:\Users\Christian\Desktop\Livestock")

concat_3 = Concatenate(FragmentA=panel_14, FragmentB=panel_13)
lookupfolder_daylighting = Honeybee_LookupDaylightingFolder(studyFolder=concat_3, studyType=Slider(5, range=1..5), refresh=Button())  # -> analysisType, resultsUnit, illFiles, ptsFiles, hdrFiles, imageFiles, iesFiles, epwFile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; plug-in component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
importpts = Honeybee_ImportPtsFile(ptsFileAddress=lookupfolder_daylighting.ptsFiles)  # -> points, vectors; plug-in component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
readallthedshourlyresults = Honeybee_ReadAllTheHourlyResultsFromAnnualDaylightStudy(illFilesAddress=lookupfolder_daylighting.illFiles, testPoints=importpts.points)  # -> iIllumLevelsNoDynamicSHD, iIllumLevelsDynamicSHDGroupI, iIllumLevelsDynamicSHDGroupII, iIlluminanceBasedOnOccupancy, shadingGroupInEffect; plug-in component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
path_mapper_2 = PathMapper(readallthedshourlyresults.iIllumLevelsNoDynamicSHD, source="{A;B}", target="{0;1}")

rundaylightanalysis = Honeybee_RunDaylightSimulation(
    HBObjects=flatten(createhbsrfs.HBSurface),
    analysisRecipe=annualdaylightsimulation,
    writeRad=Toggle(False),
    runRad=Toggle(False),
    numOfCPUs=number_slider_19,
    workingDir=panel_14,
    radFileName="CMF_Slope_test",
    overwriteResults=True)  # -> readMe, analysisType, resultsUnit, results, testPts, annual_analysis_files, radGeoFile, studyFolder, done; disabled; plug-in component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
panel_15 = Panel(rundaylightanalysis.readMe)

cmf_weather = LivestockCMFWeather(
    Temperature=bang.Branch0,
    WindSpeed=bang.Branch1,
    RelativeHumidity=bang.Branch2,
    CloudCover=bang.Branch3,
    GlobalRadiation=path_mapper_2,
    Rain=bang_2.Branch0,
    GroundTemperature=bang.Branch5,
    Location=constructlocation,
    MeshFaceCount=lng_2)  # -> readMe, Weather; inputs Temperature: tree, WindSpeed: tree, RelativeHumidity: tree, CloudCover: tree, GlobalRadiation: tree, Rain: tree, GroundTemperature: tree
#   port Temperature: Temperature in C. Either a list or a tree where the number of branches is equal to the number of mesh faces.
#   port WindSpeed: Wind speed in m/s. Either a list or a tree where the number of branches is equal to the number of mesh faces.
#   port RelativeHumidity: Relative humidity in %. Either a list or a tree where the number of branches is equal to the number of mesh faces.
#   port CloudCover: Cloud cover, unitless between 0 and 1. Either a list or a tree where the number of branches is equal to the number of mesh faces.
#   port GlobalRadiation: Global Radiation in W/m2. Either a list or a tree where the number of branches is equal to the number of mesh faces.
#   port Rain: Horizontal precipitation in mm/h. Either a list or a tree where the number of branches is equal to the number of mesh faces.
#   port GroundTemperature: Ground temperature in C. Either a list or a tree where the number of branches is equal to the number of mesh faces.
#   port Location: A Ladybug Tools Location
#   port MeshFaceCount: Number of faces in the ground mesh
#   port readMe: In case of any errors, it will be shown here.
#   port Weather: Livestock Weather Data Class
# ---------- cmf_weather: Python ----------
from livestock.components.comp_cmf import CMFWeather

comp = CMFWeather(ghenv)
comp.config()
comp.run_checks(Temperature, WindSpeed, RelativeHumidity, CloudCover, GlobalRadiation, Rain, GroundTemperature, Location, MeshFaceCount)
comp.run()

Weather = comp.results
# ---------- end cmf_weather ----------
panel_16 = Panel(cmf_weather.readMe)

readdshourlyresults = Honeybee_ReadHourlyResultsFromAnnualDaylightStudy(illFilesAddress=lookupfolder_daylighting.illFiles, testPoints=importpts.points, HOY=hoy.hoy)  # -> iIllumLevelsNoDynamicSHD, iIllumLevelsDynamicSHDGroupI, iIllumLevelsDynamicSHDGroupII, iIlluminanceBasedOnOccupancy, shadingGroupInEffect; plug-in component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
recolormesh = Ladybug_RecolorMesh(
    analysisResult=readdshourlyresults.iIllumLevelsNoDynamicSHD,
    inputMesh=item,
    legendPar=legendpar,
    analysisTitle=concat_2,
    legendTitle="W/m2")  # -> readMe, newMesh, newLegend, legendBasePt, meshColors, legendColors; plug-in component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
preview_3 = CustomPreview(Geometry=recolormesh.newMesh, Shader=recolormesh.meshColors)
preview_4 = CustomPreview(Geometry=recolormesh.newLegend, Shader=ColourSwatch(SwatchColor=RGB(0, 0, 0)))

cmf_solve = LivestockCMFSolve(
    Mesh=tri.Mesh,
    Ground=cmf_ground.Ground,
    Weather=cmf_weather.Weather,
    SolverSettings=cmf_solver_settings.SolverSettings,
    Folder=panel_14,
    CaseName="CMF_Slope_test",
    Outputs=cmf_outputs.Outputs,
    Write=Toggle(False),
    Run=Toggle(False))  # -> readMe, ResultPath; inputs Ground: list, Trees: list, BoundaryConditions: list
#   port Mesh: Topography as a mesh
#   port Ground: Input from Livestock CMF Ground
#   port Weather: Input from Livestock CMF Weather
#   port Trees: Input from Livestock CMF Tree
#   port Stream: Input from Livestock CMF Stream
#   port BoundaryConditions: Input from Livestock CMF Boundary Condition
#   port SolverSettings: Input from Livestock CMF Solver Settings
#   port Folder: Path to folder. Default is Desktop
#   port CaseName: Case name as string. Default is CMF
#   port Outputs: Connect Livestock Outputs
#   port Write: Boolean to write files
#   port Overwrite: If True excising case will be overwritten. Default is set to True
#   port Run: Boolean to run analysis Analysis will be ran through SSH. Configure the connection with Livestock SSH
#   port readMe: In case of any errors, it will be shown here.
#   port ResultPath: Path to result files
# ---------- cmf_solve: Python ----------
from livestock.components.comp_cmf import CMFSolve

comp = CMFSolve(ghenv)
comp.config()
comp.run_checks(Mesh, Ground, Weather, Trees, Stream, BoundaryConditions, 
                SolverSettings, Folder, CaseName, Outputs, Write, Overwrite, Run)
comp.run(ghdoc)

ResultPath = comp.case_path
# ---------- end cmf_solve ----------
panel_17 = Panel(cmf_solve.readMe)

# ----
# 6c. VISUALIZE RESULTS
# SOIL LAYER VOLUME
number_slider_21 = Slider(8, range=0..9)
cmf_results = LivestockCMFResults(ResultFilePath=cmf_solve.ResultPath, FetchResult=number_slider_21, Run=Toggle(False))  # -> readMe, Units, simplify(Values), CSVPath
#   port ResultFilePath: Path to result file. Accepts output from Livestock Solve
#   port FetchResult: Choose which result should be loaded: 0 - Evapotranspiration 1 - Surface water volume 2 - Surface water flux 3 - Heat flux 4 - Aerodynamic resistance 5 - Soil layer water flux 6 - Soil layer potential 7 - Soil layer theta 8 - Soil layer volume 9 - Soil layer wetness
#   port SaveCSV: Save the values as a csv file - Default is set to False
#   port Run: Run component
#   port readMe: In case of any errors, it will be shown here.
#   port Units: Shows the units of the results
#   port Values: List with chosen result values
#   port CSVPath: Path to csv file.
# ---------- cmf_results: Python ----------
from livestock.components.comp_cmf import CMFResults

comp = CMFResults(ghenv)
comp.config()
comp.run_checks(ResultFilePath, FetchResult, SaveCSV, Run)
comp.run()

Units = comp.unit
Values = comp.results
# ---------- end cmf_results ----------
int = Integer(number_slider_16)
concat_4 = Concatenate(FragmentA="{?}[", FragmentB=int, FragmentC="]")
bnd_2 = Bounds(Numbers=flatten(cmf_results.Values))
split_2 = SplitTree(Data=cmf_results.Values, Masks=flatten(concat_4))  # -> Positive, Negative
dedomain = DeconstructDomain(Domain=bnd_2)  # -> Start, End
clean = CleanTree(RemoveNulls=True, RemoveInvalid=True, RemoveEmpty=False, Tree=split_2.Positive)  # -> flatten(Tree)
legendpar_2 = Ladybug_LegendParameters(lowBound=dedomain.Start, highBound=dedomain.End, decimalPlaces=Slider(5, range=2..5))  # -> legendPar; plug-in component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
convert_geometry = ConvertGeometry(D=move_2.Geometry)  # -> B, M
recolormesh_2 = Ladybug_RecolorMesh(analysisResult=clean, inputMesh=convert_geometry.M, legendPar=legendpar_2)  # -> readMe, newMesh, newLegend, legendBasePt, meshColors, legendColors; plug-in component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
preview_5 = CustomPreview(Geometry=flatten(convert_geometry.B), Shader=recolormesh_2.meshColors)

# ----
# 6d. VISUALIZE RESULTS
# SURFACE WATER VOLUME
number_slider_22 = Slider(1, range=0..9)
cmf_results_2 = LivestockCMFResults(ResultFilePath=cmf_solve.ResultPath, FetchResult=number_slider_22, Run=Toggle(False))  # -> readMe, Units, simplify(Values), CSVPath; same code as cmf_results
bnd_3 = Bounds(Numbers=flatten(cmf_results_2.Values))
item_3 = ListItem(List=cmf_results_2.Values, Index=number_slider_17, Wrap=True)  # -> flatten(Item)
dedomain_2 = DeconstructDomain(Domain=bnd_3)  # -> Start, End
legendpar_3 = Ladybug_LegendParameters(lowBound=dedomain_2.Start, highBound=dedomain_2.End, decimalPlaces=Slider(5, range=2..5))  # -> legendPar; plug-in component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
recolormesh_3 = Ladybug_RecolorMesh(analysisResult=item_3, inputMesh=tri.Mesh, legendPar=legendpar_3)  # -> readMe, newMesh, newLegend, legendBasePt, meshColors, legendColors; plug-in component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
preview_6 = CustomPreview(Geometry=flatten(recolormesh_3.newMesh), Shader=recolormesh_3.meshColors)

# ----
# 6b. VISUALIZE RESULTS
# SOIL LAYER FLUX
number_slider_23 = Slider(5, range=0..9)
flip = FlipMatrix(Data=move_2.Geometry)  # -> simplify(Data)
cmf_results_3 = LivestockCMFResults(ResultFilePath=cmf_solve.ResultPath, FetchResult=number_slider_23, Run=Toggle(False))  # -> readMe, Units, simplify(Values), CSVPath; same code as cmf_results
int_2 = Integer(number_slider_15)
graft = GraftTree(Tree=flip, IncludeEmptyLists=True, IncludeNullItems=True)  # -> flatten(Tree)
concat_5 = Concatenate(FragmentA="{?}[", FragmentB=int_2, FragmentC="]")
volume = Volume(Geometry=graft)  # -> Volume, flatten(Centroid)
split_3 = SplitTree(Data=cmf_results_3.Values, Masks=flatten(concat_5))  # -> Positive, Negative
clean_2 = CleanTree(RemoveNulls=True, RemoveInvalid=True, RemoveEmpty=False, Tree=split_3.Positive)  # -> flatten(Tree)
multiplication = Multiplication(A=clean_2, B=Slider(20, range=0..100))
vdisex = VectorDisplayEx(Point=volume.Centroid, Vector=multiplication, Colour=RGB(0, 0, 0), Width=2)

# ----
# 6a. VISUALIZE RESULTS
# SURFACE WATER FLUX
number_slider_24 = Slider(2, range=0..9)
cmf_results_4 = LivestockCMFResults(ResultFilePath=cmf_solve.ResultPath, FetchResult=number_slider_24, Run=Toggle(False))  # -> readMe, Units, simplify(Values), CSVPath; same code as cmf_results
explode_3 = MeshExplode(Mesh=tri.Mesh, Interpolate=False)
item_4 = ListItem(List=cmf_results_4.Values, Index=number_slider_18, Wrap=True)  # -> flatten(Item)
area_3 = Area(Geometry=explode_3)  # -> Area, Centroid
multiplication_2 = Multiplication(A=item_4, B=Slider(50, range=0..100))
vdisex_2 = VectorDisplayEx(Point=area_3.Centroid, Vector=multiplication_2, Colour=RGB(0, 0, 0), Width=2)

bnd_4 = Bounds(Numbers=flatten(cmf_results_2.Values))
panel_18 = Panel(bnd_4)

# ==== cluster ConvertGeometry
D = ClusterInput()
flip = FlipMatrix(Data=D)  # -> simplify(Data)
graft = GraftTree(Tree=flip, IncludeEmptyLists=True, IncludeNullItems=True)
mesh = MeshBrep(
    Brep=graft,
    Settings={GridMaxCount=0, GridMinCount=16, JaggedSeams=False, MaxEdgeLength=0, MinEdgeLength=0.0001, MinTolerance=0, Refine=True, RefineAngle=0, RelativeTolerance=0.65, SimplePlanes=True, Tolerance=0})
cap = CapHoles(Brep=graft)
explode = MeshExplode(Mesh=mesh, Interpolate=False)
B = ClusterOutput(cap)
item = ListItem(List=explode, Index=0, Wrap=True)  # -> flatten(Item)
mjoin = MeshJoin(Meshes=item)
M = ClusterOutput(mjoin)
