# Grasshopper definition CMF Surface Run-off.gh (Grasshopper 0.9.76)
# plug-ins: MeshEdit Components, Python Interpreter

folder = Panel("C:\Users\Christian\Dropbox\Arbejde\DTU BYG\Livestock\livestock_gh\grasshopper\scripts\script_data\CMF_Surface_Flux")

# ----
# Livestock Setup
# Python and SSH
toggle = BooleanToggle(False)
ssh_machine = PythonScript(x=toggle)  # -> out, a, b, c, d
# ---------- ssh_machine: Python ----------
machine = {0: {'name': 'Bash',
               'ip': '127.0.0.1',
               'port': 2222,
               'user': 'ocni',
               'pw': '4320lejre'
               },
           1: {'name': 'Livestock_Ubuntu',
               'ip': '10.61.0.140',
               'port': 22,
               'user': 'livestock',
               'pw': 'stable'
               }}
               
print(machine[x]['name'])
a = machine[x]['ip']
b = machine[x]['port']
c = machine[x]['user']
d = machine[x]['pw']
# ---------- end ssh_machine ----------
panel = Panel(ssh_machine.out)
ssh_connection = LivestockSSHConnection(IP=ssh_machine.a, Port=ssh_machine.b, Username=ssh_machine.c, Password=ssh_machine.d)  # -> readMe
#   port IP: IP Address for SSH connection
#   port Port: Port for SSH connection
#   port Username: Username for SSH connection
#   port Password: Password for SSH connection
#   port readMe: In case of any errors, it will be shown here.
# ---------- ssh_connection: Python ----------
from livestock.components.misc import SSHConnection

comp = SSHConnection(ghenv)
comp.config()
comp.run_checks(str(IP), str(Port), str(Username), str(Password))
comp.run()
# ---------- end ssh_connection ----------
python_executor = LivestockPythonExecutor(PythonPath="C:\Program Files\Anaconda3\envs\livestock\python.exe")  # -> readMe
#   port PythonPath: Path to python.exe
#   port readMe: In case of any errors, it will be shown here.
# ---------- python_executor: Python ----------
from livestock.components.misc import PythonExecutor

comp = PythonExecutor(ghenv)
comp.config()
comp.run_checks(str(PythonPath))
comp.run()
# ---------- end python_executor ----------
panel_2 = Panel(ssh_connection)
panel_3 = Panel(python_executor)

# ----
# MESH
panel_4 = Panel("/mesh.obj")
concat = Concatenate(FragmentA=folder, FragmentB=panel_4)
load_mesh = LivestockLoadMesh(Filename=concat, Load=Toggle(True))  # -> readMe, Mesh, MeshData
#   port Filename: Directory and file name of mesh
#   port Load: Activates the component
#   port readMe: In case of any errors, it will be shown here.
#   port MeshData: Additional data if any
# ---------- load_mesh: Python ----------
from livestock.components.geometry import LoadMesh

comp = LoadMesh(ghenv)
comp.config()
comp.run_checks(Filename, Load)
comp.run()

Mesh = comp.mesh
MeshData = comp.data
# ---------- end load_mesh ----------
mesh = Mesh(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)

# ----
# Calculate Surface Run-Off
toggle_2 = BooleanToggle(False)
cmf_surface_flux_result = LivestockCMFSurfaceFluxResult(ResultFilePath=folder, Mesh=mesh, Run=toggle_2)  # -> readMe, Unit, SurfaceFluxVectors, CSVPath
#   port ResultFilePath: Path to result file. Accepts output from Livestock Solve
#   port Mesh: Mesh of the case
#   port IncludeRunOff: Include surface run-off into the surface flux vector? Default is set to True
#   port IncludeRain: Include rain into the surface flux vector? Default is False.
#   port IncludeEvapotranspiration: Include evapotranspiration into the surface flux vector? Default is set to False
#   port IncludeInfiltration: Include infiltration into the surface flux vector? Default is set to False
#   port SaveResult: Save the values as a text file - Default is set to False
#   port Run: Run component
#   port readMe: In case of any errors, it will be shown here.
#   port Unit: Shows the units of the results
#   port SurfaceFluxVectors: Tree with the surface flux vectors
#   port CSVPath: Path to csv file.
# ---------- cmf_surface_flux_result: Python ----------
from livestock.components.comp_cmf import CMFSurfaceFluxResult

comp = CMFSurfaceFluxResult(ghenv)
comp.config()
comp.run_checks(ResultFilePath, Mesh, IncludeRunOff, IncludeRain, 
                IncludeEvapotranspiration, IncludeInfiltration, SaveResult, Run)
comp.run()


Unit = comp.unit
SurfaceFluxVectors = comp.results
ResultPath = comp.result_path
# ---------- end cmf_surface_flux_result ----------
panel_5 = Panel(cmf_surface_flux_result.readMe)

cmf_results = LivestockCMFResults(ResultFilePath=folder, FetchResult=Slider(1, range=0..1), Run=Toggle(False))  # -> readMe, Units, Values, CSVPath
#   port ResultFilePath: Path to result file. Accepts output from Livestock Solve
#   port FetchResult: Choose which result should be loaded: 0 - Evapotranspiration 1 - Surface water volume 2 - Surface water flux 3 - Heat flux 4 - Aerodynamic resistance 5 - Soil layer water flux 6 - Soil layer potential 7 - Soil layer theta 8 - Soil layer volume 9 - Soil layer wetness
#   port SaveCSV: Save the values as a csv file - Default is set to False
#   port Run: Run component
#   port readMe: In case of any errors, it will be shown here.
#   port Units: Shows the units of the results
#   port Values: List with chosen result values
#   port CSVPath: Path to csv file.
# ---------- cmf_results: Python ----------
from livestock.components.comp_cmf import CMFResults

comp = CMFResults(ghenv)
comp.config()
comp.run_checks(ResultFilePath, FetchResult, SaveCSV, Run)
comp.run()

Units = comp.unit
Values = comp.results
# ---------- end cmf_results ----------

# ----
# Mesh Preview
swatch = ColourSwatch(SwatchColor=RGB(0, 0, 0))
faceb = FaceBoundaries(Mesh=mesh)
preview = CustomPreview(Geometry=faceb, Shader=swatch)

# ----
# Display Flux Vectors
number_slider = Slider(90, range=0..100)
explode = MeshExplode(Mesh=mesh, Interpolate=False)
area = Area(Geometry=explode)  # -> Area, Centroid
item = ListItem(List=cmf_surface_flux_result.SurfaceFluxVectors, Index=number_slider, Wrap=True)
vdisex = VectorDisplayEx(Point=graft(area.Centroid), Vector=item, Colour=RGB(0, 0, 0), Width=2)

item_2 = ListItem(List=cmf_results.Values, Index=number_slider, Wrap=True)
division = Division(A=flatten(item_2), B=area.Area)
faceb_2 = FaceBoundaries(Mesh=explode)  # -> flatten(Boundaries)
Z = UnitZ(Factor=division)
extr = Extrude(Base=faceb_2, Direction=Z)
cap = CapHoles(Brep=extr)
line = LineSDL(Start=graft(area.Centroid), Direction=item, Length=1)  # -> simplify(Line)
debrep = DeconstructBrep(Brep=extr)  # -> Faces, Edges, Vertices
slx = SurfaceLine(Surface=simplify(debrep.Faces), Line=line, LimitToFirst=False)  # -> Curves, Points, UVPoints, Normal
srf_cp = SurfaceClosestPoint(Point=simplify(slx.Points), Surface=simplify(debrep.Faces))  # -> Point, UVPoint, Distance
