# Grasshopper definition CMF.gh (Grasshopper 0.9.76)
# plug-ins: Python Interpreter, GH_CPython

python = PythonScript()  # -> Out, A
python_2 = PythonScript()  # -> Out, A
python_3 = PythonScript()  # -> Out, A
python_4 = PythonScript()  # -> Out, A
python_5 = PythonScript()  # -> Out, A
mesh_drainage = LivestockMeshDrainage()  # -> Readme, NewMesh, DrainCurves, EndPoints; inputs Cpu: Int32
# ---------- mesh_drainage: Python ----------
"""
Simulates drainage in order to analyse a mesh for local pooling of rain water.
Copyright: Creative Commons - Attribution 4.0 International
Contact: ocni@dtu.dk
-
Provided by Livestock 0.1, made by Christian Kongsgaard. 
    Args:
        Run: Activates the component.
        Mesh: The mesh to analyse.
        Cpu: Number of cpu's to run the component on.
    Returns:
        Readme!: In case of any errors, it will be shown here
        NewMesh: New mesh as processed by PyMesh.
        DrainCurves: Curves constructed through the drain positions of each particle.
        EndPoints: The final position of the particles.
"""
#------------------------------------------------------------------------------#
# IMPORTS

import sys
sys.path.insert(0, r'C:\livestock\python\classes')
import LivestockGH as ls
import Rhino as rc
import subprocess
import os
import scriptcontext as sc
from shutil import copyfile

n = 2
data = ls.componetData(n)
ghenv.Component.Name = data[0]
ghenv.Component.NickName = data[1]
ghenv.Component.Message = data[2]
ghenv.Component.IconDisplayMode = ghenv.Component.IconDisplayMode.application
ghenv.Component.Category = data[3]
ghenv.Component.SubCategory = data[4]
ghenv.Component.Description = data[5]
#ghenv.Component.Icon = dgh.ComponentData[n][6]

#------------------------------------------------------------------------------#
# COMPONENT

# Paths
sshPath = r'C:\livestock\python\ssh'
templatePath = r'C:\livestock\python\templates'
meshName = 'drainMesh'
meshType = '.obj'
doc = ghdoc

# SSH and commands
ip = str(sc.sticky["SSH"]['ip'])
port = str(sc.sticky["SSH"]['port'])
user = str(sc.sticky["SSH"]['user'])
pw = str(sc.sticky["SSH"]['password'])

fTrans = 'user.txt,cpu.txt,' + meshName+meshType
fRun = 'DrainMeshTemplate.py'
fReturn = 'newDrainMesh.obj,drainPoints.txt'

inData = 'InData'
py_template = templatePath + '\\SSHTemplate.py'
pyfile = templatePath + '\\sshrun.py'
py = sc.sticky['PythonExe']

def getWarnings():
    file_obj = open(sshPath + "\\out.txt",'r')
    data = file_obj.readlines()
    warn = []
    for w in data:
        print(w)
    file_obj.close()

#------------------------------------------------------------------------------#
# OUTPUTS

if Run:
    # Clean SSH folder
    ls.cleanSSHFolder()
        
    # Export mesh
    ls.bakeExportDelete(Mesh, sshPath, meshName, meshType, doc)
    
    # Write Cpu file
    ls.writeFile(int(Cpu),sshPath,'cpu')
    
    # Write user file
    ls.writeFile([user,], sshPath, 'user')
    
    # Write SSH commands
    ls.writeFile([ip,port,user,pw,fTrans,fRun,fReturn],sshPath,inData)
    
    #Copy Template
    copyfile(py_template,pyfile)
    
    # Run template
    thread = subprocess.Popen([py, pyfile])
    thread.wait()
    thread.kill()
    
    # Load results
    NewMesh = ls.importObj(sshPath+'\\newDrainMesh'+meshType)
    pts = ls.loadPoints(sshPath+'\\drainPoints.txt')
    DrainCurves, EndPoints = ls.makeCurvesFromPoints(pts)
    
    
    # File clean up
    if NewMesh and pts:
        ls.cleanSSHFolder()
# ---------- end mesh_drainage ----------
cmf_load_results = CMFLoadResults(input=Slider(0, range=0..100))  # -> output; inputs input: list
#   port input: [required] - [type = int] - [default = None] Descripe your input here * bullet point. * bullet point
#   port output: indicate your output description here. refers to a new line.
# ---------- cmf_load_results: Python ----------
import numpy as np

def totalOutput():
    for output in range(6):
        ghenv.Component.Params.Output[output].NickName = outputsDictTot[output][0]
        ghenv.Component.Params.Output[output].Name = outputsDictTot[output][0]
        ghenv.Component.Params.Output[output].Description = outputsDictTot[output][1]
# ---------- end cmf_load_results ----------
ground = PythonScript()  # -> Out, Ground
stream = PythonScript()  # -> Out, Stream
weather = PythonScript()  # -> Out, Weather
tree = PythonScript()  # -> Out, Tree
solve_cmf = PythonScript(
    Ground=ground.Ground,
    RunOffPattern=mesh_drainage.DrainCurves,
    Weather=weather.Weather,
    Trees=tree.Tree,
    Stream=stream.Stream,
    AnalysisLenght="8760",
    Run=Toggle(False))  # -> Out, A
