# Grasshopper definition CMF_1DModel.gh (Grasshopper 0.9.76)
# plug-ins: Python Interpreter

panel = Panel("""1
0.5
0.01
2.0""")
srf = Surface(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)
mesh = Mesh(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)
demesh = DeconstructMesh(Mesh=mesh)  # -> Vertices, Faces, Colours, Normals; disabled
python = PythonScript(Geometry=mesh)  # -> out, area
# ---------- python: Python ----------
import rhinoscriptsyntax as rs

if rs.IsBrep(Geometry):
    area = rs.SurfaceArea(Geometry)[0]
elif rs.IsMesh(Geometry):
    area = rs.MeshArea(Geometry)[1]
else:
    print('Gemotry has to be either surface or mesh')
    exit()
# ---------- end python ----------
python_2 = PythonScript(SurfaceWater=Toggle(False), RCurve=panel, nCells=Slider(10, range=1..20), Run=Toggle(False))  # -> out, Potential, Moisture; inputs SurfaceWater: Boolean, RCurve: list, nCells: Int32, Run: Boolean
# ---------- python_2: Python ----------
"""
Copyright: Creative Commons - Attribution 4.0 International
Contact: ocni@dtu.dk
-
Provided by Livestock 0.1, made by Christian Kongsgaard. 

    Args:
        Geometry: Surface or mesh to analyse.
        SurfaceWater: If model should have surface water or not.
        RCurve: Data for the retention curve
        nCells: Number of cells in z-direction
        Run: Activates the component.
    Returns:
        Readme!: In case of any errors, it will be shown here.
        Potential: Water potential in cells
        Moisture: Moisture content in cells
"""
#------------------------------------------------------------------------------#
# IMPORTS

import sys
sys.path.insert(0, r'C:\livestock\python\classes')
import LivestockGH as ls
import CMFClasses as cc
import Rhino.Geometry as rc
import rhinoscriptsyntax as rs

n = 25
ghenv.Component.Name = ls.ComponentData[n][0]
ghenv.Component.NickName = ls.ComponentData[n][1]
ghenv.Component.Message = ls.ComponentData[n][2]
ghenv.Component.IconDisplayMode = ghenv.Component.IconDisplayMode.application
ghenv.Component.Category = ls.ComponentData[n][3]
ghenv.Component.SubCategory = ls.ComponentData[n][4]
ghenv.Component.Description = ls.ComponentData[n][5]
#ghenv.Component.Icon = ls.ComponentData[n][6]

#------------------------------------------------------------------------------#
# COMPONENT

if rs.IsBrep(Geometry):
    area = rs.SurfaceArea(Geometry)[0]
elif rs.IsMesh(Geometry):
    area = rs.MeshArea(Geometry)[1]
else:
    print('Gemotry has to be either surface or mesh')
    exit()

#------------------------------------------------------------------------------#
# OUTPUTS

if Run:
    model = cc.Model_1D(area, nCells, surfaceWater, RCurve)
    Potential = model.potential
    Moisture = model.Moisture
# ---------- end python_2 ----------
python_executor = LivestockPythonExecutor(PythonPath="C:\Program Files\Anaconda3\envs\livestock\python.exe")  # -> out
# ---------- python_executor: Python ----------
#------------------------------------------------------------------------------#
# IMPORTS

import sys
sys.path.insert(0, r'C:\livestock\python\classes')
import LivestockGH as ls
import Rhino as rc
import scriptcontext as sc

n = 16
ghenv.Component.Name = ls.ComponentData[n][0]
ghenv.Component.NickName = ls.ComponentData[n][1]
ghenv.Component.Message = ls.ComponentData[n][2]
ghenv.Component.IconDisplayMode = ghenv.Component.IconDisplayMode.application
ghenv.Component.Category = ls.ComponentData[n][3]
ghenv.Component.SubCategory = ls.ComponentData[n][4]
ghenv.Component.Description = ls.ComponentData[n][5]
#ghenv.Component.Icon = dgh.ComponentData[n][6]

#------------------------------------------------------------------------------#
# COMPONENT

sc.sticky['PythonExe'] = PythonPath

#------------------------------------------------------------------------------#
# OUTPUTS

if PythonPath:
    print('Python Executor is set to: ' + PythonPath)
# ---------- end python_executor ----------
panel_2 = Panel(python.out)
panel_3 = Panel(python.area)
panel_4 = Panel(python_2.out)
panel_5 = Panel([python_2.Potential, python_2.Moisture])
