# Grasshopper definition CMF_Test.gh (Grasshopper 0.9.76)
# plug-ins: MeshEdit Components, Python Interpreter

# ----
# Livestock Setup
# Python and SSH
panel = Panel("C:\Program Files\Anaconda3\envs\livestock\python.exe")
# Åben Bash og kør:
# sudo service ssh --full-restart
txt = Text("stable")
ssh_connection = LivestockSSHConnection(IP="10.61.0.140", Port="22", Username="livestock", Password=txt)  # -> readMe
#   port IP: IP Address to connection
#   port Port: Port for connection
#   port Username: Username for connection
#   port Password: Password for connection
#   port readMe: In case of any errors, it will be shown here.
# ---------- ssh_connection: Python ----------
from livestock.components.misc import SSHConnection

comp = SSHConnection(ghenv)
comp.config()
comp.run_checks(str(IP), str(Port), str(Username), str(Password))
comp.run()
# ---------- end ssh_connection ----------
python_executor = LivestockPythonExecutor(PythonPath=panel)  # -> readMe
#   port PythonPath: Path to python.exe
#   port readMe: In case of any errors, it will be shown here.
# ---------- python_executor: Python ----------
from livestock.components.misc import PythonExecutor

comp = PythonExecutor(ghenv)
comp.config()
comp.run_checks(str(PythonPath))
comp.run()
# ---------- end python_executor ----------
update = LivestockUpdate(Update=Toggle(False))  # -> out
# ---------- update: Python ----------
#------------------------------------------------------------------------------#
# IMPORTS

import sys
import os
import shutil
import zipfile
import time
import urllib
import System

n = 20
ghenv.Component.Name = "Livestock Update"
ghenv.Component.NickName = "Update"
ghenv.Component.Message = "VER 0.0.1 | May 2017"
ghenv.Component.IconDisplayMode = ghenv.Component.IconDisplayMode.application
ghenv.Component.Category = "Livestock"
ghenv.Component.SubCategory = "0 | Miscellaneous"
ghenv.Component.Description = "Update Livestock"
	
#------------------------------------------------------------------------------#
# COMPONENT

def downloadSourceAndUnzip():
    """
    Download the source code from github and unzip it in temp folder
    """

    url = "https://github.com/livestock3d/livestock_gh/archive/master.zip"
    targetDirectory = r'C:\livestock'

    # download the zip file
    print("Downloading the source code...")
    zipFile = os.path.join(targetDirectory, os.path.basename(url))
    
    # if the source file is just downloded then just use the available file
    if os.path.isfile(zipFile) and time.time() - os.stat(zipFile).st_mtime < 1000:
        download = False
    else:
        download = True

        # remove the old version
        try:
            shutil.rmtree(targetDirectory)
        except:
            pass

    # create the target directory
    if not os.path.isdir(targetDirectory): os.mkdir(targetDirectory)

    if download:
        try:
            client = System.Net.WebClient()
            client.DownloadFile(url, zipFile)
            if not os.path.isfile(zipFile):
                print("Download failed! Try to download and unzip the file manually form:\n" + url)
                return
        except Exception, e:
            print(`e` + "\nDownload failed! Try to download and unzip the file manually form:\n" + url)
            return

    # unzip the file
    with zipfile.ZipFile(zipFile) as zf:
        for f in zf.namelist():
            folder = f.replace('livestock_gh-master/','C:/livestock/')
            if f.endswith('/'):
                try:
                    os.makedirs(folder)
                    os.makedirs(f)
                except:
                    pass
            else:
                zf.extract(f, targetDirectory)
                file = f.replace('livestock_gh-master/','C:/livestock/')
                shutil.move('C:/livestock/'+f,file)
                
    shutil.rmtree('C:/livestock/livestock_gh-master')
    
    #Move GH components
    userObjectsFolder = os.getenv('APPDATA') + '/Grasshopper/UserObjects/'
    componentsFolder = 'C:/livestock/grasshopper/components/'
    for obj in os.listdir(componentsFolder):
        shutil.move(componentsFolder+obj,userObjectsFolder+obj)
    shutil.rmtree('C:/livestock/grasshopper')
    
    return True

    
#------------------------------------------------------------------------------#
# OUTPUTS

if Update:
    downloadSourceAndUnzip()
    print('Download done')
# ---------- end update ----------
panel_2 = Panel(update)
panel_3 = Panel(ssh_connection)
panel_4 = Panel(python_executor)

# ----
# Geometry
canopy = Brep([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])
trunks = Brep([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])
ground = Mesh(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)
sand_curve = Curve(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)
mesh = MeshBrep(
    Brep=canopy,
    Settings={GridMaxCount=0, GridMinCount=16, JaggedSeams=False, MaxEdgeLength=0, MinEdgeLength=0.0001, MinTolerance=0, Refine=True, RefineAngle=0, RelativeTolerance=0.65, SimplePlanes=True, Tolerance=0})
mesh_2 = MeshBrep(
    Brep=trunks,
    Settings={GridMaxCount=0, GridMinCount=16, JaggedSeams=False, MaxEdgeLength=0, MinEdgeLength=0.0001, MinTolerance=0, Refine=True, RefineAngle=0, RelativeTolerance=0.65, SimplePlanes=True, Tolerance=0})

triangulate = MeshTriangulate(Mesh=ground, ShortDiagonal=True)

ladybug = Ladybug_Ladybug()  # -> Vviiiiiiiiiizzz; plug-in component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
honeybee = Honeybee_Honeybee()  # -> Vviiiiiiiiiizzz; plug-in component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

# ----
# Split mesh - Sand - Grass
explode = MeshExplode(Mesh=triangulate, Interpolate=False)
area = Area(Geometry=explode)  # -> Area, Centroid
lng = ListLength(List=explode)
incurve = PointInCurve(Point=area.Centroid, Curve=sand_curve)  # -> Relationship, Point
series = Series(Start=0, Step=1, Count=lng)
equals = Equality(FirstNumber=incurve.Relationship, SecondNumber=2)  # -> Equality, Inequality
cullf = CullFaces(Mesh=triangulate, Pattern=equals.Equality)
cull = CullPattern(List=series, CullPattern=equals.Equality)
cullf_2 = CullFaces(Mesh=triangulate, Pattern=equals.Inequality)
cull_2 = CullPattern(List=series, CullPattern=equals.Inequality)

# ----
# Look for Mesh Face
number_slider = Slider(44, range=0..55)
item = ListItem(List=area.Centroid, Index=number_slider, Wrap=True)

# ----
# Grid
mesh_3 = Mesh(triangulate)
# Solar Radiation
explode_2 = MeshExplode(Mesh=mesh_3, Interpolate=False)
area_2 = MeshArea(Mesh=explode_2)  # -> Area, Centroid
Z = UnitZ(Factor=Slider(0.25, range=0..1))
move = Move(Geometry=area_2.Centroid, Motion=graft(Z))  # -> Geometry, Transform

# ----
# Context
panel_5 = Panel("context")
callfromlibrary = Honeybee_CallFromRadianceLibrary(keywords=panel_5)  # -> materials; plug-in component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
panel_6 = Panel(callfromlibrary)
hb_epcontextsrf = HoneybeeEPContextSurfaces(shdSurfaces=flatten([canopy, trunks]), RADMaterial=panel_6)  # -> HBContext; inputs shdSurfaces: list of Brep, justBoundingBox: Boolean
# ---------- hb_epcontextsrf: Python ----------
"""
prepare shading/context geometries

    Args:
        northVectorOrRotation: A vector that shows North or a number that shows
                               the rotation of the North from the Y axis
        bldgMasses: List of closed Breps as thermal zones.
    Returns:
        report: ...
        thermalZones: Thermal zone's geometries for visualiza
"""

ghenv.Component.Name = 'Honeybee EP context Surfaces'
ghenv.Component.NickName = 'HB_EPContextSrf'
ghenv.Component.Message = 'VER 0.0.61\nFEB_05_2017'
ghenv.Component.IconDisplayMode = ghenv.Component.IconDisplayMode.application
ghenv.Component.Category = "Honeybee"
ghenv.Component.SubCategory = "10 | Energy | Energy"
#compatibleHBVersion = VER 0.0.57\nNOV_04_2016
#compatibleLBVersion = VER 0.0.59\nFEB_01_2015
ghenv.Component.AdditionalHelpFromDocStrings = "2"

import rhinoscriptsyntax as rs
import Rhino as rc
import scriptcontext as sc
import os
import System
import Grasshopper.Kernel as gh
import uuid

tolerance = sc.doc.ModelAbsoluteTolerance
import math


def main(shdSurfaces, EPTransSchedule, meshingSettings, justBoundingBox):
    
    # import the classes
    if sc.sticky.has_key('honeybee_release'):

        try:
            if not sc.sticky['honeybee_release'].isCompatible(ghenv.Component): return -1
            if sc.sticky['honeybee_release'].isInputMissing(ghenv.Component): return -1
        except:
            warning = "You need a newer version of Honeybee to use this compoent." + \
            " Use updateHoneybee component to update userObjects.\n" + \
            "If you have already updated userObjects drag Honeybee_Honeybee component " + \
            "into canvas and try again."
            w = gh.GH_RuntimeMessageLevel.Warning
            ghenv.Component.AddRuntimeMessage(w, warning)
            return -1
        
        # don't customize this part
        hb_EPSrf = sc.sticky["honeybee_EPSurface"]
        hb_EPSHDSurface = sc.sticky["honeybee_EPShdSurface"]
        hb_RADMaterialAUX = sc.sticky["honeybee_RADMaterialAUX"]
        hb_EPObjectsAux = sc.sticky["honeybee_EPObjectsAUX"]()
        HBScheduleList = sc.sticky["honeybee_ScheduleLib"].keys()

        ########################################################################
        #----------------------------------------------------------------------#
        shdBreps = []
        # create bounding box of shading geometries
        if justBoundingBox:
            for brep in shdSurfaces:
                if brep.Faces.Count>1 or not brep.Faces[0].IsPlanar(sc.doc.ModelAbsoluteTolerance):
                    shdBreps.append(brep.GetBoundingBox(True).ToBrep())
                else:
                    shdBreps.append(brep)
        else:
            shdBreps = shdSurfaces
        
        shadingClasses = []
        shadingMeshPreview = []
        
        if meshingSettings == None:
            mp = rc.Geometry.MeshingParameters.Minimal
            mp.SimplePlanes = True
        else:
            mp = meshingSettings
        
        def getRadMaterialName(radMaterial):
            nameStr = radMaterial.split(" ")[2]
            name =  nameStr.split("\n")[0]
            return name
        
        for brepCount, brep in enumerate(shdBreps):
            if brep != None:
                isPlanar = True
                # check planarity
                for face in brep.Faces:
                    if not face.IsPlanar(tolerance):
                        isPlanar = False
                        break
                
                shadingBreps = []
                if not isPlanar:
                    meshArray = rc.Geometry.Mesh.CreateFromBrep(brep, mp)
                    for mesh in meshArray:
                        for meshFace in range(mesh.Faces.Count):
                            vertices = list(mesh.Faces.GetFaceVertices(meshFace))[1:]
                            vertices = vertices + [sc.doc.ModelAbsoluteTolerance]
                            # create the brep from mesh
                            shdBrep = rc.Geometry.Brep.CreateFromCornerPoints(*vertices)
                            shadingBreps.append(shdBrep)
                else:
                    for face in brep.Faces:
                        shadingBreps.append(face.DuplicateFace(False))
                
                for faceCount, shdBrep in enumerate(shadingBreps):
                        thisShading = hb_EPSHDSurface(shdBrep, 1000*brepCount + faceCount, 'shdSrf_' + `brepCount` + '_' + `faceCount` + "_" + str(uuid.uuid4()))
                        
                        # add transmittance schedule if any
                        if EPTransSchedule!=None:
                            schedule= EPTransSchedule.upper()
                            if schedule!=None and not schedule.lower().endswith(".csv") and schedule not in HBScheduleList:
                                msg = "Cannot find " + schedule + " in Honeybee schedule library."
                                print msg
                                ghenv.Component.AddRuntimeMessage(gh.GH_RuntimeMessageLevel.Warning, msg)
                                return -1
                            elif schedule!=None and schedule.lower().endswith(".csv"):
                                # check if csv file is existed
                                if not os.path.isfile(schedule):
                                    msg = "Cannot find the shchedule file: " + schedule
                                    print msg
                                    ghenv.Component.AddRuntimeMessage(gh.GH_RuntimeMessageLevel.Warning, msg)
                                    return -1
                            
                            thisShading.TransmittanceSCH = schedule
                        
                        # add the Rad Material if any
                        if RADMaterial!=None:
                            # if it is just the name of the material make sure it is already defined
                            if len(RADMaterial.split(" ")) == 1:
                                # if the material is not in the library add it to the library
                                if not hb_RADMaterialAUX.isMatrialExistInLibrary(RADMaterial):
                                    warningMsg = "Can't find " + RADMaterial + " in RAD Material Library.\n" + \
                                                "Add the material to the library and try again."
                                    ghenv.Component.AddRuntimeMessage(gh.GH_RuntimeMessageLevel.Warning, warningMsg)
                                    return
                                
                                try:
                                    thisShading.setRADMaterial(RADMaterial)
                                except Exception, e:
                                    print e
                                    warningMsg = "You are using an old version of Honeybee_Honeybee! Update your files and try again."
                                    print warningMsg
                                    ghenv.Component.AddRuntimeMessage(gh.GH_RuntimeMessageLevel.Warning, warningMsg)
                                    return
                                
                                addedToLib = True
                            else:
                                
                                # try to add the material to the library
                                addedToLib, thisShading.RadMaterial = hb_RADMaterialAUX.analyseRadMaterials(RADMaterial, True)
                                
                            if addedToLib==False:
                                warningMsg = "Failed to add " + RADMaterial + " to the Library."
                                ghenv.Component.AddRuntimeMessage(gh.GH_RuntimeMessageLevel.Warning, warningMsg)
                                return
                        
                        # add shading to the list
                        shadingClasses.append(thisShading)
                
        # add to the hive
        hb_hive = sc.sticky["honeybee_Hive"]()
        HBContext  = hb_hive.addToHoneybeeHive(shadingClasses, ghenv.Component)
        return HBContext
        ################################################################################################
    else:
        print "You should first let Honeybee to fly..."
        w = gh.GH_RuntimeMessageLevel.Warning
        ghenv.Component.AddRuntimeMessage(w, "You should first let Honeybee to fly...")
        return -1
        

if _shdSurfaces and _shdSurfaces[0]!=None:
    # add cleaning function
    result= main(_shdSurfaces, EPTransSchedule_, meshingSettings_, justBoundingBox_)
    
    if result != -1: HBContext = result
# ---------- end hb_epcontextsrf ----------
createhbsrfs = Honeybee_createHBSrfs(geometry=mesh_3, RADMaterial=panel_6)  # -> readMe, simplify(HBSurface); plug-in component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

# ----
# Geometry Visualization
swatch = ColourSwatch(SwatchColor=RGB(107, 69, 33))
preview = CustomPreview(Geometry=mesh_2, Shader=swatch)
preview_2 = CustomPreview(Geometry=cullf_2, Shader=ColourSwatch(SwatchColor=RGB(214, 138, 66)))
preview_3 = CustomPreview(Geometry=[cullf, mesh], Shader=ColourSwatch(SwatchColor=RGB(63, 173, 29)))

# ----
# Surface Properties
number_slider_2 = Slider(1, range=0..6)
cmf_surface_properties = LivestockCMFSurfaceProperties(Property=number_slider_2)  # -> readMe, Units, SurfaceValues, SurfaceProperties
#   port Property: 0-1 grasses. 2-6 soils
#   port readMe: In case of any errors, it will be shown here.
#   port Units: Shows the units of the surface values
#   port SurfaceValues: Chosen surface properties values
#   port SurfaceProperties: Livestock surface properties data
# ---------- cmf_surface_properties: Python ----------
from livestock.components.comp_cmf import CMFSurfaceProperties

comp = CMFSurfaceProperties(ghenv)
comp.config()
comp.run_checks(Property)
comp.run()

Units = comp.units
SurfaceValues = comp.property.values()
SurfaceProperties = comp.results
# ---------- end cmf_surface_properties ----------
panel_7 = Panel(cmf_surface_properties.SurfaceValues)
panel_8 = Panel(cmf_surface_properties.Units)

# ----
# Retention Curve
number_slider_3 = Slider(1, range=0..4)
cmf_retention_curve = LivestockCMFRetentionCurve(SoilIndex=number_slider_3)  # -> readMe, Units, CurveValues, RetentionCurve
#   port SoilIndex: Index for chosing soil type
#   port readMe: In case of any errors, it will be shown here.
#   port Units: Shows the units of the curve values
#   port CurveValues: Chosen curve properties values
#   port RetentionCurve: Livestock Retention Curve
# ---------- cmf_retention_curve: Python ----------
from livestock.components.comp_cmf import CMFRetentionCurve

comp = CMFRetentionCurve(ghenv)
comp.config()
comp.run_checks(SoilIndex)
comp.run()

Units = comp.units
CurveValues = comp.property.values()
RetentionCurve = comp.results
# ---------- end cmf_retention_curve ----------
panel_9 = Panel(cmf_retention_curve.CurveValues)
panel_10 = Panel(cmf_retention_curve.Units)

# ----
# Soil Layers
number_slider_4 = Slider(1, range=0..1)
series_2 = Series(Start=number_slider_4, Step=1, Count=Slider(5, range=0..10))
panel_11 = Panel(series_2)

# ----
# Daylight Recipe
number_slider_5 = Slider(1, range=1..2)
dsparameters = Honeybee_DSParameters(outputUnits=number_slider_5, dgp_imageSize=250, onlyRunGlareAnalysis=True)  # -> DSParameters; plug-in component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
radparameters = Honeybee_RADParameters(quality=0)  # -> readMe, radParameters; plug-in component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
path = FilePath("C:\Users\Christian\Dropbox\Uddannelse\DTU\Diverse\EPW_WeatherData\CPH_DRY_2013CST.epw")
annualdaylightsimulation = Honeybee_AnnualDaylightSimulation(epwWeatherFile=path, testPoints=move.Geometry, radParameters=radparameters.radParameters, DSParameters=dsparameters)  # -> analysisRecipe; plug-in component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

# ----
# Surface Properties
number_slider_6 = Slider(0, range=0..6)
cmf_surface_properties_2 = LivestockCMFSurfaceProperties(Property=number_slider_6)  # -> readMe, Units, SurfaceValues, SurfaceProperties
#   port Property: 0-1 grasses. 2-6 soils
#   port readMe: In case of any errors, it will be shown here.
#   port Units: Shows the units of the surface values
#   port SurfaceValues: Chosen surface properties values
#   port SurfaceProperties: Livestock surface properties data
# ---------- cmf_surface_properties_2: Python ----------
from livestock.components.comp_cmf import CMFSurfaceProperties

comp = CMFSurfaceProperties(ghenv)
comp.config()
comp.run_checks(int(Property))
comp.run()

Units = comp.units
SurfaceValues = comp.property.values()
SurfaceProperties = comp.results
# ---------- end cmf_surface_properties_2 ----------
panel_12 = Panel(cmf_surface_properties_2.SurfaceValues)
panel_13 = Panel(cmf_surface_properties_2.Units)

# ----
# Retention Curve
number_slider_7 = Slider(1, range=0..4)
cmf_retention_curve_2 = LivestockCMFRetentionCurve(SoilIndex=number_slider_7)  # -> readMe, Units, CurveValues, RetentionCurve
#   port SoilIndex: Index for chosing soil type
#   port readMe: In case of any errors, it will be shown here.
#   port Units: Shows the units of the curve values
#   port CurveValues: Chosen curve properties values
#   port RetentionCurve: Livestock Retention Curve
# ---------- cmf_retention_curve_2: Python ----------
from livestock.components.comp_cmf import CMFRetentionCurve

comp = CMFRetentionCurve(ghenv)
comp.config()
comp.run_checks(int(SoilIndex))
comp.run()

Units = comp.units
CurveValues = comp.property.values()
RetentionCurve = comp.results
# ---------- end cmf_retention_curve_2 ----------
panel_14 = Panel(cmf_retention_curve_2.CurveValues)
panel_15 = Panel(cmf_retention_curve_2.Units)

# ----
# Soil Layers
number_slider_8 = Slider(1, range=0..1)
series_3 = Series(Start=number_slider_8, Step=1, Count=Slider(5, range=0..10))
panel_16 = Panel(series_3)

# ----
# Trees
number_slider_9 = Slider(25, range=5..25)
number_slider_10 = Slider(0, range=0..5)
panel_17 = Panel("""52
53""")
panel_18 = Panel("""54
55""")
synthetic_tree = LivestockSyntheticTree(FaceIndex=panel_18, TreeType=number_slider_10, Height=Slider(16, range=5..25))  # -> readMe, Units, TreeValues, TreeProperties
#   port FaceIndex: Mesh face index where tree is placed
#   port TreeType: Tree types: 0 - Deciduous, 1 - Coniferous, 2 - Shrubs. Default is deciduous
#   port Height: Height of tree in meters. Default is set to 10m
#   port readMe: In case of any errors, it will be shown here.
#   port Units: Shows the units of the tree values
#   port TreeValues: Chosen tree properties values
#   port TreeProperties: Livestock tree properties data
# ---------- synthetic_tree: Python ----------
from livestock.components.comp_cmf import CMFSyntheticTree

comp = CMFSyntheticTree(ghenv)
comp.config()
comp.run_checks(FaceIndex, TreeType, Height)
comp.run()

Units = comp.units
TreeValues = comp.property.values()
TreeProperties = comp.results
# ---------- end synthetic_tree ----------
synthetic_tree_2 = LivestockSyntheticTree(FaceIndex=panel_17, TreeType=number_slider_10, Height=number_slider_9)  # -> readMe, Units, TreeValues, TreeProperties; same code as synthetic_tree
panel_19 = Panel(synthetic_tree.TreeValues)
panel_20 = Panel(synthetic_tree_2.TreeValues)
panel_21 = Panel(synthetic_tree.Units)
panel_22 = Panel(synthetic_tree_2.Units)
merge = Merge(Data1=synthetic_tree_2.TreeProperties, Data2=synthetic_tree.TreeProperties)

# ----
# Ground #1
number_slider_11 = Slider(2, range=0..10)
cmf_ground = LivestockCMFGround(
    Layers=panel_11,
    RetentionCurve=cmf_retention_curve.RetentionCurve,
    SurfaceProperties=cmf_surface_properties.SurfaceProperties,
    SaturatedDepth=number_slider_11,
    FaceIndices=cull_2)  # -> readMe, Ground; inputs Layers: list, FaceIndices: list
#   port Layers: Soil layers to add to the mesh in m
#   port RetentionCurve: Retention curve
#   port SurfaceProperties: Input from Livestock CMF SurfaceProperties
#   port SaturatedDepth: Initial saturated depth in m. It is depth where the groundwater is located - Default is set to 3m
#   port FaceIndices: List of face indices, on where the ground properties are applied.
#   port readMe: In case of any errors, it will be shown here.
#   port Ground: Livestock Ground Data Class
# ---------- cmf_ground: Python ----------
from livestock.components.comp_cmf import CMFGround

comp = CMFGround(ghenv)
comp.config()
comp.run_checks(Layers, RetentionCurve, SurfaceProperties, SaturatedDepth, FaceIndices)
comp.run()

Ground = comp.results
# ---------- end cmf_ground ----------
panel_23 = Panel(cmf_ground.readMe)

# ----
# Ground #2
number_slider_12 = Slider(3, range=0..10)
cmf_ground_2 = LivestockCMFGround(
    Layers=panel_16,
    RetentionCurve=cmf_retention_curve_2.RetentionCurve,
    SurfaceProperties=cmf_surface_properties_2.SurfaceProperties,
    SaturatedDepth=number_slider_12,
    FaceIndices=cull)  # -> readMe, Ground; inputs Layers: list, FaceIndices: list; same code as cmf_ground
panel_24 = Panel(cmf_ground_2.readMe)

merge_2 = Merge(Data1=cmf_ground.Ground, Data2=cmf_ground_2.Ground)
panel_25 = Panel("""Evapotranspiration
Surface Water Volume
Surface Water Flux
Heat Flux""")
leaf_temperature = LivestockLeafTemperature()  # -> readMe, LeafTemperature
#   port AirTemperature: Temperature of the air in C
#   port readMe: In case of any errors, it will be shown here.
# ---------- leaf_temperature: Python ----------
from livestock.components.plant import LeafTemperature

comp = LeafTemperature(ghenv)
comp.config()
comp.run_checks(AirTemperature, RadiativeHeatFluxLeaf, LatentHeatFluxLeaf, AerodynamicResistanceLeaf)
comp.run()

LeafTemperature = comp.results
# ---------- end leaf_temperature ----------
stomatal_resistance = LivestockStomatalResistance()  # -> readMe, StomatalResistance
#   port StomatalResistance_min: Minimum of stomatal resistance in s/m
#   port readMe: In case of any errors, it will be shown here.
# ---------- stomatal_resistance: Python ----------
from livestock.components.plant import StomatalResistance

comp = StomatalResistance(ghenv)
comp.config()
comp.run_checks(StomatalResistance_min, Radiation, Temperature, RelativeHumidity)
comp.run()

StomatalResistance = comp.results
# ---------- end stomatal_resistance ----------

# ----
# Stream
number_slider_13 = Slider(20, range=0..100)
division = Division(A=Slider(1, range=0..1), B=number_slider_13)
crosssection = Curve(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)
series_4 = Series(Start=0, Step=division, Count=expr("x+1", number_slider_13))
midcurve = Curve(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)
eval = EvaluateCurve(Curve=reparameterize(midcurve), Parameter=series_4)  # -> Point, Tangent, Angle
item_2 = ListItem(List=eval.Point, Index=0, Wrap=True)
vec2pt = Vector2Pt(PointA=item_2, PointB=eval.Point, Unitize=False)  # -> Vector, Length
move_2 = Move(Geometry=crosssection, Motion=vec2pt.Vector)  # -> Geometry, Transform
python = PythonScript(midCurve=midcurve, crossSection=move_2.Geometry)  # -> out, a, b; inputs crossSection: list
# ---------- python: Python ----------
import rhinoscriptsyntax as rs

pts = []
vert = []

for crv in crossSection:
    pts.append(rs.CurveCurveIntersection(midCurve, crv)[0][1])
    vert.append(rs.PolylineVertices(crv))

a = pts

b = vert
# ---------- end python ----------
panel_26 = Panel(python.out)
panel_27 = Panel(python.a)
panel_28 = Panel(python.b)
stream = PythonScript()  # -> Out, Stream

# ----
# Weather
panel_29 = Panel("C:\Users\Christian\Dropbox\Uddannelse\DTU\11. semester - Speciale\Data\ProcessedData")
panel_30 = Panel("""/temp.txt
/windspeed.txt
/relhum.txt
/cloudcover.txt
/globalrad.txt
/rain.txt
/groundtemp.txt""")
concat = Concatenate(FragmentA=panel_29, FragmentB=panel_30)
panel_31 = Panel(concat)
constructlocation = Ladybug_ConstructLocation(
    locationName="Copenhagen",
    latitude=Slider(12, range=0..100),
    longitude=Slider(55, range=0..100),
    timeZone=0,
    elevation=0)  # -> location; plug-in component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
file = ReadFile(File=panel_31, PerLineParse=True)
cull_i = CullIndex(List=file, Indices=-1, Wrap=True)
lng_2 = ListLength(List=explode)
path_mapper = PathMapper(cull_i, source="{A;B;C}", target="{A;B}")
bang = ExplodeTree(Data=path_mapper)  # -> Branch0, Branch1, Branch2, Branch3, Branch4, Branch5, Branch6

# ----
# Lookup Results
panel_32 = Panel("\")

# ----
# Run
number_slider_14 = Slider(4, range=1..8)
merge_3 = Merge(Data1=hb_epcontextsrf, Data2=createhbsrfs.HBSurface)

# ----
# Visualize Results
number_slider_15 = Slider(1, range=0..23)
gradientlibrary = Ladybug_GradientLibrary(gradIndex=number_slider_15)  # -> customColors; plug-in component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
hoy = LadybugPlus_CalculateHOY(month=Slider(4, range=1..12), day=Slider(1, range=1..31), hour=Slider(16, range=1..24), minute=0)  # -> hoy, doy, date; plug-in component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
legendpar = Ladybug_LegendParameters(customColors=flatten(gradientlibrary))  # -> legendPar; plug-in component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
concat_2 = Concatenate(FragmentA="Solar Radiation", FragmentB=hoy.date)

# ----
# Solve
number_slider_16 = Slider(10, range=0..8760)
toggle = BooleanToggle(True)
cmf_outputs = LivestockCMFOutputs(Evapotranspiration=toggle, HeatFlux=toggle, Volume=Toggle(False))  # -> readMe, ChosenOutputs, Outputs
#   port Evapotranspiration: Cell evaporation - default is set to True
#   port SurfaceWater: Cell surface water. Collects both volumetric flux and volume - default is set to False
#   port HeatFlux: Cell surface heat flux - default is set to False
#   port AerodynamicResistance: Cell aerodynamic resistance - default is set to False
#   port VolumetricFlux: Soil layer volumetric flux vectors - default is set to False
#   port Potential: Soil layer total potential (Psi_tot = Psi_M + Psi_G - default is set to False
#   port Theta: Soil layer volumetric water content of the layer - default is set to False
#   port Volume: Soil layer volume of water in the layer - default is set to True
#   port Wetness: Soil layer wetness of the soil (V_volume/V_pores) - default is set to False
#   port readMe: In case of any errors, it will be shown here.
#   port ChosenOutputs: Shows the chosen outputs
#   port Outputs: Livestock Output Data
# ---------- cmf_outputs: Python ----------
from livestock.components.comp_cmf import CMFOutputs

comp = CMFOutputs(ghenv)
comp.config()
comp.run_checks(Evapotranspiration, SurfaceWater, HeatFlux, 
                AerodynamicResistance, VolumetricFlux, Potential, Theta, 
                Volume, Wetness)
comp.run()

ChosenOutputs = comp.output_dict.items()
Outputs = comp.results
# ---------- end cmf_outputs ----------
cmf_solver_settings = LivestockCMFSolverSettings(AnalysisLength=number_slider_16, SolverTolerance="10e-8", Verbosity=Slider(1, range=0..1))  # -> readMe, SolverSettings
#   port AnalysisLength: Analysis length in hours - Default is 24 hours
#   port SolverTolerance: Solver tolerance - Default is 1e-8
#   port Verbosity: Sets the verbosity of the print statement during runtime - Default is 1. 0 - Prints only at start and end of simulation. 1 - Prints at every time step.
#   port readMe: In case of any errors, it will be shown here.
#   port SolverSettings: Livestock Solver Settings
# ---------- cmf_solver_settings: Python ----------
from livestock.components.comp_cmf import CMFSolverSettings

comp = CMFSolverSettings(ghenv)
comp.config()
comp.run_checks(AnalysisLength, SolverTolerance, Verbosity)
comp.run()

SolverSettings = comp.results
# ---------- end cmf_solver_settings ----------
panel_33 = Panel("C:\Users\Christian\Desktop\test_cmf")

concat_3 = Concatenate(FragmentA=panel_33, FragmentB=panel_32, FragmentC="test_02")
lookupfolder_daylighting = Honeybee_LookupDaylightingFolder(studyFolder=concat_3, studyType=Slider(5, range=1..5), refresh=Button())  # -> analysisType, resultsUnit, illFiles, ptsFiles, hdrFiles, imageFiles, iesFiles, epwFile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; plug-in component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
importpts = Honeybee_ImportPtsFile(ptsFileAddress=lookupfolder_daylighting.ptsFiles)  # -> points, vectors; plug-in component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
readdshourlyresults = Honeybee_ReadHourlyResultsFromAnnualDaylightStudy(illFilesAddress=lookupfolder_daylighting.illFiles, testPoints=importpts.points, HOY=hoy.hoy)  # -> iIllumLevelsNoDynamicSHD, iIllumLevelsDynamicSHDGroupI, iIllumLevelsDynamicSHDGroupII, iIlluminanceBasedOnOccupancy, shadingGroupInEffect; plug-in component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

rundaylightanalysis = Honeybee_RunDaylightSimulation(
    HBObjects=flatten(merge_3),
    analysisRecipe=annualdaylightsimulation,
    writeRad=Toggle(False),
    runRad=Toggle(False),
    numOfCPUs=number_slider_14,
    workingDir=panel_33,
    radFileName="test_02",
    overwriteResults=True)  # -> readMe, analysisType, resultsUnit, results, testPts, annual_analysis_files, radGeoFile, studyFolder, done; disabled; plug-in component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

readallthedshourlyresults = Honeybee_ReadAllTheHourlyResultsFromAnnualDaylightStudy(illFilesAddress=lookupfolder_daylighting.illFiles, testPoints=importpts.points)  # -> iIllumLevelsNoDynamicSHD, iIllumLevelsDynamicSHDGroupI, iIllumLevelsDynamicSHDGroupII, iIlluminanceBasedOnOccupancy, shadingGroupInEffect; plug-in component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
flip = FlipMatrix(Data=readallthedshourlyresults.iIllumLevelsNoDynamicSHD)
branch = TreeBranch(Tree=flip, Path="{0;7}", MaintainPaths=True)

cmf_weather = LivestockCMFWeather(
    Temperature=bang.Branch0,
    WindSpeed=bang.Branch1,
    RelativeHumidity=bang.Branch2,
    CloudCover=bang.Branch3,
    GlobalRadiation=branch,
    Rain=bang.Branch5,
    GroundTemperature=bang.Branch6,
    Location=constructlocation,
    MeshFaceCount=lng_2)  # -> readMe, Weather; inputs Temperature: tree, WindSpeed: tree, RelativeHumidity: tree, CloudCover: tree, GlobalRadiation: tree, Rain: tree, GroundTemperature: tree
#   port Temperature: Temperature in C. Either a list or a tree where the number of branches is equal to the number of mesh faces.
#   port WindSpeed: Wind speed in m/s. Either a list or a tree where the number of branches is equal to the number of mesh faces.
#   port RelativeHumidity: Relative humidity in %. Either a list or a tree where the number of branches is equal to the number of mesh faces.
#   port CloudCover: Cloud cover, unitless between 0 and 1. Either a list or a tree where the number of branches is equal to the number of mesh faces.
#   port GlobalRadiation: Global Radiation in W/m2. Either a list or a tree where the number of branches is equal to the number of mesh faces.
#   port Rain: Horizontal precipitation in mm/h. Either a list or a tree where the number of branches is equal to the number of mesh faces.
#   port GroundTemperature: Ground temperature in C. Either a list or a tree where the number of branches is equal to the number of mesh faces.
#   port Location: A Ladybug Tools Location
#   port MeshFaceCount: Number of faces in the ground mesh
#   port readMe: In case of any errors, it will be shown here.
#   port Weather: Livestock Weather Data Class
# ---------- cmf_weather: Python ----------
from livestock.components.comp_cmf import CMFWeather

comp = CMFWeather(ghenv)
comp.config()
comp.run_checks(Temperature, WindSpeed, RelativeHumidity, CloudCover, GlobalRadiation, Rain, GroundTemperature, Location, MeshFaceCount)
comp.run()

Weather = comp.results
# ---------- end cmf_weather ----------
panel_34 = Panel(cmf_weather.readMe)

cmf_solve = LivestockCMFSolve(
    Mesh=triangulate,
    Ground=merge_2,
    Weather=cmf_weather.Weather,
    Trees=merge,
    SolverSettings=cmf_solver_settings.SolverSettings,
    Folder=panel_33,
    CaseName="test_02",
    Outputs=cmf_outputs.Outputs,
    Write=Toggle(False),
    Overwrite=Toggle(True),
    Run=Toggle(False))  # -> readMe, ResultPath; inputs Ground: list, Trees: list, BoundaryConditions: list
#   port Mesh: Topography as a mesh
#   port Ground: Input from Livestock CMF Ground
#   port Weather: Input from Livestock CMF Weather
#   port Trees: Input from Livestock CMF Tree
#   port Stream: Input from Livestock CMF Stream
#   port BoundaryConditions: Input from Livestock CMF Boundary Condition
#   port SolverSettings: Input from Livestock CMF Solver Settings
#   port Folder: Path to folder. Default is Desktop
#   port CaseName: Case name as string. Default is CMF
#   port Outputs: Connect Livestock Outputs
#   port Write: Boolean to write files
#   port Overwrite: If True excising case will be overwritten. Default is set to True
#   port Run: Boolean to run analysis Analysis will be ran through SSH. Configure the connection with Livestock SSH
#   port readMe: In case of any errors, it will be shown here.
#   port ResultPath: Path to result files
# ---------- cmf_solve: Python ----------
from livestock.components.comp_cmf import CMFSolve

comp = CMFSolve(ghenv)
comp.config()
comp.run_checks(Mesh, Ground, Weather, Trees, Stream, BoundaryConditions, 
                SolverSettings, Folder, CaseName, Outputs, Write, Overwrite, Run)
comp.run(ghdoc)
# ---------- end cmf_solve ----------
panel_35 = Panel(cmf_solve.readMe)

recolormesh = Ladybug_RecolorMesh(
    analysisResult=readdshourlyresults.iIllumLevelsNoDynamicSHD,
    inputMesh=mesh_3,
    legendPar=legendpar,
    analysisTitle=concat_2,
    legendTitle="W/m2")  # -> readMe, newMesh, newLegend, legendBasePt, meshColors, legendColors; plug-in component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
preview_4 = CustomPreview(Geometry=recolormesh.newMesh, Shader=recolormesh.meshColors)
preview_5 = CustomPreview(Geometry=recolormesh.newLegend, Shader=ColourSwatch(SwatchColor=RGB(0, 0, 0)))

# ----
# Visualize Results
number_slider_17 = Slider(0, range=0..9)
concat_4 = Concatenate(FragmentA=panel_33, FragmentB="\", FragmentC="test_02")
cmf_results = LivestockCMFResults(ResultFilePath=concat_4, FetchResult=number_slider_17, Run=Toggle(False))  # -> readMe, Units, Values, CSVPath
#   port ResultFilePath: Path to result file. Accepts output from Livestock Solve
#   port FetchResult: Choose which result should be loaded: 0 - Evapotranspiration 1 - Surface water volume 2 - Surface water flux 3 - Heat flux 4 - Aerodynamic resistance 5 - Soil layer water flux 6 - Soil layer potential 7 - Soil layer theta 8 - Soil layer volume 9 - Soil layer wetness
#   port SaveCSV: Save the values as a csv file - Default is set to False
#   port Run: Run component
#   port readMe: In case of any errors, it will be shown here.
#   port Units: Shows the units of the results
#   port Values: List with chosen result values
#   port CSVPath: Path to csv file.
# ---------- cmf_results: Python ----------
from livestock.components.comp_cmf import CMFResults

comp = CMFResults(ghenv)
comp.config()
comp.run_checks(ResultFilePath, FetchResult, SaveCSV, Run)
comp.run()

Units = comp.unit
Values = comp.results
# ---------- end cmf_results ----------
number_slider_18 = Slider(10, range=0..1000)
gradientlibrary_2 = Ladybug_GradientLibrary(gradIndex=Slider(0, range=0..23))  # -> customColors; plug-in component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
item_3 = ListItem(List=panel_25, Index=number_slider_17, Wrap=True)
flip_2 = FlipMatrix(Data=cmf_results.Values)
legendpar_2 = Ladybug_LegendParameters(customColors=flatten(gradientlibrary_2), decimalPlaces=Slider(5, range=0..10))  # -> legendPar; plug-in component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
day_month_hour_calculator = Ladybug_Day_Month_Hour(HOY=number_slider_18)  # -> day, month, hour, date; plug-in component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
branch_2 = TreeBranch(Tree=simplify(flip_2), Path=number_slider_18, MaintainPaths=True)

concat_5 = Concatenate(FragmentA=item_3, FragmentB=day_month_hour_calculator.date)

recolormesh_2 = Ladybug_RecolorMesh(
    analysisResult=branch_2,
    inputMesh=triangulate,
    legendPar=legendpar_2,
    analysisTitle=concat_5,
    legendTitle=cmf_results.Units)  # -> readMe, newMesh, newLegend, legendBasePt, meshColors, legendColors; plug-in component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
preview_6 = CustomPreview(Geometry=recolormesh_2.newMesh, Shader=recolormesh_2.meshColors)
preview_7 = CustomPreview(Geometry=recolormesh_2.newLegend, Shader=ColourSwatch(SwatchColor=RGB(0, 0, 0)))
