# Grasshopper definition Delphin_v1.gh (Grasshopper 0.9.76)
# plug-ins: Python Interpreter

panel = Panel("Air")
number_slider = Slider(1.25, range=0.5..2)
number_slider_2 = Slider(0.001, range=0..0.01)
number_slider_3 = Slider(1.25, range=0.5..2)
number_slider_4 = Slider(0.001, range=0..0.01)
matlookup = DelphinMaterialLookup(SearchTerm=Slider(64, range=0..110))  # -> out, Materials
# ---------- matlookup: Python ----------
# Delphin Material Lookup

# License?


"""
    
    Args:
        SearchTerm: Search Term to filter the materials by. Can either be a material name (string) or the material ID (integer).
    Returns:
        Materials: Returns the found material if any.

"""

#------------------------------------------------------------------------------#
# IMPORTS

import sys
sys.path.insert(0, r'C:\Users\Christian\Dropbox\Arbejde\DTU BYG\Livestock\Kode - Livestock\01 Python\Classes')
import DelphinGH as dgh
import LivestockGH as ls

n = 0
ghenv.Component.Name = dgh.ComponentData[n][0]
ghenv.Component.NickName = dgh.ComponentData[n][1]
ghenv.Component.Message = dgh.ComponentData[n][2]
ghenv.Component.IconDisplayMode = ghenv.Component.IconDisplayMode.application
ghenv.Component.Category = dgh.ComponentData[n][3]
ghenv.Component.SubCategory = dgh.ComponentData[n][4]
ghenv.Component.Description = dgh.ComponentData[n][5]
#ghenv.Component.Icon = dgh.ComponentData[n][6]

#------------------------------------------------------------------------------#
# COMPONENT

D = dgh.DelphinMaterials()
D.refreshList()

# Search accordning to material name
if isinstance(SearchTerm, str):
    name = []
    out = []
    stLength = len(SearchTerm)
    for m in D.matList:
        name.append(m[0])
    i = [j for j,x in enumerate(name) if x[:stLength]==SearchTerm]
    for k in i:
        out.append(D.matList[k])

# Search accordning to material ID
elif isinstance(SearchTerm, float):
    id = []
    out = []
    for m in D.matList:
        id.append(m[1])
    i = [j for j,x in enumerate(id) if x==SearchTerm]
    for k in i:
        out.append(D.matList[k])


#------------------------------------------------------------------------------#
# OUTPUTS

Materials = ls.list_to_tree(out)
# ---------- end matlookup ----------
discretization = DelphinDiscretization(
    X_EqualorVariable=Toggle(True),
    X_NumberOfDivisions=Slider(3, range=0..10),
    Y_EqualorVariable=Toggle(True),
    Y_NumberOfDivisions=Slider(2, range=0..10))  # -> readMe, Discretization
#   port readMe: A text confirmation of the analysis period.
# ---------- discretization: Python ----------
# License?


"""
    Returns:
        Discretization: Returns a Delphin Discretization Class.

"""

#------------------------------------------------------------------------------#
# IMPORTS

import sys
sys.path.insert(0, r'C:\Users\Christian\Dropbox\Arbejde\DTU BYG\Livestock\Kode - Livestock\01 Python\Classes')
import DelphinGH as dgh
import LivestockGH as ls

n = 12
ghenv.Component.Name = dgh.ComponentData[n][0]
ghenv.Component.NickName = dgh.ComponentData[n][1]
ghenv.Component.Message = dgh.ComponentData[n][2]
ghenv.Component.IconDisplayMode = ghenv.Component.IconDisplayMode.application
ghenv.Component.Category = dgh.ComponentData[n][3]
ghenv.Component.SubCategory = dgh.ComponentData[n][4]
ghenv.Component.Description = dgh.ComponentData[n][5]
#ghenv.Component.Icon = dgh.ComponentData[n][6]

#------------------------------------------------------------------------------#
# COMPONENT

def setInput(inputsDict):
    for input in range(6):
        ghenv.Component.Params.Input[input].NickName = inputsDict[input][0]
        ghenv.Component.Params.Input[input].Name = inputsDict[input][0]
        ghenv.Component.Params.Input[input].Description = inputsDict[input][1]

def inputDict(x,y):
    xDictVar = {
    0: ["X_EqualorVariable", "Set a boolean to True to get Equal and False to get Variable"],
    1: ["X_MinimumDivision", "Minimum Element Size in the x direction"],
    2: ["X_StretchFactor", "Strech factor of the division in the x direction"]
    }
    xDictEqual = {
    0: ["X_EqualorVariable", "Set a boolean to True to get Equal and False to get Variable"],
    1: ["X_NumberOfDivisions", "Number of divisions to make the element in the x direction."],
    2: ["..."," "]
    }
    yDictVar = {
    3: ["Y_EqualorVariable", "Set a boolean to True to get Equal and False to get Variable"],
    4: ["Y_MinimumDivision", "Minimum Element Size in the y direction"],
    5: ["Y_StretchFactor", "Strech factor of the division in the y direction"]
    }
    yDictEqual = {
    3: ["Y_EqualorVariable", "Set a boolean to True to get Equal and False to get Variable"],
    4: ["Y_NumberOfDivisions", "Number of divisions to make the element in the y direction."],
    5: ["..."," "]
    }
    
    if x:
        dict = xDictEqual.copy()
    elif not x:
        dict = xDictVar.copy()
    if y:
        dict.update(yDictEqual)
    elif not y:
        dict.update(yDictVar)
        
    return dict

id = inputDict(X_EqualorVariable,Y_EqualorVariable)
setInput(id)

if X_EqualorVariable:
    x = X_NumberOfDivisions
elif not X_EqualorVariable:
    x = [X_MinimumDivision,X_StretchFactor]

if Y_EqualorVariable:
    y = Y_NumberOfDivisions
elif not Y_EqualorVariable:
    y = [Y_MinimumDivision,Y_StretchFactor]


#------------------------------------------------------------------------------#
# OUTPUTS

Discretization = ls.PassClass([x,y],'Delphin.Discretization')
# ---------- end discretization ----------
panel_2 = Panel(matlookup.Materials)
panel_3 = Panel("""2
1""")
panel_4 = Panel("""1
2""")
panel_5 = Panel(matlookup.out)
panel_6 = Panel("""OUT
0
1
0
1""")
panel_7 = Panel("""tTest
rhTest""")
dup = DuplicateData(Data=Slider(20, range=0..100), Number=Slider(8760, range=0..10000), Order=True)
intial_geometry = DelphinInitialGeometry(X=panel_3, Y=panel_4, Discretization=discretization.Discretization)  # -> out, BareGeometry, DiscretizatedGeometry, DelphinGeometry; inputs X: list, Y: list
# ---------- intial_geometry: Python ----------
# Delphin Geometry

# License?


"""
    
    Args:
        X: List with column widths
        Y: List with row heights
        Discretization:
    Returns:
        Geometry: List with geometry rectangles

"""

#------------------------------------------------------------------------------#
# IMPORTS

import sys
sys.path.insert(0, r'C:\Users\Christian\Dropbox\Arbejde\DTU BYG\Livestock\Kode - Livestock\01 Python\Classes')
import DelphinGH as dgh
import DelphinClasses as dc
import LivestockGH as ls
import Rhino as rc
import subprocess
from shutil import copyfile
import os
import scriptcontext as sc

n = 10
ghenv.Component.Name = dgh.ComponentData[n][0]
ghenv.Component.NickName = dgh.ComponentData[n][1]
ghenv.Component.Message = dgh.ComponentData[n][2]
ghenv.Component.IconDisplayMode = ghenv.Component.IconDisplayMode.application
ghenv.Component.Category = dgh.ComponentData[n][3]
ghenv.Component.SubCategory = dgh.ComponentData[n][4]
ghenv.Component.Description = dgh.ComponentData[n][5]
#ghenv.Component.Icon = dgh.ComponentData[n][6]

#------------------------------------------------------------------------------#
# COMPONENT

def runVariableDiscretization(Width,MinimumDivision,StretchFactor):
    # Create output text file
    path = r'C:\Users\Christian\Dropbox\Arbejde\DTU BYG\Livestock\Kode - Livestock\01 Python\Templates'
    py_file = path + '\\' + 'DelphinDiscretizationTemplate.py'
    txt_file = path + '\\' + 'DelphinDiscretizationTemplate.txt'
    temp_file = path + '\\'  + 'RunningTemplate.py'
    copyfile(py_file, temp_file)
    
    
    file = open(temp_file, 'r')
    # read a list of lines into data
    data = file.readlines()
    data[10] = "Width = " + str(Width) + '\n'
    data[11] = "MinimumDivision = " + str(MinimumDivision) + '\n'
    data[12] = "StretchFactor = " + str(StretchFactor) + '\n'
    
    # and write everything back
    file = open(temp_file, 'w')
    file.writelines(data)
    file.close()
    
    py = sc.sticky['PythonExe']
    temp = subprocess.Popen([py, temp_file])
    temp.wait()
    #print(temp)
    temp.kill()
    res_file = open(txt_file,'r')
    res_data = []
    for i in res_file.readlines():
        res_data.append(float(i[:-1]))
    res_file.close()
    del res_file
    #os.remove(temp_file)
    #os.remove(txt_file)
    
    return res_data

def runEqualDiscretization(Width,Divisions):
    Divisions = int(Divisions)
    return [Width/Divisions,]*Divisions

def runDiscretization(Width,args):
    if isinstance(args,float):
        return runEqualDiscretization(Width,args)
    elif isinstance(args,list):
        return runVariableDiscretization(Width,args[0],args[1])

def createRectangles(xList,yList):
    pl = rc.Geometry.Plane.WorldXY
    xi = 0
    rec = []
    
    for x in range(0,len(xList)):
        yi = 0
        for y in yList:
            p1 = rc.Geometry.Point3d(xi,yi,0)
            yi += y
            p2 = rc.Geometry.Point3d(xi+X[x],yi,0)
            rec.append(rc.Geometry.Rectangle3d(pl,p1,p2))
        xi += X[x]
        
    return rec

def discretizatedGeometry(discretization,geometry):

    mesh = rc.Geometry.Mesh()
    pt = []
    
    xArgs = discretization.c[0]
    yArgs = discretization.c[1]
    vInt0 = 0
    
    for i in geometry:
        x = runDiscretization(i.Width,xArgs)
        y = runDiscretization(i.Height,yArgs)
        #print(x)
        #print(y)
        
        for j in range(len(x)+1):
            if j == 0:
                x0 = i.X[0]
            elif j == len(x)+1:
                x0 = i.X[1]
            else:
                x0 += x[j-1]
            #print(x0)
            
            for k in range(len(y)+1):
                if k == 0:
                    y0 = i.Y[0]
                elif k == len(y)+1:
                    y0 = i.Y[1]
                else:
                    y0 += y[k-1]
                #print(y0)
                
                pt.append(rc.Geometry.Point3d(x0,y0,0))
                mesh.Vertices.Add(x0,y0,0)
    
        #print(vInt0)
        vInt1 = vInt0+(len(x)+1)*(len(y)+1)
        #print(vInt1)
        #print(len(y))
        #print(len(x))
        o = vInt0
        while o < (vInt1-(len(y)+2)):
            mesh.Faces.AddFace(o,o+len(y)+1,o+len(y)+2,o+1)
            if o%(len(y)+1) == len(y)-1:
                o += 2
            else:
                o += 1
        vInt0 = vInt1
        #print(vInt0)
    #print(len(pt))
    return mesh

def getRange(rectangles,discretizedGeometry):
    
    def nearly_equal(a,b,sig_fig=12):
        return int(a*10**sig_fig) == int(b*10**sig_fig)
           
    def pointSearch(points, item):
        for pt in points:
            if nearly_equal(pt.X,item[0]) and nearly_equal(pt.Y, item[1]):
                point = pt
                break
        return point
    
    sortedY = []
    sortedX = []
    centers = []
    ranges = []
    for r in rectangles:
        ranges.append(['Null','Null','Null','Null'])
    i = 0
    
    while i < discretizedGeometry.Faces.Count:
        cen = discretizedGeometry.Faces.GetFaceCenter(i)
        centers.append(cen)
        i += 1
    
    for c in centers:
        sortedX.append(c.X)
        sortedY.append(c.Y)
    sortedX = list(sorted(set(sortedX)))
    sortedY = list(sorted(set(sortedY)))[::-1]
    #print(sortedX)
    #print(sortedY)
    
    for yi,y in enumerate(sortedY):
        for xi,x in enumerate(sortedX):
            #print(xi)
            pt = pointSearch(centers,(x,y))
            
            for ri,r in enumerate(rectangles):
                #print(ranges)
                #print(rectangles[ri].Y)
                if r.Contains(pt) == rc.Geometry.PointContainment.Inside:
                    
                    if xi < ranges[ri][0] or ranges[ri][0] == 'Null':
                        ranges[ri][0] = xi
                        #print('minX',ranges)
                        
                    elif xi > ranges[ri][1] or ranges[ri][1] == 'Null':
                        ranges[ri][1] = xi
                        #print('maxX',ranges)
                        
                    if yi < ranges[ri][2] or ranges[ri][2] == 'Null':
                        ranges[ri][2] = yi
                        #print('minY',ranges)
                        
                    elif yi > ranges[ri][3] or ranges[ri][3] == 'Null':
                        ranges[ri][3] = yi
                        #print('maxY',ranges)
                        
                    #print('Efter loop',ranges)
                    break
                
    return ranges

#------------------------------------------------------------------------------#
# OUTPUTS

BareGeometry = createRectangles(X,Y)

if Discretization:
    DiscretizatedGeometry = discretizatedGeometry(Discretization,BareGeometry)

DG = getRange(BareGeometry,DiscretizatedGeometry)
DelphinGeometry = []
for i in DG:
    DelphinGeometry.append(ls.PassClass(i,'Delphin.Geometry'))
# ---------- end intial_geometry ----------
panel_8 = Panel("C:\Users\Christian\Dropbox\Arbejde\DTU BYG\Livestock\Kode - Livestock\01 Python\Tests\weather_test.txt")
output_format = DelphinOutputFormat(Name="Temp", Type="Field", FieldType="TEMPER", SpaceType="Mean", TimeUnit="h")  # -> out, OutputFormat
# ---------- output_format: Python ----------
# Delphin Run

# License?


"""

    
    Args:
        Name: String - Name of the Output Format
        Type: String -
        FieldType: String -
        SpaceType: String -
        TimeType: String -
        TimeUnit: String -
        Precision: Integer -
        Width: Integer - Width of the number field
        Format: String - Number format
        Binary: String - Has to be no or yes. Default is no.
    Returns:
        BoundaryCondition: Delphin Climate Condition Class

"""

#------------------------------------------------------------------------------#
# IMPORTS

import sys
sys.path.insert(0, r'C:\Users\Christian\Dropbox\Arbejde\DTU BYG\Livestock\Kode - Livestock\01 Python\Classes')
import DelphinClasses as dc
import DelphinGH as dgh
import LivestockGH as ls

n = 15
ghenv.Component.Name = dgh.ComponentData[n][0]
ghenv.Component.NickName = dgh.ComponentData[n][1]
ghenv.Component.Message = dgh.ComponentData[n][2]
ghenv.Component.IconDisplayMode = ghenv.Component.IconDisplayMode.application
ghenv.Component.Category = dgh.ComponentData[n][3]
ghenv.Component.SubCategory = dgh.ComponentData[n][4]
ghenv.Component.Description = dgh.ComponentData[n][5]
#ghenv.Component.Icon = dgh.ComponentData[n][6]

#------------------------------------------------------------------------------#
# COMPONENT

check = True

if not Name:
    print('Name is missing')
    check = False
    
if not Type:
    print('Type is missing')
    check = False
elif Type:
    Type = Type.upper()

if not FieldType:
    print('FieldType is missing')
    check = False
elif FieldType:
    FieldType = FieldType.upper()
    
if not SpaceType:
    print('SpaceType is missing')
    check = False
elif SpaceType:
    SpaceType = SpaceType.upper()
    
if not TimeType:
    TimeType = 'NONE'
    
if not TimeUnit:
    print('TimeUnit is missing')
    check = False
    
if not Precision:
    Precision = 4
    
if not Width:
    Width = 6
    
if Format not in ['Default','Fixed','Scientific']:
    Format = 'FIXED'
elif Format in ['Default','Fixed','Scientific']:
    Format = Format.upper()

if check:
    OF = dc.OutputFormat(Name, Type, FieldType, SpaceType, TimeType, TimeUnit, Width, Precision, Format)

if OF:
    print(OF.write())
    
#------------------------------------------------------------------------------#
# OUTPUTS

if OF:
    OutputFormat = ls.PassClass(OF,'Delphin.OutputFormat')
# ---------- end output_format ----------
python_executor = LivestockPythonExecutor(PythonPath="C:\Program Files\Anaconda3\envs\livestock\python.exe")  # -> out
# ---------- python_executor: Python ----------
#------------------------------------------------------------------------------#
# IMPORTS

import sys
sys.path.insert(0, r'C:\Users\Christian\Dropbox\Arbejde\DTU BYG\Livestock\Kode - Livestock\01 Python\Classes')
import DelphinGH as dgh
import DelphinClasses as dc
import Rhino as rc
import scriptcontext as sc

n = 16
ghenv.Component.Name = dgh.ComponentData[n][0]
ghenv.Component.NickName = dgh.ComponentData[n][1]
ghenv.Component.Message = dgh.ComponentData[n][2]
ghenv.Component.IconDisplayMode = ghenv.Component.IconDisplayMode.application
ghenv.Component.Category = dgh.ComponentData[n][3]
ghenv.Component.SubCategory = dgh.ComponentData[n][4]
ghenv.Component.Description = dgh.ComponentData[n][5]
#ghenv.Component.Icon = dgh.ComponentData[n][6]

#------------------------------------------------------------------------------#
# COMPONENT

sc.sticky['PythonExe'] = PythonPath

#------------------------------------------------------------------------------#
# OUTPUTS

print('Python Executor is set to: ' + PythonPath)
# ---------- end python_executor ----------
indoor_climate = DelphinIndoorClimate(TemperatureData=dup, IndoorClimateClass="A", Names=panel_7, Path="C:\Users\Christian\Desktop")  # -> out, TemperaturePath, RelativeHumidityPath; inputs TemperatureData: list, Names: list; disabled
# ---------- indoor_climate: Python ----------
# Delphin Create .ccd weather file

# License?


"""

    
    Args:
        ConditionType: Condition Type: Currently the following types are supported: HEATCOND, VAPDIFF, RAIN, SHWRAD, LOWRAD.
        Kind: Boundary Kind: This is tied to which condition type is used. See Delphin documentation.
        InOut: 0 - If condition is to be used outside. 1 - if condition is to be used inside. 
        CoefficientArguments: Coefficient arguments which applies to the the boundary condition.
        Weather: Delphin Climate Condition Class which should be applied to the boundary condition.
    Returns:
        BoundaryCondition: Delphin Climate Condition Class

"""

#------------------------------------------------------------------------------#
# IMPORTS

import sys
sys.path.insert(0, r'C:\Users\Christian\Dropbox\Arbejde\DTU BYG\Livestock\Kode - Livestock\01 Python\Classes')
import DelphinClasses as dc
import DelphinGH as dgh
import LivestockGH as ls
import subprocess
from shutil import copyfile
import scriptcontext as sc

n = 9
ghenv.Component.Name = dgh.ComponentData[n][0]
ghenv.Component.NickName = dgh.ComponentData[n][1]
ghenv.Component.Message = dgh.ComponentData[n][2]
ghenv.Component.IconDisplayMode = ghenv.Component.IconDisplayMode.application
ghenv.Component.Category = dgh.ComponentData[n][3]
ghenv.Component.SubCategory = dgh.ComponentData[n][4]
ghenv.Component.Description = dgh.ComponentData[n][5]
#ghenv.Component.Icon = dgh.ComponentData[n][6]

#------------------------------------------------------------------------------#
# COMPONENT

path = r'C:\Users\Christian\Dropbox\Arbejde\DTU BYG\Livestock\Kode - Livestock\01 Python\Templates'
IndoorFile = path + '\\DelphinIndoorClimateTemplate.py'
py = sc.sticky['PythonExe']

def createIndoorFiles(temperatureData, indoorClimateClass, names, outPath):
    data = [indoorClimateClass,names[0],names[1],outPath]
    ls.writeFile(data,path,'IndoorData')

    if isinstance(TemperatureData,list):
        ls.writeFile(TemperatureData,path,'Temp')
        InCl = subprocess.Popen([py, IndoorFile])
        InCl.wait()
        InCl.kill()
    
    elif isinstance(TemperatureData,str):
        temp_file = r'C:\Users\Christian\Dropbox\Arbejde\DTU BYG\Livestock\Kode - Livestock\01 Python\Templates\Temp.txt'
        copyfile(TemperatureData, temp_file)
        InCl = subprocess.Popen([py, IndoorFile])
        InCl.wait()
        InCl.kill()

#------------------------------------------------------------------------------#
# OUTPUTS

createIndoorFiles(TemperatureData, IndoorClimateClass, Names, Path)
TemperaturePath = Path + '\\' + Names[0] + '.ccd' 
RelativeHumidityPath = Path + '\\' + Names[1] + '.ccd'
# ---------- end indoor_climate ----------
output_grid = DelphinOutputGrid(Name="Hour", Inteval="h")  # -> out, OutputGrid
# ---------- output_grid: Python ----------
# Delphin Setup 

# License?


"""

    
    Args:
        Name: String - Containing the name of the grid
        Inteval: String - can be s, min, h, d or a
    Returns:
        Setup: Delphin Output Grid Class

"""

#------------------------------------------------------------------------------#
# IMPORTS

import sys
sys.path.insert(0, r'C:\Users\Christian\Dropbox\Arbejde\DTU BYG\Livestock\Kode - Livestock\01 Python\Classes')
import DelphinClasses as dc
import DelphinGH as dgh
import LivestockGH as ls

n = 13
ghenv.Component.Name = dgh.ComponentData[n][0]
ghenv.Component.NickName = dgh.ComponentData[n][1]
ghenv.Component.Message = dgh.ComponentData[n][2]
ghenv.Component.IconDisplayMode = ghenv.Component.IconDisplayMode.application
ghenv.Component.Category = dgh.ComponentData[n][3]
ghenv.Component.SubCategory = dgh.ComponentData[n][4]
ghenv.Component.Description = dgh.ComponentData[n][5]
#ghenv.Component.Icon = dgh.ComponentData[n][6]

#------------------------------------------------------------------------------#
# COMPONENT

if str(Inteval) not in ['s','min','h','d','a']:
    print('Inteval has to be s, min, h, d or a')
    exit()
OG = dc.Grid(Name, Inteval)

print(OG.write())

#------------------------------------------------------------------------------#
# OUTPUTS

OutputGrid = ls.PassClass(OG,"Delphin.OutputGrid")
# ---------- end output_grid ----------
output_file = DelphinOutputFile(Name="_Test", OutputGrid=output_grid.OutputGrid, OutputFormat=output_format.OutputFormat)  # -> out, OutputFile
# ---------- output_file: Python ----------
# Delphin Setup 

# License?


"""

    
    Args:
        Name: String - Containing the name of the grid
        Inteval: String - can be s, min, h, d or a
    Returns:
        Setup: Delphin Output File Class

"""

#------------------------------------------------------------------------------#
# IMPORTS

import sys
sys.path.insert(0, r'C:\Users\Christian\Dropbox\Arbejde\DTU BYG\Livestock\Kode - Livestock\01 Python\Classes')
import DelphinClasses as dc
import DelphinGH as dgh
import LivestockGH as ls

n = 14
ghenv.Component.Name = dgh.ComponentData[n][0]
ghenv.Component.NickName = dgh.ComponentData[n][1]
ghenv.Component.Message = dgh.ComponentData[n][2]
ghenv.Component.IconDisplayMode = ghenv.Component.IconDisplayMode.application
ghenv.Component.Category = dgh.ComponentData[n][3]
ghenv.Component.SubCategory = dgh.ComponentData[n][4]
ghenv.Component.Description = dgh.ComponentData[n][5]
#ghenv.Component.Icon = dgh.ComponentData[n][6]

#------------------------------------------------------------------------------#
# COMPONENT

if not Name:
    print('Name is missing')
    exit()
    
if not OutputGrid:
    print('OutputGrid is missing')
    exit()

if not OutputFormat:
    print('OutputFormat is missing')
    exit()
    
OF = dc.OutputFile(Name, OutputGrid.c,OutputFormat.c,[0,0,0,0])

print(OF.writeOutputFile())
#------------------------------------------------------------------------------#
# OUTPUTS

OutputFile = ls.PassClass(OF,"Delphin.OutputFile")
# ---------- end output_file ----------
panel_9 = Panel("""0
1
0
1""")
split = SplitList(List=matlookup.Materials, Index=1)  # -> ListA, ListB
wall = DelphinWall(Orientation=Slider(168, range=0..360))  # -> out, Wall
# ---------- wall: Python ----------
# Delphin Wall 

# License?


"""    
    Args:
        Orientation: Orientation of the wall in degrees. North = 0 Deg, East = 90 Deg 
        Inclination: Inclination of the wall in degrees. Default is set at 90 Deg, which coresponds to a vertical wall
        Latitude: Latitude for the location where the wall is placed. The information is used for Delphins solar radiation calculation
    Returns:
        Wall: Delphin Wall Class

"""

#------------------------------------------------------------------------------#
# IMPORTS

import sys
sys.path.insert(0, r'C:\Users\Christian\Dropbox\Arbejde\DTU BYG\Livestock\Kode - Livestock\01 Python\Classes')
import DelphinClasses as dc
import DelphinGH as dgh
import LivestockGH as ls

n = 3
ghenv.Component.Name = dgh.ComponentData[n][0]
ghenv.Component.NickName = dgh.ComponentData[n][1]
ghenv.Component.Message = dgh.ComponentData[n][2]
ghenv.Component.IconDisplayMode = ghenv.Component.IconDisplayMode.application
ghenv.Component.Category = dgh.ComponentData[n][3]
ghenv.Component.SubCategory = dgh.ComponentData[n][4]
ghenv.Component.Description = dgh.ComponentData[n][5]
#ghenv.Component.Icon = dgh.ComponentData[n][6]

#------------------------------------------------------------------------------#
# COMPONENT
Orientation = int(Orientation)
if Inclination:
    Inclination = int(Inclination)
else:
    Inclination = 90
if Latitude:
    Latitude = int(Latitude)
else:
    Latitude = 55

W = dc.Wall(Orientation,Inclination, Latitude)

print(W.write())

#------------------------------------------------------------------------------#
# OUTPUTS

Wall = ls.PassClass(W,"Delphin.Wall")
# ---------- end wall ----------
geo = Geometry(intial_geometry.DiscretizatedGeometry)
climatecon = DelphinClimateCondition(InOut=Toggle(True), Type="TEMPER", Path=panel_8)  # -> out, ClimateCondition
# ---------- climatecon: Python ----------
# Delphin Climate Condition

# License?


"""
    Args:
        InOut: 0 - If condition is to be used outside. 1 - if condition is to be used inside. 
        Type: Climate Type. Currently the following types are supported: TEMPER, RELHUM, HORRAIN, NORRAIN, WINDDIR, WINDVEL, DIRRAD, DIFRAD, SKYEMISS, SHWRAD.
        Path: File path to .cdd weather file.
    Returns:
        ClimateCondition: Delphin Climate Condition Class

"""

#------------------------------------------------------------------------------#
# IMPORTS

import sys
sys.path.insert(0, r'C:\Users\Christian\Dropbox\Arbejde\DTU BYG\Livestock\Kode - Livestock\01 Python\Classes')
import DelphinClasses as dc
import DelphinGH as dgh
import LivestockGH as ls

n = 1
ghenv.Component.Name = dgh.ComponentData[n][0]
ghenv.Component.NickName = dgh.ComponentData[n][1]
ghenv.Component.Message = dgh.ComponentData[n][2]
ghenv.Component.IconDisplayMode = ghenv.Component.IconDisplayMode.application
ghenv.Component.Category = dgh.ComponentData[n][3]
ghenv.Component.SubCategory = dgh.ComponentData[n][4]
ghenv.Component.Description = dgh.ComponentData[n][5]
#ghenv.Component.Icon = dgh.ComponentData[n][6]

        
#------------------------------------------------------------------------------#
# COMPONENT

if InOut == 0:
    InOut = 'IN'
elif InOut == 1:
    InOut = 'OUT'
else:
    print('InOut need to be either 0 or 1')
    exit()
CC = dc.Weather(InOut, Type, Path)
print(CC.write())

#------------------------------------------------------------------------------#
# OUTPUTS

ClimateCondition = ls.PassClass(CC,'Delphin.ClimateCondition')
# ---------- end climatecon ----------
boundcon = DelphinBoundaryCondition(
    ConditionType="HEATCOND",
    Kind="EXCHANGE",
    InOut=panel_6,
    Coefficient_Arguments=Slider(8, range=0..10),
    Weather=climatecon.ClimateCondition)  # -> out, BoundaryCondition; inputs InOut: list, Coefficient_Arguments: list, Weather: list
# ---------- boundcon: Python ----------
# Delphin Boundary Condition

# License?


"""

    
    Args:
        ConditionType: Condition Type: Currently the following types are supported: HEATCOND, VAPDIFF, RAIN, SHWRAD, LOWRAD.
        Kind: Boundary Kind: This is tied to which condition type is used. See Delphin documentation.
        InOut: List - First elements has to be OUT or IN, indicating if the Boundary Condition is on the inside or outside. Second element indicates what element the boundary condition should be assigned to 
        CoefficientArguments: Coefficient arguments which applies to the the boundary condition.
        Weather: Delphin Climate Condition Class which should be applied to the boundary condition.
    Returns:
        BoundaryCondition: Delphin Climate Condition Class

"""

#------------------------------------------------------------------------------#
# IMPORTS

import sys
sys.path.insert(0, r'C:\Users\Christian\Dropbox\Arbejde\DTU BYG\Livestock\Kode - Livestock\01 Python\Classes')
import DelphinClasses as dc
import DelphinGH as dgh
import LivestockGH as ls

n = 2
ghenv.Component.Name = dgh.ComponentData[n][0]
ghenv.Component.NickName = dgh.ComponentData[n][1]
ghenv.Component.Message = dgh.ComponentData[n][2]
ghenv.Component.IconDisplayMode = ghenv.Component.IconDisplayMode.application
ghenv.Component.Category = dgh.ComponentData[n][3]
ghenv.Component.SubCategory = dgh.ComponentData[n][4]
ghenv.Component.Description = dgh.ComponentData[n][5]
#ghenv.Component.Icon = dgh.ComponentData[n][6]

#------------------------------------------------------------------------------#
# COMPONENT
InOut = [InOut[0],]+[InOut[1:]]

# Unpack weather list
weather = []
for w in Weather:
    weather.append(w.c)

BC = dc.BoundaryCondition(ConditionType,Kind,InOut,Coefficient_Arguments,weather)

print(BC.writeBoundary())
print(BC.writeAssign())

#------------------------------------------------------------------------------#
# OUTPUTS

BoundaryCondition = ls.PassClass(BC,"Delphin.BoundaryCondition")
# ---------- end boundcon ----------
ccd_file = DelphinCreateClimateFile()  # -> out, FilePath
# ---------- ccd_file: Python ----------
# Delphin Create .ccd weather file

# License?


"""

    
    Args:
        ConditionType: Condition Type: Currently the following types are supported: HEATCOND, VAPDIFF, RAIN, SHWRAD, LOWRAD.
        Kind: Boundary Kind: This is tied to which condition type is used. See Delphin documentation.
        InOut: 0 - If condition is to be used outside. 1 - if condition is to be used inside. 
        CoefficientArguments: Coefficient arguments which applies to the the boundary condition.
        Weather: Delphin Climate Condition Class which should be applied to the boundary condition.
    Returns:
        BoundaryCondition: Delphin Climate Condition Class

"""

#------------------------------------------------------------------------------#
# IMPORTS

import sys
sys.path.insert(0, r'C:\Users\Christian\Dropbox\Arbejde\DTU BYG\Livestock\Kode - Livestock\01 Python\Classes')
import DelphinClasses as dc
import DelphinGH as dgh
import LivestockGH as ls

n = 8
ghenv.Component.Name = dgh.ComponentData[n][0]
ghenv.Component.NickName = dgh.ComponentData[n][1]
ghenv.Component.Message = dgh.ComponentData[n][2]
ghenv.Component.IconDisplayMode = ghenv.Component.IconDisplayMode.application
ghenv.Component.Category = dgh.ComponentData[n][3]
ghenv.Component.SubCategory = dgh.ComponentData[n][4]
ghenv.Component.Description = dgh.ComponentData[n][5]
#ghenv.Component.Icon = dgh.ComponentData[n][6]

#------------------------------------------------------------------------------#
# COMPONENT

dc.writeWeatherFile(Data, Type, Unit, Name, Path)

#------------------------------------------------------------------------------#
# OUTPUTS

FilePath = Path + '\\' + Name + '.dpj'
# ---------- end ccd_file ----------
facen = FaceNormals(Mesh=geo)  # -> Centers, Normals
panel_10 = Panel(python_executor)
material = DelphinMaterial(Name=split.ListA, ID=split.ListB, Range=panel_9, Colour=ColourSwatch(SwatchColor=RGB(134, 126, 204)))  # -> out, Material; inputs Range: list
# ---------- material: Python ----------
# Delphin Wall 

# License?


"""

    
    Args:
        Name: String - Name of the material as stated in the material database
        ID: Integer - ID number of the material as stated in the material database
        Range: List with 4 integers - Range, which the material covers
    Returns:
        Material: Delphin Material Class

"""

#------------------------------------------------------------------------------#
# IMPORTS

import sys
sys.path.insert(0, r'C:\Users\Christian\Dropbox\Arbejde\DTU BYG\Livestock\Kode - Livestock\01 Python\Classes')
import DelphinClasses as dc
import DelphinGH as dgh
import LivestockGH as ls

n = 4
ghenv.Component.Name = dgh.ComponentData[n][0]
ghenv.Component.NickName = dgh.ComponentData[n][1]
ghenv.Component.Message = dgh.ComponentData[n][2]
ghenv.Component.IconDisplayMode = ghenv.Component.IconDisplayMode.application
ghenv.Component.Category = dgh.ComponentData[n][3]
ghenv.Component.SubCategory = dgh.ComponentData[n][4]
ghenv.Component.Description = dgh.ComponentData[n][5]
#ghenv.Component.Icon = dgh.ComponentData[n][6]

#------------------------------------------------------------------------------#
# COMPONENT

C = dgh.rgbToHex(int(Colour.R),int(Colour.G),int(Colour.B))
M = dc.Material(Name, ID, Range, color=C)
print(M.writeMaterial())
print(M.writeAssign())

#------------------------------------------------------------------------------#
# OUTPUTS

Material = ls.PassClass(M,"Delphin.Material")
# ---------- end material ----------
panel_11 = Panel(output_file.out)
panel_12 = Panel(output_file.OutputFile)
panel_13 = Panel(output_format.out)
panel_14 = Panel(output_format.OutputFormat)
panel_15 = Panel(output_grid.out)
panel_16 = Panel(output_grid.OutputGrid)
bang = ExplodeTree(Data=simplify(intial_geometry.BareGeometry))  # -> Branch0, Branch1, Branch2, Branch3
panel_17 = Panel(bang.Branch0)
points = PointList(Points=facen.Centers)
item = ListItem(List=intial_geometry.DelphinGeometry, Index=Slider(0, range=0..4), Wrap=True)
setup = DelphinSetup(FileName="test", FilePath="C:\Users\Christian\Desktop\")  # -> out, Setup
# ---------- setup: Python ----------
# Delphin Setup 

# License?


"""

    
    Args:
        FileName: String - Containing the filename
        FilePath: String - Folder path
    Returns:
        Setup: Delphin Setup Class

"""

#------------------------------------------------------------------------------#
# IMPORTS

import sys
sys.path.insert(0, r'C:\Users\Christian\Dropbox\Arbejde\DTU BYG\Livestock\Kode - Livestock\01 Python\Classes')
import DelphinClasses as dc
import DelphinGH as dgh
import LivestockGH as ls

n = 5
ghenv.Component.Name = dgh.ComponentData[n][0]
ghenv.Component.NickName = dgh.ComponentData[n][1]
ghenv.Component.Message = dgh.ComponentData[n][2]
ghenv.Component.IconDisplayMode = ghenv.Component.IconDisplayMode.application
ghenv.Component.Category = dgh.ComponentData[n][3]
ghenv.Component.SubCategory = dgh.ComponentData[n][4]
ghenv.Component.Description = dgh.ComponentData[n][5]
#ghenv.Component.Icon = dgh.ComponentData[n][6]

#------------------------------------------------------------------------------#
# COMPONENT

F = dc.File(FileName, FilePath)
PI = dc.ProjectInfo()
I = dc.Initialization()
if not OutputFolder:
    OG = dc.OutputGeneral(FilePath + '\\' + FileName + '.results')
else:
    OG = dc.OutputGeneral(OutputFolder)

print(F.F)
print(PI.write())
print(I.write())
print(OG.write())

#------------------------------------------------------------------------------#
# OUTPUTS

Setup = [ls.PassClass(F,"Delphin.File"),ls.PassClass(PI,"Delphin.ProjectInfo"),ls.PassClass(I,"Delphin.Initialization"),ls.PassClass(OG,"Delphin.OutputGeneral")]
# ---------- end setup ----------
panel_18 = Panel(wall.Wall)
panel_19 = Panel(wall.out)
panel_20 = Panel(material.Material)
panel_21 = Panel(material.out)
panel_22 = Panel(boundcon.BoundaryCondition)
panel_23 = Panel(boundcon.out)
panel_24 = Panel(climatecon.ClimateCondition)
panel_25 = Panel(climatecon.out)
mesh_geometry = DelphinMeshGeometry(
    Geometry=item,
    Material=matlookup.Materials,
    Color=ColourSwatch(SwatchColor=RGB(64, 206, 204)),
    BoundaryCondition=boundcon.BoundaryCondition)  # -> out, DelphinGeometry; inputs Material: list
# ---------- mesh_geometry: Python ----------
# Delphin Material Lookup

# License?


"""
    
    Args:
        SearchTerm: Search Term to filter the materials by. Can either be a material name (string) or the material ID (integer).
    Returns:
        Materials: Returns the found material if any.

"""

#------------------------------------------------------------------------------#
# IMPORTS

import sys
sys.path.insert(0, r'C:\Users\Christian\Dropbox\Arbejde\DTU BYG\Livestock\Kode - Livestock\01 Python\Classes')
import DelphinGH as dgh
import DelphinClasses as dc
import LivestockGH as ls

n = 11
ghenv.Component.Name = dgh.ComponentData[n][0]
ghenv.Component.NickName = dgh.ComponentData[n][1]
ghenv.Component.Message = dgh.ComponentData[n][2]
ghenv.Component.IconDisplayMode = ghenv.Component.IconDisplayMode.application
ghenv.Component.Category = dgh.ComponentData[n][3]
ghenv.Component.SubCategory = dgh.ComponentData[n][4]
ghenv.Component.Description = dgh.ComponentData[n][5]
#ghenv.Component.Icon = dgh.ComponentData[n][6]

#------------------------------------------------------------------------------#
# COMPONENT

if not Color:
    C = dgh.rgbToHex(145,145,145)
else:
    C = dgh.rgbToHex(int(Color.R),int(Color.G),int(Color.B))
range = Geometry.c

M = dc.Material(Material[0], Material[1], range, color=C)
geo = {'material':M}

if BoundaryCondition:
    if BoundaryCondition.c.IO[0] == 'OUT':
        io = [BoundaryCondition.c.IO[0],[range[1],range[1],range[2],range[3]]]
        BC = dc.BoundaryCondition(BoundaryCondition.c.CT,BoundaryCondition.c.K,io,BoundaryCondition.c.CA,BoundaryCondition.c.W)
    elif BoundaryCondition.c.IO[0] == 'IN':
        io = [BoundaryCondition.c.IO[0],[range[0],range[0],range[2],range[3]]]
        BC = dc.BoundaryCondition(BoundaryCondition.c.CT,BoundaryCondition.c.K,io,BoundaryCondition.c.CA,BoundaryCondition.c.W)
    geo['boundaryCon'] = BC

#if InitialCondition:
#print(M.writeMaterial())
#print(M.writeAssign())



#------------------------------------------------------------------------------#
# OUTPUTS


DelphinGeometry = ls.PassClass(geo,"Delphin.Geometry")
# ---------- end mesh_geometry ----------
panel_26 = Panel(setup.out)
panel_27 = Panel(setup.Setup)
create = DelphinCreateFile(
    Setup=setup.Setup,
    Wall=wall.Wall,
    OutputGrids=output_grid.OutputGrid,
    OutputFormat=output_format.OutputFormat,
    Create=Toggle(False))  # -> out, FileName
# ---------- create: Python ----------
# Delphin Wall 

# License?


"""

    
    Args:
        Setup: Delphin Setup Class
        Materials: Delphin Material Class
        Wall: Delphin Wall Class
        ClimateConditions: Delphin Climate Condition Class
        BoundaryConditions: Delphin Boundary Condition Class
        InitialConditions: Delphin Initial Condition Class
        ContactConditions: Delphin Contact Condition Class
        Discretisation: Delphin Discretisation Class
        OutputGeneral: Delphin OutputGeneral Class
        Grids: Delphin Grid Class
        OutputFormats: Delphin OutputFormat Class
        OutputFiles: Delphin OutputFiles Class
    Returns:
        FileName: File name of the created file

"""

#------------------------------------------------------------------------------#
# IMPORTS

import sys
sys.path.insert(0, r'C:\Users\Christian\Dropbox\Arbejde\DTU BYG\Livestock\Kode - Livestock\01 Python\Classes')
import DelphinClasses as dc
import DelphinGH as dgh
import LivestockGH as ls

n = 6
ghenv.Component.Name = dgh.ComponentData[n][0]
ghenv.Component.NickName = dgh.ComponentData[n][1]
ghenv.Component.Message = dgh.ComponentData[n][2]
ghenv.Component.IconDisplayMode = ghenv.Component.IconDisplayMode.application
ghenv.Component.Category = dgh.ComponentData[n][3]
ghenv.Component.SubCategory = dgh.ComponentData[n][4]
ghenv.Component.Description = dgh.ComponentData[n][5]
#ghenv.Component.Icon = dgh.ComponentData[n][6]

#------------------------------------------------------------------------------#
# COMPONENT

# Unpack Setup
File, Info, Init = Setup[0].c, Setup[1].c, Setup[2].c

# Unpack material list
materials = []
for m in Materials:
    materials.append(m.c)
    
# Unpack ClimateConditions list
climateConditions = []
for cc in ClimateConditions:
    climateConditions.append(cc.c)

# Unpack BoundaryConditions list
boundaryConditions = []
for bc in BoundaryConditions:
    boundaryConditions.append(bc.c)

# Unpack InitialConditions list
if not InitialConditions:
    initialConditions = False
else: 
    initialConditions = []
    for ic in InitialConditions:
        initialConditions.append(ic.c)

# Unpack ContactConditions list
if not ContactConditions:
    contactConditions = False
else: 
    contactConditions = []
    for cc in ContactConditions:
        contactConditions.append(cc.c)
        
# Unpack OutputFormats list
outputFormats = []
for of in OutputFormats:
    outputFormats.append(of.c)

# Unpack OutputFiles list
outputFiles = []
for of in OutputFiles:
    outputFiles.append(of.c)

D = dc.Delphin(File, Info, Init, materials, Wall.c, climateConditions, boundaryConditions, initialConditions, contactConditions, Discretisation.c, OutputGeneral.c, Grid.c, outputFormats, outputFiles)

if Create:
    D.create()

#------------------------------------------------------------------------------#
# OUTPUTS

if Create:
    FileName = File.F
    read = open(FileName, 'r')
    lines = read.readlines()
    print(lines)
# ---------- end create ----------
run = DelphinRun(FileNames=create.FileName, Run=Toggle(False))  # -> out, a
# ---------- run: Python ----------
# Delphin Run

# License?


"""

    
    Args:
        ConditionType: Condition Type: Currently the following types are supported: HEATCOND, VAPDIFF, RAIN, SHWRAD, LOWRAD.
        Kind: Boundary Kind: This is tied to which condition type is used. See Delphin documentation.
        InOut: 0 - If condition is to be used outside. 1 - if condition is to be used inside. 
        CoefficientArguments: Coefficient arguments which applies to the the boundary condition.
        Weather: Delphin Climate Condition Class which should be applied to the boundary condition.
    Returns:
        BoundaryCondition: Delphin Climate Condition Class

"""

#------------------------------------------------------------------------------#
# IMPORTS

import sys
sys.path.insert(0, r'C:\Users\Christian\Dropbox\Arbejde\DTU BYG\Livestock\Kode - Livestock\01 Python\Classes')
import DelphinClasses as dc
import DelphinGH as dgh
import LivestockGH as ls

n = 7
ghenv.Component.Name = dgh.ComponentData[n][0]
ghenv.Component.NickName = dgh.ComponentData[n][1]
ghenv.Component.Message = dgh.ComponentData[n][2]
ghenv.Component.IconDisplayMode = ghenv.Component.IconDisplayMode.application
ghenv.Component.Category = dgh.ComponentData[n][3]
ghenv.Component.SubCategory = dgh.ComponentData[n][4]
ghenv.Component.Description = dgh.ComponentData[n][5]
#ghenv.Component.Icon = dgh.ComponentData[n][6]

#------------------------------------------------------------------------------#
# COMPONENT


#------------------------------------------------------------------------------#
# OUTPUTS
# ---------- end run ----------
