# Grasshopper definition FixMesh.gh (Grasshopper 0.9.76)
# plug-ins: Python Interpreter, ItemSelector

# ----
# Åben Bash og kør:
# sudo service ssh --full-restart
panel = Panel("ocni")
python_executor = LivestockPythonExecutor(PythonPath="C:\Program Files\Anaconda3\envs\livestock\python.exe")  # -> out
# ---------- python_executor: Python ----------
#------------------------------------------------------------------------------#
# IMPORTS

import sys
sys.path.insert(0, r'C:\livestock\python\classes')
import LivestockGH as ls
import Rhino as rc
import scriptcontext as sc

n = 16
ghenv.Component.Name = ls.ComponentData[n][0]
ghenv.Component.NickName = ls.ComponentData[n][1]
ghenv.Component.Message = ls.ComponentData[n][2]
ghenv.Component.IconDisplayMode = ghenv.Component.IconDisplayMode.application
ghenv.Component.Category = ls.ComponentData[n][3]
ghenv.Component.SubCategory = ls.ComponentData[n][4]
ghenv.Component.Description = ls.ComponentData[n][5]
#ghenv.Component.Icon = dgh.ComponentData[n][6]

#------------------------------------------------------------------------------#
# COMPONENT

sc.sticky['PythonExe'] = PythonPath

#------------------------------------------------------------------------------#
# OUTPUTS

print('Python Executor is set to: ' + PythonPath)
# ---------- end python_executor ----------
update = LivestockUpdate(Update=Toggle(False))  # -> out
# ---------- update: Python ----------
#------------------------------------------------------------------------------#
# IMPORTS

import sys
import os
import shutil
import zipfile
import time
import urllib
import System

n = 20
ghenv.Component.Name = "Livestock Update"
ghenv.Component.NickName = "Update"
ghenv.Component.Message = "VER 0.0.1 | May 2017"
ghenv.Component.IconDisplayMode = ghenv.Component.IconDisplayMode.application
ghenv.Component.Category = "Livestock"
ghenv.Component.SubCategory = "0 | Miscellaneous"
ghenv.Component.Description = "Update Livestock"
	
#------------------------------------------------------------------------------#
# COMPONENT

def downloadSourceAndUnzip():
    """
    Download the source code from github and unzip it in temp folder
    """

    url = "https://github.com/livestock3d/livestock_gh/archive/master.zip"
    targetDirectory = r'C:\livestock'

    # download the zip file
    print("Downloading the source code...")
    zipFile = os.path.join(targetDirectory, os.path.basename(url))
    
    # if the source file is just downloded then just use the available file
    if os.path.isfile(zipFile) and time.time() - os.stat(zipFile).st_mtime < 1000:
        download = False
    else:
        download = True

        # remove the old version
        try:
            shutil.rmtree(targetDirectory)
        except:
            pass

    # create the target directory
    if not os.path.isdir(targetDirectory): os.mkdir(targetDirectory)

    if download:
        try:
            client = System.Net.WebClient()
            client.DownloadFile(url, zipFile)
            if not os.path.isfile(zipFile):
                print("Download failed! Try to download and unzip the file manually form:\n" + url)
                return
        except Exception, e:
            print(`e` + "\nDownload failed! Try to download and unzip the file manually form:\n" + url)
            return

    # unzip the file
    with zipfile.ZipFile(zipFile) as zf:
        for f in zf.namelist():
            folder = f.replace('livestock_gh-master/','C:/livestock/')
            if f.endswith('/'):
                try:
                    os.makedirs(folder)
                    os.makedirs(f)
                except:
                    pass
            else:
                zf.extract(f, targetDirectory)
                file = f.replace('livestock_gh-master/','C:/livestock/')
                shutil.move('C:/livestock/'+f,file)
                
    shutil.rmtree('C:/livestock/livestock_gh-master')
    
    #Move GH components
    userObjectsFolder = os.getenv('APPDATA') + '/Grasshopper/UserObjects/'
    componentsFolder = 'C:/livestock/grasshopper/components/'
    for obj in os.listdir(componentsFolder):
        shutil.move(componentsFolder+obj,userObjectsFolder+obj)
    shutil.rmtree('C:/livestock/grasshopper')
    
    return True

    
#------------------------------------------------------------------------------#
# OUTPUTS

if Update:
    downloadSourceAndUnzip()
    print('Download done')
# ---------- end update ----------
ssh_connection = LivestockSSHConnection(IpAddress="127.0.0.1", Port="2222", Username=panel, Password="4320lejre")  # -> out
# ---------- ssh_connection: Python ----------
#------------------------------------------------------------------------------#
# IMPORTS

import sys
sys.path.insert(0, r'C:\livestock\python\classes')
import LivestockGH as ls
import Rhino as rc
import scriptcontext as sc
import subprocess

n = 17
ghenv.Component.Name = ls.ComponentData[n][0]
ghenv.Component.NickName = ls.ComponentData[n][1]
ghenv.Component.Message = ls.ComponentData[n][2]
ghenv.Component.IconDisplayMode = ghenv.Component.IconDisplayMode.application
ghenv.Component.Category = ls.ComponentData[n][3]
ghenv.Component.SubCategory = ls.ComponentData[n][4]
ghenv.Component.Description = ls.ComponentData[n][5]
#ghenv.Component.Icon = dgh.ComponentData[n][6]

#------------------------------------------------------------------------------#
# COMPONENT

sc.sticky['SSH'] = {'ip':IpAddress,'port':Port,'user':Username,'password':Password}

#------------------------------------------------------------------------------#
# OUTPUTS

print('SSH connection is set to:\nIP Address: ' + str(IpAddress) + '\nPort: ' + str(Port) + '\nUser: ' + Username)
# ---------- end ssh_connection ----------
panel_2 = Panel(update)
panel_3 = Panel(python_executor)
panel_4 = Panel(ssh_connection)

panel_5 = Panel("""low
normal
high""")
mesh = Mesh(<mesh referenced from the Rhino model>)
list = Honeybee_ItemSelector(panel_5, {"low", "normal", "high"}, selected="low")
fix_mesh = LivestockFixMesh(Mesh=mesh, DetailLevel=list, Run=Toggle(False))  # -> Readme, NewMesh
# ---------- fix_mesh: Python ----------
"""
Simulates drainage in order to analyse a mesh for local pooling of rain water.
Copyright: Creative Commons - Attribution 4.0 International
Contact: ocni@dtu.dk
-
Provided by Livestock 0.1, made by Christian Kongsgaard. 

    Args:
        Mesh: The mesh to fix.
        DetailLevel: The detail level of the wanted mesh. Should be low, normal or high.
        Run: Activates the component.
    Returns:
        Readme!: In case of any errors, it will be shown here.
        NewMesh: Returns mesh after processing.
"""
#------------------------------------------------------------------------------#
# IMPORTS

import sys
sys.path.insert(0, r'C:\livestock\python\classes')
import LivestockGH as ls
import Rhino as rc
import subprocess
import os
import scriptcontext as sc
from shutil import copyfile

n = 22
ghenv.Component.Name = ls.ComponentData[n][0]
ghenv.Component.NickName = ls.ComponentData[n][1]
ghenv.Component.Message = ls.ComponentData[n][2]
ghenv.Component.IconDisplayMode = ghenv.Component.IconDisplayMode.application
ghenv.Component.Category = ls.ComponentData[n][3]
ghenv.Component.SubCategory = ls.ComponentData[n][4]
ghenv.Component.Description = ls.ComponentData[n][5]
#ghenv.Component.Icon = ls.ComponentData[n][6]

#------------------------------------------------------------------------------#
# COMPONENT

# Paths
sshPath = r'C:\livestock\python\ssh'
templatePath = r'C:\livestock\python\templates'
meshName = 'mesh'
meshType = '.obj'
doc = ghdoc

# SSH and commands
ip = str(sc.sticky["SSH"]['ip'])
port = str(sc.sticky["SSH"]['port'])
user = str(sc.sticky["SSH"]['user'])
pw = str(sc.sticky["SSH"]['password'])

fTrans = 'user.txt,detail.txt,' + meshName+meshType
fRun = 'FixMeshTemplate.py'
fReturn = 'fixedMesh.obj'

inData = 'InData'
py_template = templatePath + '\\SSHTemplate.py'
pyfile = templatePath + '\\sshrun.py'
py = sc.sticky['PythonExe']


#------------------------------------------------------------------------------#
# OUTPUTS

if Run:
    # Export mesh
    ls.bakeExportDelete(Mesh, sshPath, meshName, meshType, doc)
    
    # Write user file
    ls.writeFile([user,], sshPath, 'user')
    
    # Write user file
    ls.writeFile([DetailLevel,], sshPath, 'detail')
    
    # Write SSH commands
    ls.writeFile([ip,port,user,pw,fTrans,fRun,fReturn],sshPath,inData)
    
    #Copy Template
    copyfile(py_template,pyfile)
    
    # Run template
    thread = subprocess.Popen([py, pyfile])
    thread.wait()
    thread.kill()
    
    # Load results
    NewMesh = ls.importObj(sshPath+'\\fixedMesh'+meshType)
    
    # File clean up
    if NewMesh and pts:
        os.remove(sshPath + '\\user.txt')
        os.remove(sshPath + '\\detail.txt')
        os.remove(sshPath + '\\' + inData+'.txt')
        os.remove(pyfile)
        os.remove(sshPath+'\\'+meshName+meshType)
        os.remove(sshPath + '\\out.txt')
        os.remove(sshPath + '\\fixedMesh.obj')
# ---------- end fix_mesh ----------
mesh_2 = Mesh(fix_mesh.NewMesh)
panel_6 = Panel(fix_mesh.Readme)
