# Grasshopper definition MeshDrainage.gh (Grasshopper 0.9.76)
# plug-ins: Python Interpreter

brep = Brep(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)
brep_2 = Brep(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)
mesh = MeshBrep(
    Brep=brep,
    Settings={GridMaxCount=0, GridMinCount=16, JaggedSeams=False, MaxEdgeLength=0, MinEdgeLength=0.0001, MinTolerance=0, Refine=True, RefineAngle=0, RelativeTolerance=0.65, SimplePlanes=True, Tolerance=0})
mesh_2 = MeshBrep(
    Brep=brep_2,
    Settings={GridMaxCount=0, GridMinCount=16, JaggedSeams=False, MaxEdgeLength=0, MinEdgeLength=0.0001, MinTolerance=0, Refine=True, RefineAngle=0, RelativeTolerance=0.65, SimplePlanes=True, Tolerance=0})
number_slider = Slider(0.25, range=0..1)
number_slider_2 = Slider(1.15, range=0..3)
mesh_3 = Mesh(mesh)
mesh_4 = Mesh(mesh_2)
panel = Panel("C:\Users\Christian\Dropbox\Arbejde\DTU BYG\Livestock\Kode - Livestock\01 Python\Tests\drainPoints.txt")
boundingmesh = PythonScript(analysisMesh=mesh_4, gridSize=number_slider_2)  # -> out, a, b; inputs analysisMesh: Mesh, gridSize: Int32
# ---------- boundingmesh: Python ----------
import Rhino as rc
import rhinoscriptsyntax as rs

vert = analysisMesh.Vertices
minX, maxX, minY, maxY, minZ, maxZ = 0,0,0,0,0,0

for v in vert:
    if v.X < minX:
        minX = v.X
    if v.X > maxX:
        maxX = v.X
        
    if v.Y < minY:
        minY = v.Y
    if v.Y > maxY:
        maxY = v.Y
        
    if v.Z < minZ:
        minZ = v.Z
    if v.Z > maxZ:
        maxZ = v.Z

a0 = rc.Geometry.BoundingBox(minX,minY,minZ,maxX,maxY,maxZ)
a1 = rc.Geometry.Brep.CreateFromBox(a0).Faces
a2 = a1[5].DuplicateFace(0)

meshParam = rc.Geometry.MeshingParameters.Default
meshParam.MaximumEdgeLength = gridSize
meshParam.MinimumEdgeLength = gridSize
meshParam.GridAspectRatio = 1

a = rc.Geometry.Mesh.CreateFromBrep(a2, meshParam)
b = a2
# ---------- end boundingmesh ----------
meshdrainage = MeshDrainageAnalysis(Toggle=Toggle(False), Mesh=mesh_4, Tolerance=Slider(0.1, range=0..1))  # -> Readme, DrainCurves, EndPoints
# ---------- meshdrainage: Python ----------
"""
Simulates drainage in order to analyse a mesh for local pooling of rain water.
Copyright: Creative Commons - Attribution 4.0 International
Contact: ocni@dtu.dk
-
Provided by Livestock 0.1, made by Christian Kongsgaard. 
    Args:
        Toggle: Activates the component.
        Mesh: The mesh to analyse.
        Tolerance: The precision with which the particles are moved.
    Returns:
        Readme!: In case of any errors, it will be shown here
        DrainCurves: Curves constructed through the drain positions of each particle.
        EndPoints: The final position of the particles.
"""
#------------------------------------------------------------------------------#
# IMPORTS

import sys
sys.path.insert(0, r'C:\Users\Christian\Dropbox\Arbejde\DTU BYG\Livestock\Kode - Livestock\01 Python\Classes')
import RainClasses as rain
import LivestockGH as ls
import Rhino as rc

n = 18
ghenv.Component.Name = dgh.ComponentData[n][0]
ghenv.Component.NickName = dgh.ComponentData[n][1]
ghenv.Component.Message = dgh.ComponentData[n][2]
ghenv.Component.IconDisplayMode = ghenv.Component.IconDisplayMode.application
ghenv.Component.Category = dgh.ComponentData[n][3]
ghenv.Component.SubCategory = dgh.ComponentData[n][4]
ghenv.Component.Description = dgh.ComponentData[n][5]
#ghenv.Component.Icon = dgh.ComponentData[n][6]

#------------------------------------------------------------------------------#
# COMPONENT

filePath = r'C:\Users\Christian\Dropbox\Arbejde\DTU BYG\Livestock\Kode - Livestock\01 Python\Templates'
fileName = 'drainMesh'
fileType = '.obj'
doc = ghdoc

#------------------------------------------------------------------------------#
# OUTPUTS

if Toggle:
    ls.bakeExportDelete(Mesh, filePath, fileName, fileType, doc)
    
    ls.importObj(filePath+'\\'+fileName+fileType)
# ---------- end meshdrainage ----------
meshdrainage_2 = MeshDrainageAnalysis(Toggle=Toggle(False), Mesh=mesh_4, Tolerance=Slider(0.1, range=0..1))  # -> Readme, DrainCurves, EndPoints; inputs Mesh: Mesh
# ---------- meshdrainage_2: Python ----------
"""
Simulates drainage in order to analyse a mesh for local pooling of rain water.
Copyright: Creative Commons - Attribution 4.0 International
Contact: ocni@dtu.dk
-
Provided by Livestock 0.1, made by Christian Kongsgaard. 
    Args:
        Toggle: Activates the component.
        Mesh: The mesh to analyse.
        Tolerance: The precision with which the particles are moved.
    Returns:
        Readme!: In case of any errors, it will be shown here
        DrainCurves: Curves constructed through the drain positions of each particle.
        EndPoints: The final position of the particles.
"""


#Import
import Rhino as rc
import rhinoscriptsyntax as rs
import System.Threading.Tasks as tasks

# Set component name/nick
ghenv.Component.Name = "MeshDrainageAnalysis"
ghenv.Component.NickName = "MeshDrainage"
ghenv.Component.Message = 'VER 0.0.1\nJan_2017'
ghenv.Component.IconDisplayMode = ghenv.Component.IconDisplayMode.application
ghenv.Component.Category = "Livestock"
ghenv.Component.SubCategory = "1 | Water"

# Tolerance Check
if Tolerance == 0:
    print('Tolerance can not be 0')
    exit()
    
# Drain Function
def makeDrainMeshPaths(mesh,startPoints,tolerance):
    
    """ Estimates the trail of a drainage path on a mesh. Based on Benjamin 
    Golders concept and Remy's VB code found here:
    http://www.grasshopper3d.com/forum/topics/drainage-direction-script """
    
    # Return list
    drainPaths = []
    
    # Task function
    def drainPath(pt):
        
        # Particle list and current particle plane
        particles = []
        paPl = rc.Geometry.Plane(pt,rc.Geometry.Vector3d.ZAxis)
        run = True
        
        while run:
            
            # Get the point on the mesh closest to the particle
            meshPt = mesh.ClosestMeshPoint(paPl.Origin,0.0)
            paPl = rc.Geometry.Plane(meshPt.Point,mesh.NormalAt(meshPt))
            
            # Check that first step has been taken and that current step is down slope
            if len(particles) != 0 and paPl.Origin.Z > particles[-1].Z:
                run = False
                
            else:
                # Add particle to list
                particles.append(paPl.Origin)
                
                # Move particle down slope
                an = rc.Geometry.Vector3d.VectorAngle(paPl.XAxis,-rc.Geometry.Vector3d.ZAxis,paPl)
                paPl.Rotate(an,paPl.ZAxis)
                paPl.Translate(paPl.XAxis*tolerance)
             
            lines = mesh.GetNakedEdges()
            for line in lines:
                lineParam = line.ClosestParameter(paPl.Origin)
                linePoint = line.PointAt(lineParam)
                pointDistance = linePoint.DistanceTo(paPl.Origin)
                if pointDistance <= Tolerance:
                    run = False
                    particles.append(linePoint)
                
                
        # Make drain curve
        print(type(particles))
        if len(particles) > 1:
            crv = rc.Geometry.Curve.CreateControlPointCurve(particles)
            drainPaths.append(crv)
            
    # Call task function
    tasks.Parallel.ForEach(startPoints,drainPath)

    return drainPaths

#Run Component
if Toggle and Mesh:
    # Make mesh centerpoints as startpoint
    startPoints = []
    i = 0 
    while i < Mesh.Faces.Count:
        cen = Mesh.Faces.GetFaceCenter(i)
        startPoints.append(cen)
        i += 1

    # Make drain curves
    DrainCurves = makeDrainMeshPaths(Mesh,startPoints,Tolerance)
    DrainCurves = list(filter(None, DrainCurves))
    EndPoints = [crv.PointAtEnd for crv in DrainCurves]
# ---------- end meshdrainage_2 ----------
lng = ListLength(List=meshdrainage_2.EndPoints)
dup = DuplicateData(Data=Slider(0.001, range=0..0.1), Number=lng, Order=True)
loadpoints = PythonScript(x=panel)  # -> out, simplify(Points), Lines
# ---------- loadpoints: Python ----------
import Rhino as rc
import rhinoscriptsyntax as rs
import System.Threading.Tasks as tasks
import sys
sys.path.insert(0, r'C:\Users\Christian\Dropbox\Arbejde\DTU BYG\Livestock\Kode - Livestock\01 Python\Classes')
#import RainClasses as rain
import LivestockGH as ls

pts = ls.loadPoints(x)
Points = ls.list_to_tree(pts)
    
Lines = ls.makeCurvesFromPoints(pts)
# ---------- end loadpoints ----------
panel_2 = Panel(dup)
crv = Curve(loadpoints.Lines)
gentestpts = Honeybee_GenerateTestPoints(testGeometry=boundingmesh.b, gridSize=number_slider_2, distBaseSrf=Slider(0.1, range=0..0.1), moveTestMesh=True)  # -> readMe, simplify(testPoints), simplify(ptsVectors), simplify(facesArea), simplify(mesh); plug-in component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
python = PythonScript()  # -> out, a
# ---------- python: Python ----------
import Rhino as rc
import rhinoscriptsyntax as rs

file = 'C:\\Users\\Christian\\Desktop\\drainMesh.obj'
a = rc.FileIO.File3dm.Read(file)
b = a.Objects
print(b.Item)
# ---------- end python ----------
panel_3 = Panel(loadpoints.out)
pt = Point(meshdrainage_2.EndPoints)
smoothpline = SmoothPolyline(Strength=1, Times=1)
crv_2 = Curve(meshdrainage_2.DrainCurves)
facen = FaceNormals(Mesh=gentestpts.mesh)  # -> Centers, Normals
panel_4 = Panel(python.out)
meshpooling = MeshPooling(Mesh=mesh_4, EndPoints=meshdrainage_2.EndPoints, WaterContent=panel_2)  # -> Readme, Volume, WaterSurfaces, PoolMesh, plane; inputs Mesh: Mesh, EndPoints: list of Point3d, WaterContent: list
# ---------- meshpooling: Python ----------
"""
Simulates drainage in order to analyse a mesh for local pooling of rain water.
Copyright: Creative Commons - Attribution 4.0 International
Contact: ocni@dtu.dk
-
Provided by Livestock 0.1, made by Christian Kongsgaard. 
    Args:
        Toggle: Activates the component.
        Mesh: The mesh to analyse.
        EndPoints: The final position of the particles.
        WaterContent: Water content at each end point in m3
    Returns:
        Readme!: In case of any errors, it will be shown here
        
        
"""

import Rhino as rc
import rhinoscriptsyntax as rs
import System.Threading.Tasks as tasks

# Set component name/nick
ghenv.Component.Name = "MeshPooling"
ghenv.Component.NickName = "MeshPooling"
ghenv.Component.Message = 'VER 0.0.1\nJan_2017'
ghenv.Component.IconDisplayMode = ghenv.Component.IconDisplayMode.application
ghenv.Component.Category = "Livestock"
ghenv.Component.SubCategory = "1 | Water"

if len(EndPoints) != len(WaterContent):
    print('Number of EndPoints <' + str(len(EndPoints)) + '> has to be the same as the list length of WaterContent <' + str(len(WaterContent)) +'>')
    exit()
    
def binarySearch(alist, item):
    first = 0
    last = len(alist)-1
    found = False
    
    while first<=last and not found:
        midpoint = (first + last)//2
        if alist[midpoint] == item:
            found = True
        else:
            if item < alist[midpoint]:
                last = midpoint-1
            else:
                first = midpoint+1
                
    return midpoint

pts = []
z = []
for p in EndPoints:
    if len(pts) == 0:
        pts.append(p)
        z.append(p.Z)
    elif len(pts) == 1:
        if p.Z > z[0]:
            pts.insert(0,p)
            z.insert(0,p.Z)
        elif p.Z < z[0]:
            pts.append(p)
            z.append(p.Z)
        else:
            pts.append(p)
            z.append(p.Z)
    else:
        i = binarySearch(z,p.Z)
        pts.insert(i,p)
        z.insert(i,p.Z)

meshParam = rc.Geometry.MeshingParameters.Default


pt = pts[0]

def createPool(point, volume):
    add = 0.01
    pt.Z = pt.Z + add
    vec = rc.Geometry.Vector3d(0,0,1)
    plane = rc.Geometry.Plane(pt,vec)
    bottomMesh = Mesh.Split(plane)[1]
    edges = bottomMesh.GetNakedEdges()
    lines = []
    for e in edges:
        for l in e.GetSegments():
            lines.append(rc.Geometry.LineCurve(l))

    cap = rc.Geometry.Brep.CreatePlanarBreps(lines)[0]
    cap = rc.Geometry.Mesh.CreateFromBrep(cap, meshParam)[0]
    pool = rc.Geometry.Mesh()
    pool.Append(cap)
    pool.Append(bottomMesh)

    vol = rc.Geometry.VolumeMassProperties.Compute(pool)
    volume = vol.Volume

Volume = volume
WaterSurfaces = 0
PoolMesh = pool
# ---------- end meshpooling ----------
mesh_5 = Mesh(gentestpts.mesh)
panel_5 = Panel(meshpooling.Readme)
file = ReadFile(File="C:\\Users\\Christian\\Desktop\\drainMesh.obj", PerLineParse=True)
geo = Geometry(meshpooling.plane)
geo_2 = Geometry(meshpooling.WaterSurfaces)
geo_3 = Geometry(meshpooling.PoolMesh)
panel_6 = Panel(meshpooling.Volume)
