# Grasshopper definition Regnværktøj v0.0.1.gh (Grasshopper 0.9.76)
# plug-ins: Python Interpreter

honeybee = Honeybee_Honeybee()  # -> Vviiiiiiiiiizzz; plug-in component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
ladybug = Ladybug_Ladybug()  # -> Vviiiiiiiiiizzz; plug-in component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

# ----
# Initial geometry
X = Slider(13, range=1..20)
Y = Slider(2, range=1..10)
canopy = Canopy(B=X, B_2=Y)
building = Brep(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)

update = LivestockUpdate(Update=Toggle(False))  # -> out
# ---------- update: Python ----------
#------------------------------------------------------------------------------#
# IMPORTS

import sys
import os
import shutil
import zipfile
import time
import urllib
import System

n = 20
ghenv.Component.Name = "Livestock Update"
ghenv.Component.NickName = "Update"
ghenv.Component.Message = "VER 0.0.1 | May 2017"
ghenv.Component.IconDisplayMode = ghenv.Component.IconDisplayMode.application
ghenv.Component.Category = "Livestock"
ghenv.Component.SubCategory = "0 | Miscellaneous"
ghenv.Component.Description = "Update Livestock"
	
#------------------------------------------------------------------------------#
# COMPONENT

def downloadSourceAndUnzip():
    """
    Download the source code from github and unzip it in temp folder
    """

    url = "https://github.com/ocni-dtu/livestock_gh/archive/master.zip"
    targetDirectory = r'C:\livestock'

    # download the zip file
    print("Downloading the source code...")
    zipFile = os.path.join(targetDirectory, os.path.basename(url))
    
    # if the source file is just downloded then just use the available file
    if os.path.isfile(zipFile) and time.time() - os.stat(zipFile).st_mtime < 1000:
        download = False
    else:
        download = True

        # remove the old version
        try:
            shutil.rmtree(targetDirectory)
        except:
            pass

    # create the target directory
    if not os.path.isdir(targetDirectory): os.mkdir(targetDirectory)

    if download:
        try:
            client = System.Net.WebClient()
            client.DownloadFile(url, zipFile)
            if not os.path.isfile(zipFile):
                print("Download failed! Try to download and unzip the file manually form:\n" + url)
                return
        except Exception, e:
            print(`e` + "\nDownload failed! Try to download and unzip the file manually form:\n" + url)
            return

    # unzip the file
    with zipfile.ZipFile(zipFile) as zf:
        for f in zf.namelist():
            folder = f.replace('livestock_gh-master/','C:/livestock/')
            if f.endswith('/'):
                try:
                    os.makedirs(folder)
                    os.makedirs(f)
                except:
                    pass
            else:
                zf.extract(f, targetDirectory)
                file = f.replace('livestock_gh-master/','C:/livestock/')
                shutil.move('C:/livestock/'+f,file)
                
    shutil.rmtree('C:/livestock/livestock_gh-master')
    
    # Create SSH folder
    if not os.path.isdir('C:/livestock/python/ssh'):
        os.mkdir('C:/livestock/python/ssh')
    
    #Move GH components
    userObjectsFolder = os.getenv('APPDATA') + '/Grasshopper/UserObjects/'
    componentsFolder = 'C:/livestock/grasshopper/components/'
    for obj in os.listdir(componentsFolder):
        shutil.move(componentsFolder+obj,userObjectsFolder+obj)
    shutil.rmtree('C:/livestock/grasshopper')
    
    return True

    
#------------------------------------------------------------------------------#
# OUTPUTS

if Update:
    downloadSourceAndUnzip()
    print('Download done')
# ---------- end update ----------

panel = Panel("C:\Users\Christian\Dropbox\Uddannelse\DTU\Diverse\EPW_WeatherData\New York\USA_NY_New.York-J.F.Kennedy.Intl.AP.744860_TMY3.epw")

# ----
# Rotation
number_slider = Slider(43, range=0..360)
rad = Radians(Degrees=number_slider)

# ----
# Import of weather data
importepw = Ladybug_ImportEpw(epwFile=panel)  # -> readMe, latitude, location, dryBulbTemperature, dewPointTemperature, relativeHumidity, windSpeed, windDirection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; plug-in component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
separatedata = Ladybug_SeparateData(inputList=flatten(importepw.dryBulbTemperature))  # -> numbers, strings; plug-in component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
separatedata_2 = Ladybug_SeparateData(inputList=flatten(importepw.windSpeed))  # -> numbers, strings; plug-in component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
separatedata_3 = Ladybug_SeparateData(inputList=flatten(importepw.windDirection))  # -> numbers, strings; plug-in component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
separatedata_4 = Ladybug_SeparateData(inputList=flatten(importepw.liquidPrecipitationDepth))  # -> numbers, strings; plug-in component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

# ----
# Modified geometry
rotate = Rotate(Geometry=canopy, Angle=rad, Plane=PlaneXY(0, 0, 0))  # -> Geometry, Transform
rotate_2 = Rotate(Geometry=building, Angle=rad, Plane=PlaneXY(0, 0, 0))  # -> Geometry, Transform
debrep = DeconstructBrep(Brep=rotate_2.Geometry)  # -> Faces, Edges, Vertices
wires = BrepWireframe(Brep=[rotate_2.Geometry, rotate.Geometry], Density=-1)
item = ListItem(List=debrep.Faces, Index=Slider(3, range=0..5), Wrap=True)

# ----
# Preview
swatch = ColourSwatch(SwatchColor=RGB(0, 0, 0))
preview = CustomPreview(Geometry=wires, Shader=swatch)
preview_2 = CustomPreview(Geometry=rotate.Geometry, Shader=ColourSwatch(SwatchColor=RGBA(201, 36, 36, 142)))

number_slider_2 = Slider(1000, range=0..8760)

# ----
# Test points and mesh
number_slider_3 = Slider(0, range=0..2)
gentestpts = Honeybee_GenerateTestPoints(testGeometry=item, gridSize=Slider(1, range=0..2), distBaseSrf=number_slider_3, moveTestMesh=Toggle(False))  # -> readMe, simplify(testPoints), simplify(ptsVectors), simplify(facesArea), simplify(mesh); plug-in component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

merge = Merge(Data1=Slider(0.5, range=0..0.5), Data2=Slider(0, range=0..0.5))
split = SplitList(List=separatedata_4.numbers, Index=number_slider_2)  # -> ListA, ListB
split_2 = SplitList(List=separatedata_3.numbers, Index=number_slider_2)  # -> ListA, ListB
split_3 = SplitList(List=separatedata_2.numbers, Index=number_slider_2)  # -> ListA, ListB
split_4 = SplitList(List=separatedata.numbers, Index=number_slider_2)  # -> ListA, ListB

# ----
# Calulate driving rain
toggle = BooleanToggle(False)
hits = CalculateHits(
    Precipitation=separatedata_4.numbers,
    Wind_direction=separatedata_3.numbers,
    Wind_speed=separatedata_2.numbers,
    Surfaces=item,
    Obstacles=rotate.Geometry,
    Test_points=gentestpts.testPoints,
    Run=toggle)  # -> Readme, Vectors, Hits; inputs Precipitation: list, Wind_direction: list, Wind_speed: list, Surfaces: list, Obstacles: list, Test_points: list
# ---------- hits: Python ----------
# Calculate Hits (Hits)

# @license GPL-3.0+ <http://spdx.org/licenses/GPL-3.0+>


"""
Use this component to calculate the view vectors for a surface.
The component takes in hourly weather datasets and calculates the view vector of the surface(s) in question.
The view vector is used to determine if, and what hour of the year, the test point is hit by rain. 
The calculatin method is based on the paper: 
Ennis, B. J., & Litster, J. D. (1997). A Study of Driving Rain. Knowledge Creation Diffusion Utilization, 20–54.
-
Provided by Livestock 0.1, made by Christian Kongsgaard. 

    
    Args:
        Precipitation: Precipitation rate in mm/h. Import from e.g. epw data
        Wind_speed: Hourly wind speed in m/s
        Wind_direction: Hourly wind direction. 0° = North, 90° = East
        Surfaces: NURB surface which is under investigation
        Obstacles: Canopy or other buildings that "shades" the investigated surface(s)
        Test_points: Test points on surface. Can be created by Honeybee_Generate Test Points
        Run: Set boolean to True to run the simulation
    Returns:
        Readme!: In case of any errors, it will be shown here
        Vectors: Vector for every hour of the year, that is the reversed vector of the incoming rain.
        Hits: Returns hourly results for each calculation point
"""

ghenv.Component.Name = "Calculate Hits"
ghenv.Component.NickName = 'Hits'
ghenv.Component.Message = 'VER 0.0.1\nFEB_2016'
ghenv.Component.IconDisplayMode = ghenv.Component.IconDisplayMode.application
ghenv.Component.Category = "Livestock"
ghenv.Component.SubCategory = "1 | Water"

###

import ghpythonlib.components as ghcomp
import ghpythonlib.parallel
import rhinoscriptsyntax as rs
import math

#Help functions
def rotate_xy(angle):
    return rs.XformRotation2(angle,[0,0,1],[0,0,0])
    
def rotate_yz(angle):
    return rs.XformRotation2(angle,[1,0,0],[0,0,0])

def make_lines(points,vectors):
    return ghcomp.LineSDL(points,vectors,1).line
    
def make_ray(point,vector,obstacles):
    x=rs.ShootRay(obstacles,point,vector,1)
    if x:
        return True
    else:
        return False

def rain_vector(Vw,Regn):
    #Rain drop radius:
    A=1.3
    p=0.232
    n=2.25
    if Regn == 0:
        return 0
    
    def f_a(I):
        return A*I**p

    a=f_a(Regn)
    r=a*math.exp(math.log(-math.log(0.5))/n)/1000
    
    #Angle:
    rho_L=1.2
    rho_w=1000
    g=9.81
    c=0.3

    alpha = math.acos((3*c*rho_L*Vw**2*r**2)/math.sqrt(r**4*(9*Vw**4*c**2*rho_L**2+64*g**2*r**2*rho_w**2)))
    return alpha

#Function that transforms nestings of lists or tuples to a Grasshopper DataTree
def list_to_tree(input, none_and_holes=True, source=[0]):
    from Grasshopper import DataTree as Tree
    from Grasshopper.Kernel.Data import GH_Path as Path
    from System import Array
    def proc(input,tree,track):
        path = Path(Array[int](track))
        if len(input) == 0 and none_and_holes: tree.EnsurePath(path); return
        for i,item in enumerate(input):
            if hasattr(item, '__iter__'): #if list or tuple
                track.append(i); proc(item,tree,track); track.pop()
            else:
                if none_and_holes: tree.Insert(item,path,i)
                elif item is not None: tree.Add(item,path)
    if input is not None: t=Tree[object]();proc(input,t,source[:]);return t


#Final function
if Run:
    i=0
    result=[]
    dv_hourly=[]
    while i<len(Precipitation):
        dv=[]
        
        #Rotate vectors towards the sky
        R_v=rain_vector(Wind_speed[i],Precipitation[i])
        towards_sky=rotate_yz(math.degrees(R_v))

        #Rotate vectors towards the wind
        w_d= -Wind_direction[i]
        towards_wind=rotate_xy(w_d)

        #Combine:
        transformation = rs.XformMultiply(towards_wind,towards_sky)
        north_vector=rs.VectorCreate(rs.AddPoint(0,0,0),rs.AddPoint(0,-1,0))
        direction_vector=rs.VectorTransform(north_vector,transformation)
        dv+=[direction_vector]
        
        hourly_result=[]
        for p in Test_points:
            ray=make_ray(p,direction_vector,Obstacles)
            hourly_result+=[ray]
        
        dv_hourly+=[dv]
        result+=[hourly_result]
        i+=1
    
    #Outputs:
    Hits = result
    Vectors = list_to_tree(dv_hourly)
# ---------- end hits ----------
wdr = WindDrivenRainSimulation(
    Precipitation=separatedata_4.numbers,
    Wind_direction=separatedata_3.numbers,
    Wind_speed=separatedata_2.numbers,
    Hits=hits.Hits,
    Temperature=separatedata.numbers,
    Wall_Orientation=number_slider,
    K_rain_miss=Slider(0.3, range=0..0.5),
    K_rain_hit=Slider(0, range=0..0.5),
    Run=Toggle(False))  # -> Readme, Driving_Rain; inputs Precipitation: list, Wind_direction: list, Wind_speed: list, Hits: list, Temperature: list
# ---------- wdr: Python ----------
# Wind Driven Rain (WDR)

# @license GPL-3.0+ <http://spdx.org/licenses/GPL-3.0+>


"""
Use this component to calculate the wind driven rain on a surface.
The component takes in hourly weather datasets and calculates the corresponding hourly wind driven rain on the surface(s) in question.
Note that the simulation doesn't take water runoff into account i.e. the result can be considered as the rain load on the surface. 
The simulation method is similar to that of Delphin and are based on the paper: 
Ennis, B. J., & Litster, J. D. (1997). A Study of Driving Rain. Knowledge Creation Diffusion Utilization, 20–54.
-
Provided by Livestock 0.1, made by Christian Kongsgaard. 

    
    Args:
        Precipitation: Precipitation rate in mm/h. Import from e.g. epw data
        Wind_direction: Hourly wind direction. 0° = North, 90° = East
        Wind_speed: Hourly wind speed in m/s
        Hits: Import result from Livestock | Calculate Hits
        Temperature: Hourly temperature values in °C. Import from e.g. epw data
        Wall_Orientation: Oriention of the surface normal. 0° = North, 90° = West
        K_rain_miss: K_rain in case the view vectors don't hit an obstruction
        K_rain_hit: K_rain in case the view vectors hit an obstruction 
        Run: Set boolean to True to run the simulation
    Returns:
        Readme!: In case of any errors, it will be shown here
        Driving_Rain: Returns hourly results for each calculation point in mm/h
"""

ghenv.Component.Name = "Wind Driven Rain Simulation"
ghenv.Component.NickName = 'WDR'
ghenv.Component.Message = 'VER 0.0.1\nFEB_2016'
ghenv.Component.IconDisplayMode = ghenv.Component.IconDisplayMode.application
ghenv.Component.Category = "Livestock"
ghenv.Component.SubCategory = "1 | Water"

###

import math


def J_regn_normal(Beta,J_rain,V_wind,Hits,T,Angle):
    
    #Correction of wind direction
    def B_wind(direction):
        c=360-(Angle+90)
        print(c)
        a=abs(c-direction)
        if a<180:
            b=a
        else:
            b=360-a
        return math.radians(b)

    result=[]
    i=0
    while i < len(Beta):
        sub_result=[]
        
        #Check the wind direction
        B=B_wind(Beta[i])
        if B>math.pi/2:
            sub_result=[0]*len(Hits[i])
            
        #Check the temperature:
        elif T[i]<=-2:
            sub_result=[0]*len(Hits[i])
            
        #Check the wind speed:
        elif V_wind[i]<=0:
            sub_result=[0]*len(Hits[i])
            
        #Check to see if it rains:
        elif J_rain[i]<=0:
            sub_result=[0]*len(Hits[i])
        
        else:
            K_wind=math.cos(B)/math.sqrt(1+1142*(math.sqrt(J_rain[i])/V_wind[i]**4))*math.exp(-12/(V_wind[i]*5*J_rain[i]**(0.25)))
            for j in Hits[i]:
                if j == False:
                    K_rain=K_rain_miss
                else:
                    K_rain=K_rain_hit
                
                sub_result+=[K_wind*K_rain*J_rain[i]]

        result+=[sub_result]
        i+=1
    return result

#Function that transforms nestings of lists or tuples to a Grasshopper DataTree
def list_to_tree(input, none_and_holes=True, source=[0]):
    from Grasshopper import DataTree as Tree
    from Grasshopper.Kernel.Data import GH_Path as Path
    from System import Array
    def proc(input,tree,track):
        path = Path(Array[int](track))
        if len(input) == 0 and none_and_holes: tree.EnsurePath(path); return
        for i,item in enumerate(input):
            if hasattr(item, '__iter__'): #if list or tuple
                track.append(i); proc(item,tree,track); track.pop()
            else:
                if none_and_holes: tree.Insert(item,path,i)
                elif item is not None: tree.Add(item,path)
    if input is not None: t=Tree[object]();proc(input,t,source[:]);return t
    
#Output:
if Run:
    Driving_Rain = list_to_tree(J_regn_normal(Wind_direction,Precipitation,Wind_speed,Hits,Temperature,Wall_Orientation))
# ---------- end wdr ----------

simple_rain = LivestockSimpleRain(
    Precipitation=split.ListA,
    WindDirection=split_2.ListA,
    WindSpeed=split_3.ListA,
    Obstacles=flatten(rotate.Geometry),
    Temperature=split_4.ListA,
    KFactors=merge,
    TestPoints=gentestpts.testPoints,
    TestVectors=gentestpts.ptsVectors,
    CPUs=Slider(3, range=1..4),
    Run=Toggle(False))  # -> Readme, Vectors, Hits, DrivingRain; inputs Precipitation: list, WindDirection: list, WindSpeed: list, Obstacles: list, Temperature: list, KFactors: list, TestPoints: list of Point3d, TestVectors: list, CPUs: Int32
# ---------- simple_rain: Python ----------
"""
    Args:
        Precipitation: Precipitation rate in mm/h. Import from e.g. epw data
        Wind_speed: Hourly wind speed in m/s
        Wind_direction: Hourly wind direction. 0° = North, 90° = East
        Surfaces: NURB surface which is under investigation
        Obstacles: Canopy or other buildings that "shades" the investigated surface(s)
        Test_points: Test points on surface. Can be created by Honeybee_Generate Test Points
        Run: Set boolean to True to run the simulation
    Returns:
        Readme!: In case of any errors, it will be shown here
        Vectors: Vector for every hour of the year, that is the reversed vector of the incoming rain.
        Hits: Returns hourly results for each calculation point
"""

#------------------------------------------------------------------------------#
# IMPORTS

import sys
sys.path.insert(0, r'C:\livestock\python\classes')
import LivestockGH as ls
from RainClasses import simpleRain
import Rhino as rc
import os
import scriptcontext as sc

n = 21
ghenv.Component.Name = ls.ComponentData[n][0]
ghenv.Component.NickName = ls.ComponentData[n][1]
ghenv.Component.Message = ls.ComponentData[n][2]
ghenv.Component.IconDisplayMode = ghenv.Component.IconDisplayMode.application
ghenv.Component.Category = ls.ComponentData[n][3]
ghenv.Component.SubCategory = ls.ComponentData[n][4]
ghenv.Component.Description = ls.ComponentData[n][5]
#ghenv.Component.Icon = ls.ComponentData[n][6]


#------------------------------------------------------------------------------#
# COMPONENT

# A failed attampt to use mesh instead of brep so the component could work with trimmed surfaces
if len(Obstacles) != 0:
    ## clean the geometry and bring them to rhinoCommon separated as mesh and Brep
    contextMesh, contextBrep = ls.cleanAndCoerceList(Obstacles)
    ## mesh Brep
    contextMeshedBrep = ls.parallel_makeContextMesh(contextBrep)

    ## Flatten the list of surfaces
    contextMeshedBrep = ls.flattenList(contextMeshedBrep)
    contextSrfs = contextMesh + contextMeshedBrep
    joinedContext = ls.joinMesh(contextSrfs)

    # Get rid of trimmed parts
    Obstacles = rc.Geometry.Brep.CreateFromMesh(joinedContext, False)


        
#------------------------------------------------------------------------------#
# OUTPUTS

if Run:
    rain = simpleRain(CPUs, Precipitation, WindSpeed, WindDirection,  TestPoints, TestVectors, Obstacles, Temperature, KFactors)
    rain.computeAngles()
    rain.rainHits()
    Vectors = rain.dirVec
    Hits = ls.list_to_tree(rain.hourlyResult)
    DrivingRain = ls.list_to_tree(rain.wdr)
# ---------- end simple_rain ----------
clean = CleanTree(RemoveNulls=True, RemoveInvalid=True, RemoveEmpty=False, Tree=simple_rain.Vectors)
vdisex = VectorDisplayEx(Point=graft(gentestpts.testPoints), Vector=clean, Colour=RGB(0, 0, 0), Width=2)  # disabled
panel_2 = Panel(hits.Vectors)

# ----
# Yearly values
# Max and Min
flip = FlipMatrix(Data=simple_rain.DrivingRain)
ma = MassAddition(Input=flip)  # -> flatten(Result), PartialResults
bnd = Bounds(Numbers=ma.Result)
panel_3 = Panel(bnd)

# ----
# Visualize result
number_slider_4 = Slider(15, range=0..21)
gradientlibrary = Ladybug_GradientLibrary(gradIndex=number_slider_4)  # -> customColors; plug-in component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
legendpar = Ladybug_LegendParameters(customColors=flatten(gradientlibrary))  # -> legendPar; plug-in component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
recolormesh = Ladybug_RecolorMesh(
    analysisResult=ma.Result,
    inputMesh=gentestpts.mesh,
    legendPar=legendpar,
    analysisTitle="Wind Driven Rain",
    legendTitle="mm/year")  # -> readMe, newMesh, newLegend, legendBasePt, meshColors, legendColors; plug-in component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
preview_3 = CustomPreview(Geometry=recolormesh.newMesh, Shader=recolormesh.meshColors)

origin_planes = OriginPlanes(B=item, P=recolormesh.legendBasePt, B_2=Slider(-8, range=-10..10), B_3=Slider(-10.5, range=-20..0))  # -> pl_2, P_2
orient = Orient(Geometry=recolormesh.newLegend, Source=origin_planes.P_2, Target=origin_planes.pl_2)  # -> Geometry, Transform
preview_4 = CustomPreview(Geometry=orient.Geometry, Shader=ColourSwatch(SwatchColor=RGB(0, 0, 0)))

# ==== cluster Canopy
B = ClusterInput()
B_2 = ClusterInput()
pt = Point(Point(-7.41547637, 0, 6.542180394))
pdecon = Deconstruct(Point=pt)  # -> XComponent, YComponent, ZComponent
addition = Addition(A=pdecon.XComponent, B=B)
addition_2 = Addition(A=pdecon.YComponent, B=B_2)
pt_2 = ConstructPoint(XCoordinate=addition, YCoordinate=0, ZCoordinate=pdecon.ZComponent)
pt_3 = ConstructPoint(XCoordinate=0, YCoordinate=addition_2, ZCoordinate=pdecon.ZComponent)
rec_3pt = Rectangle3Pt(PointA=pt, PointB=pt_2, PointC=pt_3)  # -> Rectangle, Length
boundary = BoundarySurfaces(Edges=rec_3pt.Rectangle)
S = ClusterOutput(boundary)

# ==== cluster OriginPlanes
B = ClusterInput()
debrep = DeconstructBrep(Brep=B)  # -> Faces, Edges, Vertices
item = ListItem(List=debrep.Vertices, Index=Slider(0, range=0..3), Wrap=True)
item_2 = ListItem(List=debrep.Vertices, Index=Slider(2, range=0..3), Wrap=True)
vec2pt = Vector2Pt(PointA=item_2, PointB=item, Unitize=False)  # -> Vector, Length
Z = UnitZ(Factor=1)
P = ClusterInput()
pl = ConstructPlane(Origin=Point(0, 0, 0), XAxis=vec2pt.Vector, YAxis=Z)
B_2 = ClusterInput()
B_3 = ClusterInput()
pdecon = Deconstruct(Point=P)  # -> XComponent, YComponent, ZComponent
pl_2 = ClusterOutput(pl)
addition = Addition(A=pdecon.XComponent, B=B_2)
addition_2 = Addition(A=pdecon.XComponent, B=B_3)
pt = ConstructPoint(XCoordinate=addition, YCoordinate=addition_2, ZCoordinate=0)
xy = XYPlane(Origin=pt)
P_2 = ClusterOutput(xy)
