# Grasshopper definition Regnværktøj v0.0.1_Kristoffer.gh (Grasshopper 0.9.76)
# plug-ins: Python Interpreter

# ----
# Initial geometry
X = Slider(13, range=1..20)
Y = Slider(2.6, range=1..10)
canopy = Canopy(B=X, B_2=Y)  # disabled
building = Brep(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)

open_weather_file = Ladybug_OpenEPWWeatherFile(open=Toggle(True))  # -> epwFile; plug-in component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

honeybee = Honeybee_Honeybee()  # -> Vviiiiiiiiiizzz; plug-in component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
ladybug = Ladybug_Ladybug()  # -> Vviiiiiiiiiizzz; plug-in component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

# ----
# Rotation
number_slider = Slider(50, range=0..360)
rad = Radians(Degrees=number_slider)

# ----
# Import of weather data
importepw = Ladybug_ImportEpw(epwFile=open_weather_file)  # -> readMe, latitude, location, dryBulbTemperature, dewPointTemperature, relativeHumidity, windSpeed, windDirection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; plug-in component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
separatedata = Ladybug_SeparateData(inputList=flatten(importepw.dryBulbTemperature))  # -> numbers, strings; plug-in component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
separatedata_2 = Ladybug_SeparateData(inputList=flatten(importepw.windSpeed))  # -> numbers, strings; plug-in component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
separatedata_3 = Ladybug_SeparateData(inputList=flatten(importepw.windDirection))  # -> numbers, strings; plug-in component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
separatedata_4 = Ladybug_SeparateData(inputList=flatten(importepw.liquidPrecipitationDepth))  # -> numbers, strings; plug-in component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

# ----
# Compare with wind data
number_slider_2 = Slider(0, range=-15..15)
pt = ConstructPoint(XCoordinate=Slider(25, range=-25..25), YCoordinate=number_slider_2, ZCoordinate=0)
windrose = Ladybug_WindRose(
    north=0,
    hourlyWindDirection=importepw.windDirection,
    hourlyWindSpeed=importepw.windSpeed,
    centerPoint=pt,
    scale=Slider(0.1, range=0..1),
    runIt=Toggle(False))  # -> readMe, calmRoseMesh, windRoseMesh, windRoseCrvs, windRoseCenPts, legend, legendBasePts, title; plug-in component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

yz = YZPlane(Origin=Point(0, 0, 0))

# ----
# Modified geometry
rotate = Rotate(Geometry=canopy, Angle=rad, Plane=PlaneXY(0, 0, 0))  # -> Geometry, Transform; disabled
rotate_2 = Rotate(Geometry=building, Angle=rad, Plane=yz)  # -> Geometry, Transform
debrep = DeconstructBrep(Brep=rotate_2.Geometry)  # -> Faces, Edges, Vertices
wires = BrepWireframe(Brep=[rotate_2.Geometry, rotate.Geometry], Density=-1)
item = ListItem(List=debrep.Faces, Index=Slider(3, range=0..5), Wrap=True)

number_slider_3 = Slider(10, range=0..10)
number_slider_4 = Slider(0, range=0..360)
number_slider_5 = Slider(1, range=0..1)
brep = Brep(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)
Y_2 = UnitY(Factor=Slider(9, range=5..20))
move = Move(Geometry=brep, Motion=Y_2)  # -> Geometry, Transform

# ----
# Preview
swatch = ColourSwatch(SwatchColor=RGB(0, 0, 0))
preview = CustomPreview(Geometry=wires, Shader=swatch)
preview_2 = CustomPreview(Geometry=move.Geometry, Shader=ColourSwatch(SwatchColor=RGBA(201, 36, 36, 142)))

# ----
# Test points and mesh
number_slider_6 = Slider(0, range=0..2)
gentestpts = Honeybee_GenerateTestPoints(testGeometry=item, gridSize=Slider(1.5, range=0..2), distBaseSrf=number_slider_6, moveTestMesh=Toggle(False))  # -> readMe, simplify(testPoints), simplify(ptsVectors), simplify(facesArea), simplify(mesh); plug-in component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

srf = Surface(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)

# ----
# Calulate driving rain
toggle = BooleanToggle(True)
hits = CalculateHits(
    Precipitation=number_slider_5,
    Wind_direction=number_slider_4,
    Wind_speed=number_slider_3,
    Surfaces=gentestpts.mesh,
    Obstacles=brep,
    Test_points=gentestpts.testPoints,
    Run=toggle)  # -> Readme, Wall_Orientation, Hits; inputs Precipitation: list, Wind_direction: list, Wind_speed: list, Surfaces: list, Obstacles: list, Test_points: list
# ---------- hits: Python ----------
# Calculate Hits (Hits)

# @license GPL-3.0+ <http://spdx.org/licenses/GPL-3.0+>


"""
Use this component to calculate the view vectors for a surface.
The component takes in hourly weather datasets and calculates the view vector of the surface(s) in question.
The view vector is used to determine if, and what hour of the year, the test point is hit by rain. 
The calculatin method is based on the paper: 
Ennis, B. J., & Litster, J. D. (1997). A Study of Driving Rain. Knowledge Creation Diffusion Utilization, 20–54.
-
Provided by Livestock 0.1, made by Christian Kongsgaard. 

    
    Args:
        Precipitation: Precipitation rate in mm/h. Import from e.g. epw data
        Wind_speed: Hourly wind speed in m/s
        Wind_direction: Hourly wind direction. 0° = North, 90° = East
        Surfaces: NURB surface which is under investigation
        Obstacles: Canopy or other buildings that "shades" the investigated surface(s)
        Test_points: Test points on surface. Can be created by Honeybee_Generate Test Points
        Run: Set boolean to True to run the simulation
    Returns:
        Readme!: In case of any errors, it will be shown here
        Wall_Orientation: Generates an output that should be plugged into the Wall_Orientation in the WDR component. 
        Hits: Returns hourly results for each calculation point
"""

ghenv.Component.Name = "Calculate Hits"
ghenv.Component.NickName = 'Hits'
ghenv.Component.Message = 'VER 0.0.1\nFEB_2016'
ghenv.Component.IconDisplayMode = ghenv.Component.IconDisplayMode.application
ghenv.Component.Category = "Livestock"
ghenv.Component.SubCategory = "1 | Water"

###

import ghpythonlib.components as ghcomp
import ghpythonlib.parallel
import rhinoscriptsyntax as rs
import math

#Help functions
def rotate_xy(angle):
    return rs.XformRotation2(angle,[0,0,1],[0,0,0])
    
def rotate_yz(angle):
    return rs.XformRotation2(angle,[1,0,0],[0,0,0])

def make_lines(points,vectors):
    return ghcomp.LineSDL(points,vectors,1).line
    
def make_ray(point,vector,obstacles):
    x=rs.ShootRay(obstacles,point,vector,1)
    if x:
        return True
    else:
        return False

def rain_vector(Vw,Regn):
    #Rain drop radius:
    A=1.3
    p=0.232
    n=2.25
    if Regn == 0:
        return 0
    
    def f_a(I):
        return A*I**p

    a=f_a(Regn)
    r=a*math.exp(math.log(-math.log(0.5))/n)/1000
    
    #Angle:
    rho_L=1.2
    rho_w=1000
    g=9.81
    c=0.3

    alpha = math.acos((3*c*rho_L*Vw**2*r**2)/math.sqrt(r**4*(9*Vw**4*c**2*rho_L**2+64*g**2*r**2*rho_w**2)))
    return alpha

def Wall_Or(surface):
    SN=rs.MeshFaceNormals(surface)
    XYN=[0,0,1]
    YZN=[1,0,0]
    
    angle_to_XY=[]
    angle_to_YZ=[]
    
    for n in SN:
        a1 = math.degrees(math.asin(math.cos(math.radians(rs.VectorAngle(n,XYN)))))
        a2 = math.degrees(math.asin(math.cos(math.radians(rs.VectorAngle(n,YZN)))))

#Vertital orientation. Vertical = 90°, Horizotal = 0° and 270°
        if n[1]==0 and n[2]==0:
            b2=90
            
        elif n[1]==0:
            b2=90

        elif n[2]==0:
            if n[1]<0:
                b2=180
            elif n[1]>0:
                b2=0

        elif n[1]<0:
            b2=180-a2

        elif n[1]>0:
            b2=a2

        else:
            print('Error in angle calculations')

#Horizontal orientation. North = 0°, West = 90°
        if n[0]==0 and n[1]==0:
            b1=None
            
        elif n[0]==0:
            if n[1]<0:
                b1=180
            elif n[1]>0:
                b1=0

        elif n[1]==0:
            if n[0]<0:
                b1=90
            elif n[0]>0:
                b1=270

        elif n[0]<0:
            if n[1]<0:
                b1=180+a1
            elif n[1]>0:
                b1=360-a1

        elif n[0]>0:
            if n[1]<0:
                b1=180-a1
            elif n[1]>0:
                b1=a1

        else:
            print('Error in angle calculations')

        angle_to_XY+=[b1]
        angle_to_YZ+=[b2]
    print(angle_to_XY)
    print(angle_to_YZ)
    return (angle_to_XY,angle_to_YZ)



#Final function
def Calculate_hits(args):
    precipitation,wind_speed,wind_direction, surface, obstacles,test_points = args
    i=0
    result=[]

    while i<len(precipitation):
        
        #Rotate vectors towards the sky
        R_v=rain_vector(Wind_speed[i],Precipitation[i])
        towards_sky=rotate_yz(math.degrees(R_v))

        #Rotate vectors towards the wind
        w_d= -Wind_direction[i]
        towards_wind=rotate_xy(w_d)

        #Combine:
        transformation = rs.XformMultiply(towards_wind,towards_sky)
        north_vector=rs.VectorCreate(rs.AddPoint(0,0,0),rs.AddPoint(0,-1,0))
        direction_vector=rs.VectorTransform(north_vector,transformation)
        
        hourly_result=[]
        for p in test_points:
            ray=make_ray(p,direction_vector,obstacles)
            hourly_result+=[ray]

        result+=[hourly_result]
        i+=1
    return result

#Output
items = (Precipitation,Wind_speed,Wind_direction, Surfaces, Obstacles,Test_points)
if Run:
    Hits = Calculate_hits(items)
    Wall_Orientation=Wall_Or(Surfaces)
# ---------- end hits ----------
wdr = WindDrivenRainSimulation(
    Precipitation=number_slider_5,
    Wind_direction=number_slider_4,
    Wind_speed=number_slider_3,
    Hits=hits.Hits,
    Temperature=Slider(10, range=0..10),
    Wall_Orientation=hits.Wall_Orientation,
    K_rain_miss=Slider(0.3, range=0..0.5),
    K_rain_hit=Slider(0, range=0..0.5),
    Run=Toggle(True))  # -> Readme, Driving_Rain; inputs Precipitation: list, Wind_direction: list, Wind_speed: list, Hits: list, Temperature: list, Wall_Orientation: list
# ---------- wdr: Python ----------
# Wind Driven Rain (WDR)

# @license GPL-3.0+ <http://spdx.org/licenses/GPL-3.0+>


"""
Use this component to calculate the wind driven rain on a surface.
The component takes in hourly weather datasets and calculates the corresponding hourly wind driven rain on the surface(s) in question.
Note that the simulation doesn't take water runoff into account i.e. the result can be considered as the rain load on the surface. 
The simulation method is similar to that of Delphin and are based on the paper: 
Ennis, B. J., & Litster, J. D. (1997). A Study of Driving Rain. Knowledge Creation Diffusion Utilization, 20–54.
-
Provided by Livestock 0.1, made by Christian Kongsgaard. 

    
    Args:
        Precipitation: Precipitation rate in mm/h. Import from e.g. epw data
        Wind_direction: Hourly wind direction. 0° = North, 90° = East
        Wind_speed: Hourly wind speed in m/s
        Hits: Import result from Livestock | Calculate Hits
        Temperature: Hourly temperature values in °C. Import from e.g. epw data
        Wall_Orientation: Plug in the Wall_Orientation output from the Hits component here.
        K_rain_miss: K_rain in case the view vectors don't hit an obstruction
        K_rain_hit: K_rain in case the view vectors hit an obstruction 
        Run: Set boolean to True to run the simulation
    Returns:
        Readme!: In case of any errors, it will be shown here
        Driving_Rain: Returns hourly results for each calculation point in mm/h
"""

ghenv.Component.Name = "Wind Driven Rain Simulation"
ghenv.Component.NickName = 'WDR'
ghenv.Component.Message = 'VER 0.0.1\nFEB_2016'
ghenv.Component.IconDisplayMode = ghenv.Component.IconDisplayMode.application
ghenv.Component.Category = "Livestock"
ghenv.Component.SubCategory = "1 | Water"

###

import math
import rhinoscriptsyntax as rs


def J_regn_normal(Beta,J_rain,V_wind,Hits,T,Orientation):
    Angle=Orientation[0]
    #Correction of wind direction
    def B_wind(direction):
        c=360-(Angle+90)
        #print(c)
        a=abs(c-direction)
        if a<180:
            b=a
        else:
            b=360-a
        
        #print('b: ', b)
        return math.radians(b)

    result=[]
    i=0
    while i < len(Beta):
        sub_result=[]
        B = B_wind(Beta[i])
        
        #Check the temperature:
        if T[i]<=-2:
            sub_result=[0]*len(Hits[i])
            
        #Check to see if it rains:
        elif J_rain[i]<=0:
            sub_result=[0]*len(Hits[i])
        
        elif not Orientation[1]:
            for k in Hits[i]:
                if k == False:
                    K_rain=K_rain_miss
                else: 
                    K_rain = K_rain_hit
                sub_result+=[K_rain*J_rain[i]]
        
        #Check the wind direction
        elif B > math.pi/2:
            sub_result=[0]*len(Hits[i])

        #Check the wind speed:
        elif V_wind[i]<=0:
            sub_result=[0]*len(Hits[i])
            
        elif Orientation[1]:
            K_wind=math.cos(B)/math.sqrt(1+1142*(math.sqrt(J_rain[i])/V_wind[i]**4))*math.exp(-12/(V_wind[i]*5*J_rain[i]**(0.25)))
            if Orientation[2]:
                c=1-abs(math.sin(math.radians(Orientation[1][1])))*K_wind
            elif not ang:
                c=K_wind
            else:
                c=1+(K_wind-1)*math.sin(math.radias(Orientation[1][1]))**2
                    
            for j in Hits[i]:
                if j == False:
                    K_rain=K_rain_miss
                else:
                    K_rain=K_rain_hit
                sub_result+=[c*K_rain*J_rain[i]]
                    
                
        else:
            K_wind=math.cos(B)/math.sqrt(1+1142*(math.sqrt(J_rain[i])/V_wind[i]**4))*math.exp(-12/(V_wind[i]*5*J_rain[i]**(0.25)))
            for j in Hits[i]:
                if j == False:
                    K_rain=K_rain_miss
                else:
                    K_rain=K_rain_hit
                
                sub_result+=[K_wind*K_rain*J_rain[i]]
        result+=[sub_result]
        i+=1
    return result

#Function that transforms nestings of lists or tuples to a Grasshopper DataTree
def list_to_tree(input, none_and_holes=True, source=[0]):
    from Grasshopper import DataTree as Tree
    from Grasshopper.Kernel.Data import GH_Path as Path
    from System import Array
    def proc(input,tree,track):
        path = Path(Array[int](track))
        if len(input) == 0 and none_and_holes: tree.EnsurePath(path); return
        for i,item in enumerate(input):
            if hasattr(item, '__iter__'): #if list or tuple
                track.append(i); proc(item,tree,track); track.pop()
            else:
                if none_and_holes: tree.Insert(item,path,i)
                elif item is not None: tree.Add(item,path)
    if input is not None: t=Tree[object]();proc(input,t,source[:]);return t
    
#Output:
if Run:
    Driving_Rain = list_to_tree(J_regn_normal(Wind_direction,Precipitation,Wind_speed,Hits,Temperature,Wall_Orientation))
# ---------- end wdr ----------

panel = Panel(hits.Wall_Orientation)
panel_2 = Panel(hits.Readme)

# ----
# Yearly values
# Max and Min
flip = FlipMatrix(Data=wdr.Driving_Rain)
ma = MassAddition(Input=flip)  # -> flatten(Result), PartialResults
bnd = Bounds(Numbers=ma.Result)
panel_3 = Panel(bnd)

# ----
# Visualize result
number_slider_7 = Slider(15, range=0..21)
gradientlibrary = Ladybug_GradientLibrary(gradIndex=number_slider_7)  # -> customColors; plug-in component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
legendpar = Ladybug_LegendParameters(customColors=flatten(gradientlibrary))  # -> legendPar; plug-in component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
recolormesh = Ladybug_RecolorMesh(
    analysisResult=ma.Result,
    inputMesh=gentestpts.mesh,
    legendPar=legendpar,
    analysisTitle="Wind Driven Rain",
    legendTitle="mm/year")  # -> readMe, newMesh, newLegend, legendBasePt, meshColors, legendColors; plug-in component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
preview_3 = CustomPreview(
    Geometry=recolormesh.newMesh,
    Shader={ambient=RGB(0, 0, 0), diffuse=RGB(255, 105, 180), emission=RGB(76, 32, 54), shine=0.5, specular=RGB(255, 255, 255), transparency=0})

origin_planes = OriginPlanes(B=srf, P=recolormesh.legendBasePt, B_2=Slider(-8, range=-10..10), B_3=Slider(-10.5, range=-20..0))  # -> pl_2, P_2
orient = Orient(Geometry=recolormesh.newLegend, Source=origin_planes.P_2, Target=origin_planes.pl_2)  # -> Geometry, Transform

# ==== cluster Canopy
B = ClusterInput()
B_2 = ClusterInput()
pt = Point(Point(-7.41547637, 0, 6.542180394))
pdecon = Deconstruct(Point=pt)  # -> XComponent, YComponent, ZComponent
addition = Addition(A=pdecon.XComponent, B=B)
addition_2 = Addition(A=pdecon.YComponent, B=B_2)
pt_2 = ConstructPoint(XCoordinate=addition, YCoordinate=0, ZCoordinate=pdecon.ZComponent)
pt_3 = ConstructPoint(XCoordinate=0, YCoordinate=addition_2, ZCoordinate=pdecon.ZComponent)
rec_3pt = Rectangle3Pt(PointA=pt, PointB=pt_2, PointC=pt_3)  # -> Rectangle, Length
boundary = BoundarySurfaces(Edges=rec_3pt.Rectangle)
S = ClusterOutput(boundary)

# ==== cluster OriginPlanes
B = ClusterInput()
debrep = DeconstructBrep(Brep=B)  # -> Faces, Edges, Vertices
item = ListItem(List=debrep.Vertices, Index=Slider(0, range=0..3), Wrap=True)
item_2 = ListItem(List=debrep.Vertices, Index=Slider(2, range=0..3), Wrap=True)
vec2pt = Vector2Pt(PointA=item_2, PointB=item, Unitize=False)  # -> Vector, Length
Z = UnitZ(Factor=1)
P = ClusterInput()
pl = ConstructPlane(Origin=Point(0, 0, 0), XAxis=vec2pt.Vector, YAxis=Z)
B_2 = ClusterInput()
B_3 = ClusterInput()
pdecon = Deconstruct(Point=P)  # -> XComponent, YComponent, ZComponent
pl_2 = ClusterOutput(pl)
addition = Addition(A=pdecon.XComponent, B=B_2)
addition_2 = Addition(A=pdecon.XComponent, B=B_3)
pt = ConstructPoint(XCoordinate=addition, YCoordinate=addition_2, ZCoordinate=0)
xy = XYPlane(Origin=pt)
P_2 = ClusterOutput(xy)
