# Grasshopper definition RemoteComputation.gh (Grasshopper 0.9.76)
# plug-ins: Python Interpreter

# skriv kodeord her
# skriv komando her (linux komando i det her tilfælde)
panel = Panel("C:\Program Files\Anaconda3\envs\livestock\python.exe")
# cd /mnt/c/Users/Christian/Desktop && mkdir test
# cd /mnt/c/Users/Christian/Desktop && python test.py
toggle = BooleanToggle(False)
# Første gang kør dette i Bash
# sudo service ssh --full-restart
toggle_2 = BooleanToggle(False)
python_executor = LivestockPythonExecutor(PythonPath=panel)  # -> out
# ---------- python_executor: Python ----------
#------------------------------------------------------------------------------#
# IMPORTS

import sys
sys.path.insert(0, r'C:\livestock\python\classes')
import LivestockGH as ls
import Rhino as rc
import scriptcontext as sc

n = 16
ghenv.Component.Name = ls.ComponentData[n][0]
ghenv.Component.NickName = ls.ComponentData[n][1]
ghenv.Component.Message = ls.ComponentData[n][2]
ghenv.Component.IconDisplayMode = ghenv.Component.IconDisplayMode.application
ghenv.Component.Category = ls.ComponentData[n][3]
ghenv.Component.SubCategory = ls.ComponentData[n][4]
ghenv.Component.Description = ls.ComponentData[n][5]
#ghenv.Component.Icon = dgh.ComponentData[n][6]

#------------------------------------------------------------------------------#
# COMPONENT

sc.sticky['PythonExe'] = PythonPath

#------------------------------------------------------------------------------#
# OUTPUTS

print('Python Executor is set to: ' + PythonPath)
# ---------- end python_executor ----------
ssh_connection = LivestockSSHConnection(IpAddress="127.0.0.1", Port="2222", Username="ocni")  # -> out
# ---------- ssh_connection: Python ----------
#------------------------------------------------------------------------------#
# IMPORTS

import sys
sys.path.insert(0, r'C:\livestock\python\classes')
import LivestockGH as ls
import Rhino as rc
import scriptcontext as sc
import subprocess

n = 17
ghenv.Component.Name = ls.ComponentData[n][0]
ghenv.Component.NickName = ls.ComponentData[n][1]
ghenv.Component.Message = ls.ComponentData[n][2]
ghenv.Component.IconDisplayMode = ghenv.Component.IconDisplayMode.application
ghenv.Component.Category = ls.ComponentData[n][3]
ghenv.Component.SubCategory = ls.ComponentData[n][4]
ghenv.Component.Description = ls.ComponentData[n][5]
#ghenv.Component.Icon = dgh.ComponentData[n][6]

#------------------------------------------------------------------------------#
# COMPONENT

sc.sticky['SSH'] = {'ip':IpAddress,'port':Port,'user':Username,'password':Password}

#------------------------------------------------------------------------------#
# OUTPUTS

print('SSH connection is set to:\nIP Address: ' + str(IpAddress) + '\nPort: ' + str(Port) + '\nUser: ' + Username)
# ---------- end ssh_connection ----------
test_ssh = PythonScript(Run=toggle_2)  # -> out
# ---------- test_ssh: Python ----------
#------------------------------------------------------------------------------#
# IMPORTS

import sys
sys.path.insert(0, r'C:\Users\Christian\Dropbox\Arbejde\DTU BYG\Livestock\Kode - Livestock\01 Python\Classes')
import LivestockGH as ls
import scriptcontext as sc
import subprocess
from shutil import copyfile
import os

ip = str(sc.sticky["SSH"]['ip'])
port = str(sc.sticky["SSH"]['port'])
user = str(sc.sticky["SSH"]['user'])
pw = str(sc.sticky["SSH"]['password'])
folder = r'C:\Users\Christian\Dropbox\Arbejde\DTU BYG\Livestock\Kode - Livestock\01 Python\Templates'
inData = 'InData'
py_template = folder + '\\SSHTemplate.py'
pyfile = folder + '\\sshrun.py'
py = sc.sticky['PythonExe']

if Run:
    ls.writeFile([ip,port,user,pw,x],folder,inData)
    copyfile(py_template,pyfile)
    temp = subprocess.Popen([py, pyfile])
    temp.wait()
    temp.kill()
    
    os.remove(folder + '\\' + inData+'.txt')
    os.remove(pyfile)
# ---------- end test_ssh ----------
panel_2 = Panel(test_ssh)
panel_3 = Panel(ssh_connection)
panel_4 = Panel(python_executor)
