# Grasshopper definition WaterFlow_01.gh (Grasshopper 0.9.76)
# Copyright: BIG IDEAS ©
# plug-ins: Python Interpreter

dom = ConstructDomain(DomainStart=Slider(2.1, range=0.1..2.1), DomainEnd=Slider(1.1, range=0.1..2.1))
range = Range(Domain=Domain(0, 1), Steps=10)
num = Number(range)
# BIG IDEAS
# 
# Kristoffer Negendahl
# 
# - Simulation Specialist – Civ Eng PhD
# - BIG - Kløverbladsgade 56 2500 Valby - Copenhagen
# - krne@big.dk
# - +45 26 70 45 50
crv = Curve(<curve referenced from the Rhino model>)
range_2 = Range(Domain=dom, Steps="22")
panel = Panel(range_2)
python = PythonScript(Zl="0.2", Zr="0.1", B=panel, d="1", S="0.01", n="0.013")  # -> out, Points, angle
# ---------- python: Python ----------
import math
import rhinoscriptsyntax as rc

###output degree angle of slope###
if S == 0:
    angle = 0
elif S == 1:
    angle = round(math.degrees(math.tanh(1/(1/S)+0.06)),1)
else:
    angle = round(math.degrees(math.tanh(1/(1/S))),1)
angle = str(angle) + " degrees"

###draw profile based on input###
P0 = rc.AddPoint(0,0,0)
P1 = rc.AddPoint(Zl,-d,0)
P2 = rc.AddPoint(Zl+B,-d,0)
P3 = rc.AddPoint(Zl+B+Zr,0,0)

PointsName = []
Points = []
for p in range(4):
    PointsName.append(str("P"+str(p))) #forloop
    Points.append(eval(PointsName[p]))

###convert to imp##
Zl 
Zr 
B = B*3.28084
d = d*3.28084
S
n
# ---------- end python ----------
# Flow in open channels
# Mannings equations
pframes = PerpFrames(Curve=crv, Count="22", Align=True)  # -> Frames, Parameters
pline = PolyLine(Vertices=python.Points, Closed=False)  # -> flatten(Polyline)
xy = XYPlane(Origin=Point(0, 0, 0))
flip = FlipCurve(Curve=pline)  # -> Curve, Flag
orient = Orient(Geometry=pline, Source=xy, Target=pframes.Frames)  # -> Geometry, Transform
loft = Loft(Curves=orient.Geometry, Options={Adjust=False, Closed=False, LoftEnds=0, LoftSimp=0, LoftType=0, Rebuild=10, Refit=0.01})
cluster = Cluster(channel_brep=loft, slices_crvs=orient.Geometry)
debrep = DeconstructBrep(Brep=loft)  # -> Faces, Edges, Vertices
S = Number(cluster)
partition = PartitionList(List=debrep.Faces, Size=3)
number_slider = Slider(0.04, range=0.01..0.05)

panel_2 = Panel(range_2)
panel_3 = Panel("0.01")
python_2 = PythonScript(Zl="0.2", Zr="0.1", B=panel_2, d="1", S=S, n="0.013")  # -> out, Wft, Q, angle
# ---------- python_2: Python ----------
import math
import rhinoscriptsyntax as rc

###output degree angle of slope###
if S == 0:
    angle = 0
elif S == 1:
    angle = round(math.degrees(math.tanh(1/(1/S)+0.06)),1)
else:
    angle = round(math.degrees(math.tanh(1/(1/S))),1)
angle = str(angle) + " degrees"


###convert to imp##
Zl 
Zr 
B = B*3.28084
d = d*3.28084
S
n


def SQRT(number):
    return math.sqrt(number)
def POW(numbers,power):
    return math.pow(numbers,power)


A = 1/2*Zl*math.pow(d,2) + 1/2*Zr*math.pow(d,2) + B*d
P = POW(Zl*Zl + 1,(1/2))*d + POW(Zr*Zr + 1,(1/2))*d + B
R = A/P
V = 1.486/n*(POW(R,(2/3))*POW(S,(1/2)))
T = B+Zl*d+Zr*d
Dm = A/T
sC =14.56*n*n*Dm/POW(R,(4/3))

Q = 0.743*SQRT(S)*Zl*d*d*POW(A/(POW(Zl*Zl + 1,0.5)*d + POW(Zr*Zr + 1,0.5)*d + B),(2/3))/n + 0.743*SQRT(S)*Zr*d*d*POW(A/(POW(Zl*Zl + 1,0.5)*d + POW(Zr*Zr + 1,0.5)*d + B),(2/3))/n + 1.486*B*SQRT(S)*d*POW(A/(POW(Zl*Zl + 1,0.5)*d + POW(Zr*Zr + 1,0.5)*d + B),(2/3))/n

Wft = S-sC 
print Wft
#print Q
# ---------- end python_2 ----------

bnd = Bounds(Numbers=python_2.Q)
dom_2 = ConstructDomain(DomainStart=0, DomainEnd=Slider(1, range=0..1))
panel_4 = Panel("0")
dedomain = DeconstructDomain(Domain=bnd)  # -> Start, End
cull_i = CullIndex(List=python_2.Q, Indices="0", Wrap=True)
gradient = Gradient(
    LowerLimit=dedomain.Start,
    UpperLimit=dedomain.End,
    Parameter=cull_i,
    stops=[0: RGB(255, 0, 0), 0.248: RGB(255, 200, 0), 0.499: RGB(255, 251, 0), 0.754: RGB(0, 171, 214), 1: RGB(4, 0, 214)])
panel_5 = Panel(python_2.Q)
cull_i_2 = CullIndex(List=orient.Geometry, Indices="0", Wrap=True)
preview = CustomPreview(Geometry=flatten(cull_i_2), Shader=gradient)

# ==== cluster Cluster
slices_crvs = ClusterInput()
channel_brep = ClusterInput()
slices_crvs_2 = Curve(slices_crvs)
channel_brep_2 = Brep(channel_brep)
curvepoint = PointOnCurve(slices_crvs_2, parameter=0.5)
pdecon = Deconstruct(Point=curvepoint)  # -> XComponent, YComponent, ZComponent
shift = ShiftList(List=curvepoint, Shift=1, Wrap=False)
cull_i = CullIndex(List=pdecon.ZComponent, Indices=-1, Wrap=True)
pdecon_2 = Deconstruct(Point=shift)  # -> XComponent, YComponent, ZComponent
pt = ConstructPoint(XCoordinate=pdecon_2.XComponent, YCoordinate=pdecon_2.YComponent, ZCoordinate=pdecon.ZComponent)
ln = Line(StartPoint=curvepoint, EndPoint=shift)
ln_2 = Line(StartPoint=pt, EndPoint=curvepoint)
angle = Angle(VectorA=ln, VectorB=ln_2)  # -> Angle, Reflex
line = LineSDL(Start=shift, Direction=ln_2, Length=1)
end = EndPoints(Curve=line)  # -> Start, End
Z = UnitZ(Factor=-1)
cull_i_2 = CullIndex(List=end.End, Indices=-1, Wrap=True)
line_2 = LineSDL(Start=cull_i_2, Direction=Z, Length=1)
bcx = BrepCurve(Brep=channel_brep_2, Curve=line_2)  # -> Curves, Points
dist = Distance(PointA=flatten(bcx.Points), PointB=flatten(cull_i_2))  # -> reverse(flatten(Distance))
S = Number(dist)
S_2 = ClusterOutput(S)
