# Grasshopper definition CMF Outlet.gh (Grasshopper 0.9.76)
# plug-ins: Python Interpreter

# ----
# 1. GEOMETRY
number_slider = Slider(9, range=0..10000)
sqrt = SquareRoot(Value=number_slider)
dom = ConstructDomain(DomainStart=0, DomainEnd=sqrt)
dom_2 = ConstructDomain(DomainStart=0, DomainEnd=sqrt)
rectangle = Rectangle(Plane=PlaneXY(0, 0, 0), XSize=dom, YSize=dom_2, Radius=0)  # -> Rectangle, Length
rad = Radians(Degrees=Slider(15, range=0..180))
yz = YZPlane(Origin=Point(0, 0, 0))
rotate = Rotate(Geometry=rectangle.Rectangle, Angle=rad, Plane=yz)  # -> Geometry, Transform
mesh = MeshBrep(
    Brep=rotate.Geometry,
    Settings={GridMaxCount=0, GridMinCount=16, JaggedSeams=False, MaxEdgeLength=0, MinEdgeLength=0.0001, MinTolerance=0, Refine=True, RefineAngle=0, RelativeTolerance=0.65, SimplePlanes=True, Tolerance=0})

# ----
# Livestock Setup
# Python and SSH
toggle = BooleanToggle(True)
ssh_machine = PythonScript(x=toggle)  # -> out, a, b, c, d
# ---------- ssh_machine: Python ----------
machine = {0: {'name': 'Bash',
               'ip': '127.0.0.1',
               'port': 2222,
               'user': 'ocni',
               'pw': '4320lejre'
               },
           1: {'name': 'Livestock_Ubuntu',
               'ip': '10.61.0.140',
               'port': 22,
               'user': 'livestock',
               'pw': 'stable'
               }}
               
print(machine[x]['name'])
a = machine[x]['ip']
b = machine[x]['port']
c = machine[x]['user']
d = machine[x]['pw']
# ---------- end ssh_machine ----------
panel = Panel(ssh_machine.out)
ssh_connection = LivestockSSHConnection(IP=ssh_machine.a, Port=ssh_machine.b, Username=ssh_machine.c, Password=ssh_machine.d)  # -> readMe
#   port IP: IP Address for SSH connection
#   port Port: Port for SSH connection
#   port Username: Username for SSH connection
#   port Password: Password for SSH connection
#   port readMe: In case of any errors, it will be shown here.
# ---------- ssh_connection: Python ----------
from livestock.components.misc import SSHConnection

comp = SSHConnection(ghenv)
comp.config()
comp.run_checks(str(IP), str(Port), str(Username), str(Password))
comp.run()
# ---------- end ssh_connection ----------
python_executor = LivestockPythonExecutor(PythonPath="C:\Program Files\Anaconda3\envs\livestock\python.exe")  # -> readMe
#   port PythonPath: Path to python.exe
#   port readMe: In case of any errors, it will be shown here.
# ---------- python_executor: Python ----------
from livestock.components.misc import PythonExecutor

comp = PythonExecutor(ghenv)
comp.config()
comp.run_checks(str(PythonPath))
comp.run()
# ---------- end python_executor ----------
panel_2 = Panel(ssh_connection)
panel_3 = Panel(python_executor)

# ----
# Retention Curve
number_slider_2 = Slider(0, range=0..5)
cmf_retention_curve = LivestockCMFRetentionCurve(SoilIndex=number_slider_2, K_sat=Slider(0.1, range=0.1..1))  # -> readMe, Units, CurveValues, RetentionCurve
#   port SoilIndex: Index for choosing soil type. Index from 0-5. Default is set to 0, which is the default CMF retention curve.
#   port K_sat: Saturated conductivity in m/day
#   port Phi: Porosity in m3/m3
#   port Alpha: Inverse of water entry potential in 1/cm
#   port N: Pore size distribution parameter is unitless
#   port M: VanGenuchten m (if negative, 1-1/n is used) is unitless
#   port L: Mualem tortoisivity is unitless
#   port readMe: In case of any errors, it will be shown here.
#   port Units: Shows the units of the curve values
#   port CurveValues: Chosen curve properties values
#   port RetentionCurve: Livestock Retention Curve
# ---------- cmf_retention_curve: Python ----------
from livestock.components.comp_cmf import CMFRetentionCurve

comp = CMFRetentionCurve(ghenv)
comp.config()
comp.run_checks(SoilIndex, K_sat, Phi, Alpha, N, M, L)
comp.run()

Units = comp.units
CurveValues = comp.property.values()
RetentionCurve = comp.results
# ---------- end cmf_retention_curve ----------
panel_4 = Panel(cmf_retention_curve.CurveValues)
panel_5 = Panel(cmf_retention_curve.Units)

# ----
# Soil Layers
number_slider_3 = Slider(0, range=0..2)
series = Series(Start=Slider(0.1, range=0..1), Step=number_slider_3, Count=Slider(1, range=1..10))

# ----
# Surface Properties
number_slider_4 = Slider(2, range=0..5)
cmf_vegetation_properties = LivestockCMFVegetationProperties(Property=number_slider_4)  # -> readMe, Units, VegetationValues, VegetationProperties
#   port Property: 0-1 grasses. 2-6 soils
#   port readMe: In case of any errors, it will be shown here.
#   port Units: Shows the units of the surface values
#   port VegetationValues: Chosen surface properties values
#   port VegetationProperties: Livestock surface properties data
# ---------- cmf_vegetation_properties: Python ----------
from livestock.components.comp_cmf import CMFVegetationProperties

comp = CMFVegetationProperties(ghenv)
comp.config()
comp.run_checks(Property)
comp.run()

Units = comp.units
VegetationValues = comp.property.values()
VegetationProperties = comp.results
# ---------- end cmf_vegetation_properties ----------
panel_6 = Panel(cmf_vegetation_properties.VegetationValues)
panel_7 = Panel(cmf_vegetation_properties.Units)

faceb = FaceBoundaries(Mesh=mesh)
Z = UnitZ(Factor=series)
Z_2 = UnitZ(Factor=expr("-x", series))  # -> graft(UnitVector)
extr = Extrude(Base=faceb, Direction=Z)
move = Move(Geometry=extr, Motion=Z_2)  # -> Geometry, Transform
# Visualize Geometry
area = Area(Geometry=faceb)  # -> Area, Centroid
wires = BrepWireframe(Brep=move.Geometry, Density=-1)  # -> simplify(Wireframe)

# ----
# Ladybug Tools - Location
number_slider_5 = Slider(12, range=0..100)
constructlocation = Ladybug_ConstructLocation(locationName="Copenhagen", latitude=number_slider_5, longitude=Slider(55, range=0..100), timeZone=0, elevation=0)  # -> location; plug-in component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

preview = CustomPreview(Geometry=wires, Shader=ColourSwatch(SwatchColor=RGB(0, 0, 0)))
points = PointList(Points=area.Centroid, Size=Slider(0.25, range=0..1))
preview_2 = CustomPreview(Geometry=mesh, Shader=ColourSwatch(SwatchColor=RGB(203, 162, 125)))

# ----
# Face Indices
panel_8 = Panel("""0
1""")

# ----
# 2. GROUND
number_slider_6 = Slider(5, range=1..10)
cmf_ground = LivestockCMFGround(
    Layers=series,
    RetentionCurve=cmf_retention_curve.RetentionCurve,
    VegetationProperties=cmf_vegetation_properties.VegetationProperties,
    SaturatedDepth=number_slider_6,
    SurfaceWaterVolume=Slider(2, range=0..2),
    FaceIndices=panel_8,
    ETMethod=Slider(0, range=0..2))  # -> readMe, Ground; inputs Layers: list, FaceIndices: list
#   port Layers: Soil layers to add to the mesh in m
#   port RetentionCurve: Livestock CMF Retention Curve
#   port VegetationProperties: Input from Livestock CMF Vegetation Properties
#   port SaturatedDepth: Initial saturated depth in m. It is depth where the groundwater is located - Default is set to 3m
#   port SurfaceWaterVolume: Initial surface water volume in m3. - Default is set to 0 m3
#   port FaceIndices: List of face indices, on where the ground properties are applied.
#   port ETMethod: Set method to calculate evapotranspiration. 0: No evapotranspiration 1: Penman-Monteith 2: Shuttleworth-Wallace Default is set to Shuttleworth-Wallace
#   port Manning: Set Manning roughness. If not set CMF calculates it from the above given values.
#   port PuddleDepth: Set puddle depth. Puddle depth is the height were run-off begins. Default is set to 0.01m
#   port SurfaceRunOffMethod: Set the method for computing the surface run-off. 0 - Kinematic Wave. 1 - Diffusive Wave. Default is set 0 - Kinematic Wave.
#   port readMe: In case of any errors, it will be shown here.
#   port Ground: Livestock Ground Data Class
# ---------- cmf_ground: Python ----------
from livestock.components.comp_cmf import CMFGround

comp = CMFGround(ghenv)
comp.config()
comp.run_checks(Layers, RetentionCurve, VegetationProperties, SaturatedDepth, 
                SurfaceWaterVolume, FaceIndices, ETMethod, Manning, PuddleDepth, 
                SurfaceRunOffMethod)
comp.run()

Ground = comp.results
# ---------- end cmf_ground ----------

# ----
# Solver Settings & Outputs
number_slider_7 = Slider(0, range=0..1)
toggle_2 = BooleanToggle(True)
number_slider_8 = Slider(48, range=1..8760)
cmf_outputs = LivestockCMFOutputs(Evapotranspiration=Toggle(False), SurfaceWaterVolume=toggle_2, Volume=toggle_2)  # -> readMe, ChosenOutputs, Outputs
#   port Evapotranspiration: Cell evaporation - default is set to True
#   port SurfaceWaterVolume: Cell surface water - default is set to False
#   port SurfaceWaterFlux: Cell surface water flux - default is set to False
#   port HeatFlux: Cell surface heat flux - default is set to False
#   port AerodynamicResistance: Cell aerodynamic resistance - default is set to False
#   port VolumetricFlux: Soil layer volumetric flux vectors - default is set to False
#   port Potential: Soil layer total potential (Psi_tot = Psi_M + Psi_G - default is set to False
#   port Theta: Soil layer volumetric water content of the layer - default is set to False
#   port Volume: Soil layer volume of water in the layer - default is set to False
#   port Wetness: Soil layer wetness of the soil (V_volume/V_pores) - default is set to False
#   port readMe: In case of any errors, it will be shown here.
#   port ChosenOutputs: Shows the chosen outputs
#   port Outputs: Livestock Output Data
# ---------- cmf_outputs: Python ----------
from livestock.components.comp_cmf import CMFOutputs

comp = CMFOutputs(ghenv)
comp.config()
comp.run_checks(Evapotranspiration, SurfaceWaterVolume, SurfaceWaterFlux, 
                HeatFlux, AerodynamicResistance, VolumetricFlux, Potential, 
                Theta, Volume, Wetness)
comp.run()

ChosenOutputs = comp.output_dict.items()
Outputs = comp.results
# ---------- end cmf_outputs ----------
cmf_solver_settings = LivestockCMFSolverSettings(AnalysisLength=number_slider_8, SolverTolerance="1e-04", Verbosity=number_slider_7)  # -> readMe, SolverSettings
#   port AnalysisLength: Total length of the simulation in hours - default is set to 24 hours.
#   port TimeStep: Size of each time step in hours - e.g. 1/60 equals time steps of 1 min and 24 is a time step of one day. Default is 1 hour
#   port SolverTolerance: Solver tolerance - Default is 1e-8
#   port Verbosity: Sets the verbosity of the print statement during runtime - Default is 1. 0 - Prints only at start and end of simulation. 1 - Prints at every time step.
#   port readMe: In case of any errors, it will be shown here.
#   port SolverSettings: Livestock Solver Settings
# ---------- cmf_solver_settings: Python ----------
from livestock.components.comp_cmf import CMFSolverSettings

comp = CMFSolverSettings(ghenv)
comp.config()
comp.run_checks(AnalysisLength, TimeStep, SolverTolerance, Verbosity)
comp.run()

SolverSettings = comp.results
# ---------- end cmf_solver_settings ----------

# ----
# Constant Weather Data
dup = DuplicateData(Data=0, Number=number_slider_8, Order=True)
expression = Expression(R=dup, Expression="0.65")
expression_2 = Expression(R=dup, Expression="20")
expression_3 = Expression(R=dup, Expression="0.8")
expression_4 = Expression(R=dup, Expression="0")
expression_5 = Expression(R=dup, Expression="1")
expression_6 = Expression(R=dup, Expression="20")

expression_7 = Expression(R=dup, Expression="0")

# ----
# 3. Weather
cmf_weather = LivestockCMFWeather(
    Temperature=expression_2,
    WindSpeed=expression_5,
    RelativeHumidity=expression,
    CloudCover=expression_3,
    GlobalRadiation=expression_4,
    Rain=expression_7,
    GroundTemperature=expression_6,
    Location=constructlocation,
    MeshFaceCount=2)  # -> readMe, Weather; inputs Temperature: tree, WindSpeed: tree, RelativeHumidity: tree, CloudCover: tree, GlobalRadiation: tree, Rain: tree, GroundTemperature: tree
#   port Temperature: Temperature in C. Either a list or a tree where the number of branches is equal to the number of mesh faces.
#   port WindSpeed: Wind speed in m/s. Either a list or a tree where the number of branches is equal to the number of mesh faces.
#   port RelativeHumidity: Relative humidity in %. Either a list or a tree where the number of branches is equal to the number of mesh faces.
#   port CloudCover: Cloud cover, unitless between 0 and 1. Either a list or a tree where the number of branches is equal to the number of mesh faces.
#   port GlobalRadiation: Global Radiation in W/m2. Either a list or a tree where the number of branches is equal to the number of mesh faces.
#   port Rain: Horizontal precipitation in mm/h. Either a list or a tree where the number of branches is equal to the number of mesh faces.
#   port GroundTemperature: Ground temperature in C. Either a list or a tree where the number of branches is equal to the number of mesh faces.
#   port Location: A Ladybug Tools Location
#   port MeshFaceCount: Number of faces in the ground mesh
#   port readMe: In case of any errors, it will be shown here.
#   port Weather: Livestock Weather Data Class
# ---------- cmf_weather: Python ----------
from livestock.components.comp_cmf import CMFWeather

comp = CMFWeather(ghenv)
comp.config()
comp.run_checks(Temperature, WindSpeed, RelativeHumidity, CloudCover, GlobalRadiation, Rain, GroundTemperature, Location, MeshFaceCount)
comp.run()

Weather = comp.results
# ---------- end cmf_weather ----------
panel_9 = Panel(cmf_weather.readMe)

# ----
# Outlet
number_slider_9 = Slider(1.5, range=0..10)
number_slider_10 = Slider(0, range=0..100)
pt = ConstructPoint(XCoordinate=number_slider_9, YCoordinate=0, ZCoordinate=0)
cmf_outlet = LivestockCMFOutlet(
    Location=pt,
    ConnectedCell=number_slider_10,
    ConnectedLayer=number_slider_10,
    OutletType=Slider(3, range=1..3),
    ConnectionParameter=Slider(11, range=0..11))  # -> readMe, BoundaryCondition
#   port Location: Location of the outlet in x, y and z coordinates. Default is 0,0,0
#   port ConnectedCell: Cell to connect to. Default is set to first cell
#   port ConnectedLayer: Layer of cell to connect to. 0 is surface water. 1 is first layer of cell and so on. Default is set to 0 - surface water
#   port OutletType: Set type of outlet connection. 1 - Richards. 2 - Kinematic wave. 3 - Technical Flux.
#   port ConnectionParameter: If Richards: Potential - Sets the potential of the outlet. The difference in potential is what drives the flux. If Kinematic wave: Residence Time - Linear flow parameter of travel time in days. If Technical Flux: Maximum Flux - The maximum flux is in m3/day.
#   port readMe: In case of any errors, it will be shown here.
#   port BoundaryCondition: Livestock Boundary Condition
# ---------- cmf_outlet: Python ----------
from livestock.components.comp_cmf import CMFOutlet

comp = CMFOutlet(ghenv)
comp.config()
comp.run_checks(Location, ConnectedCell, ConnectedLayer, OutletType, 
                ConnectionParameter)
comp.run()

BoundaryCondition = comp.results
# ---------- end cmf_outlet ----------
panel_10 = Panel(cmf_outlet.readMe)

# ----
# 4. SOLVE
panel_11 = Panel("C:\Users\Christian\Dropbox\Arbejde\DTU BYG\Livestock\livestock_gh\grasshopper\scripts\script_data")
cmf_solve = LivestockCMFSolve(
    Mesh=mesh,
    Ground=cmf_ground.Ground,
    Weather=cmf_weather.Weather,
    BoundaryConditions=cmf_outlet.BoundaryCondition,
    SolverSettings=cmf_solver_settings.SolverSettings,
    Folder=panel_11,
    CaseName="CMF_Outlet",
    Outputs=cmf_outputs.Outputs,
    Write=Toggle(False),
    Run=Toggle(False))  # -> readMe, ResultPath; inputs Ground: list, Trees: list, BoundaryConditions: list
#   port Mesh: Topography as a mesh
#   port Ground: Input from Livestock CMF Ground
#   port Weather: Input from Livestock CMF Weather
#   port Trees: Input from Livestock CMF Tree
#   port Stream: Input from Livestock CMF Stream
#   port BoundaryConditions: Input from Livestock CMF Boundary Condition
#   port SolverSettings: Input from Livestock CMF Solver Settings
#   port Folder: Path to folder. Default is Desktop
#   port CaseName: Case name as string. Default is CMF
#   port Outputs: Connect Livestock Outputs
#   port Write: Boolean to write files
#   port Overwrite: If True excising case will be overwritten. Default is set to True
#   port Run: Boolean to run analysis Analysis will be ran through SSH. Configure the connection with Livestock SSH
#   port readMe: In case of any errors, it will be shown here.
#   port ResultPath: Path to result files
# ---------- cmf_solve: Python ----------
from livestock.components.comp_cmf import CMFSolve

comp = CMFSolve(ghenv)
comp.config()
comp.run_checks(Mesh, Ground, Weather, Trees, Stream, BoundaryConditions, 
                SolverSettings, Folder, CaseName, Outputs, Write, Overwrite, Run)
comp.run(ghdoc)

ResultPath = comp.case_path
# ---------- end cmf_solve ----------
panel_12 = Panel(cmf_solve.readMe)
