# Grasshopper definition Comfort.gh (Grasshopper 0.9.76)
# plug-ins: Python Interpreter

adaptive_clothing = LivestockAdaptiveClothing(Temperature=Slider(10.7, range=-30..40))  # -> readMe, ClothingValue
#   port Temperature: Temperature in C
#   port readMe: In case of any errors, it will be shown here.
#   port ClothingValue: Calculated clothing value in clo.
# ---------- adaptive_clothing: Python ----------
import sys
sys.path.insert(0, r'C:\livestock\python\classes')
from ComponentClasses import AdaptiveClothing

comp = AdaptiveClothing()
comp.config(ghenv)
comp.runChecks(ghenv, Temperature)
comp.run(ghenv)

ClothingValue = comp.results
# ---------- end adaptive_clothing ----------
panel = Panel(adaptive_clothing.ClothingValue)
