# Grasshopper definition Livestock Components.gh (Grasshopper 0.9.76)
# plug-ins: Python Interpreter

ssh_connection = LivestockSSHConnection()  # -> readMe
#   port IP: IP Address for SSH connection
#   port Port: Port for SSH connection
#   port Username: Username for SSH connection
#   port Password: Password for SSH connection
#   port readMe: In case of any errors, it will be shown here.
# ---------- ssh_connection: Python ----------
from livestock.components.misc import SSHConnection

comp = SSHConnection(ghenv)
comp.config()
comp.run_checks(str(IP), str(Port), str(Username), str(Password))
comp.run()
# ---------- end ssh_connection ----------

# ----
# MISCELLANEOUS
# Open Bash and run:
# sudo service ssh --full-restart
toggle = BooleanToggle(False)
python_executor = LivestockPythonExecutor()  # -> readMe
#   port PythonPath: Path to python.exe
#   port readMe: In case of any errors, it will be shown here.
# ---------- python_executor: Python ----------
from livestock.components.misc import PythonExecutor

comp = PythonExecutor(ghenv)
comp.config()
comp.run_checks(str(PythonPath))
comp.run()
# ---------- end python_executor ----------
# VEGETATION
hour_to_date = LivestockHourToDate()  # -> readMe, Date
#   port Hour: Hour of the year
#   port readMe: In case of any errors, it will be shown here.
#   port Date: Converted Date.
# ---------- hour_to_date: Python ----------
from livestock.components.misc import HourToDate

comp = HourToDate(ghenv)
comp.config()
comp.run_checks(Hour)
comp.run()

Date = comp.results
# ---------- end hour_to_date ----------
update = LivestockUpdate(Update=toggle)  # -> ReadMe
# ---------- update: Python ----------
#------------------------------------------------------------------------------#
# IMPORTS

import sys
import os
import shutil
import zipfile
import time
import urllib
import System

ghenv.Component.Name = "Livestock Update"
ghenv.Component.NickName = "Update"
ghenv.Component.Message = "VER 0.0.1 | August 2017"
ghenv.Component.IconDisplayMode = ghenv.Component.IconDisplayMode.application
ghenv.Component.Category = "Livestock"
ghenv.Component.SubCategory = "0 | Miscellaneous"
ghenv.Component.Description = "Update Livestock"
	
#------------------------------------------------------------------------------#
# COMPONENT

def downloadSourceAndUnzip():
    """
    Download the source code from github and unzip it in temp folder
    """

    url = "https://github.com/livestock3d/livestock_gh/archive/master.zip"
    targetDirectory = r'C:\livestock'

    # download the zip file
    print("Downloading the source code...")
    zipFile = os.path.join(targetDirectory, os.path.basename(url))
    
    # if the source file is just downloded then just use the available file
    if os.path.isfile(zipFile) and time.time() - os.stat(zipFile).st_mtime < 1000:
        download = False
    else:
        download = True

        # remove the old version
        try:
            shutil.rmtree(targetDirectory)
        except:
            pass

    # create the target directory
    if not os.path.isdir(targetDirectory): os.mkdir(targetDirectory)

    if download:
        try:
            client = System.Net.WebClient()
            client.DownloadFile(url, zipFile)
            if not os.path.isfile(zipFile):
                print("Download failed! Try to download and unzip the file manually form:\n" + url)
                return
        except Exception, e:
            print(`e` + "\nDownload failed! Try to download and unzip the file manually form:\n" + url)
            return

    # unzip the file
    with zipfile.ZipFile(zipFile) as zf:
        for f in zf.namelist():
            folder = f.replace('livestock_gh-master/','C:/livestock/')
            if f.endswith('/'):
                try:
                    os.makedirs(folder)
                    os.makedirs(f)
                except:
                    pass
            else:
                zf.extract(f, targetDirectory)
                file = f.replace('livestock_gh-master/','C:/livestock/')
                shutil.move('C:/livestock/'+f,file)
                
    shutil.rmtree('C:/livestock/livestock_gh-master')
    
    #Move GH components
    userObjectsFolder = os.getenv('APPDATA') + '/Grasshopper/UserObjects/'
    componentsFolder = 'C:/livestock/grasshopper/components/'
    for obj in os.listdir(componentsFolder):
        shutil.move(componentsFolder+obj,userObjectsFolder+obj)
    shutil.rmtree('C:/livestock/grasshopper')
    shutil.rmtree('C:/livestock/wiki')
    
    # Create SSH folder:
    os.mkdir(r'C:\livestock\python\ssh')
    
    return True

    
#------------------------------------------------------------------------------#
# OUTPUTS

if Update:
    downloadSourceAndUnzip()
    print('Download done')
# ---------- end update ----------
panel = Panel(ssh_connection)
panel_2 = Panel(python_executor)
panel_3 = Panel(update)

# ----
# CMF
cmf_outputs = LivestockCMFOutputs()  # -> readMe, ChosenOutputs, Outputs
#   port Evapotranspiration: Cell evaporation - default is set to True
#   port SurfaceWaterVolume: Cell surface water - default is set to False
#   port SurfaceWaterFlux: Cell surface water flux - default is set to False
#   port HeatFlux: Cell surface heat flux - default is set to False
#   port AerodynamicResistance: Cell aerodynamic resistance - default is set to False
#   port VolumetricFlux: Soil layer volumetric flux vectors - default is set to False
#   port Potential: Soil layer total potential (Psi_tot = Psi_M + Psi_G - default is set to False
#   port Theta: Soil layer volumetric water content of the layer - default is set to False
#   port Volume: Soil layer volume of water in the layer - default is set to False
#   port Wetness: Soil layer wetness of the soil (V_volume/V_pores) - default is set to False
#   port readMe: In case of any errors, it will be shown here.
#   port ChosenOutputs: Shows the chosen outputs
#   port Outputs: Livestock Output Data
# ---------- cmf_outputs: Python ----------
from livestock.components.comp_cmf import CMFOutputs

comp = CMFOutputs(ghenv)
comp.config()
comp.run_checks(Evapotranspiration, SurfaceWaterVolume, SurfaceWaterFlux, 
                HeatFlux, AerodynamicResistance, VolumetricFlux, Potential, 
                Theta, Volume, Wetness)
comp.run()

ChosenOutputs = comp.output_dict.items()
Outputs = comp.results
# ---------- end cmf_outputs ----------
cmf_outlet = LivestockCMFOutlet()  # -> readMe, BoundaryCondition
#   port Location: Location of the outlet in x, y and z coordinates. Default is 0,0,0
#   port ConnectedCell: Cell to connect to. Default is set to first cell
#   port ConnectedLayer: Layer of cell to connect to. 0 is surface water. 1 is first layer of cell and so on. Default is set to 0 - surface water
#   port OutletType: Set type of outlet connection. 1 - Richards. 2 - Kinematic wave. 3 - Technical Flux.
#   port ConnectionParameter: If Richards: Potential - Sets the potential of the outlet. The difference in potential is what drives the flux. If Kinematic wave: Residence Time - Linear flow parameter of travel time in days. If Technical Flux: Maximum Flux - The maximum flux is in m3/day.
#   port readMe: In case of any errors, it will be shown here.
#   port BoundaryCondition: Livestock Boundary Condition
# ---------- cmf_outlet: Python ----------
from livestock.components.comp_cmf import CMFOutlet

comp = CMFOutlet(ghenv)
comp.config()
comp.run_checks(Location, ConnectedCell, ConnectedLayer, OutletType, 
                ConnectionParameter)
comp.run()

BoundaryCondition = comp.results
# ---------- end cmf_outlet ----------
cmf_surface_flux_result = LivestockCMFSurfaceFluxResult()  # -> readMe, Unit, SurfaceFluxVectors, CSVPath
#   port ResultFolder: Path to result folder. Accepts output from Livestock Solve
#   port Mesh: Mesh of the case
#   port IncludeRunOff: Include surface run-off into the surface flux vector? Default is set to True
#   port IncludeRain: Include rain into the surface flux vector? Default is False.
#   port IncludeEvapotranspiration: Include evapotranspiration into the surface flux vector? Default is set to False
#   port IncludeInfiltration: Include infiltration into the surface flux vector? Default is set to False
#   port SaveResult: Save the values as a text file - Default is set to False
#   port Write: Write component files
#   port Run: Run component
#   port readMe: In case of any errors, it will be shown here.
#   port Unit: Shows the units of the results
#   port SurfaceFluxVectors: Tree with the surface flux vectors
#   port CSVPath: Path to csv file.
# ---------- cmf_surface_flux_result: Python ----------
from livestock.components.comp_cmf import CMFSurfaceFluxResult

comp = CMFSurfaceFluxResult(ghenv)
comp.config()
comp.run_checks(ResultFilePath, Mesh, IncludeRunOff, IncludeRain, 
                IncludeEvapotranspiration, IncludeInfiltration, SaveResult, 
                Write, Run)
comp.run()


Unit = comp.unit
SurfaceFluxVectors = comp.results
ResultPath = comp.result_path
# ---------- end cmf_surface_flux_result ----------
cmf_solve = LivestockCMFSolve()  # -> readMe, ResultPath; inputs Ground: list, Trees: list, BoundaryConditions: list
#   port Mesh: Topography as a mesh
#   port Ground: Input from Livestock CMF Ground
#   port Weather: Input from Livestock CMF Weather
#   port Trees: Input from Livestock CMF Tree
#   port Stream: Input from Livestock CMF Stream
#   port BoundaryConditions: Input from Livestock CMF Boundary Condition
#   port SolverSettings: Input from Livestock CMF Solver Settings
#   port Folder: Path to folder. Default is Desktop
#   port CaseName: Case name as string. Default is CMF
#   port Outputs: Connect Livestock Outputs
#   port Write: Boolean to write files
#   port Overwrite: If True excising case will be overwritten. Default is set to True
#   port Run: Boolean to run analysis Analysis will be ran through SSH. Configure the connection with Livestock SSH
#   port readMe: In case of any errors, it will be shown here.
#   port ResultPath: Path to result files
# ---------- cmf_solve: Python ----------
from livestock.components.comp_cmf import CMFSolve

comp = CMFSolve(ghenv)
comp.config()
comp.run_checks(Mesh, Ground, Weather, Trees, Stream, BoundaryConditions, 
                SolverSettings, Folder, CaseName, Outputs, Write, Overwrite, Run)
comp.run(ghdoc)

ResultPath = comp.case_path
# ---------- end cmf_solve ----------
cmf_solver_settings = LivestockCMFSolverSettings()  # -> readMe, SolverSettings
#   port AnalysisLength: Total length of the simulation in hours - default is set to 24 hours.
#   port TimeStep: Size of each time step in hours - e.g. 1/60 equals time steps of 1 min and 24 is a time step of one day. Default is 1 hour
#   port SolverTolerance: Solver tolerance - Default is 1e-8
#   port Verbosity: Sets the verbosity of the print statement during runtime - Default is 1. 0 - Prints only at start and end of simulation. 1 - Prints at every time step.
#   port readMe: In case of any errors, it will be shown here.
#   port SolverSettings: Livestock Solver Settings
# ---------- cmf_solver_settings: Python ----------
from livestock.components.comp_cmf import CMFSolverSettings

comp = CMFSolverSettings(ghenv)
comp.config()
comp.run_checks(AnalysisLength, TimeStep, SolverTolerance, Verbosity)
comp.run()

SolverSettings = comp.results
# ---------- end cmf_solver_settings ----------
cmf_vegetation_properties = LivestockCMFVegetationProperties()  # -> readMe, Units, VegetationValues, VegetationProperties
#   port Property: 0-1 grasses. 2-6 soils
#   port readMe: In case of any errors, it will be shown here.
#   port Units: Shows the units of the surface values
#   port VegetationValues: Chosen surface properties values
#   port VegetationProperties: Livestock surface properties data
# ---------- cmf_vegetation_properties: Python ----------
from livestock.components.comp_cmf import CMFVegetationProperties

comp = CMFVegetationProperties(ghenv)
comp.config()
comp.run_checks(Property)
comp.run()

Units = comp.units
VegetationValues = comp.property.values()
VegetationProperties = comp.results
# ---------- end cmf_vegetation_properties ----------
cmf_weather = LivestockCMFWeather()  # -> readMe, Weather; inputs Temperature: tree, WindSpeed: tree, RelativeHumidity: tree, CloudCover: tree, GlobalRadiation: tree, Rain: tree, GroundTemperature: tree
#   port Temperature: Temperature in C. Either a list or a tree where the number of branches is equal to the number of mesh faces.
#   port WindSpeed: Wind speed in m/s. Either a list or a tree where the number of branches is equal to the number of mesh faces.
#   port RelativeHumidity: Relative humidity in %. Either a list or a tree where the number of branches is equal to the number of mesh faces.
#   port CloudCover: Cloud cover, unitless between 0 and 1. Either a list or a tree where the number of branches is equal to the number of mesh faces.
#   port GlobalRadiation: Global Radiation in W/m2. Either a list or a tree where the number of branches is equal to the number of mesh faces.
#   port Rain: Horizontal precipitation in mm/h. Either a list or a tree where the number of branches is equal to the number of mesh faces.
#   port GroundTemperature: Ground temperature in C. Either a list or a tree where the number of branches is equal to the number of mesh faces.
#   port Location: A Ladybug Tools Location
#   port MeshFaceCount: Number of faces in the ground mesh
#   port readMe: In case of any errors, it will be shown here.
#   port Weather: Livestock Weather Data Class
# ---------- cmf_weather: Python ----------
from livestock.components.comp_cmf import CMFWeather

comp = CMFWeather(ghenv)
comp.config()
comp.run_checks(Temperature, WindSpeed, RelativeHumidity, CloudCover, GlobalRadiation, Rain, GroundTemperature, Location, MeshFaceCount)
comp.run()

Weather = comp.results
# ---------- end cmf_weather ----------
cmf_ground = LivestockCMFGround()  # -> readMe, Ground; inputs Layers: list, FaceIndices: list
#   port Layers: Soil layers to add to the mesh in m
#   port RetentionCurve: Livestock CMF Retention Curve
#   port VegetationProperties: Input from Livestock CMF Vegetation Properties
#   port SaturatedDepth: Initial saturated depth in m. It is depth where the groundwater is located - Default is set to 3m
#   port SurfaceWaterVolume: Initial surface water volume in m3. - Default is set to 0 m3
#   port FaceIndices: List of face indices, on where the ground properties are applied.
#   port ETMethod: Set method to calculate evapotranspiration. 0: No evapotranspiration 1: Penman-Monteith 2: Shuttleworth-Wallace Default is set to Shuttleworth-Wallace
#   port Manning: Set Manning roughness. If not set CMF calculates it from the above given values.
#   port PuddleDepth: Set puddle depth. Puddle depth is the height were run-off begins. Default is set to 0.01m
#   port SurfaceRunOffMethod: Set the method for computing the surface run-off. 0 - Kinematic Wave. 1 - Diffusive Wave. Default is set 0 - Kinematic Wave.
#   port readMe: In case of any errors, it will be shown here.
#   port Ground: Livestock Ground Data Class
# ---------- cmf_ground: Python ----------
from livestock.components.comp_cmf import CMFGround

comp = CMFGround(ghenv)
comp.config()
comp.run_checks(Layers, RetentionCurve, VegetationProperties, SaturatedDepth, 
                SurfaceWaterVolume, FaceIndices, ETMethod, Manning, PuddleDepth, 
                SurfaceRunOffMethod)
comp.run()

Ground = comp.results
# ---------- end cmf_ground ----------
cmf_retention_curve = LivestockCMFRetentionCurve()  # -> readMe, Units, CurveValues, RetentionCurve
#   port SoilIndex: Index for choosing soil type. Index from 0-5. Default is set to 0, which is the default CMF retention curve.
#   port K_sat: Saturated conductivity in m/day
#   port Phi: Porosity in m3/m3
#   port Alpha: Inverse of water entry potential in 1/cm
#   port N: Pore size distribution parameter is unitless
#   port M: VanGenuchten m (if negative, 1-1/n is used) is unitless
#   port L: Mualem tortoisivity is unitless
#   port readMe: In case of any errors, it will be shown here.
#   port Units: Shows the units of the curve values
#   port CurveValues: Chosen curve properties values
#   port RetentionCurve: Livestock Retention Curve
# ---------- cmf_retention_curve: Python ----------
from livestock.components.comp_cmf import CMFRetentionCurve

comp = CMFRetentionCurve(ghenv)
comp.config()
comp.run_checks(SoilIndex, K_sat, Phi, Alpha, N, M, L)
comp.run()

Units = comp.units
CurveValues = comp.property.values()
RetentionCurve = comp.results
# ---------- end cmf_retention_curve ----------
synthetic_tree = LivestockSyntheticTree()  # -> readMe, Units, TreeValues, TreeProperties
#   port FaceIndex: Mesh face index where tree is placed
#   port TreeType: Tree types: 0 - Deciduous, 1 - Coniferous, 2 - Shrubs. Default is deciduous
#   port Height: Height of tree in meters. Default is set to 10m
#   port readMe: In case of any errors, it will be shown here.
#   port Units: Shows the units of the tree values
#   port TreeValues: Chosen tree properties values
#   port TreeProperties: Livestock tree properties data
# ---------- synthetic_tree: Python ----------
from livestock.components.comp_cmf import CMFSyntheticTree

comp = CMFSyntheticTree(ghenv)
comp.config()
comp.run_checks(FaceIndex, TreeType, Height)
comp.run()

Units = comp.units
TreeValues = comp.property.values()
TreeProperties = comp.results
# ---------- end synthetic_tree ----------
cmf_results = LivestockCMFResults()  # -> readMe, Units, Values, CSVPath
#   port ResultFolder: Path to result folder. Accepts output from Livestock Solve
#   port FetchResult: Choose which result should be loaded: 0 - Evapotranspiration 1 - Surface water volume 2 - Surface water flux 3 - Heat flux 4 - Aerodynamic resistance 5 - Soil layer water flux 6 - Soil layer potential 7 - Soil layer theta 8 - Soil layer volume 9 - Soil layer wetness
#   port SaveCSV: Save the values as a csv file - Default is set to False
#   port Run: Run component
#   port readMe: In case of any errors, it will be shown here.
#   port Units: Shows the units of the results
#   port Values: List with chosen result values
#   port CSVPath: Path to csv file.
# ---------- cmf_results: Python ----------
from livestock.components.comp_cmf import CMFResults

comp = CMFResults(ghenv)
comp.config()
comp.run_checks(ResultFolder, FetchResult, SaveCSV, Run)
comp.run()

Units = comp.unit
Values = comp.results
# ---------- end cmf_results ----------
panel_4 = Panel(cmf_outputs.readMe)
panel_5 = Panel(cmf_solve.readMe)
panel_6 = Panel(cmf_retention_curve.readMe)
panel_7 = Panel(synthetic_tree.readMe)
panel_8 = Panel(cmf_solver_settings.readMe)
panel_9 = Panel(cmf_weather.readMe)
panel_10 = Panel(cmf_vegetation_properties.readMe)
panel_11 = Panel(cmf_surface_flux_result.readMe)

# ----
# GEOMETRY
load_mesh = LivestockLoadMesh()  # -> readMe, Mesh, MeshData
#   port Filename: Directory and file name of mesh
#   port Load: Activates the component
#   port readMe: In case of any errors, it will be shown here.
#   port MeshData: Additional data if any
# ---------- load_mesh: Python ----------
from livestock.components.geometry import LoadMesh

comp = LoadMesh(ghenv)
comp.config()
comp.run_checks(Filename, Load)
comp.run()

Mesh = comp.mesh
MeshData = comp.data
# ---------- end load_mesh ----------
remesh = LivestockRebuildMesh()  # -> Readme, NewMesh
# ---------- remesh: Python ----------
"""
Simulates drainage in order to analyse a mesh for local pooling of rain water.
Copyright: Creative Commons - Attribution 4.0 International
Contact: ocni@dtu.dk
-
Provided by Livestock 0.1, made by Christian Kongsgaard. 

    Args:
        Mesh: The mesh to fix.
        DetailLevel: The detail level of the wanted mesh. 0 is low, 1 is normal and 2 is high.
        Run: Activates the component.
    Returns:
        Readme!: In case of any errors, it will be shown here.
        NewMesh: Returns mesh after processing.
"""
#------------------------------------------------------------------------------#
# IMPORTS

import sys
sys.path.insert(0, r'C:\livestock\python\classes')
import LivestockGH as ls
import Rhino as rc
import subprocess
import os
import scriptcontext as sc
from shutil import copyfile

n = 6
data = ls.componetData(n)
ghenv.Component.Name = data[0]
ghenv.Component.NickName = data[1]
ghenv.Component.Message = data[2]
ghenv.Component.IconDisplayMode = ghenv.Component.IconDisplayMode.application
ghenv.Component.Category = data[3]
ghenv.Component.SubCategory = data[4]
ghenv.Component.Description = data[5]
#ghenv.Component.Icon = dgh.ComponentData[n][6]

#------------------------------------------------------------------------------#
# COMPONENT

# Paths
sshPath = r'C:\livestock\python\ssh'
templatePath = r'C:\livestock\python\templates'
meshName = 'mesh'
meshType = '.obj'
doc = ghdoc

# SSH and commands
ip = str(sc.sticky["SSH"]['ip'])
port = str(sc.sticky["SSH"]['port'])
user = str(sc.sticky["SSH"]['user'])
pw = str(sc.sticky["SSH"]['password'])

fTrans = 'user.txt,detail.txt,' + meshName+meshType
fRun = 'FixMeshTemplate.py'
fReturn = 'fixedMesh.obj'

inData = 'InData'
py_template = templatePath + '\\SSHTemplate.py'
pyfile = templatePath + '\\sshrun.py'
py = sc.sticky['PythonExe']


#------------------------------------------------------------------------------#
# OUTPUTS

if Run:
    # Clean SSH folder
    ls.cleanSSHFolder()
    
    # Export mesh
    ls.bakeExportDelete(Mesh, sshPath, meshName, meshType, doc)
    
    # Write user file
    ls.writeFile([user,], sshPath, 'user')
    
    detail = ['low','normal','high']
    # Write user file
    ls.writeFile([detail[DetailLevel],], sshPath, 'detail')
    
    # Write SSH commands
    ls.writeFile([ip,port,user,pw,fTrans,fRun,fReturn],sshPath,inData)
    
    #Copy Template
    copyfile(py_template,pyfile)
    
    # Run template
    thread = subprocess.Popen([py, pyfile])
    thread.wait()
    thread.kill()
    
    # Load results
    NewMesh = ls.importObj(sshPath+'\\fixedMesh'+meshType)
    
    # File clean up
    if NewMesh:
        ls.cleanSSHFolder()
# ---------- end remesh ----------
save_mesh = LivestockSaveMesh()  # -> readMe; inputs Save: Boolean
#   port Data: Additional data if any
#   port Directory: File path to save mesh to
#   port Save: Activates the component
#   port readMe: In case of any errors, it will be shown here.
# ---------- save_mesh: Python ----------
from livestock.components.geometry import SaveMesh

comp = SaveMesh(ghenv)
comp.config()
comp.run_checks(Mesh, Data, Directory, Filename, Save)
comp.run(ghdoc)
# ---------- end save_mesh ----------
panel_12 = Panel(load_mesh.readMe)
panel_13 = Panel(remesh.Readme)
panel_14 = Panel(save_mesh)

# ----
# RAIN & FLOW
simple_rain = LivestockSimpleRain()  # -> Readme, Vectors, Hits, DrivingRain; inputs Precipitation: list, WindDirection: list, WindSpeed: list, Obstacles: list, Temperature: list, KFactors: list, TestPoints: list of Point3d, TestVectors: list, CPUs: Int32
# ---------- simple_rain: Python ----------
"""
    Args:
        Precipitation: Precipitation rate in mm/h. Import from e.g. epw data
        Wind_speed: Hourly wind speed in m/s
        Wind_direction: Hourly wind direction. 0° = North, 90° = East
        Obstacles: Canopy or other buildings that "shades" the investigated surface(s)
        Temperature: Hourly temperature values in °C. Import from e.g. epw data
        Test_points: Test points on surface. Can be created by Honeybee_Generate Test Points
        TestVectors: Test vectors on surface. Can be created by Honeybee_Generate Test Points
        KFactors: List. KFactors[0] in case the view vectors don't hit an obstruction and KFactors[1] in case the view vectors hit an obstruction 
        CPUs: Number of cpus you which to compute with
        Run: Set boolean to True to run the simulation
    Returns:
        Readme!: In case of any errors, it will be shown here
        Vectors: Vector for every hour of the year, that is the reversed vector of the incoming rain.
        Hits: Returns hourly results for each calculation point
        DrivingRain: Returns hourly results for each calculation point in mm/h
"""

        
#------------------------------------------------------------------------------#
# IMPORTS

import sys
sys.path.insert(0, r'C:\livestock\python\classes')
import LivestockGH as ls
from RainClasses import simpleRain
import Rhino as rc
import os
import scriptcontext as sc

n = 5
data = ls.componetData(n)
ghenv.Component.Name = data[0]
ghenv.Component.NickName = data[1]
ghenv.Component.Message = data[2]
ghenv.Component.IconDisplayMode = ghenv.Component.IconDisplayMode.application
ghenv.Component.Category = data[3]
ghenv.Component.SubCategory = data[4]
ghenv.Component.Description = data[5]
#ghenv.Component.Icon = dgh.ComponentData[n][6]


#------------------------------------------------------------------------------#
# COMPONENT

# A failed attampt to use mesh instead of brep so the component could work with trimmed surfaces
if len(Obstacles) != 0:
    ## clean the geometry and bring them to rhinoCommon separated as mesh and Brep
    contextMesh, contextBrep = ls.cleanAndCoerceList(Obstacles)
    ## mesh Brep
    contextMeshedBrep = ls.parallel_makeContextMesh(contextBrep)

    ## Flatten the list of surfaces
    contextMeshedBrep = ls.flattenList(contextMeshedBrep)
    contextSrfs = contextMesh + contextMeshedBrep
    joinedContext = ls.joinMesh(contextSrfs)

    # Get rid of trimmed parts
    Obstacles = rc.Geometry.Brep.CreateFromMesh(joinedContext, False)


        
#------------------------------------------------------------------------------#
# OUTPUTS

if Run:
    rain = simpleRain(CPUs, Precipitation, WindSpeed, WindDirection,  TestPoints, TestVectors, Obstacles, Temperature, KFactors)
    rain.computeAngles()
    rain.rainHits()
    Vectors = rain.dirVec
    Hits = ls.list_to_tree(rain.hourlyResult)
    DrivingRain = ls.list_to_tree(rain.wdr)
# ---------- end simple_rain ----------
mesh_pools = LivestockMeshPools()  # -> Readme, Pools; inputs EndPoints: list of Point3d, VolumePoints: list
# ---------- mesh_pools: Python ----------
"""
Copyright: Creative Commons - Attribution 4.0 International
Contact: ocni@dtu.dk
-
Provided by Livestock 0.1, made by Christian Kongsgaard.
 
    Args:
        Mesh: The mesh to analyse.
        EndPoints:
        VolumePoints:
        Run: Activates the component.
    Returns:
        Readme!: In case of any errors, it will be shown here
        Pools: The formed pools.
"""
#------------------------------------------------------------------------------#
# IMPORTS

import sys
sys.path.insert(0, r'C:\livestock\python\classes')
import LivestockGH as ls
import Rhino as rc
import subprocess
import os
import scriptcontext as sc
from shutil import copyfile

n = 3
data = ls.componetData(n)
ghenv.Component.Name = data[0]
ghenv.Component.NickName = data[1]
ghenv.Component.Message = data[2]
ghenv.Component.IconDisplayMode = ghenv.Component.IconDisplayMode.application
ghenv.Component.Category = data[3]
ghenv.Component.SubCategory = data[4]
ghenv.Component.Description = data[5]
#ghenv.Component.Icon = dgh.ComponentData[n][6]


#------------------------------------------------------------------------------#
# COMPONENT
sshPath = r'C:\livestock\python\ssh'
templatePath = r'C:\livestock\python\templates'
meshName = 'drainMesh'
meshType = '.obj'
pointName = 'EndPoints'
volumeName = 'VolumePoints'

# SSH and commands
ip = str(sc.sticky["SSH"]['ip'])
port = str(sc.sticky["SSH"]['port'])
user = str(sc.sticky["SSH"]['user'])
pw = str(sc.sticky["SSH"]['password'])

fTrans = 'user.txt,' + meshName+meshType + ',' + pointName + '.txt,' + volumeName + '.txt'
fRun = 'DrainPoolsTemplate.py'
fReturn = ' '

inData = 'InData'
py_template = templatePath + '\\SSHTemplate.py'
pyfile = templatePath + '\\sshrun.py'
py = sc.sticky['PythonExe']


# Organize inputs 
pts = []
for p in EndPoints:
    pts.append(str(p.X)+','+str(p.Y)+','+str(p.Z))

if len(VolumePoints) != len(EndPoints):
    if len(VolumePoints) == 1:
        VolumePoints = VolumePoints*len(EndPoints)
    else:
        print('Length of VolumePoints has to be either be 1 or the same length as EndPoints!')
        exit()

def export():
    # Export mesh
    doc = ghdoc
    ls.bakeExportDelete(Mesh, sshPath, meshName, meshType, doc)
    
    # Export end points file
    ls.writeFile(pts, sshPath, pointName)
    
    # Write user file
    ls.writeFile([user,], sshPath, 'user')
    
    # Export volume file
    ls.writeFile(VolumePoints, sshPath, volumeName)
    
    # Write SSH commands
    ls.writeFile([ip,port,user,pw,fTrans,fRun,fReturn],sshPath,inData)
    
    #Copy Template
    copyfile(py_template,pyfile)

def importResults():
    
    # Read mesh names
    file_obj = open(sshPath + "\\meshNames.txt",'r')
    data = file_obj.readline().split(',')
    names = []
    for n in data:
        names.append(n)
    file_obj.close()
    names = names[1:]
    
    # Import meshes
    pools = []
    for n in names:
        pools.append(ls.importObj(sshPath + '\\' + n))
        os.remove(sshPath + '\\' + n)
    
    return pools

def getWarnings():
    file_obj = open(sshPath + "\\out.txt",'r')
    data = file_obj.readlines()
    warn = []
    for w in data:
        print(w)
    file_obj.close()
 
        
#------------------------------------------------------------------------------#
# OUTPUTS

if Mesh and EndPoints and VolumePoints and Run:
    # Clean SSH Folder
    ls.cleanSSHFolder()
        
    # Export data
    export()
    
    # Run template
    thread = subprocess.Popen([py, pyfile])
    thread.wait()
    thread.kill()
    
    # Import results
    Pools = importResults()
    
    # Clean up
    if Pools:
        ls.cleanSSHFolder()
# ---------- end mesh_pools ----------
mesh_drainage = LivestockMeshDrainage()  # -> readMe, NewMesh, DrainCurves, EndPoints, DrainFaces; inputs Run: Int32
#   port Mesh: Mesh to preform computation on.
#   port CPUs: Number of cpu's to run the component on - Default is set to 1.
#   port Run: Activates the component
#   port readMe: In case of any errors, it will be shown here.
#   port NewMesh: New mesh as processed by PyMesh.
#   port DrainCurves: Curves constructed through the drain positions of each particle.
#   port EndPoints: The final position of the particles.
#   port DrainFaces: Faces where the drain paths go through.
# ---------- mesh_drainage: Python ----------
from livestock.components.rain import MeshDrainPaths

comp = MeshDrainPaths(ghenv)
comp.config()
comp.run_checks(Mesh, CPUs, Run)
comp.run(ghdoc)

NewMesh = comp.results['new_mesh']
DrainCurves = comp.results['drain_curves']
EndPoints = comp.results['end_points']
DrainFaces = comp.results['drain_faces']
# ---------- end mesh_drainage ----------
panel_15 = Panel(simple_rain.Readme)
panel_16 = Panel(mesh_pools.Readme)

# ----
# COMFORT
new_air_conditions = LivestockNewAirConditions()  # -> readMe, NewTemperature, NewRelativeHumidity; inputs Evapotranspiration: tree, HeatFlux: tree, AirTemperature: list, AirRelativeHumidity: list
#   port Evapotranspiration: Evapotranspiration in m^3/day. Each tree branch should represent one time unit, with all the cell values to that time.
#   port HeatFlux: HeatFlux in MJ/m^2day. Each tree branch should represent one time unit, with all the cell values to that time.
#   port AirTemperature: Air temperature in C
#   port AirRelativeHumidity: Relative Humidity in -
#   port AirBoundaryHeight: Top of the air column in m. Default is set to 10m
#   port InvestigationHeight: Height at which the new air temperature and relative humidity should be calculated. Default is set to 1.1m
#   port CPUs: Number of cpus to perform the computation on. Default is set to 2
#   port ResultFolder: Folder where the result files should be saved
#   port Run: Run the component
#   port readMe: In case of any errors, it will be shown here.
#   port NewTemperature: New temperature in C.
#   port NewRelativeHumidity: New relative humidity in -.
# ---------- new_air_conditions: Python ----------
from livestock.components.comfort import NewAirConditions

comp = NewAirConditions(ghenv)
comp.config()
comp.run_checks(Mesh, Evapotranspiration, HeatFlux, AirTemperature, 
                AirRelativeHumidity, AirBoundaryHeight, InvestigationHeight, 
                CPUs, ResultFolder, Run)
comp.run()

NewTemperature = comp.results['temperature']
NewRelativeHumidity = comp.results['relative_humidity']
# ---------- end new_air_conditions ----------
load_air_result = LivestockLoadAirResult()  # -> readMe, NewTemperature, NewRelativeHumidity
#   port ResultFolder: Path to result folder.
#   port LoadResult: Run component
#   port readMe: In case of any errors, it will be shown here.
#   port NewTemperature: New temperature in C.
#   port NewRelativeHumidity: New relative humidity in -.
# ---------- load_air_result: Python ----------
from livestock.components.comfort import LoadAirResult

comp = LoadAirResult(ghenv)
comp.config()
comp.run_checks(ResultFolder, LoadResult)
comp.run()

NewTemperature = comp.results['temperature']
NewRelativeHumidity = comp.results['relative_humidity']
# ---------- end load_air_result ----------
