# Grasshopper definition Livestock Update.gh (Grasshopper 0.9.76)
# plug-ins: Python Interpreter

update = LivestockUpdate(Update=Toggle(False))  # -> out
# ---------- update: Python ----------
#------------------------------------------------------------------------------#
# IMPORTS

import sys
import os
import shutil
import zipfile
import time
import urllib
import System

n = 20
ghenv.Component.Name = "Livestock Update"
ghenv.Component.NickName = "Update"
ghenv.Component.Message = "VER 0.0.1 | May 2017"
ghenv.Component.IconDisplayMode = ghenv.Component.IconDisplayMode.application
ghenv.Component.Category = "Livestock"
ghenv.Component.SubCategory = "0 | Miscellaneous"
ghenv.Component.Description = "Update Livestock"
	
#------------------------------------------------------------------------------#
# COMPONENT

def downloadSourceAndUnzip():
    """
    Download the source code from github and unzip it in temp folder
    """

    url = "https://github.com/ocni-dtu/livestock_gh/archive/master.zip"
    targetDirectory = r'C:\livestock'

    # download the zip file
    print("Downloading the source code...")
    zipFile = os.path.join(targetDirectory, os.path.basename(url))
    
    # if the source file is just downloded then just use the available file
    if os.path.isfile(zipFile) and time.time() - os.stat(zipFile).st_mtime < 1000:
        download = False
    else:
        download = True

        # remove the old version
        try:
            shutil.rmtree(targetDirectory)
        except:
            pass

    # create the target directory
    if not os.path.isdir(targetDirectory): os.mkdir(targetDirectory)

    if download:
        try:
            client = System.Net.WebClient()
            client.DownloadFile(url, zipFile)
            if not os.path.isfile(zipFile):
                print("Download failed! Try to download and unzip the file manually form:\n" + url)
                return
        except Exception, e:
            print(`e` + "\nDownload failed! Try to download and unzip the file manually form:\n" + url)
            return

    # unzip the file
    with zipfile.ZipFile(zipFile) as zf:
        for f in zf.namelist():
            folder = f.replace('livestock_gh-master/','C:/livestock/')
            if f.endswith('/'):
                try:
                    os.makedirs(folder)
                    os.makedirs(f)
                except:
                    pass
            else:
                zf.extract(f, targetDirectory)
                file = f.replace('livestock_gh-master/','C:/livestock/')
                shutil.move('C:/livestock/'+f,file)
                
    shutil.rmtree('C:/livestock/livestock_gh-master')
    
    # Create SSH folder
    if not os.path.isdir('C:/livestock/python/ssh'):
        os.mkdir('C:/livestock/python/ssh')
    
    #Move GH components
    userObjectsFolder = os.getenv('APPDATA') + '/Grasshopper/UserObjects/'
    componentsFolder = 'C:/livestock/grasshopper/components/'
    for obj in os.listdir(componentsFolder):
        shutil.move(componentsFolder+obj,userObjectsFolder+obj)
    shutil.rmtree('C:/livestock/grasshopper')
    
    return True

    
#------------------------------------------------------------------------------#
# OUTPUTS

if Update:
    downloadSourceAndUnzip()
    print('Download done')
# ---------- end update ----------
panel = Panel(update)
