# Grasshopper definition LoadSave Mesh.gh (Grasshopper 0.9.76)
# plug-ins: Python Interpreter

update = LivestockUpdate(Update=Toggle(False))  # -> out
# ---------- update: Python ----------
#------------------------------------------------------------------------------#
# IMPORTS

import sys
import os
import shutil
import zipfile
import time
import urllib
import System

n = 20
ghenv.Component.Name = "Livestock Update"
ghenv.Component.NickName = "Update"
ghenv.Component.Message = "VER 0.0.1 | May 2017"
ghenv.Component.IconDisplayMode = ghenv.Component.IconDisplayMode.application
ghenv.Component.Category = "Livestock"
ghenv.Component.SubCategory = "0 | Miscellaneous"
ghenv.Component.Description = "Update Livestock"
	
#------------------------------------------------------------------------------#
# COMPONENT

def downloadSourceAndUnzip():
    """
    Download the source code from github and unzip it in temp folder
    """

    url = "https://github.com/ocni-dtu/livestock_gh/archive/master.zip"
    targetDirectory = r'C:\livestock'

    # download the zip file
    print("Downloading the source code...")
    zipFile = os.path.join(targetDirectory, os.path.basename(url))
    
    # if the source file is just downloded then just use the available file
    if os.path.isfile(zipFile) and time.time() - os.stat(zipFile).st_mtime < 1000:
        download = False
    else:
        download = True

        # remove the old version
        try:
            shutil.rmtree(targetDirectory)
        except:
            pass

    # create the target directory
    if not os.path.isdir(targetDirectory): os.mkdir(targetDirectory)

    if download:
        try:
            client = System.Net.WebClient()
            client.DownloadFile(url, zipFile)
            if not os.path.isfile(zipFile):
                print("Download failed! Try to download and unzip the file manually form:\n" + url)
                return
        except Exception, e:
            print(`e` + "\nDownload failed! Try to download and unzip the file manually form:\n" + url)
            return

    # unzip the file
    with zipfile.ZipFile(zipFile) as zf:
        for f in zf.namelist():
            folder = f.replace('livestock_gh-master/','C:/livestock/')
            if f.endswith('/'):
                try:
                    os.makedirs(folder)
                    os.makedirs(f)
                except:
                    pass
            else:
                zf.extract(f, targetDirectory)
                file = f.replace('livestock_gh-master/','C:/livestock/')
                shutil.move('C:/livestock/'+f,file)
                
    shutil.rmtree('C:/livestock/livestock_gh-master')
    
    # Create SSH folder
    if not os.path.isdir('C:/livestock/python/ssh'):
        os.mkdir('C:/livestock/python/ssh')
    
    #Move GH components
    userObjectsFolder = os.getenv('APPDATA') + '/Grasshopper/UserObjects/'
    componentsFolder = 'C:/livestock/grasshopper/components/'
    for obj in os.listdir(componentsFolder):
        shutil.move(componentsFolder+obj,userObjectsFolder+obj)
    shutil.rmtree('C:/livestock/grasshopper')
    
    return True

    
#------------------------------------------------------------------------------#
# OUTPUTS

if Update:
    downloadSourceAndUnzip()
    print('Download done')
# ---------- end update ----------
panel = Panel(update)

panel_2 = Panel("C:\Users\Christian\Desktop\")
concat = Concatenate(FragmentA=panel_2, FragmentB="\", FragmentC="TestMesh", FragmentD=".obj")
panel_3 = Panel(concat)
mesh = Mesh(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)
demesh = DeconstructMesh(Mesh=mesh)  # -> Vertices, Faces, Colours, Normals
lng = ListLength(List=demesh.Faces)
random = Random(Range=Domain(0, 1), Number=lng, Seed=2)
load_mesh = LivestockLoadMesh(Filename=panel_3, Load=Toggle(False))  # -> readMe, Mesh, MeshData
#   port Filename: Directory and file name of mesh
#   port Load: Activates the component
#   port readMe: In case of any errors, it will be shown here.
#   port MeshData: Additional data if any
# ---------- load_mesh: Python ----------
from livestock.components.geometry import LoadMesh

comp = LoadMesh(ghenv)
comp.config()
comp.run_checks(Filename, Load)
comp.run()

Mesh = comp.mesh
MeshData = comp.data
# ---------- end load_mesh ----------
save_mesh = LivestockSaveMesh(Mesh=mesh, Directory=panel_2, Filename="TestMesh", Save=Toggle(False))  # -> readMe; inputs Save: Boolean
#   port Data: Additional data if any
#   port Directory: File path to save mesh to
#   port Save: Activates the component
#   port readMe: In case of any errors, it will be shown here.
# ---------- save_mesh: Python ----------
from livestock.components.geometry import SaveMesh

comp = SaveMesh(ghenv)
comp.config()
comp.run_checks(Mesh, Data, Directory, Filename, Save)
comp.run(ghdoc)
# ---------- end save_mesh ----------
panel_4 = Panel(save_mesh)
panel_5 = Panel(load_mesh.MeshData)
panel_6 = Panel(load_mesh.readMe)
mesh_2 = Mesh(load_mesh.Mesh)
