# Grasshopper definition MeshDrainage.gh (Grasshopper 0.9.76)
# plug-ins: Python Interpreter

double_pool_mesh = Mesh(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)
water_fall_mesh = Mesh(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)
sloping_mesh = Mesh(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)

# ----
# Åben Bash og kør:
# sudo service ssh --full-restart
panel = Panel("ocni")
ssh_connection = LivestockSSHConnection(IP="127.0.0.1", Port="2222", Username=panel, Password="4320lejre")  # -> readMe
#   port IP: IP Address to connection
#   port Port: Port for connection
#   port Username: Username for connection
#   port Password: Password for connection
#   port readMe: In case of any errors, it will be shown here.
# ---------- ssh_connection: Python ----------
from livestock.components.misc import SSHConnection

comp = SSHConnection(ghenv)
comp.config()
comp.run_checks(str(IP), str(Port), str(Username), str(Password))
comp.run()
# ---------- end ssh_connection ----------
python_executor = LivestockPythonExecutor(PythonPath="C:\Program Files\Anaconda3\envs\livestock\python.exe")  # -> readMe
#   port PythonPath: Path to python.exe
#   port readMe: In case of any errors, it will be shown here.
# ---------- python_executor: Python ----------
from livestock.components.misc import PythonExecutor

comp = PythonExecutor(ghenv)
comp.config()
comp.run_checks(str(PythonPath))
comp.run()
# ---------- end python_executor ----------
update = LivestockUpdate(Update=Toggle(False))  # -> ReadMe
# ---------- update: Python ----------
#------------------------------------------------------------------------------#
# IMPORTS

import sys
import os
import shutil
import zipfile
import time
import urllib
import System

ghenv.Component.Name = "Livestock Update"
ghenv.Component.NickName = "Update"
ghenv.Component.Message = "VER 0.0.1 | August 2017"
ghenv.Component.IconDisplayMode = ghenv.Component.IconDisplayMode.application
ghenv.Component.Category = "Livestock"
ghenv.Component.SubCategory = "0 | Miscellaneous"
ghenv.Component.Description = "Update Livestock"
	
#------------------------------------------------------------------------------#
# COMPONENT

def downloadSourceAndUnzip():
    """
    Download the source code from github and unzip it in temp folder
    """

    url = "https://github.com/livestock3d/livestock_gh/archive/master.zip"
    targetDirectory = r'C:\livestock'

    # download the zip file
    print("Downloading the source code...")
    zipFile = os.path.join(targetDirectory, os.path.basename(url))
    
    # if the source file is just downloded then just use the available file
    if os.path.isfile(zipFile) and time.time() - os.stat(zipFile).st_mtime < 1000:
        download = False
    else:
        download = True

        # remove the old version
        try:
            shutil.rmtree(targetDirectory)
        except:
            pass

    # create the target directory
    if not os.path.isdir(targetDirectory): os.mkdir(targetDirectory)

    if download:
        try:
            client = System.Net.WebClient()
            client.DownloadFile(url, zipFile)
            if not os.path.isfile(zipFile):
                print("Download failed! Try to download and unzip the file manually form:\n" + url)
                return
        except Exception, e:
            print(`e` + "\nDownload failed! Try to download and unzip the file manually form:\n" + url)
            return

    # unzip the file
    with zipfile.ZipFile(zipFile) as zf:
        for f in zf.namelist():
            folder = f.replace('livestock_gh-master/','C:/livestock/')
            if f.endswith('/'):
                try:
                    os.makedirs(folder)
                    os.makedirs(f)
                except:
                    pass
            else:
                zf.extract(f, targetDirectory)
                file = f.replace('livestock_gh-master/','C:/livestock/')
                shutil.move('C:/livestock/'+f,file)
                
    shutil.rmtree('C:/livestock/livestock_gh-master')
    
    #Move GH components
    userObjectsFolder = os.getenv('APPDATA') + '/Grasshopper/UserObjects/'
    componentsFolder = 'C:/livestock/grasshopper/components/'
    for obj in os.listdir(componentsFolder):
        shutil.move(componentsFolder+obj,userObjectsFolder+obj)
    shutil.rmtree('C:/livestock/grasshopper')
    shutil.rmtree('C:/livestock/wiki')
    
    # Create SSH folder:
    os.mkdir(r'C:\livestock\python\ssh')
    
    return True

    
#------------------------------------------------------------------------------#
# OUTPUTS

if Update:
    downloadSourceAndUnzip()
    print('Download done')
# ---------- end update ----------
panel_2 = Panel(update)
panel_3 = Panel(python_executor)
panel_4 = Panel(ssh_connection)

simple_pool_mesh = Mesh(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)
remesh = LivestockRebuildMesh(Mesh=simple_pool_mesh, DetailLevel=Slider(1, range=0..2), Run=Toggle(False))  # -> Readme, NewMesh; inputs DetailLevel: Int32
# ---------- remesh: Python ----------
"""
Simulates drainage in order to analyse a mesh for local pooling of rain water.
Copyright: Creative Commons - Attribution 4.0 International
Contact: ocni@dtu.dk
-
Provided by Livestock 0.1, made by Christian Kongsgaard. 

    Args:
        Mesh: The mesh to fix.
        DetailLevel: The detail level of the wanted mesh. 0 is low, 1 is normal and 2 is high.
        Run: Activates the component.
    Returns:
        Readme!: In case of any errors, it will be shown here.
        NewMesh: Returns mesh after processing.
"""
#------------------------------------------------------------------------------#
# IMPORTS

import sys
sys.path.insert(0, r'C:\livestock\python\classes')
import LivestockGH as ls
import Rhino as rc
import subprocess
import os
import scriptcontext as sc
from shutil import copyfile

n = 6
data = ls.componetData(n)
ghenv.Component.Name = data[0]
ghenv.Component.NickName = data[1]
ghenv.Component.Message = data[2]
ghenv.Component.IconDisplayMode = ghenv.Component.IconDisplayMode.application
ghenv.Component.Category = data[3]
ghenv.Component.SubCategory = data[4]
ghenv.Component.Description = data[5]
#ghenv.Component.Icon = dgh.ComponentData[n][6]

#------------------------------------------------------------------------------#
# COMPONENT

# Paths
sshPath = r'C:\livestock\python\ssh'
templatePath = r'C:\livestock\python\templates'
meshName = 'mesh'
meshType = '.obj'
doc = ghdoc

# SSH and commands
ip = str(sc.sticky["SSH"]['ip'])
port = str(sc.sticky["SSH"]['port'])
user = str(sc.sticky["SSH"]['user'])
pw = str(sc.sticky["SSH"]['password'])

fTrans = 'user.txt,detail.txt,' + meshName+meshType
fRun = 'FixMeshTemplate.py'
fReturn = 'fixedMesh.obj'

inData = 'InData'
py_template = templatePath + '\\SSHTemplate.py'
pyfile = templatePath + '\\sshrun.py'
py = sc.sticky['PythonExe']


#------------------------------------------------------------------------------#
# OUTPUTS

if Run:
    # Clean SSH folder
    ls.cleanSSHFolder()
    
    # Export mesh
    ls.bakeExportDelete(Mesh, sshPath, meshName, meshType, doc)
    
    # Write user file
    ls.writeFile([user,], sshPath, 'user')
    
    detail = ['low','normal','high']
    # Write user file
    ls.writeFile([detail[DetailLevel],], sshPath, 'detail')
    
    # Write SSH commands
    ls.writeFile([ip,port,user,pw,fTrans,fRun,fReturn],sshPath,inData)
    
    #Copy Template
    copyfile(py_template,pyfile)
    
    # Run template
    thread = subprocess.Popen([py, pyfile])
    thread.wait()
    thread.kill()
    
    # Load results
    NewMesh = ls.importObj(sshPath+'\\fixedMesh'+meshType)
    
    # File clean up
    if NewMesh:
        ls.cleanSSHFolder()
# ---------- end remesh ----------
mesh = Mesh(simple_pool_mesh)
topological_index = LivestockTopologicalIndex(Mesh=mesh, Run=Toggle(False))  # -> Readme, TopographicIndex; inputs DrainFaces: tree
# ---------- topological_index: Python ----------
"""
Simulates drainage in order to analyse a mesh for local pooling of rain water.
Copyright: Creative Commons - Attribution 4.0 International
Contact: ocni@dtu.dk
-
Provided by Livestock 0.1, made by Christian Kongsgaard. 
    Args:
        
        Mesh: The mesh to analyse.
        DrainFaces: List of face indices from Livestock Mesh Drainage.
        Run: Activates the component.
    Returns:
        Readme!: In case of any errors, it will be shown here
        TopologicalIndex: Returns the topological index of each face.
"""
#------------------------------------------------------------------------------#
# IMPORTS

import sys
sys.path.insert(0, r'C:\livestock\python\classes')
import LivestockGH as ls
import TemplateClasses as tc
import Rhino as rc
import subprocess
import os
import scriptcontext as sc
import time

n = 9
data = ls.componetData(n)
ghenv.Component.Name = data[0]
ghenv.Component.NickName = data[1]
ghenv.Component.Message = data[2]
ghenv.Component.IconDisplayMode = ghenv.Component.IconDisplayMode.application
ghenv.Component.Category = data[3]
ghenv.Component.SubCategory = data[4]
ghenv.Component.Description = data[5]
#ghenv.Component.Icon = dgh.ComponentData[n][6]

#------------------------------------------------------------------------------#
# COMPONENT

# Paths
sshPath = r'C:\livestock\python\ssh'
#templatePath = r'C:\livestock\python\templates'
meshName = 'drainMesh'
meshType = '.obj'
doc = ghdoc

# SSH and commands
ip = str(sc.sticky["SSH"]['ip'])
port = str(sc.sticky["SSH"]['port'])
user = str(sc.sticky["SSH"]['user'])
pw = str(sc.sticky["SSH"]['password'])

fTrans = 'user.txt,drainfaces.txt,topographicIndexTemplate.py,' + meshName+meshType
fRun = 'topographicIndexTemplate.py'
fReturn = 'topographicIndex.txt'

inData = 'InData'
sshTemplate = sshPath + '\\sshTemplate.py'
py = sc.sticky['PythonExe']

def loadTopoIndex():
    file_obj = open(sshPath + "\\topographicIndex.txt",'r')
    lines = file_obj.readlines()
    faces = []
    for l in lines[:-1]:
        faces.append(l[:-1])
    file_obj.close()
    return faces
    
#------------------------------------------------------------------------------#
# OUTPUTS

if Run:
    # Clean SSH folder
    ls.cleanSSHFolder()
    
    #Create Templates
    tc.sshTemplate(sshPath)
    tc.topographicIndexTemplate(sshPath)
    time.sleep(0.5)
    
    # Export mesh
    ls.bakeExportDelete(Mesh, sshPath, meshName, meshType, doc)
    
    # Write Cpu file
    ls.writeFile(ls.tree_to_list(DrainFaces),sshPath,'drainfaces')
    
    # Write user file
    ls.writeFile([user,], sshPath, 'user')
    
    # Write SSH commands
    ls.writeFile([ip,port,user,pw,fTrans,fRun,fReturn],sshPath,inData)

    # Run template
    thread = subprocess.Popen([py, sshTemplate])
    thread.wait()
    thread.kill()
    
    # Load results
    TopographicIndex = loadTopoIndex()
    
    
    # File clean up
    if TopographicIndex:
        ls.cleanSSHFolder()
# ---------- end topological_index ----------
bnd = Bounds(Numbers=topological_index.TopographicIndex)
mesh_drainage = LivestockMeshDrainage(Mesh=mesh, CPUs=Slider(3, range=1..4), Run=Toggle(False))  # -> readMe, NewMesh, DrainCurves, EndPoints, DrainFaces; inputs Run: Int32
#   port Mesh: Mesh to preform computation on.
#   port CPUs: Number of cpu's to run the component on - Default is set to 1.
#   port Run: Activates the component
#   port readMe: In case of any errors, it will be shown here.
#   port NewMesh: New mesh as processed by PyMesh.
#   port DrainCurves: Curves constructed through the drain positions of each particle.
#   port EndPoints: The final position of the particles.
#   port DrainFaces: Faces where the drain paths go through.
# ---------- mesh_drainage: Python ----------
from livestock.components.rain import MeshDrainPaths

comp = MeshDrainPaths(ghenv)
comp.config()
comp.run_checks(Mesh, CPUs, Run)
comp.run(ghdoc)

NewMesh = comp.results['new_mesh']
DrainCurves = comp.results['drain_curves']
EndPoints = comp.results['end_points']
DrainFaces = comp.results['drain_faces']
# ---------- end mesh_drainage ----------
panel_5 = Panel(bnd)
mesh_2 = Mesh(mesh_drainage.NewMesh)
crv = Curve(mesh_drainage.DrainCurves)
pt = Point(mesh_drainage.EndPoints)
panel_6 = Panel("0.0005")
panel_7 = Panel(mesh_drainage.readMe)
mesh_3 = Mesh(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)
pt_2 = Point([Point(2.038921197, 2.021107276, -0.9961340229), Point(2.038921197, 2.021107276, -0.9961340229), Point(2.038921197, 2.021107276, -0.9961340229), Point(2.038921197, 2.021107276, -0.9961340229), Point(2.038921197, 2.021107276, -0.9961340229), Point(2.038921197, 2.021107276, -0.9961340229)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])
preview = CustomPreview(Geometry=crv, Shader=ColourSwatch(SwatchColor=RGB(0, 0, 0)))
preview_2 = CustomPreview(Geometry=pt, Shader=ColourSwatch(SwatchColor=RGB(184, 7, 7)))
mesh_pools = LivestockMeshPools(Mesh=mesh_2, EndPoints=pt, Run=Toggle(False))  # -> Readme, Pools; inputs EndPoints: list of Point3d, VolumePoints: list
# ---------- mesh_pools: Python ----------
"""
Copyright: Creative Commons - Attribution 4.0 International
Contact: ocni@dtu.dk
-
Provided by Livestock 0.1, made by Christian Kongsgaard.
 
    Args:
        Mesh: The mesh to analyse.
        EndPoints:
        VolumePoints:
        Run: Activates the component.
    Returns:
        Readme!: In case of any errors, it will be shown here
        Pools: The formed pools.
"""
#------------------------------------------------------------------------------#
# IMPORTS

import sys
sys.path.insert(0, r'C:\livestock\python\classes')
import LivestockGH as ls
import Rhino as rc
import subprocess
import os
import scriptcontext as sc
from shutil import copyfile

n = 3
data = ls.componetData(n)
ghenv.Component.Name = data[0]
ghenv.Component.NickName = data[1]
ghenv.Component.Message = data[2]
ghenv.Component.IconDisplayMode = ghenv.Component.IconDisplayMode.application
ghenv.Component.Category = data[3]
ghenv.Component.SubCategory = data[4]
ghenv.Component.Description = data[5]
#ghenv.Component.Icon = dgh.ComponentData[n][6]


#------------------------------------------------------------------------------#
# COMPONENT
sshPath = r'C:\livestock\python\ssh'
templatePath = r'C:\livestock\python\templates'
meshName = 'drainMesh'
meshType = '.obj'
pointName = 'EndPoints'
volumeName = 'VolumePoints'

# SSH and commands
ip = str(sc.sticky["SSH"]['ip'])
port = str(sc.sticky["SSH"]['port'])
user = str(sc.sticky["SSH"]['user'])
pw = str(sc.sticky["SSH"]['password'])

fTrans = 'user.txt,' + meshName+meshType + ',' + pointName + '.txt,' + volumeName + '.txt'
fRun = 'DrainPoolsTemplate.py'
fReturn = ' '

inData = 'InData'
py_template = templatePath + '\\SSHTemplate.py'
pyfile = templatePath + '\\sshrun.py'
py = sc.sticky['PythonExe']


# Organize inputs 
pts = []
for p in EndPoints:
    pts.append(str(p.X)+','+str(p.Y)+','+str(p.Z))

if len(VolumePoints) != len(EndPoints):
    if len(VolumePoints) == 1:
        VolumePoints = VolumePoints*len(EndPoints)
    else:
        print('Length of VolumePoints has to be either be 1 or the same length as EndPoints!')
        exit()

def export():
    # Export mesh
    doc = ghdoc
    ls.bakeExportDelete(Mesh, sshPath, meshName, meshType, doc)
    
    # Export end points file
    ls.writeFile(pts, sshPath, pointName)
    
    # Write user file
    ls.writeFile([user,], sshPath, 'user')
    
    # Export volume file
    ls.writeFile(VolumePoints, sshPath, volumeName)
    
    # Write SSH commands
    ls.writeFile([ip,port,user,pw,fTrans,fRun,fReturn],sshPath,inData)
    
    #Copy Template
    copyfile(py_template,pyfile)

def importResults():
    
    # Read mesh names
    file_obj = open(sshPath + "\\meshNames.txt",'r')
    data = file_obj.readline().split(',')
    names = []
    for n in data:
        names.append(n)
    file_obj.close()
    names = names[1:]
    
    # Import meshes
    pools = []
    for n in names:
        pools.append(ls.importObj(sshPath + '\\' + n))
        os.remove(sshPath + '\\' + n)
    
    return pools

def getWarnings():
    file_obj = open(sshPath + "\\out.txt",'r')
    data = file_obj.readlines()
    warn = []
    for w in data:
        print(w)
    file_obj.close()
 
        
#------------------------------------------------------------------------------#
# OUTPUTS

if Mesh and EndPoints and VolumePoints and Run:
    # Clean SSH Folder
    ls.cleanSSHFolder()
        
    # Export data
    export()
    
    # Run template
    thread = subprocess.Popen([py, pyfile])
    thread.wait()
    thread.kill()
    
    # Import results
    Pools = importResults()
    
    # Clean up
    if Pools:
        ls.cleanSSHFolder()
# ---------- end mesh_pools ----------
geo = Geometry(mesh_pools.Pools)
panel_8 = Panel(mesh_pools.Readme)
