# Grasshopper definition Blender Mesh Drainage.gh (Grasshopper 0.9.76)
# plug-ins: Python Interpreter

panel = Panel("C:\Users\Christian\Dropbox\Arbejde\DTU BYG\Livestock\livestock_gh\grasshopper\tests\test_data\topografi.3dm")
simple_pool_mesh = Mesh(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)
double_pool_mesh = Mesh(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)
water_fall_mesh = Mesh(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)
_3dm = Import3DM(File=panel, Layer="mesh", Name="*")
sloping_mesh = Mesh(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)

panel_2 = Panel("C:\Users\ocni\AppData\Local\Continuum\anaconda3\envs\livestock_env\python.exe")
# Åben Bash og kør:
# sudo service ssh --full-restart
panel_3 = Panel("ocni")
ssh_connection = LivestockSSHConnection(IP="127.0.0.1", Port="2222", Username=panel_3, Password="4320lejre")  # -> readMe
#   port IP: IP Address for SSH connection
#   port Port: Port for SSH connection
#   port Username: Username for SSH connection
#   port Password: Password for SSH connection
#   port readMe: In case of any errors, it will be shown here.
# ---------- ssh_connection: Python ----------
from livestock.components.misc import SSHConnection

comp = SSHConnection(ghenv)
comp.config()
comp.run_checks(str(IP), str(Port), str(Username), str(Password))
comp.run()
# ---------- end ssh_connection ----------
python_executor = LivestockPythonExecutor(PythonPath=panel_2)  # -> readMe
#   port PythonPath: Path to python.exe
#   port readMe: In case of any errors, it will be shown here.
# ---------- python_executor: Python ----------
from livestock.components.misc import PythonExecutor

comp = PythonExecutor(ghenv)
comp.config()
comp.run_checks(str(PythonPath))
comp.run()
# ---------- end python_executor ----------
panel_4 = Panel(python_executor)
panel_5 = Panel(ssh_connection)

mesh = Mesh(simple_pool_mesh)
topological_index = LivestockTopologicalIndex(Mesh=mesh, Run=Toggle(False))  # -> Readme, TopographicIndex; inputs DrainFaces: tree
# ---------- topological_index: Python ----------
"""
Simulates drainage in order to analyse a mesh for local pooling of rain water.
Copyright: Creative Commons - Attribution 4.0 International
Contact: ocni@dtu.dk
-
Provided by Livestock 0.1, made by Christian Kongsgaard. 
    Args:
        
        Mesh: The mesh to analyse.
        DrainFaces: List of face indices from Livestock Mesh Drainage.
        Run: Activates the component.
    Returns:
        Readme!: In case of any errors, it will be shown here
        TopologicalIndex: Returns the topological index of each face.
"""
#------------------------------------------------------------------------------#
# IMPORTS

import sys
sys.path.insert(0, r'C:\livestock\python\classes')
import LivestockGH as ls
import TemplateClasses as tc
import Rhino as rc
import subprocess
import os
import scriptcontext as sc
import time

n = 9
data = ls.componetData(n)
ghenv.Component.Name = data[0]
ghenv.Component.NickName = data[1]
ghenv.Component.Message = data[2]
ghenv.Component.IconDisplayMode = ghenv.Component.IconDisplayMode.application
ghenv.Component.Category = data[3]
ghenv.Component.SubCategory = data[4]
ghenv.Component.Description = data[5]
#ghenv.Component.Icon = dgh.ComponentData[n][6]

#------------------------------------------------------------------------------#
# COMPONENT

# Paths
sshPath = r'C:\livestock\python\ssh'
#templatePath = r'C:\livestock\python\templates'
meshName = 'drainMesh'
meshType = '.obj'
doc = ghdoc

# SSH and commands
ip = str(sc.sticky["SSH"]['ip'])
port = str(sc.sticky["SSH"]['port'])
user = str(sc.sticky["SSH"]['user'])
pw = str(sc.sticky["SSH"]['password'])

fTrans = 'user.txt,drainfaces.txt,topographicIndexTemplate.py,' + meshName+meshType
fRun = 'topographicIndexTemplate.py'
fReturn = 'topographicIndex.txt'

inData = 'InData'
sshTemplate = sshPath + '\\sshTemplate.py'
py = sc.sticky['PythonExe']

def loadTopoIndex():
    file_obj = open(sshPath + "\\topographicIndex.txt",'r')
    lines = file_obj.readlines()
    faces = []
    for l in lines[:-1]:
        faces.append(l[:-1])
    file_obj.close()
    return faces
    
#------------------------------------------------------------------------------#
# OUTPUTS

if Run:
    # Clean SSH folder
    ls.cleanSSHFolder()
    
    #Create Templates
    tc.sshTemplate(sshPath)
    tc.topographicIndexTemplate(sshPath)
    time.sleep(0.5)
    
    # Export mesh
    ls.bakeExportDelete(Mesh, sshPath, meshName, meshType, doc)
    
    # Write Cpu file
    ls.writeFile(ls.tree_to_list(DrainFaces),sshPath,'drainfaces')
    
    # Write user file
    ls.writeFile([user,], sshPath, 'user')
    
    # Write SSH commands
    ls.writeFile([ip,port,user,pw,fTrans,fRun,fReturn],sshPath,inData)

    # Run template
    thread = subprocess.Popen([py, sshTemplate])
    thread.wait()
    thread.kill()
    
    # Load results
    TopographicIndex = loadTopoIndex()
    
    
    # File clean up
    if TopographicIndex:
        ls.cleanSSHFolder()
# ---------- end topological_index ----------
mesh_drainage = LivestockMeshDrainage(Mesh=mesh, Run=Toggle(False))  # -> ReadMe, DrainCurves, EndPoints; inputs Run: Int32
#   port Required: Below are the required inputs to make this component work
#   port Mesh: Mesh to preform computation on.
#   port Run: Activates the component
#   port Optional: Below are the optional inputs to make this component work
#   port CPUs: Number of cpu's to run the component on. Default is set to 1.
#   port SSH: If True the case will be computed through the SSH connection.To get the SSH connection to work; the Livestock SSH Component should be configured. If False; the case will be run locally. Default is set to False
#   port ReadMe: In case of any errors, it will be shown here.
#   port DrainCurves: Curves constructed through the drain positions of each particle.
#   port EndPoints: The final position of the particles.
# ---------- mesh_drainage: Python ----------
from livestock.components.rain import MeshDrainPaths

comp = MeshDrainPaths(ghenv)
comp.config()
comp.run_checks(Mesh, Run, CPUs, SSH)
comp.run(ghdoc)

DrainCurves = comp.results['drain_curves']
EndPoints = comp.results['end_points']
# ---------- end mesh_drainage ----------
bnd = Bounds(Numbers=topological_index.TopographicIndex)
panel_6 = Panel(bnd)
crv = Curve(mesh_drainage.DrainCurves)
pt = Point(mesh_drainage.EndPoints)
panel_7 = Panel(mesh_drainage.ReadMe)
preview = CustomPreview(Geometry=crv, Shader=ColourSwatch(SwatchColor=RGB(0, 0, 0)))
preview_2 = CustomPreview(Geometry=pt, Shader=ColourSwatch(SwatchColor=RGB(184, 7, 7)))
