# Grasshopper definition CMF Compute Slope Run-off.gh (Grasshopper 0.9.76)
# plug-ins: Python Interpreter

# ----
# Slope Function
number_slider = Slider(0.25, range=0..1)
series = Series(Start="-3", Step=number_slider, Count=11)
sqr = Square(Value=series)

panel = Panel("C:\Users\Christian\Miniconda3\envs\livestock_dev\python.exe")

# ----
# Livestock Setup
# Python and SSH
panel_2 = Panel("C:\Users\ocni\AppData\Local\Continuum\anaconda3\envs\livestock_env\python.exe")
python_executor = LivestockPythonExecutor(PythonPath=panel)  # -> readMe
#   port PythonPath: Path to python.exe
#   port readMe: In case of any errors, it will be shown here.
# ---------- python_executor: Python ----------
from livestock.components.misc import PythonExecutor

comp = PythonExecutor(ghenv)
comp.config()
comp.run_checks(str(PythonPath))
comp.run()
# ---------- end python_executor ----------
panel_3 = Panel(python_executor)

# ----
# X Direction
number_slider_2 = Slider(11, range=0..100)
series_2 = Series(Start=0, Step=Slider(2.5, range=0.5..5), Count=number_slider_2)

# ----
# 1. GEOMETRY
number_slider_3 = Slider(1, range=0..1)
pt = ConstructPoint(XCoordinate=series_2, YCoordinate=0, ZCoordinate=sqr)
pt_2 = ConstructPoint(XCoordinate=series_2, YCoordinate=number_slider_3, ZCoordinate=sqr)
weave = Weave(Pattern=[0, 1], Stream0=pt, Stream1=pt_2, NullGaps=False)
srfgrid = SurfaceFromPoints(Points=weave, UCount=number_slider_2, Interpolate=False)
mesh = MeshBrep(
    Brep=srfgrid,
    Settings={GridMaxCount=0, GridMinCount=16, JaggedSeams=False, MaxEdgeLength=0, MinEdgeLength=0.0001, MinTolerance=0, Refine=True, RefineAngle=0, RelativeTolerance=0.65, SimplePlanes=True, Tolerance=0})

# ---- group: Sort Faces
toggle = BooleanToggle(True)
faceb = FaceBoundaries(Mesh=mesh)
toggle_2 = BooleanToggle(False)
lng = ListLength(List=faceb)
dup = DuplicateData(Data=toggle, Number=expr("x-1", lng), Order=True)
dup_2 = DuplicateData(Data=toggle_2, Number=expr("x-1", lng), Order=True)
cullf = CullFaces(Mesh=mesh, Pattern=flatten([toggle_2, dup]))
cullf_2 = CullFaces(Mesh=mesh, Pattern=flatten([toggle, dup_2]))

# ----
# Soil Layers
number_slider_4 = Slider(0, range=0..2)
series_3 = Series(Start=Slider(0.1, range=0..1), Step=number_slider_4, Count=Slider(1, range=1..10))

# ----
# Soil Layers
number_slider_5 = Slider(0, range=0..2)
series_4 = Series(Start=Slider(0.1, range=0..1), Step=number_slider_5, Count=Slider(1, range=1..10))

# ----
# Soil Layers
number_slider_6 = Slider(0, range=0..2)
series_5 = Series(Start=Slider(0.1, range=0..1), Step=number_slider_6, Count=Slider(1, range=1..10))

# ----
# Soil Layers
number_slider_7 = Slider(0, range=0..2)
series_6 = Series(Start=Slider(0.1, range=0..1), Step=number_slider_7, Count=Slider(1, range=1..10))

# ----
# 2. GROUND
number_slider_8 = Slider(0, range=0..1)
cmf_ground = LivestockCMFGround(
    MeshFaces=cullf,
    Layers=series_3,
    GroundType=Slider(2, range=0..2),
    SurfaceWater=Slider(9, range=0..10),
    ETMethod=Slider(0, range=0..2),
    SurfaceRunOffMethod=number_slider_8)  # -> ReadMe, GroundData, Ground; inputs Layers: list
#   port Required: Below are the required inputs to make this component work
#   port MeshFaces: The mesh the where the ground properties should be applied.
#   port Write: Boolean to write the mesh to disk
#   port Optional: Below are the optional inputs to make this component work
#   port Layers: List of the depth of soil layers to add to the mesh in m. If the values 1 and 2 are given, two layers will be created. One from 0 to 1m and one from 1m to 2m. Default is 1m
#   port GroundType: Ground type to be applied. A number from 0-6 can be provided or the Livestock Ground Type component can be connected. 0 - Short grass with medium ground 1 - Gravel (light color and permeable) 2 - Pavement (dark color and non-permeable) Default is 0 - Short grass with medium ground
#   port SurfaceWater: Initial volume of surface water placed on each mesh face in m3. Default is set to 0m3
#   port ETMethod: Set method to calculate evapotranspiration. 0: No evapotranspiration 1: Penman-Monteith 2: Shuttleworth-Wallace Default is set to no evapotranspiratio.
#   port SurfaceRunOffMethod: Set the method for computing the surface run-off. 0 - Kinematic Wave. 1 - Diffusive Wave. Default is set 0 - Kinematic Wave.
#   port ReadMe: In case of any errors, it will be shown here.
#   port GroundData: Livestock Ground Data
#   port Ground: Livestock Ground Data Class
# ---------- cmf_ground: Python ----------
from livestock.components.comp_cmf import CMFGround

comp = CMFGround(ghenv)
comp.config()
comp.run_checks(MeshFaces, Write, Layers, GroundType, SurfaceWater, ETMethod,  
                SurfaceRunOffMethod)
                
comp.run(ghdoc)

Ground = comp.results
# ---------- end cmf_ground ----------

# ----
# 2. GROUND
number_slider_9 = Slider(1, range=0..1)
cmf_ground_2 = LivestockCMFGround(
    MeshFaces=cullf,
    Layers=series_4,
    GroundType=Slider(2, range=0..2),
    SurfaceWater=Slider(9, range=0..10),
    ETMethod=Slider(0, range=0..2),
    SurfaceRunOffMethod=number_slider_9)  # -> ReadMe, GroundData, Ground; inputs Layers: list
#   port Required: Below are the required inputs to make this component work
#   port Optional: Below are the optional inputs to make this component work
#   port ETMethod: Set method to calculate evapotranspiration. 0: No evapotranspiration 1: Penman-Monteith 2: Shuttleworth-Wallace Default is set to no evapotranspiration
#   port ReadMe: In case of any errors, it will be shown here.
# ---------- cmf_ground_2: Python ----------
__author__ = "Christian Kongsgaard"
__license__ = "MIT"

# ---------------------------------------------------------------------------- #
# Imports

# Module imports
import os
import xml.etree.ElementTree as ET
import collections
import subprocess
from shutil import copyfile
import pprint
import json
from System.Diagnostics import Process
import pickle

# Livestock imports
import livestock.lib.ssh as ssh
import livestock.lib.cmf_lib as cmf_lib
import livestock.lib.geometry as gh_geo
import livestock.lib.livestock_csv as csv
from livestock.components.component import GHComponent
from livestock.components import component
import livestock.lib.misc as gh_misc
from livestock.lib.templates import pick_template

# Grasshopper imports
import Rhino.Geometry as rg
import rhinoscriptsyntax as rs


# ---------------------------------------------------------------------------- #
# Classes

class CMFGround(GHComponent):
    """A component class that generates the CMF ground"""

    def __init__(self, ghenv):
        GHComponent.__init__(self, ghenv)

        def inputs():
            return {0: component.inputs('required'),

                    1: {'name': 'MeshFaces',
                        'description': 'The mesh the where the ground '
                                       'properties should be applied.',
                        'access': 'item',
                        'default_value': None},

                    2: component.inputs('optional'),

                    3: {'name': 'Layers',
                        'description': 'List of the depth of soil layers to '
                                       'add to the mesh in m.\n'
                                       'If the values 1 and 2 are given, two '
                                       'layers will be created. '
                                       'One from 0 to 1m and one from 1m to 2m.'
                                       '\nDefault is 1m',
                        'access': 'list',
                        'default_value': 1},

                    4: {'name': 'GroundType',
                        'description': 'Ground type to be applied. A number '
                                       'from 0-6 can be provided or the '
                                       'Livestock Ground Type component can be '
                                       'connected.\n'
                                       '0 - Short grass with medium ground\n'
                                       '1 - Gravel (light color and '
                                       'permeable)\n'
                                       '2 - Pavement (dark color and '
                                       'non-permeable)\n'
                                       'Default is 0 - Short grass with medium '
                                       'ground',
                        'access': 'item',
                        'default_value': 0},

                    5: {'name': 'SurfaceWater',
                        'description': 'Initial volume of surface water placed '
                                       'on each mesh face in m3.\n'
                                       'Default is set to 0m3',
                        'access': 'item',
                        'default_value': 0},

                    6: {'name': 'ETMethod',
                        'description': 'Set method to calculate '
                                       'evapotranspiration.\n'
                                       '0: No evapotranspiration\n'
                                       '1: Penman-Monteith\n'
                                       '2: Shuttleworth-Wallace\n'
                                       'Default is set to no evapotranspiration',
                        'access': 'item',
                        'default_value': 0},

                    7: {'name': 'SurfaceRunOffMethod',
                        'description': 'Set the method for computing the '
                                       'surface run-off.\n'
                                       '0 - Kinematic Wave.\n'
                                       '1 - Diffusive Wave.\n'
                                       'Default is set 0 - Kinematic Wave.',
                        'access': 'item',
                        'default_value': 0}
                    }

        def outputs():
            return {0: component.outputs('readme'),

                    1: {'name': 'GroundData',
                        'description': 'Livestock Ground Data'},

                    2: {'name': 'Ground',
                        'description': 'Livestock Ground Data Class'}}

        # Component Config
        self.inputs = inputs()
        self.outputs = outputs()
        self.component_number = 11
        self.description = 'Generates CMF ground' \
                           '\nCMF ground is a mesh surface with porous or ' \
                           'glass-like properties.' \
                           'CMF ground can be used to model surface runoff and ' \
                           'water transport on and within the mesh.' \
                           '\nIcon art based created by Ben Davis from the ' \
                           'Noun Project.'
        self.checks = False
        self.results = None

        # Data Parameters
        self.mesh_faces = None
        self.layers = None
        self.ground_type = None
        self.surface_water = None
        self.et_number = None
        self.surface_run_off_method = None

    def check_inputs(self):
        """
        Checks inputs and raises a warning if an input is not the correct type.
        """

        self.checks = True

    def config(self):
        """Generates the Grasshopper component."""

        # Generate Component
        self.config_component(self.component_number)

    def run_checks(self, mesh_faces, layers, ground_type, surface_water,
                   et_method, surface_run_off_method):
        """
        Gathers the inputs and checks them.

        :param layers: Depth of layers.
        :param retention_curve: Livestock retention curve dict.
        :param vegetation_properties: Livestock vegetation properties dict.
        :param saturated_depth: Saturated depth of the cell.
        :param surface_water: Initial surface water volume.
        :param face_indices: Face indices where the properties should be applied to.
        :param et_method: Evapotranspriation calculation method.
        :param manning_: Manning roughness.
        :param puddle: Puddle depth.
        :param surface_run_off_method: Surface Run-off method.
        """

        # Gather data
        self.mesh_faces = self.add_default_value(mesh_faces, 1)
        self.layers = self.add_default_value(layers, 3)
        self.ground_type = self.convert_ground_type(ground_type)
        self.surface_water = self.add_default_value(surface_water, 5)
        self.et_number = self.add_default_value(et_method, 6)
        self.surface_run_off_method = self.add_default_value(surface_run_off_method, 7)

        # Run checks
        self.check_inputs()

    def convert_ground_type(self, ground_type):
        if isinstance(ground_type, int) or isinstance(ground_type, float):
            return self.construct_ground_type(ground_type)

        elif not ground_type:
            return self.construct_ground_type(0)

        else:
            return ground_type.c

    def construct_ground_type(self, index):
        manning = None
        puddle = 0.01
        saturated_depth = 3

        if index == 0:
            return {'retention_curve': cmf_lib.load_retention_curve(0),
                    'surface_properties': cmf_lib.load_surface_cover(0),
                    'manning': manning,
                    'puddle_depth': puddle,
                    'saturated_depth': saturated_depth, }

        elif index == 1:
            return {'retention_curve': cmf_lib.load_retention_curve(1),
                    'surface_properties': cmf_lib.load_surface_cover(3),
                    'manning': manning,
                    'puddle_depth': puddle,
                    'saturated_depth': saturated_depth, }

        elif index == 2:
            return {'retention_curve': cmf_lib.load_retention_curve(0,
                                                                    {'k_sat':
                                                                         0.01}),
                    'surface_properties': cmf_lib.load_surface_cover(5),
                    'manning': manning,
                    'puddle_depth': puddle,
                    'saturated_depth': saturated_depth, }

        else:
            raise ValueError('Ground type should be an integer from 0-2. '
                             'Given value was:' + str(index))

    def convert_et_number_to_method(self):
        """
        Converts a number into a ET method.

        :return: ET method name.
        """

        if self.et_number == 0:
            return None
        elif self.et_number == 1:
            return 'penman_monteith'
        elif self.et_number == 2:
            return 'shuttleworth_wallace'
        else:
            w = 'ETMethod has to between 0 and 2. Input was: ' + str(self.et_number)
            self.add_warning(w)
            raise ValueError(w)

    def convert_runoff_number_to_method(self):
        """
        Converts a number into a surface run-off method.

        :return: Surface run-off name
        """

        if self.surface_run_off_method == 0:
            return 'kinematic'
        elif self.surface_run_off_method == 1:
            return 'diffusive'
        else:
            w = 'SurfaceRunOffMethod has to between 0 and 1. Input was: ' + str(self.surface_run_off_method)
            self.add_warning(w)
            raise ValueError(w)

    def run(self):
        """
        In case all the checks have passed the component runs.
        The component puts all the inputs into a dict and uses PassClass to pass it on.
        """

        if self.checks:
            ground_dict = {'mesh': self.mesh_faces,
                           'layers': self.layers,
                           'ground_type': self.ground_type,
                           'surface_water': self.surface_water,
                           'et_method': self.convert_et_number_to_method(),
                           'runoff_method': self.convert_runoff_number_to_method()
                           }

            self.results = gh_misc.PassClass(ground_dict, 'Ground')

comp = CMFGround(ghenv)
comp.config()
comp.run_checks(MeshFaces, Layers, GroundType, SurfaceWater, ETMethod,  
                SurfaceRunOffMethod)
comp.run()

print str(comp.mesh_faces)
print type(comp.mesh_faces)

Ground = comp.results
# ---------- end cmf_ground_2 ----------

# ----
# 2. GROUND
number_slider_10 = Slider(0, range=0..1)
number_slider_11 = Slider(0, range=0..2)
cmf_ground_3 = LivestockCMFGround(
    MeshFaces=cullf_2,
    Layers=series_5,
    GroundType=Slider(2, range=0..2),
    SurfaceWater=number_slider_11,
    ETMethod=number_slider_11,
    SurfaceRunOffMethod=number_slider_10)  # -> ReadMe, GroundData, Ground; inputs Layers: list
#   port Required: Below are the required inputs to make this component work
#   port MeshFaces: The mesh the where the ground properties should be applied.
#   port Write: Boolean to write the mesh to disk
#   port Optional: Below are the optional inputs to make this component work
#   port Layers: List of the depth of soil layers to add to the mesh in m. If the values 1 and 2 are given, two layers will be created. One from 0 to 1m and one from 1m to 2m. Default is 1m
#   port GroundType: Ground type to be applied. A number from 0-6 can be provided or the Livestock Ground Type component can be connected. 0 - Short grass with medium ground 1 - Gravel (light color and permeable) 2 - Pavement (dark color and non-permeable) Default is 0 - Short grass with medium ground
#   port SurfaceWater: Initial volume of surface water placed on each mesh face in m3. Default is set to 0m3
#   port ETMethod: Set method to calculate evapotranspiration. 0: No evapotranspiration 1: Penman-Monteith 2: Shuttleworth-Wallace Default is set to no evapotranspiratio.
#   port SurfaceRunOffMethod: Set the method for computing the surface run-off. 0 - Kinematic Wave. 1 - Diffusive Wave. Default is set 0 - Kinematic Wave.
#   port ReadMe: In case of any errors, it will be shown here.
#   port GroundData: Livestock Ground Data
#   port Ground: Livestock Ground Data Class
# ---------- cmf_ground_3: Python ----------
from livestock.components.comp_cmf import CMFGround

comp = CMFGround(ghenv)
comp.config()
comp.run_checks(MeshFaces, Write, Layers, GroundType, SurfaceWater, ETMethod,  
                SurfaceRunOffMethod)
comp.run(ghdoc)

Ground = comp.results
# ---------- end cmf_ground_3 ----------

# ----
# 2. GROUND
number_slider_12 = Slider(0, range=0..1)
cmf_ground_4 = LivestockCMFGround(
    MeshFaces=cullf_2,
    Layers=series_6,
    GroundType=Slider(2, range=0..2),
    SurfaceWater=0,
    ETMethod=Slider(0, range=0..2),
    SurfaceRunOffMethod=number_slider_12)  # -> ReadMe, GroundData, Ground; inputs Layers: list
#   port Required: Below are the required inputs to make this component work
#   port Optional: Below are the optional inputs to make this component work
#   port ETMethod: Set method to calculate evapotranspiration. 0: No evapotranspiration 1: Penman-Monteith 2: Shuttleworth-Wallace Default is set to no evapotranspiration
#   port ReadMe: In case of any errors, it will be shown here.
# ---------- cmf_ground_4: Python ----------
__author__ = "Christian Kongsgaard"
__license__ = "MIT"

# ---------------------------------------------------------------------------- #
# Imports

# Module imports
import os
import xml.etree.ElementTree as ET
import collections
import subprocess
from shutil import copyfile
import pprint
import json
from System.Diagnostics import Process
import pickle

# Livestock imports
import livestock.lib.ssh as ssh
import livestock.lib.cmf_lib as cmf_lib
import livestock.lib.geometry as gh_geo
import livestock.lib.livestock_csv as csv
from livestock.components.component import GHComponent
from livestock.components import component
import livestock.lib.misc as gh_misc
from livestock.lib.templates import pick_template

# Grasshopper imports
import Rhino.Geometry as rg
import rhinoscriptsyntax as rs


# ---------------------------------------------------------------------------- #
# Classes

class CMFGround(GHComponent):
    """A component class that generates the CMF ground"""

    def __init__(self, ghenv):
        GHComponent.__init__(self, ghenv)

        def inputs():
            return {0: component.inputs('required'),

                    1: {'name': 'MeshFaces',
                        'description': 'The mesh the where the ground '
                                       'properties should be applied.',
                        'access': 'item',
                        'default_value': None},

                    2: component.inputs('optional'),

                    3: {'name': 'Layers',
                        'description': 'List of the depth of soil layers to '
                                       'add to the mesh in m.\n'
                                       'If the values 1 and 2 are given, two '
                                       'layers will be created. '
                                       'One from 0 to 1m and one from 1m to 2m.'
                                       '\nDefault is 1m',
                        'access': 'list',
                        'default_value': 1},

                    4: {'name': 'GroundType',
                        'description': 'Ground type to be applied. A number '
                                       'from 0-6 can be provided or the '
                                       'Livestock Ground Type component can be '
                                       'connected.\n'
                                       '0 - Short grass with medium ground\n'
                                       '1 - Gravel (light color and '
                                       'permeable)\n'
                                       '2 - Pavement (dark color and '
                                       'non-permeable)\n'
                                       'Default is 0 - Short grass with medium '
                                       'ground',
                        'access': 'item',
                        'default_value': 0},

                    5: {'name': 'SurfaceWater',
                        'description': 'Initial volume of surface water placed '
                                       'on each mesh face in m3.\n'
                                       'Default is set to 0m3',
                        'access': 'item',
                        'default_value': 0},

                    6: {'name': 'ETMethod',
                        'description': 'Set method to calculate '
                                       'evapotranspiration.\n'
                                       '0: No evapotranspiration\n'
                                       '1: Penman-Monteith\n'
                                       '2: Shuttleworth-Wallace\n'
                                       'Default is set to no evapotranspiration',
                        'access': 'item',
                        'default_value': 0},

                    7: {'name': 'SurfaceRunOffMethod',
                        'description': 'Set the method for computing the '
                                       'surface run-off.\n'
                                       '0 - Kinematic Wave.\n'
                                       '1 - Diffusive Wave.\n'
                                       'Default is set 0 - Kinematic Wave.',
                        'access': 'item',
                        'default_value': 0}
                    }

        def outputs():
            return {0: component.outputs('readme'),

                    1: {'name': 'GroundData',
                        'description': 'Livestock Ground Data'},

                    2: {'name': 'Ground',
                        'description': 'Livestock Ground Data Class'}}

        # Component Config
        self.inputs = inputs()
        self.outputs = outputs()
        self.component_number = 11
        self.description = 'Generates CMF ground' \
                           '\nCMF ground is a mesh surface with porous or ' \
                           'glass-like properties.' \
                           'CMF ground can be used to model surface runoff and ' \
                           'water transport on and within the mesh.' \
                           '\nIcon art based created by Ben Davis from the ' \
                           'Noun Project.'
        self.checks = False
        self.results = None

        # Data Parameters
        self.mesh_faces = None
        self.layers = None
        self.ground_type = None
        self.surface_water = None
        self.et_number = None
        self.surface_run_off_method = None

    def check_inputs(self):
        """
        Checks inputs and raises a warning if an input is not the correct type.
        """

        self.checks = True

    def config(self):
        """Generates the Grasshopper component."""

        # Generate Component
        self.config_component(self.component_number)

    def run_checks(self, mesh_faces, layers, ground_type, surface_water,
                   et_method, surface_run_off_method):
        """
        Gathers the inputs and checks them.

        :param layers: Depth of layers.
        :param retention_curve: Livestock retention curve dict.
        :param vegetation_properties: Livestock vegetation properties dict.
        :param saturated_depth: Saturated depth of the cell.
        :param surface_water: Initial surface water volume.
        :param face_indices: Face indices where the properties should be applied to.
        :param et_method: Evapotranspriation calculation method.
        :param manning_: Manning roughness.
        :param puddle: Puddle depth.
        :param surface_run_off_method: Surface Run-off method.
        """

        # Gather data
        self.mesh_faces = self.add_default_value(mesh_faces, 1)
        self.layers = self.add_default_value(layers, 3)
        self.ground_type = self.convert_ground_type(ground_type)
        self.surface_water = self.add_default_value(surface_water, 5)
        self.et_number = self.add_default_value(et_method, 6)
        self.surface_run_off_method = self.add_default_value(surface_run_off_method, 7)

        # Run checks
        self.check_inputs()

    def convert_ground_type(self, ground_type):
        if isinstance(ground_type, int) or isinstance(ground_type, float):
            return self.construct_ground_type(ground_type)

        elif not ground_type:
            return self.construct_ground_type(0)

        else:
            return ground_type.c

    def construct_ground_type(self, index):
        manning = None
        puddle = 0.01
        saturated_depth = 3

        if index == 0:
            return {'retention_curve': cmf_lib.load_retention_curve(0),
                    'surface_properties': cmf_lib.load_surface_cover(0),
                    'manning': manning,
                    'puddle_depth': puddle,
                    'saturated_depth': saturated_depth, }

        elif index == 1:
            return {'retention_curve': cmf_lib.load_retention_curve(1),
                    'surface_properties': cmf_lib.load_surface_cover(3),
                    'manning': manning,
                    'puddle_depth': puddle,
                    'saturated_depth': saturated_depth, }

        elif index == 2:
            return {'retention_curve': cmf_lib.load_retention_curve(0,
                                                                    {'k_sat':
                                                                         0.01}),
                    'surface_properties': cmf_lib.load_surface_cover(5),
                    'manning': manning,
                    'puddle_depth': puddle,
                    'saturated_depth': saturated_depth, }

        else:
            raise ValueError('Ground type should be an integer from 0-2. '
                             'Given value was:' + str(index))

    def convert_et_number_to_method(self):
        """
        Converts a number into a ET method.

        :return: ET method name.
        """

        if self.et_number == 0:
            return None
        elif self.et_number == 1:
            return 'penman_monteith'
        elif self.et_number == 2:
            return 'shuttleworth_wallace'
        else:
            w = 'ETMethod has to between 0 and 2. Input was: ' + str(self.et_number)
            self.add_warning(w)
            raise ValueError(w)

    def convert_runoff_number_to_method(self):
        """
        Converts a number into a surface run-off method.

        :return: Surface run-off name
        """

        if self.surface_run_off_method == 0:
            return 'kinematic'
        elif self.surface_run_off_method == 1:
            return 'diffusive'
        else:
            w = 'SurfaceRunOffMethod has to between 0 and 1. Input was: ' + str(self.surface_run_off_method)
            self.add_warning(w)
            raise ValueError(w)

    def run(self):
        """
        In case all the checks have passed the component runs.
        The component puts all the inputs into a dict and uses PassClass to pass it on.
        """

        if self.checks:
            ground_dict = {'mesh': self.mesh_faces,
                           'layers': self.layers,
                           'ground_type': self.ground_type,
                           'surface_water': self.surface_water,
                           'et_method': self.convert_et_number_to_method(),
                           'runoff_method': self.convert_runoff_number_to_method()
                           }

            self.results = gh_misc.PassClass(ground_dict, 'Ground')
            

comp = CMFGround(ghenv)
comp.config()
comp.run_checks(MeshFaces, Layers, GroundType, SurfaceWater, ETMethod,  
                SurfaceRunOffMethod)
comp.run()

Ground = comp.results

print(comp.surface_water)
# ---------- end cmf_ground_4 ----------

panel_4 = Panel(cmf_ground.ReadMe)

# ----
# Solver Settings & Outputs
number_slider_13 = Slider(1, range=0..1)
toggle_3 = BooleanToggle(True)
cmf_outputs = LivestockCMFOutputs(Evapotranspiration=Toggle(False), SurfaceWaterVolume=toggle_3, SurfaceWaterFlux=toggle_3)  # -> readMe, ChosenOutputs, Outputs
#   port Evapotranspiration: Cell evaporation - default is set to True
#   port SurfaceWaterVolume: Cell surface water - default is set to False
#   port SurfaceWaterFlux: Cell surface water flux - default is set to False
#   port HeatFlux: Cell surface heat flux - default is set to False
#   port AerodynamicResistance: Cell aerodynamic resistance - default is set to False
#   port VolumetricFlux: Soil layer volumetric flux vectors - default is set to False
#   port Potential: Soil layer total potential (Psi_tot = Psi_M + Psi_G - default is set to False
#   port Theta: Soil layer volumetric water content of the layer - default is set to False
#   port Volume: Soil layer volume of water in the layer - default is set to False
#   port Wetness: Soil layer wetness of the soil (V_volume/V_pores) - default is set to False
#   port readMe: In case of any errors, it will be shown here.
#   port ChosenOutputs: Shows the chosen outputs
#   port Outputs: Livestock Output Data
# ---------- cmf_outputs: Python ----------
from livestock.components.comp_cmf import CMFOutputs

comp = CMFOutputs(ghenv)
comp.config()
comp.run_checks(Evapotranspiration, SurfaceWaterVolume, SurfaceWaterFlux, 
                HeatFlux, AerodynamicResistance, VolumetricFlux, Potential, 
                Theta, Volume, Wetness)
comp.run()

ChosenOutputs = comp.output_dict.items()
Outputs = comp.results
# ---------- end cmf_outputs ----------
cmf_solver_settings = LivestockCMFSolverSettings(AnalysisLength=Slider(1, range=1..8760), TimeStep="0.0002778", SolverTolerance="1e-04", Verbosity=number_slider_13)  # -> readMe, SolverSettings
#   port AnalysisLength: Total length of the simulation in hours - default is set to 24 hours.
#   port TimeStep: Size of each time step in hours - e.g. 1/60 equals time steps of 1 min and 24 is a time step of one day. Default is 1 hour
#   port SolverTolerance: Solver tolerance - Default is 1e-8
#   port Verbosity: Sets the verbosity of the print statement during runtime - Default is 1. 0 - Prints only at start and end of simulation. 1 - Prints at every time step.
#   port readMe: In case of any errors, it will be shown here.
#   port SolverSettings: Livestock Solver Settings
# ---------- cmf_solver_settings: Python ----------
from livestock.components.comp_cmf import CMFSolverSettings

comp = CMFSolverSettings(ghenv)
comp.config()
comp.run_checks(AnalysisLength, TimeStep, SolverTolerance, Verbosity)
comp.run()

SolverSettings = comp.results
# ---------- end cmf_solver_settings ----------

python = PythonScript(x=cmf_ground_2.Ground)  # -> out, a
# ---------- python: Python ----------
import rhinoscriptsyntax as rs
import pickle

b = str(pickle.loads(x.c['mesh']))
a = b
print a
print type(a)
# ---------- end python ----------

# ----
# Solver Settings & Outputs
number_slider_14 = Slider(1, range=0..1)
toggle_4 = BooleanToggle(True)
cmf_outputs_2 = LivestockCMFOutputs(Evapotranspiration=Toggle(False), SurfaceWaterVolume=toggle_4, SurfaceWaterFlux=toggle_4)  # -> readMe, ChosenOutputs, Outputs; same code as cmf_outputs
cmf_solver_settings_2 = LivestockCMFSolverSettings(AnalysisLength=Slider(1, range=1..8760), TimeStep="0.0002778", SolverTolerance="1e-04", Verbosity=number_slider_14)  # -> readMe, SolverSettings; same code as cmf_solver_settings

faceb_2 = FaceBoundaries(Mesh=mesh)
Z = UnitZ(Factor=series_3)
Z_2 = UnitZ(Factor=expr("-x", series_3))  # -> graft(UnitVector)
# Visualize Geometry
extr = Extrude(Base=faceb_2, Direction=Z)
move = Move(Geometry=extr, Motion=Z_2)  # -> Geometry, Transform
wires = BrepWireframe(Brep=move.Geometry, Density=-1)  # -> simplify(Wireframe)

mesh_2 = Mesh(python.a)

preview = CustomPreview(Geometry=wires, Shader=ColourSwatch(SwatchColor=RGB(0, 0, 0)))
preview_2 = CustomPreview(Geometry=mesh, Shader=ColourSwatch(SwatchColor=RGB(203, 162, 125)))

# ----
# 4. SOLVE
panel_5 = Panel("C:\Users\ocni\PycharmProjects\livestock_gh\grasshopper\tests\test_data")
panel_6 = Panel("C:\Users\Christian\Dropbox\Arbejde\DTU BYG\Livestock\livestock_gh\grasshopper\tests\test_data")
cmf_solve = LivestockCMFSolve(
    Ground=[cmf_ground.Ground, cmf_ground_3.Ground],
    Write=Toggle(False),
    Run=Toggle(False),
    CaseName="CMF_Slope_v0",
    Folder=panel_6,
    SSH=Toggle(False))  # -> ReadMe, ResultPath; inputs Ground: list, Trees: list, BoundaryConditions: list
#   port Required: Below are the required inputs to make this component work
#   port Ground: Output from Livestock CMF Ground
#   port Write: Boolean to write files
#   port Run: Boolean to run analysis
#   port Optional: Below are the optional inputs to make this component work
#   port Weather: Input from Livestock CMF Weather
#   port Trees: Input from Livestock CMF Tree
#   port BoundaryConditions: Input from Livestock CMF Boundary Condition
#   port SolverSettings: Input from Livestock CMF Solver Settings
#   port Outputs: Connect Livestock Outputs
#   port CaseName: Case name as string. Default is: unnamed_cmf_case
#   port Folder: Path to case folder. Default is C:/livestock/analyses
#   port SSH: If True the case will be computed through the SSH connection.To get the SSH connection to work; the Livestock SSH Component should be configured. If False; the case will be run locally. Default is set to False
#   port ReadMe: In case of any errors, it will be shown here.
#   port ResultPath: Path to result files
# ---------- cmf_solve: Python ----------
from livestock.components.comp_cmf import CMFSolve

comp = CMFSolve(ghenv)
comp.config()
comp.run_checks(Ground, Write, Run, Weather, Trees, BoundaryConditions, 
                SolverSettings, Outputs, CaseName, Folder, SSH)
comp.run(ghdoc)
#print(comp.case_path)
ResultPath = comp.case_path
# ---------- end cmf_solve ----------
panel_7 = Panel(cmf_solve.ReadMe)

# ----
# 4. SOLVE
panel_8 = Panel("C:\Users\ocni\PycharmProjects\livestock_gh\grasshopper\tests\test_data")
panel_9 = Panel("C:\Users\Christian\Dropbox\Arbejde\DTU BYG\Livestock\livestock_gh\grasshopper\tests\test_data")
cmf_solve_2 = LivestockCMFSolve(
    Ground=[cmf_ground_2.Ground, cmf_ground_4.Ground],
    Write=Toggle(True),
    Run=Toggle(False),
    CaseName="CMF_Slope_v0",
    Folder=panel_9,
    SSH=Toggle(False))  # -> ReadMe, ResultPath; inputs Ground: list, Trees: list, BoundaryConditions: list
#   port Required: Below are the required inputs to make this component work
#   port Optional: Below are the optional inputs to make this component work
#   port CaseName: Case name as string. Default is: unnamed_cmf_case
#   port Folder: Path to case folder. Default is C:/livestock/analyses
#   port ReadMe: In case of any errors, it will be shown here.
# ---------- cmf_solve_2: Python ----------
__author__ = "Christian Kongsgaard"
__license__ = "MIT"

# ---------------------------------------------------------------------------- #
# Imports

# Module imports
import os
import xml.etree.ElementTree as ET
import collections
import subprocess
from shutil import copyfile
import pprint
import json
from System.Diagnostics import Process
import pickle

# Livestock imports
import livestock.lib.ssh as ssh
import livestock.lib.cmf_lib as cmf_lib
import livestock.lib.geometry as gh_geo
import livestock.lib.livestock_csv as csv
from livestock.components.component import GHComponent
from livestock.components import component
import livestock.lib.misc as gh_misc
from livestock.lib.templates import pick_template

# Grasshopper imports
import Rhino.Geometry as rg
import rhinoscriptsyntax as rs


# ---------------------------------------------------------------------------- #
# Classes

class CMFSolve(GHComponent):
    """A component class that solves the CMF Case."""

    def __init__(self, ghenv):
        GHComponent.__init__(self, ghenv)

        def inputs():
            return {0: component.inputs('required'),

                    1: {'name': 'Ground',
                        'description': 'Output from Livestock CMF Ground',
                        'access': 'list',
                        'default_value': None},

                    2: {'name': 'Write',
                        'description': 'Boolean to write files',
                        'access': 'item',
                        'default_value': False},

                    3: {'name': 'Run',
                        'description': 'Boolean to run analysis\n',
                        'access': 'item',
                        'default_value': False},

                    4: component.inputs('optional'),

                    5: {'name': 'Weather',
                        'description': 'Input from Livestock CMF Weather',
                        'access': 'item',
                        'default_value': None},

                    6: {'name': 'Trees',
                        'description': 'Input from Livestock CMF Tree',
                        'access': 'list',
                        'default_value': None},

                    7: {'name': 'BoundaryConditions',
                        'description': 'Input from Livestock CMF Boundary Condition',
                        'access': 'list',
                        'default_value': None},

                    8: {'name': 'SolverSettings',
                        'description': 'Input from Livestock CMF Solver Settings',
                        'access': 'item',
                        'default_value': None},

                    9: {'name': 'Outputs',
                        'description': 'Connect Livestock Outputs',
                        'access': 'item',
                        'default_value': None},

                    10: {'name': 'CaseName',
                         'description': 'Case name as string.\n'
                                        'Default is: unnamed_cmf_case',
                         'access': 'item',
                         'default_value': 'unnamed_cmf_case'},

                    11: {'name': 'Folder',
                         'description': 'Path to case folder.\n'
                                        'Default is C:/livestock/analyses',
                         'access': 'item',
                         'default_value': r'C:\livestock\analyses'},

                    12: {'name': 'SSH',
                         'description': 'If True the case will be computed '
                                        'through the SSH connection.'
                                        'To get the SSH connection to work; '
                                        'the Livestock SSH Component '
                                        'should be configured. If False; '
                                        'the case will be run locally.\n'
                                        'Default is set to False',
                         'access': 'item',
                         'default_value': False},
                    }

        def outputs():
            return {0: component.outputs('readme'),

                    1: {'name': 'ResultPath',
                        'description': 'Path to result files'}}

        # Component Config
        self.inputs = inputs()
        self.outputs = outputs()
        self.component_number = 14
        self.description = 'Solves CMF Case.\n' \
                           'Icon art based on Vectors Market from the ' \
                           'Noun Project.'
        self.checks = False
        self.results = None

        # Data Parameters
        self.ground = None
        self.write_case = None
        self.run_case = None
        self.weather = None
        self.trees = None
        self.boundary_conditions = None
        self.solver_settings = None
        self.output_config = None
        self.folder = None
        self.case_name = None
        self.ssh = None

        # Additional Parameters
        self.case_path = None
        self.mesh = None
        self.py_exe = gh_misc.get_python_exe()
        self.written = False

    def check_inputs(self):
        """Checks inputs and raises a warning if an input is not
        the correct type."""

        if self.ground:
            self.checks = True
        else:
            warning = 'Temperature should be a float'
            self.add_warning(warning)

    def config(self):
        """Generates the Grasshopper component."""

        # Generate Component
        self.config_component(self.component_number)

    def run_checks(self, ground, write, run, weather, trees,
                   boundary_conditions, solver_settings,
                   outputs, name, folder, ssh,):
        """
        Gathers the inputs and checks them.

        :param ground: Livestock Ground dict
        :param write: Whether to write or not
        :param run: Whether to run or not.
        :param weather: Livestock Weather dict
        :param trees: Livestock Tree dict
        :param boundary_conditions: Livestock Boundary Condition dict
        :param solver_settings: Livestock Solver settings dict
        :param outputs: Livestock Outputs dict
        :param name: Case name
        :param folder: Case folder
        :param ssh: Whether to run on ssh or not.
        """

        # Gather data
        self.ground = self.add_default_value(ground, 1)
        self.write_case = self.add_default_value(write, 2)
        self.run_case = self.add_default_value(run, 3)
        self.weather = self.add_default_value(weather, 5)
        self.trees = self.add_default_value(trees, 6)
        self.boundary_conditions = self.add_default_value(boundary_conditions,
                                                          7)
        self.solver_settings = self.convert_solver_settings(solver_settings)
        self.output_config = self.convert_outputs(outputs)
        self.case_name = self.add_default_value(name, 10)
        self.folder = self.add_default_value(folder, 11)
        self.ssh = self.add_default_value(ssh, 12)

        self.update_case_path()

        # Run checks
        self.check_inputs()

    def update_case_path(self):
        """Updates the case folder path."""

        self.case_path = self.folder + '\\' + self.case_name + '\\cmf'

    @staticmethod
    def convert_solver_settings(solver_settings):
        if not solver_settings:
            return cmf_lib.default_solver_settings()
        else:
            return solver_settings.c

    @staticmethod
    def convert_outputs(outputs):
        if not outputs:
            return cmf_lib.default_outputs()
        else:
            return outputs.c

    def write(self, doc):
        """
        Writes the needed files.

        :param doc: Grasshopper document.
        """

        # Helper functions
        def write_weather(weather_dict, folder):

            # Write json file
            weather_file = 'weather.json'
            with open(folder + '/' + weather_file, 'w') as outfile:
                json.dump(weather_dict.c, outfile)

            return weather_file

        def write_ground(ground_dict_, folder):

            # Process ground
            ground_dict = [ground.c
                           for ground in ground_dict_]

            # Join meshes
            #meshes = []
            joined_mesh = rg.Mesh()
            for ground_ in ground_dict:
                m = rs.coerceguid(ground_['mesh'])
                print m
                joined_mesh.Append(m)
                """
                mp = str(pickle.loads(ground_['mesh']))
                m = rs.coerceguid(mp)
                print m
                print type(m)
                m = rs.coercemesh(m)
                meshes.append(m)
                
            joined_mesh = rs.JoinMeshes(meshes)
            """
            # Compute face indices list
            joined_mesh_centers = rs.MeshFaceCenters(joined_mesh)
            for ground in ground_dict:
                mesh_ = rg.Mesh().Append(rs.coercemesh(ground['mesh']))
                print mesh_
                ground_centers = (mesh_.Faces())
                print ground_centers
                ground['mesh'] = []
                for center_pt in ground_centers:
                    ground['mesh'].append(joined_mesh_centers.index(center_pt))


            # Save Mesh
            gh_geo.bake_export_delete(joined_mesh, folder, 'mesh', '.obj', doc)

            # Write json file
            ground_file = 'ground.json'
            with open(folder + '/' + ground_file, 'w') as outfile:
                json.dump(ground_dict, outfile)

            return ground_file

        def write_trees(tree_dict_, folder):
            # Process trees

            tree_dict = list(tree.c for tree in tree_dict_)
            tree_root = ET.Element('tree')

            for i in range(0, len(tree_dict)):
                tree = ET.SubElement(tree_root, 'tree_%i' % i)
                t_keys = tree_dict[i].keys()

                for t in t_keys:
                    data = ET.SubElement(tree, str(t))
                    data_to_write = tree_dict[i][str(t)]
                    if isinstance(data_to_write, dict):
                        data.text = str(dict(data_to_write))
                    else:
                        data.text = str(data_to_write)

            tree_tree = ET.ElementTree(tree_root)
            tree_file = 'trees.xml'
            tree_tree.write(folder + '/' + tree_file, xml_declaration=True)

            return tree_file

        def write_outputs(output_dict, folder):

            # Write json file
            output_file = 'outputs.json'
            with open(folder + '/' + output_file, 'w') as outfile:
                json.dump(output_dict, outfile)

            return output_file

        def write_boundary_conditions(boundary_dict_, folder):
            # Process boundary conditions
            boundary_conditions_dict = list(bc.c
                                            for bc in boundary_dict_)

            boundary_conditions_root = ET.Element('boundary_conditions')

            for i in range(0, len(boundary_conditions_dict)):
                boundary_condition = ET.SubElement(boundary_conditions_root,
                                                   'boundary_condition_%i' % i)

                bc_type = ET.SubElement(boundary_condition, 'type')
                bc_type.text = str(boundary_conditions_dict[i]['type'])

                bc_cell = ET.SubElement(boundary_condition, 'cell')
                bc_cell.text = str(boundary_conditions_dict[i]['cell'])

                bc_layer = ET.SubElement(boundary_condition, 'layer')
                bc_layer.text = str(boundary_conditions_dict[i]['layer'])

                if boundary_conditions_dict[i]['type'] == 'inlet':
                    bc_flux = ET.SubElement(boundary_condition, 'inlet_flux')
                    bc_flux.text = str(boundary_conditions_dict[i]['inlet_flux'])

                    bc_step = ET.SubElement(boundary_condition, 'time_step')
                    bc_step.text = str(boundary_conditions_dict[i]['time_step'])

                elif boundary_conditions_dict[i]['type'] == 'outlet':
                    bc_flux = ET.SubElement(boundary_condition, 'outlet_type')

                    outlet_connection = ET.SubElement(bc_flux,
                                                      'outlet_connection')
                    outlet_connection.text = str(boundary_conditions_dict[i]['outlet_type']['connection'])

                    outlet_parameter = ET.SubElement(bc_flux,
                                                     'connection_parameter')
                    outlet_parameter.text = str(boundary_conditions_dict[i]['outlet_type']['connection_parameter'])

                    bc_flux = ET.SubElement(boundary_condition, 'location')
                    bc_flux.text = str(boundary_conditions_dict[i]['location'])

            boundary_conditions_tree = ET.ElementTree(boundary_conditions_root)
            boundary_condition_file = 'boundary_condition.xml'
            boundary_conditions_tree.write(folder + '/' + boundary_condition_file, xml_declaration=True)

            return boundary_condition_file

        def write_solver_info(solver_dict, folder):

            # Write json file
            solver_file = 'solver.json'
            with open(folder + '/' + solver_file, 'w') as outfile:
                json.dump(solver_dict, outfile)

            return solver_file

        def write_ssh_files(files_written_):
            # Clean SSH folder
            ssh.clean_ssh_folder()

            # SSH commands
            ssh_command = ssh.get_ssh()

            file_transfer = files_written_
            file_run = ['cmf_template.py']
            file_return = ['results.json']

            ssh_command['file_transfer'] = ','.join(file_transfer) + \
                                           ',cmf_template.py'
            ssh_command['file_run'] = ','.join(file_run)
            ssh_command['file_return'] = ','.join(file_return)
            ssh_command['template'] = 'cmf'

            ssh.write_ssh_commands(ssh_command)

            return ssh_command

        # check if folder exists
        if os.path.exists(self.case_path):
            self.written = True
        else:
            os.mkdir(self.case_path)

        # Append to files written
        files_written = list()
        files_written.append('mesh.obj')
        files_written.append(write_ground(self.ground, self.case_path))
        files_written.append(write_outputs(self.output_config, self.case_path))
        files_written.append(write_solver_info(self.solver_settings,
                                               self.case_path))

        if self.trees:
            files_written.append(write_trees(self.trees, self.case_path))

        if self.boundary_conditions:
            files_written.append(write_boundary_conditions(
                self.boundary_conditions, self.case_path))

        if self.weather:
            files_written.append(write_weather(self.weather,
                                               self.case_path))

        # template
        pick_template('cmf', self.case_path)

        # ssh
        if self.ssh:
            ssh_cmd = write_ssh_files(files_written)
            transfer_files = ssh_cmd['file_transfer'].split(',')

            # Copy files from case folder to ssh folder
            for file_ in transfer_files:
                copyfile(os.path.join(self.case_path, file_),
                         os.path.join(ssh.ssh_path, file_))

        self.written = True

        return True

    def do_case(self):
        """Spawns a new subprocess, that runs the ssh template."""

        if self.ssh:
            template = ssh.ssh_path + '/ssh_template.py'
        else:
            template = self.case_path + '/cmf_template.py'

        # Run template
        Process.Start(self.py_exe, '"' + str(template) + '"').WaitForExit()

        return True

    def check_results(self):
        """
        Checks if the result files exists and then copies them form the ssh
        folder to the case folder.
        If not then a warning is raised.
        """

        ssh_result = ssh.ssh_path + '/results.json'
        result_path = self.case_path + '/results.json'

        if os.path.exists(ssh_result):
            copyfile(ssh_result, result_path)
            ssh.clean_ssh_folder()
            return result_path

        elif os.path.exists(result_path):
            return result_path

        else:
            warning = 'Could not find result file. Unknown error occurred'
            self.add_warning(warning)

    @staticmethod
    def read_log():
        log_file = os.path.join(ssh.livestock_path,
                                'logs',
                                'livestock_info.log')

        if os.path.exists(log_file):
            with open(log_file, 'r') as file_:
                log_lines = file_.readlines()

            for line in log_lines:
                print(line.strip())

    def run(self, doc):
        """
        In case all the checks have passed and write_case is True the
        component writes the case files.
        If all checks have passed and run_case is True the
        simulation is started.
        """

        if self.checks and self.write_case:
            self.write(doc)

        if self.checks and self.run_case:
            self.do_case()
            self.results = self.check_results()
            self.read_log()


comp = CMFSolve(ghenv)
comp.config()
comp.run_checks(Ground, Write, Run, Weather, Trees, BoundaryConditions, 
                SolverSettings, Outputs, CaseName, Folder, SSH)
comp.run(ghdoc)
#print(comp.case_path)
ResultPath = comp.case_path
# ---------- end cmf_solve_2 ----------
panel_10 = Panel(cmf_solve_2.ReadMe)
