# Grasshopper definition CMF Process Slope Run-off.gh (Grasshopper 0.9.76)
# plug-ins: MeshEdit Components, Python Interpreter

folder = Panel("C:\Users\Christian\Dropbox\Arbejde\DTU BYG\Livestock\livestock_gh\grasshopper\tests\test_data\CMF_Slope_sec_v0\cmf")

# ----
# Livestock Setup
# Python and SSH
panel = Panel("C:\Users\Christian\Anaconda3\envs\livestock_env\python.exe")
panel_2 = Panel("C:\Users\Christian\Miniconda3\envs\livestock_dev\python.exe")
python_executor = LivestockPythonExecutor(PythonPath=panel_2)  # -> readMe
#   port PythonPath: Path to python.exe
#   port readMe: In case of any errors, it will be shown here.
# ---------- python_executor: Python ----------
from livestock.components.misc import PythonExecutor

comp = PythonExecutor(ghenv)
comp.config()
comp.run_checks(str(PythonPath))
comp.run()
# ---------- end python_executor ----------
panel_3 = Panel(python_executor)

# ---- group: TIME
number_slider = Slider(0, range=0..9)

# ----
# MESH
python = PythonScript(x=folder)  # -> out, a
# ---------- python: Python ----------
import os

a = []

for f in os.listdir(x):
    if f.endswith('.obj'):
        a.append(os.path.join(x, f))
# ---------- end python ----------
load_mesh = LivestockLoadMesh(Filename=python.a, Load=Toggle(True))  # -> ReadMe, Mesh, MeshData
#   port Required: Below are the required inputs to make this component work
#   port Filename: Directory and file name of mesh
#   port Load: Activates the component
#   port ReadMe: In case of any errors, it will be shown here.
#   port MeshData: Additional data if any
# ---------- load_mesh: Python ----------
from livestock.components.geometry import LoadMesh

comp = LoadMesh(ghenv)
comp.config()
comp.run_checks(Filename, Load)
comp.run()

Mesh = comp.mesh
MeshData = comp.data
# ---------- end load_mesh ----------

mjoin = MeshJoin(Meshes=load_mesh.Mesh)

mesh = Mesh(mjoin)

# ----
# Calculate Surface Run-Off
toggle = BooleanToggle(False)
cmf_surface_flux_result = LivestockCMFSurfaceFluxResult(ResultFolder=folder, Mesh=mesh, SaveResult=Toggle(False), Write=toggle, Run=Toggle(False))  # -> readMe, Unit, SurfaceFluxVectors, CSVPath; disabled
#   port ResultFolder: Path to result folder. Accepts output from Livestock Solve
#   port Mesh: Mesh of the case
#   port IncludeRunOff: Include surface run-off into the surface flux vector? Default is set to True
#   port IncludeRain: Include rain into the surface flux vector? Default is False.
#   port IncludeEvapotranspiration: Include evapotranspiration into the surface flux vector? Default is set to False
#   port IncludeInfiltration: Include infiltration into the surface flux vector? Default is set to False
#   port SaveResult: Save the values as a text file - Default is set to False
#   port Write: Write component files
#   port Run: Run component
#   port readMe: In case of any errors, it will be shown here.
#   port Unit: Shows the units of the results
#   port SurfaceFluxVectors: Tree with the surface flux vectors
#   port CSVPath: Path to csv file.
# ---------- cmf_surface_flux_result: Python ----------
from livestock.components.comp_cmf import CMFSurfaceFluxResult

comp = CMFSurfaceFluxResult(ghenv)
comp.config()
comp.run_checks(ResultFilePath, Mesh, IncludeRunOff, IncludeRain, 
                IncludeEvapotranspiration, IncludeInfiltration, SaveResult, 
                Write, Run)
comp.run()


Unit = comp.unit
SurfaceFluxVectors = comp.results
ResultPath = comp.result_path
# ---------- end cmf_surface_flux_result ----------
panel_4 = Panel(cmf_surface_flux_result.readMe)

# ----
# Mesh Preview
swatch = ColourSwatch(SwatchColor=RGB(0, 0, 0))
faceb = FaceBoundaries(Mesh=mesh)
preview = CustomPreview(Geometry=faceb, Shader=swatch)

# ----
# Display Flux Vectors
number_slider_2 = Slider(10, range=0..100)
explode = MeshExplode(Mesh=mesh, Interpolate=False)
area = Area(Geometry=explode)  # -> Area, Centroid
item = ListItem(List=cmf_surface_flux_result.SurfaceFluxVectors, Index=Slider(10, range=0..10), Wrap=True)
vdisex = VectorDisplayEx(Point=graft(area.Centroid), Vector=item, Colour=RGB(0, 0, 0), Width=2)

# ----
# Create Volumes
number_slider_3 = Slider(1, range=0..1)
cmf_results = LivestockCMFResults(ResultFolder=folder, FetchResult=number_slider_3, Run=Toggle(True))  # -> ReadMe, Units, Values
#   port Required: Below are the required inputs to make this component work
#   port ResultFolder: Path to result folder. Accepts output from Livestock Solve.
#   port FetchResult: Choose which result should be loaded: 0 - Evapotranspiration 1 - Surface water volume 2 - Surface water flux 3 - Heat flux 4 - Soil layer water flux 5 - Soil layer potential 6 - Soil layer theta 7 - Soil layer volume 8 - Soil layer wetness
#   port Run: Run component
#   port ReadMe: In case of any errors, it will be shown here.
#   port Units: Shows the units of the results
#   port Values: List with chosen result values
# ---------- cmf_results: Python ----------
from livestock.components.comp_cmf import CMFResults

comp = CMFResults(ghenv)
comp.config()
comp.run_checks(ResultFolder, FetchResult, Run)
comp.run()

Units = comp.unit
Values = comp.results
# ---------- end cmf_results ----------
item_2 = ListItem(List=simplify(cmf_results.Values), Index=number_slider, Wrap=True)  # -> flatten(Item)
division = Division(A=item_2, B=area.Area)
faceb_2 = FaceBoundaries(Mesh=explode)  # -> flatten(Boundaries)
Z = UnitZ(Factor=division)
extr = Extrude(Base=faceb_2, Direction=Z)
cap = CapHoles(Brep=extr)
