# Grasshopper definition CMF Surface Properties.gh (Grasshopper 0.9.76)
# plug-ins: Python Interpreter

panel = Panel("C:\Users\Christian\Miniconda3\envs\livestock_env\python.exe")

# ----
# Livestock Setup
# Python and SSH
panel_2 = Panel("C:\Users\ocni\AppData\Local\Continuum\anaconda3\envs\livestock_env\python.exe")
python_executor = LivestockPythonExecutor(PythonPath=panel_2)  # -> readMe
#   port PythonPath: Path to python.exe
#   port readMe: In case of any errors, it will be shown here.
# ---------- python_executor: Python ----------
from livestock.components.misc import PythonExecutor

comp = PythonExecutor(ghenv)
comp.config()
comp.run_checks(str(PythonPath))
comp.run()
# ---------- end python_executor ----------
panel_3 = Panel(python_executor)

number_slider = Slider(3, range=0..10)
# 1. GEOMETRY
dom = ConstructDomain(DomainStart=0, DomainEnd=Slider(5, range=0..10))
rectangle = Rectangle(Plane=PlaneXY(0, 0, 0), XSize=dom, YSize=dom, Radius=0)  # -> Rectangle, Length
mesh_uv = MeshSurface(Surface=rectangle.Rectangle, UCount=number_slider, VCount=number_slider, Overhang=True, Equalize=False)

# ----
# 3c) Ground Type with Custom Property Components
number_slider_2 = Slider(7.6, range=0..10)
cmf_vegetation_properties = LivestockCMFVegetationProperties(SurfaceCover=Slider(7, range=0..10), Height=number_slider_2, LeafWidth=Slider(0.1, range=0..0.1))  # -> ReadMe, Units, SurfaceValues, SurfaceProperties
#   port Optional: Below are the optional inputs to make this component work
#   port SurfaceCover: Sets the surface cover for the ground. 0 - Short Grass: 0.12m 1 - High Grass: 0.4m 2 - Wet Sand 3 - Yellow Sand 4 - White Sand 5 - Bare Moist Soil 6 - Bare Dry Soil 7 - Deciduous Tree(s) Default is set to 0: Short Grass: 0.12m
#   port Height: Height of the surface cover in meters. Default is 0.12m. Unless for trees there it is 5m
#   port LeafAreaIndex: Leaf area index of the surface cover. Leaf area index is unitless. Default is 2.88
#   port Albedo: Albedo of the surface cover. Albedo is unitless. Default is 0.23
#   port CanopyClosure: Canopy closure of the surface cover. Canopy closure is unitless. Default is 1.0
#   port CanopyPARExtinction: Canopy PAR Extinction of the surface cover. Canopy PAR Extinction is unitless. Default is 0.6
#   port CanopyCapacityLAI: Canopy Capacity per LAI of the surface cover. Canopy Capacity per LAI is in millimeters. Default is 0.1
#   port StomatalResistance: Stomatal Resistance of the surface cover. Stomatal Resistance is in s/m. Default is 100.0
#   port RootDepth: Root Depth of the surface cover. Root Depth is in meters. Default is 0.25
#   port FractionRootDepth: Fraction at root depth of the surface cover. Fraction at root depth is unitless. Default is 1
#   port LeafWidth: Leaf width of the surface cover. Leaf width is in meters. Default is 0.005m
#   port ReadMe: In case of any errors, it will be shown here.
#   port Units: Shows the units of the surface values
#   port SurfaceValues: Chosen Surface Properties Values
#   port SurfaceProperties: Livestock Surface Properties Data Class
# ---------- cmf_vegetation_properties: Python ----------
from livestock.components.comp_cmf import CMFSurfaceProperties

comp = CMFSurfaceProperties(ghenv)
comp.config()
comp.run_checks(SurfaceCover, Height, LeafAreaIndex, Albedo, CanopyClosure, 
                CanopyPARExtinction, CanopyCapacityLAI, StomatalResistance, 
                RootDepth, FractionRootDepth, LeafWidth)
                
comp.run()

Units = comp.units.items()
SurfaceValues = comp.property.items()
SurfaceProperties = comp.results
# ---------- end cmf_vegetation_properties ----------
cmf_retention_curve = LivestockCMFRetentionCurve(SoilIndex=Slider(3, range=0..10), Alpha=Slider(0.8, range=0..1))  # -> ReadMe, Units, CurveValues, RetentionCurve
#   port SoilIndex: Sets the retention curve for the ground. Should be an integer from 0-5 0 - Standard CMF Retention Curve 1 - Coarse Soil 2 - Medium Soil 3 - Medium Fine Soil 4 - Fine Soil 5 - Very Fine Soil Default is set to 0: Standard CMF Retention Curve
#   port K_sat: Saturated conductivity in m/day
#   port Phi: Porosity in m3/m3
#   port Alpha: Inverse of water entry potential in 1/cm
#   port N: Pore size distribution parameter is unitless
#   port M: Van Genuchten m (if negative, 1-1/n is used) is unitless
#   port L: Mualem tortoisivity is unitless
#   port ReadMe: In case of any errors, it will be shown here.
#   port Units: Shows the units of the curve values
#   port CurveValues: Chosen curve properties values
#   port RetentionCurve: Livestock Retention Curve
# ---------- cmf_retention_curve: Python ----------
from livestock.components.comp_cmf import CMFRetentionCurve

comp = CMFRetentionCurve(ghenv)
comp.config()
comp.run_checks(SoilIndex, K_sat, Phi, Alpha, N, M, L)
                
comp.run()

Units = comp.units.items()
CurveValues = comp.property.items()
RetentionCurve = comp.results
# ---------- end cmf_retention_curve ----------
cmf_ground_type = LivestockCMFGroundType(RetentionCurve=cmf_retention_curve.RetentionCurve, SurfaceCover=cmf_vegetation_properties.SurfaceProperties)  # -> ReadMe, GroundTypeData, GroundType
#   port Optional: Below are the optional inputs to make this component work
#   port RetentionCurve: Sets the retention curve for the ground. Can either be an integer from 0-5 orthe output from CMF RetentionCurve. 0 - Standard CMF Retention Curve 1 - Coarse Soil 2 - Medium Soil 3 - Medium Fine Soil 4 - Fine Soil 5 - Very Fine Soil Default is set to 0: Standard CMF Retention Curve
#   port SurfaceCover: Sets the surface cover for the ground. Can either be an integer from 0-6 orthe output from CMF Surface Cover. 0 - Short Grass: 0.12m 1 - High Grass: 0.4m 2 - Wet Sand 3 - Yellow Sand 4 - White Sand 5 - Bare Moist Soil 6 - Bare Dry Soil 7 - Deciduous Tree(s) Default is set to 0: Short Grass: 0.12m
#   port Manning: Set Manning roughness. If not set CMF calculates it from the above given values.
#   port PuddleDepth: Set puddle depth. Puddle depth is the height were run-off begins. Default is set to 0.01m
#   port SaturatedDepth: Set the saturated depth. The saturated depth is where the ground water level is at. Default is set to 3m
#   port ReadMe: In case of any errors, it will be shown here.
#   port GroundTypeData: Livestock Ground Type Data
#   port GroundType: Livestock Ground Type Data Class
# ---------- cmf_ground_type: Python ----------
from livestock.components.comp_cmf import CMFGroundType

comp = CMFGroundType(ghenv)
comp.config()
comp.run_checks(RetentionCurve, SurfaceCover, Manning, PuddleDepth, SaturatedDepth)
                
comp.run()

GroundTypeData = comp.property.items()
GroundType = comp.results
# ---------- end cmf_ground_type ----------

# ----
# 3b) Ground Type with Property Components
number_slider_3 = Slider(2, range=0..10)
cmf_vegetation_properties_2 = LivestockCMFVegetationProperties(SurfaceCover=number_slider_3)  # -> ReadMe, Units, SurfaceValues, SurfaceProperties; same code as cmf_vegetation_properties
number_slider_4 = Slider(3, range=0..10)
cmf_retention_curve_2 = LivestockCMFRetentionCurve(SoilIndex=number_slider_4)  # -> ReadMe, Units, CurveValues, RetentionCurve; same code as cmf_retention_curve
cmf_ground_type_2 = LivestockCMFGroundType(RetentionCurve=number_slider_4, SurfaceCover=cmf_vegetation_properties_2.SurfaceProperties)  # -> ReadMe, GroundTypeData, GroundType; same code as cmf_ground_type

# ----
# Soil Layers
number_slider_5 = Slider(0, range=0..2)
series = Series(Start=Slider(1, range=0..1), Step=number_slider_5, Count=Slider(1, range=1..10))

# ----
# 3 GROUND TYPES
# 3a) Ground Type with Sliders
number_slider_6 = Slider(5, range=0..10)
cmf_ground_type_3 = LivestockCMFGroundType(RetentionCurve=Slider(3, range=0..10), SurfaceCover=number_slider_6)  # -> ReadMe, GroundTypeData, GroundType; same code as cmf_ground_type

# ----
# 2. GROUND
number_slider_7 = Slider(0, range=0..1)
cmf_ground = LivestockCMFGround(
    MeshFaces=mesh_uv,
    Write=Toggle(True),
    Layers=series,
    GroundType=cmf_ground_type_3.GroundType,
    SurfaceWater=Slider(9, range=0..10),
    ETMethod=Slider(0, range=0..2),
    SurfaceRunOffMethod=number_slider_7)  # -> ReadMe, GroundData, Ground; inputs Layers: list
#   port Required: Below are the required inputs to make this component work
#   port MeshFaces: The mesh the where the ground properties should be applied.
#   port Write: Boolean to write the mesh to disk
#   port Optional: Below are the optional inputs to make this component work
#   port Layers: List of the depth of soil layers to add to the mesh in m. If the values 1 and 2 are given, two layers will be created. One from 0 to 1m and one from 1m to 2m. Default is 1m
#   port GroundType: Ground type to be applied. A number from 0-6 can be provided or the Livestock Ground Type component can be connected. 0 - Short grass with medium ground 1 - Gravel (light color and permeable) 2 - Pavement (dark color and non-permeable) Default is 0 - Short grass with medium ground
#   port SurfaceWater: Initial volume of surface water placed on each mesh face in m3. Default is set to 0m3
#   port ETMethod: Set method to calculate evapotranspiration. 0: No evapotranspiration 1: Penman-Monteith 2: Shuttleworth-Wallace Default is set to no evapotranspiratio.
#   port SurfaceRunOffMethod: Set the method for computing the surface run-off. 0 - Kinematic Wave. 1 - Diffusive Wave. Default is set 0 - Kinematic Wave.
#   port ReadMe: In case of any errors, it will be shown here.
#   port GroundData: Livestock Ground Data
#   port Ground: Livestock Ground Data Class
# ---------- cmf_ground: Python ----------
from livestock.components.comp_cmf import CMFGround

comp = CMFGround(ghenv)
comp.config()
comp.run_checks(MeshFaces, Write, Layers, GroundType, SurfaceWater, ETMethod,  
                SurfaceRunOffMethod)
                
comp.run(ghdoc)

GroundData = comp.ground_dict.items()
Ground = comp.results
# ---------- end cmf_ground ----------

panel_4 = Panel(cmf_ground.GroundData)

# ----
# Solver Settings & Outputs
number_slider_8 = Slider(-5, range=-10..-2, expression="10^x")
panel_5 = Panel("""2
1
2005""")
panel_6 = Panel("""6
s""")
panel_7 = Panel("""1
s""")
cmf_outputs = LivestockCMFOutputs(SurfaceWaterVolume=Toggle(False), Volume=Toggle(False))  # -> ReadMe, ChosenOutputs, Outputs
#   port Optional: Below are the optional inputs to make this component work
#   port Evapotranspiration: Cell evaporation Default is set to False
#   port SurfaceWaterVolume: Cell surface water Default is set to True
#   port SurfaceWaterFlux: Cell surface water flux Default is set to False
#   port HeatFlux: Cell surface heat flux Default is set to False
#   port VolumetricFlux: Soil layer volumetric flux vectors Default is set to False
#   port Potential: Soil layer total potential (Psi_tot = Psi_M + Psi_G) Default is set to False
#   port Theta: Soil layer volumetric water content of the layer Default is set to False
#   port Volume: Soil layer volume of water in the layer Default is set to True
#   port Wetness: Soil layer wetness of the soil (V_volume/V_pores) Default is set to False
#   port ReadMe: In case of any errors, it will be shown here.
#   port ChosenOutputs: Shows the chosen outputs
#   port Outputs: Livestock Output Data
# ---------- cmf_outputs: Python ----------
from livestock.components.comp_cmf import CMFOutputs

comp = CMFOutputs(ghenv)
comp.config()
comp.run_checks(Evapotranspiration, SurfaceWaterVolume, SurfaceWaterFlux, 
                HeatFlux, VolumetricFlux, Potential, 
                Theta, Volume, Wetness)
comp.run()

ChosenOutputs = comp.output_dict.items()
Outputs = comp.results
# ---------- end cmf_outputs ----------
cmf_solver_settings = LivestockCMFSolverSettings(AnalysisLength=panel_6, TimeStep=panel_7, StartTime=panel_5, SolverTolerance=number_slider_8)  # -> ReadMe, ChosenSolverSettings, SolverSettings; inputs AnalysisLength: list, TimeStep: list, StartTime: list
#   port Optional: Below are the optional inputs to make this component work
#   port AnalysisLength: Total length of the simulation.The input should be a list with two values. The first value is the numerical length e.g. 24. Second value is the time unit e.g. h for hour. The second option is optional and if not giventhe time unit is set to hours. The time unit has to be one of the following values: y - year d - day h - hour m - minute s - second Default is set to 24 hours.
#   port TimeStep: Size of each simulation time step.The input should be a list with two values. The first value is the numerical length e.g. 24. Second value is the time unit e.g. h for hour. The second option is optional and if not giventhe time unit is set to hours. The time unit has to be one of the following values: y - year d - day h - hour m - minute s - second Default is 1 hour
#   port StartTime: Sets the start time for the simulation. The input should be a list with three values. The first value is the day. Second value is the month. Third value is the year. All values should be integers and they all start from 1. Default is 01-01-[current year]
#   port SolverTolerance: Solver tolerance Default is 1e-8
#   port ReadMe: In case of any errors, it will be shown here.
#   port ChosenSolverSettings: Shows the chosen solver settings
#   port SolverSettings: Livestock Solver Settings
# ---------- cmf_solver_settings: Python ----------
from livestock.components.comp_cmf import CMFSolverSettings

comp = CMFSolverSettings(ghenv)
comp.config()
comp.run_checks(AnalysisLength, TimeStep, StartTime, SolverTolerance)
comp.run()

ChosenSolverSettings = comp.settings_dict.items()
SolverSettings = comp.results
# ---------- end cmf_solver_settings ----------

faceb = FaceBoundaries(Mesh=mesh_uv)
Z = UnitZ(Factor=series)
Z_2 = UnitZ(Factor=expr("-x", series))  # -> graft(UnitVector)
# Visualize Geometry
extr = Extrude(Base=faceb, Direction=Z)
move = Move(Geometry=extr, Motion=Z_2)  # -> Geometry, Transform
wires = BrepWireframe(Brep=move.Geometry, Density=-1)  # -> simplify(Wireframe)

# ----
# 4. SOLVE
number_slider_9 = Slider(0, range=0..5)
panel_8 = Panel("C:\Users\ocni\Dropbox\Arbejde\DTU BYG\Livestock\livestock_gh\grasshopper\tests\test_data")
panel_9 = Panel(cmf_outputs.ChosenOutputs)
int = Integer(number_slider_9)
concat = Concatenate(FragmentA="surface_properties_v", FragmentB=int)
cmf_solve = LivestockCMFSolve(
    Ground=cmf_ground.Ground,
    Write=Toggle(False),
    Run=Toggle(False),
    SolverSettings=cmf_solver_settings.SolverSettings,
    Outputs=cmf_outputs.Outputs,
    CaseName=concat,
    Folder=panel_8)  # -> ReadMe, ResultPath; inputs Ground: list, BoundaryConditions: list
#   port Required: Below are the required inputs to make this component work
#   port Ground: Output from Livestock CMF Ground
#   port Write: Boolean to write files
#   port Run: Boolean to run analysis
#   port Optional: Below are the optional inputs to make this component work
#   port Weather: Input from Livestock CMF Weather
#   port BoundaryConditions: Input from Livestock CMF Boundary Condition
#   port SolverSettings: Input from Livestock CMF Solver Settings
#   port Outputs: Connect Livestock Outputs
#   port CaseName: Case name as string. Default is: unnamed_cmf_case
#   port Folder: Path to case folder. Default is C:/livestock/analyses
#   port SSH: If True the case will be computed through the SSH connection.To get the SSH connection to work; the Livestock SSH Component should be configured. If False; the case will be run locally. Default is set to False
#   port ReadMe: In case of any errors, it will be shown here.
#   port ResultPath: Path to result files
# ---------- cmf_solve: Python ----------
from livestock.components.comp_cmf import CMFSolve

comp = CMFSolve(ghenv)
comp.config()
comp.run_checks(Ground, Write, Run, Weather, BoundaryConditions, 
                SolverSettings, Outputs, CaseName, Folder, SSH)
comp.run(ghdoc)
ResultPath = comp.case_path
# ---------- end cmf_solve ----------
panel_10 = Panel(cmf_solve.ReadMe)

preview = CustomPreview(Geometry=wires, Shader=ColourSwatch(SwatchColor=RGB(0, 0, 0)))
preview_2 = CustomPreview(Geometry=mesh_uv, Shader=ColourSwatch(SwatchColor=RGB(203, 162, 125)))
