# Grasshopper definition CMF Weather.gh (Grasshopper 0.9.76)
# plug-ins: Python Interpreter

panel = Panel("C:\Users\Christian\Miniconda3\envs\livestock_env\python.exe")

# ----
# Livestock Setup
# Python and SSH
panel_2 = Panel("C:\Users\ocni\AppData\Local\Continuum\anaconda3\envs\livestock_env\python.exe")
python_executor = LivestockPythonExecutor(PythonPath=panel_2)  # -> readMe
#   port PythonPath: Path to python.exe
#   port readMe: In case of any errors, it will be shown here.
# ---------- python_executor: Python ----------
from livestock.components.misc import PythonExecutor

comp = PythonExecutor(ghenv)
comp.config()
comp.run_checks(str(PythonPath))
comp.run()
# ---------- end python_executor ----------
panel_3 = Panel(python_executor)

number_slider = Slider(3, range=0..10)
# 1. GEOMETRY
dom = ConstructDomain(DomainStart=0, DomainEnd=Slider(5, range=0..10))
rectangle = Rectangle(Plane=PlaneXY(0, 0, 0), XSize=dom, YSize=dom, Radius=0)  # -> Rectangle, Length
mesh_uv = MeshSurface(Surface=rectangle.Rectangle, UCount=number_slider, VCount=number_slider, Overhang=True, Equalize=False)

ladybug = Ladybug_Ladybug()  # -> Vviiiiiiiiiizzz; plug-in component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
path = FilePath("C:\Users\ocni\PycharmProjects\livestock_gh\grasshopper\tests\test_data\DNK_Copenhagen.061800_IWEC.epw")
# 3. APPLY WEATHER
importepw = Ladybug_ImportEpw(epwFile=path)  # -> readMe, latitude, location, dryBulbTemperature, dewPointTemperature, relativeHumidity, windSpeed, windDirection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; plug-in component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
split = SplitList(List=importepw.dryBulbTemperature, Index=7)  # -> ListA, simplify(ListB)
split_2 = SplitList(List=importepw.windSpeed, Index=7)  # -> ListA, simplify(ListB)
split_3 = SplitList(List=importepw.globalHorizontalRadiation, Index=7)  # -> ListA, simplify(ListB)
split_4 = SplitList(List=importepw.totalSkyCover, Index=7)  # -> ListA, simplify(ListB)
split_5 = SplitList(List=importepw.relativeHumidity, Index=7)  # -> ListA, simplify(ListB)

# ----
# Soil Layers
number_slider_2 = Slider(0, range=0..2)
series = Series(Start=Slider(1, range=0..1), Step=number_slider_2, Count=Slider(1, range=1..10))

demesh = DeconstructMesh(Mesh=mesh_uv)  # -> Vertices, Faces, Colours, Normals
lng = ListLength(List=demesh.Faces)

# ----
# Version 2
# Cellwise
tree_random = TreeRandom(x=split_5.ListB)
tree_random_2 = TreeRandom(x=split.ListB)
lng_2 = ListLength(List=demesh.Faces)
cmf_weather = LivestockCMFWeather(Location=importepw.location, MeshFaceCount=lng_2, Temperature=tree_random_2, RelativeHumidity=tree_random)  # -> ReadMe, Weather; inputs Temperature: tree, WindSpeed: tree, RelativeHumidity: tree, CloudCover: tree, GlobalRadiation: tree, Rain: tree, GroundTemperature: tree
#   port Required: Below are the required inputs to make this component work
#   port Location: A Ladybug Tools Location
#   port MeshFaceCount: Number of faces in the ground mesh
#   port Optional: Below are the optional inputs to make this component work
#   port Temperature: Temperature in C. Either a list or a tree where the number of branches is equal to the number of mesh faces.
#   port WindSpeed: Wind speed in m/s. Either a list or a tree where the number of branches is equal to the number of mesh faces.
#   port RelativeHumidity: Relative humidity in %. Either a list or a tree where the number of branches is equal to the number of mesh faces.
#   port CloudCover: Cloud cover, unitless between 0 and 1. Either a list or a tree where the number of branches is equal to the number of mesh faces.
#   port GlobalRadiation: Global Radiation in W/m2. Either a list or a tree where the number of branches is equal to the number of mesh faces.
#   port Rain: Horizontal precipitation in mm/h. Either a list or a tree where the number of branches is equal to the number of mesh faces.
#   port GroundTemperature: Ground temperature in C. Either a list or a tree where the number of branches is equal to the number of mesh faces.
#   port ReadMe: In case of any errors, it will be shown here.
#   port Weather: Livestock Weather Data Class
# ---------- cmf_weather: Python ----------
from livestock.components.comp_cmf import CMFWeather

comp = CMFWeather(ghenv)
comp.config()
comp.run_checks(Location, MeshFaceCount, Temperature, WindSpeed, 
                RelativeHumidity, CloudCover, GlobalRadiation, Rain, 
                GroundTemperature)
comp.run()

Weather = comp.results
# ---------- end cmf_weather ----------
panel_4 = Panel(cmf_weather.ReadMe)

# ----
# 2. GROUND
number_slider_3 = Slider(0, range=0..1)
cmf_ground = LivestockCMFGround(
    MeshFaces=mesh_uv,
    Write=Toggle(True),
    Layers=series,
    GroundType=Slider(2, range=0..2),
    SurfaceWater=Slider(9, range=0..10),
    ETMethod=Slider(0, range=0..2),
    SurfaceRunOffMethod=number_slider_3)  # -> ReadMe, GroundData, Ground; inputs Layers: list
#   port Required: Below are the required inputs to make this component work
#   port MeshFaces: The mesh the where the ground properties should be applied.
#   port Write: Boolean to write the mesh to disk
#   port Optional: Below are the optional inputs to make this component work
#   port Layers: List of the depth of soil layers to add to the mesh in m. If the values 1 and 2 are given, two layers will be created. One from 0 to 1m and one from 1m to 2m. Default is 1m
#   port GroundType: Ground type to be applied. A number from 0-6 can be provided or the Livestock Ground Type component can be connected. 0 - Short grass with medium ground 1 - Gravel (light color and permeable) 2 - Pavement (dark color and non-permeable) Default is 0 - Short grass with medium ground
#   port SurfaceWater: Initial volume of surface water placed on each mesh face in m3. Default is set to 0m3
#   port ETMethod: Set method to calculate evapotranspiration. 0: No evapotranspiration 1: Penman-Monteith 2: Shuttleworth-Wallace Default is set to no evapotranspiratio.
#   port SurfaceRunOffMethod: Set the method for computing the surface run-off. 0 - Kinematic Wave. 1 - Diffusive Wave. Default is set 0 - Kinematic Wave.
#   port ReadMe: In case of any errors, it will be shown here.
#   port GroundData: Livestock Ground Data
#   port Ground: Livestock Ground Data Class
# ---------- cmf_ground: Python ----------
from livestock.components.comp_cmf import CMFGround

comp = CMFGround(ghenv)
comp.config()
comp.run_checks(MeshFaces, Write, Layers, GroundType, SurfaceWater, ETMethod,  
                SurfaceRunOffMethod)
                
comp.run(ghdoc)

GroundData = comp.ground_dict.items()
Ground = comp.results
# ---------- end cmf_ground ----------

# ----
# Version 1
# Partial Weather
cmf_weather_2 = LivestockCMFWeather(Location=importepw.location, MeshFaceCount=lng, Temperature=split.ListB, RelativeHumidity=split_5.ListB)  # -> ReadMe, Weather; inputs Temperature: tree, WindSpeed: tree, RelativeHumidity: tree, CloudCover: tree, GlobalRadiation: tree, Rain: tree, GroundTemperature: tree
#   port Required: Below are the required inputs to make this component work
#   port Location: A Ladybug Tools Location
#   port MeshFaceCount: Number of faces in the ground mesh
#   port Optional: Below are the optional inputs to make this component work
#   port Temperature: Temperature in C. Either a list or a tree where the number of branches is equal to the number of mesh faces.
#   port WindSpeed: Wind speed in m/s. Either a list or a tree where the number of branches is equal to the number of mesh faces.
#   port RelativeHumidity: Relative humidity in %. Either a list or a tree where the number of branches is equal to the number of mesh faces.
#   port CloudCover: Cloud cover, unitless between 0 and 1. Either a list or a tree where the number of branches is equal to the number of mesh faces.
#   port GlobalRadiation: Global Radiation in W/m2. Either a list or a tree where the number of branches is equal to the number of mesh faces.
#   port Rain: Horizontal precipitation in mm/h. Either a list or a tree where the number of branches is equal to the number of mesh faces.
#   port GroundTemperature: Ground temperature in C. Either a list or a tree where the number of branches is equal to the number of mesh faces.
#   port ReadMe: In case of any errors, it will be shown here.
#   port Weather: Livestock Weather Data Class
# ---------- cmf_weather_2: Python ----------
from livestock.components.comp_cmf import CMFWeather
            
comp = CMFWeather(ghenv)
comp.config()
comp.run_checks(Location, MeshFaceCount, Temperature, WindSpeed, 
                RelativeHumidity, CloudCover, GlobalRadiation, Rain, 
                GroundTemperature)
comp.run()

Weather = comp.results
# ---------- end cmf_weather_2 ----------
panel_5 = Panel(cmf_weather_2.ReadMe)

# ----
# Version 0
# Full Weather
cmf_weather_3 = LivestockCMFWeather(
    Location=importepw.location,
    MeshFaceCount=lng,
    Temperature=split.ListB,
    WindSpeed=split_2.ListB,
    RelativeHumidity=split_5.ListB,
    CloudCover=split_4.ListB,
    GlobalRadiation=split_3.ListB,
    Rain=split_2.ListB,
    GroundTemperature=split.ListB)  # -> ReadMe, Weather; inputs Temperature: tree, WindSpeed: tree, RelativeHumidity: tree, CloudCover: tree, GlobalRadiation: tree, Rain: tree, GroundTemperature: tree; same code as cmf_weather_2
panel_6 = Panel(cmf_weather_3.ReadMe)

# ----
# Solver Settings & Outputs
number_slider_4 = Slider(-5, range=-10..-2, expression="10^x")
panel_7 = Panel("""2
1
2005""")
panel_8 = Panel("""6
s""")
panel_9 = Panel("""1
s""")
cmf_outputs = LivestockCMFOutputs(SurfaceWaterVolume=Toggle(False), Volume=Toggle(False))  # -> ReadMe, ChosenOutputs, Outputs
#   port Optional: Below are the optional inputs to make this component work
#   port Evapotranspiration: Cell evaporation Default is set to False
#   port SurfaceWaterVolume: Cell surface water Default is set to True
#   port SurfaceWaterFlux: Cell surface water flux Default is set to False
#   port HeatFlux: Cell surface heat flux Default is set to False
#   port VolumetricFlux: Soil layer volumetric flux vectors Default is set to False
#   port Potential: Soil layer total potential (Psi_tot = Psi_M + Psi_G) Default is set to False
#   port Theta: Soil layer volumetric water content of the layer Default is set to False
#   port Volume: Soil layer volume of water in the layer Default is set to True
#   port Wetness: Soil layer wetness of the soil (V_volume/V_pores) Default is set to False
#   port ReadMe: In case of any errors, it will be shown here.
#   port ChosenOutputs: Shows the chosen outputs
#   port Outputs: Livestock Output Data
# ---------- cmf_outputs: Python ----------
from livestock.components.comp_cmf import CMFOutputs

comp = CMFOutputs(ghenv)
comp.config()
comp.run_checks(Evapotranspiration, SurfaceWaterVolume, SurfaceWaterFlux, 
                HeatFlux, VolumetricFlux, Potential, 
                Theta, Volume, Wetness)
comp.run()

ChosenOutputs = comp.output_dict.items()
Outputs = comp.results
# ---------- end cmf_outputs ----------
cmf_solver_settings = LivestockCMFSolverSettings(AnalysisLength=panel_8, TimeStep=panel_9, StartTime=panel_7, SolverTolerance=number_slider_4)  # -> ReadMe, ChosenSolverSettings, SolverSettings; inputs AnalysisLength: list, TimeStep: list, StartTime: list
#   port Optional: Below are the optional inputs to make this component work
#   port AnalysisLength: Total length of the simulation.The input should be a list with two values. The first value is the numerical length e.g. 24. Second value is the time unit e.g. h for hour. The second option is optional and if not giventhe time unit is set to hours. The time unit has to be one of the following values: y - year d - day h - hour m - minute s - second Default is set to 24 hours.
#   port TimeStep: Size of each simulation time step.The input should be a list with two values. The first value is the numerical length e.g. 24. Second value is the time unit e.g. h for hour. The second option is optional and if not giventhe time unit is set to hours. The time unit has to be one of the following values: y - year d - day h - hour m - minute s - second Default is 1 hour
#   port StartTime: Sets the start time for the simulation. The input should be a list with three values. The first value is the day. Second value is the month. Third value is the year. All values should be integers and they all start from 1. Default is 01-01-[current year]
#   port SolverTolerance: Solver tolerance Default is 1e-8
#   port ReadMe: In case of any errors, it will be shown here.
#   port ChosenSolverSettings: Shows the chosen solver settings
#   port SolverSettings: Livestock Solver Settings
# ---------- cmf_solver_settings: Python ----------
from livestock.components.comp_cmf import CMFSolverSettings

comp = CMFSolverSettings(ghenv)
comp.config()
comp.run_checks(AnalysisLength, TimeStep, StartTime, SolverTolerance)
comp.run()

ChosenSolverSettings = comp.settings_dict.items()
SolverSettings = comp.results
# ---------- end cmf_solver_settings ----------

faceb = FaceBoundaries(Mesh=mesh_uv)
Z = UnitZ(Factor=series)
Z_2 = UnitZ(Factor=expr("-x", series))  # -> graft(UnitVector)
# Visualize Geometry
extr = Extrude(Base=faceb, Direction=Z)
move = Move(Geometry=extr, Motion=Z_2)  # -> Geometry, Transform
wires = BrepWireframe(Brep=move.Geometry, Density=-1)  # -> simplify(Wireframe)

# ----
# 4. SOLVE
number_slider_5 = Slider(1, range=0..5)
panel_10 = Panel(cmf_outputs.ChosenOutputs)
panel_11 = Panel("C:\Users\ocni\Dropbox\Arbejde\DTU BYG\Livestock\livestock_gh\grasshopper\tests\test_data")
int = Integer(number_slider_5)
concat = Concatenate(FragmentA="Weather_v", FragmentB=int)
cmf_solve = LivestockCMFSolve(
    Ground=cmf_ground.Ground,
    Write=Toggle(False),
    Run=Toggle(False),
    Weather=cmf_weather_2.Weather,
    SolverSettings=cmf_solver_settings.SolverSettings,
    CaseName=concat,
    Folder=panel_11,
    SSH=Toggle(False))  # -> ReadMe, ResultPath; inputs Ground: list, Trees: list, BoundaryConditions: list
#   port Required: Below are the required inputs to make this component work
#   port Ground: Output from Livestock CMF Ground
#   port Write: Boolean to write files
#   port Run: Boolean to run analysis
#   port Optional: Below are the optional inputs to make this component work
#   port Weather: Input from Livestock CMF Weather
#   port Trees: Input from Livestock CMF Tree
#   port BoundaryConditions: Input from Livestock CMF Boundary Condition
#   port SolverSettings: Input from Livestock CMF Solver Settings
#   port Outputs: Connect Livestock Outputs
#   port CaseName: Case name as string. Default is: unnamed_cmf_case
#   port Folder: Path to case folder. Default is C:/livestock/analyses
#   port SSH: If True the case will be computed through the SSH connection.To get the SSH connection to work; the Livestock SSH Component should be configured. If False; the case will be run locally. Default is set to False
#   port ReadMe: In case of any errors, it will be shown here.
#   port ResultPath: Path to result files
# ---------- cmf_solve: Python ----------
from livestock.components.comp_cmf import CMFSolve

comp = CMFSolve(ghenv)
comp.config()
comp.run_checks(Ground, Write, Run, Weather, Trees, BoundaryConditions, 
                SolverSettings, Outputs, CaseName, Folder, SSH)
comp.run(ghdoc)
#print(comp.case_path)
ResultPath = comp.case_path
# ---------- end cmf_solve ----------
panel_12 = Panel(cmf_solve.ReadMe)

preview = CustomPreview(Geometry=wires, Shader=ColourSwatch(SwatchColor=RGB(0, 0, 0)))
preview_2 = CustomPreview(Geometry=mesh_uv, Shader=ColourSwatch(SwatchColor=RGB(203, 162, 125)))

# ==== cluster TreeRandom
x = ClusterInput()
python = PythonScript(x=flatten(x))  # -> out, a, b, c, d, e, f, g, h, i; inputs x: list
# ---------- python: Python ----------
import random

def add_random(y):
    
    z = []
    for yi in y:
        z.append(yi + random.uniform(0, 3))
    
    return z

a = add_random(x)
b = add_random(x)
c = add_random(x)
d = add_random(x)
e = add_random(x)
f = add_random(x)
g = add_random(x)
h = add_random(x)
i = add_random(x)
# ---------- end python ----------
path_mapper = PathMapper(python.g, source="{A}", target="{A;6}")
path_mapper_2 = PathMapper(python.i, source="{A}", target="{A;8}")
path_mapper_3 = PathMapper(python.h, source="{A}", target="{A;7}")
path_mapper_4 = PathMapper(python.f, source="{A}", target="{A;5}")
path_mapper_5 = PathMapper(python.a, source="{A}", target="{A;0}")
path_mapper_6 = PathMapper(python.c, source="{A}", target="{A;2}")
path_mapper_7 = PathMapper(python.e, source="{A}", target="{A;4}")
path_mapper_8 = PathMapper(python.b, source="{A}", target="{A;1}")
path_mapper_9 = PathMapper(python.d, source="{A}", target="{A;3}")
merge = Merge(
    Data1=path_mapper_5,
    Data2=path_mapper_8,
    Data3=path_mapper_6,
    Data4=path_mapper_9,
    Data5=path_mapper_7,
    Data6=path_mapper_4,
    Data7=path_mapper,
    Data8=path_mapper_3,
    Data9=path_mapper_2)
R = ClusterOutput(merge)
