# Grasshopper definition Geometry Load and Save.gh (Grasshopper 0.9.76)
# plug-ins: Python Interpreter

# ----
# PATH
panel = Panel("C:\Users\ocni\Dropbox\Arbejde\DTU BYG\Livestock\livestock_gh\grasshopper\tests\test_data\save_load")

# ----
# Save
panel_2 = Panel("""simple_pool
sloping_mesh
water_fall
double_pool
hill_slope""")
double_pool_mesh = Mesh(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)
simple_pool_mesh = Mesh(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)
water_fall_mesh = Mesh(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)
sloping_mesh = Mesh(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)
hill_slope = Mesh(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)
number_slider = Slider(0, range=0..4)
merge = Merge(Data1=hill_slope, Data2=simple_pool_mesh, Data3=sloping_mesh, Data4=water_fall_mesh, Data5=double_pool_mesh)  # -> flatten(Result)
item = ListItem(List=panel_2, Index=number_slider, Wrap=True)
item_2 = ListItem(List=merge, Index=number_slider, Wrap=True)
save_mesh = LivestockSaveMesh(Mesh=item_2, Directory=panel, Filename=item, Save=Toggle(False))  # -> ReadMe; inputs Save: Boolean
#   port Required: Below are the required inputs to make this component work
#   port Directory: File path to save mesh to
#   port Save: Activates the component
#   port Optional: Below are the optional inputs to make this component work
#   port Data: Additional data if any
#   port ReadMe: In case of any errors, it will be shown here.
# ---------- save_mesh: Python ----------
from livestock.components.geometry import SaveMesh

comp = SaveMesh(ghenv)
comp.config()
comp.run_checks(Mesh, Directory, Filename, Save, Data)
comp.run(ghdoc)
# ---------- end save_mesh ----------

# ----
# Load
number_slider_2 = Slider(0, range=0..4)
python = PythonScript(x=panel)  # -> out, a
# ---------- python: Python ----------
import os

a = []

for f in os.listdir(x):
    if f.endswith('.obj'):
        a.append(os.path.join(x, f))
# ---------- end python ----------
item_3 = ListItem(List=python.a, Index=number_slider_2, Wrap=True)
load_mesh = LivestockLoadMesh(Filename=item_3, Load=Toggle(False))  # -> ReadMe, Mesh, MeshData
#   port Required: Below are the required inputs to make this component work
#   port Filename: Directory and file name of mesh
#   port Load: Activates the component
#   port ReadMe: In case of any errors, it will be shown here.
#   port MeshData: Additional data if any
# ---------- load_mesh: Python ----------
from livestock.components.geometry import LoadMesh

comp = LoadMesh(ghenv)
comp.config()
comp.run_checks(Filename, Load)
comp.run()

Mesh = comp.mesh
MeshData = comp.data
# ---------- end load_mesh ----------
mesh = Mesh(load_mesh.Mesh)
