# Grasshopper definition 1 - Ground Analysis.gh (Grasshopper 0.9.76)
# plug-ins: Python Interpreter, Human

# ----
# Livestock Setup
# Python and SSH
panel = Panel("C:\Users\Christian\Anaconda3\envs\livestock_env\python.exe")
python_executor = LivestockPythonExecutor()  # -> readMe
#   port PythonPath: Path to python.exe
#   port readMe: In case of any errors, it will be shown here.
# ---------- python_executor: Python ----------
from livestock.components.misc import PythonExecutor

comp = PythonExecutor(ghenv)
comp.config()
comp.run_checks(str(PythonPath))
comp.run()
# ---------- end python_executor ----------
panel_2 = Panel(python_executor)

wardi_curves = Curve([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])
# Wadi
boundary = BoundarySurfaces(Edges=wardi_curves)

# ----
# Geometry
# Ground Surface
# Create Trees
# Find Faces under Trees
ground_curves = Curve([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])
number_slider = Slider(10, range=0..10)
canopy_curves = Curve([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])
boundary_2 = BoundarySurfaces(Edges=ground_curves)
bbox = BoundingBox(Content=canopy_curves, Plane=PlaneXY(0, 0, 0))  # -> Box, Box_2
drec = DeconstuctRectangle(Rectangle=bbox.Box)  # -> BasePlane, XInterval, YInterval
dedomain = DeconstructDomain(Domain=drec.XInterval)  # -> Start, End
subtraction = Subtraction(A=dedomain.End, B=dedomain.Start)
mesh_uv = MeshSurface(Surface=boundary, UCount=number_slider, VCount=Slider(2, range=1..5), Overhang=True, Equalize=False)  # -> flatten(Mesh)
mesh_uv_2 = MeshSurface(Surface=boundary_2, UCount=number_slider, VCount=5, Overhang=True, Equalize=False)
mjoin = MeshJoin(Meshes=mesh_uv_2)
facen = FaceNormals(Mesh=mjoin)  # -> Centers, Normals
Z = UnitZ(Factor=subtraction)
extr = Extrude(Base=bbox.Box, Direction=Z)
multiplication = Multiplication(A=Z, B=Slider(0.75, range=0..1))
incurves = PointInCurves(Point=facen.Centers, Curves=canopy_curves)  # -> Relationship, Index, Point
move = Move(Geometry=extr, Motion=multiplication)  # -> Geometry, Transform

# ----
# Load Radiation Results
number_slider_2 = Slider(1, range=0..10)
int = Integer(number_slider_2)
concat = Concatenate(FragmentA="Wadi_Radiation_v", FragmentB=int)
python = PythonScript()  # -> out, DBpath
# ---------- python: Python ----------
import getpass

DBpath = 'C:/Users/' + getpass.getuser() + '/Dropbox'
# ---------- end python ----------
panel_3 = Panel(concat)
concat_2 = Concatenate(FragmentA=python.DBpath, FragmentB="\Uddannelse\DTU\Projekter\Speciale\Wadi")
concat_3 = Concatenate(FragmentA=concat_2, FragmentB="\", FragmentC=panel_3)
lookupfolder_daylighting = Honeybee_LookupDaylightingFolder(studyFolder=concat_3, studyType=Slider(5, range=1..5), refresh=Button())  # -> analysisType, resultsUnit, illFiles, ptsFiles, hdrFiles, imageFiles, iesFiles, epwFile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; plug-in component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
importpts = Honeybee_ImportPtsFile(ptsFileAddress=lookupfolder_daylighting.ptsFiles)  # -> points, vectors; plug-in component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
readallthedshourlyresults = Honeybee_ReadAllTheHourlyResultsFromAnnualDaylightStudy(illFilesAddress=lookupfolder_daylighting.illFiles, testPoints=importpts.points)  # -> iIllumLevelsNoDynamicSHD, iIllumLevelsDynamicSHDGroupI, iIllumLevelsDynamicSHDGroupII, iIlluminanceBasedOnOccupancy, shadingGroupInEffect; plug-in component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
flip = FlipMatrix(Data=readallthedshourlyresults.iIllumLevelsNoDynamicSHD)
split = SplitList(List=flip)  # -> ListA, ListB
path_mapper = PathMapper(split.ListA, source="{A;B;C}", target="{0;B}")

# ----
# Write Ground
toggle = BooleanToggle(False)

# ----
# Sprinkler for trees
number_slider_3 = Slider(153, range=0..1000)
panel_4 = Panel("""3
3
3
3
3
3
0
0
0
0
0
0
0
0
0
0
0
0
0
0
0
0
0
0""")
panel_5 = Panel("""0
0
3
3
3
3
0
0
0
0
0
0
0
0
0
0
0
0
0
0
0
0
0
0""")
panel_6 = Panel("""0
0
3
3
3
3
0
0
0
0
0
0
0
0
0
0
0
0
0
0
0
0
0
0""")
dup = DuplicateData(Data=panel_4, Number=number_slider_3, Order=True)  # -> simplify(graft(Data))
dup_2 = DuplicateData(Data=panel_5, Number=Slider(91, range=0..1000), Order=True)  # -> simplify(graft(Data))
path_mapper_2 = PathMapper(dup, source="{A}", target="{A+2904}")
path_mapper_3 = PathMapper(dup_2, source="{A}", target="{A+6576}")
dup_3 = DuplicateData(Data=panel_6, Number=Slider(121, range=0..1000), Order=True)  # -> simplify(graft(Data))
sort = SortList()  # -> Keys, ValuesA
merge = Merge(Data1=dup_3, Data2=path_mapper_2, Data3=path_mapper_3)
panel_7 = Panel(sort.Keys)
lng = ListLength(List=sort.Keys)
path = ConstructPath(Indices=graft(panel_7))  # -> flatten(Branch)
dup_4 = DuplicateData(Data=merge, Number=lng, Order=True)
flip_2 = FlipMatrix(Data=dup_4)  # -> simplify(Data)
tstat = TreeStatistics(Tree=flip_2)  # -> Paths, Length, Count
replace = ReplacePaths(Data=flip_2, Search=tstat.Paths, Replace=path)

# ----
# Water for Wadi
number_slider_4 = Slider(0.2, range=0..1)
faceb = FaceBoundaries(Mesh=mesh_uv)
dup_5 = DuplicateData(Data=number_slider_4, Number=2, Order=True)  # -> graft(Data)
lng_2 = ListLength(List=faceb)
dup_6 = DuplicateData(Data=dup_5, Number=lng_2, Order=True)
path_2 = ConstructPath()  # -> flatten(Branch)
flip_3 = FlipMatrix(Data=dup_6)  # -> simplify(Data)
tstat_2 = TreeStatistics(Tree=flip_3)  # -> Paths, Length, Count
replace_2 = ReplacePaths(Data=flip_3, Search=tstat_2.Paths, Replace=path_2)

# ----
# Ground - Wadi
number_slider_5 = Slider(6, range=0..7)
cmf_vegetation_properties = LivestockCMFVegetationProperties(SurfaceCover=number_slider_5)  # -> ReadMe, Units, SurfaceValues, SurfaceProperties
#   port Optional: Below are the optional inputs to make this component work
#   port SurfaceCover: Sets the surface cover for the ground. 0 - Short Grass: 0.12m 1 - High Grass: 0.4m 2 - Wet Sand 3 - Yellow Sand 4 - White Sand 5 - Bare Moist Soil 6 - Bare Dry Soil 7 - Deciduous Tree(s) Default is set to 0: Short Grass: 0.12m
#   port Height: Height of the surface cover in meters. Default is 0.12m. Unless for trees there it is 5m
#   port LeafAreaIndex: Leaf area index of the surface cover. Leaf area index is unitless. Default is 2.88
#   port Albedo: Albedo of the surface cover. Albedo is unitless. Default is 0.23
#   port CanopyClosure: Canopy closure of the surface cover. Canopy closure is unitless. Default is 1.0
#   port CanopyPARExtinction: Canopy PAR Extinction of the surface cover. Canopy PAR Extinction is unitless. Default is 0.6
#   port CanopyCapacityLAI: Canopy Capacity per LAI of the surface cover. Canopy Capacity per LAI is in millimeters. Default is 0.1
#   port StomatalResistance: Stomatal Resistance of the surface cover. Stomatal Resistance is in s/m. Default is 100.0
#   port RootDepth: Root Depth of the surface cover. Root Depth is in meters. Default is 0.25
#   port FractionRootDepth: Fraction at root depth of the surface cover. Fraction at root depth is unitless. Default is 1
#   port LeafWidth: Leaf width of the surface cover. Leaf width is in meters. Default is 0.005m
#   port ReadMe: In case of any errors, it will be shown here.
#   port Units: Shows the units of the surface values
#   port SurfaceValues: Chosen Surface Properties Values
#   port SurfaceProperties: Livestock Surface Properties Data Class
# ---------- cmf_vegetation_properties: Python ----------
from livestock.components.comp_cmf import CMFSurfaceProperties

comp = CMFSurfaceProperties(ghenv)
comp.config()
comp.run_checks(SurfaceCover, Height, LeafAreaIndex, Albedo, CanopyClosure, 
                CanopyPARExtinction, CanopyCapacityLAI, StomatalResistance, 
                RootDepth, FractionRootDepth, LeafWidth)
                
comp.run()

Units = comp.units.items()
SurfaceValues = comp.property.items()
SurfaceProperties = comp.results
# ---------- end cmf_vegetation_properties ----------
cmf_retention_curve = LivestockCMFRetentionCurve(SoilIndex=Slider(0, range=0..5), K_sat=Slider(0.1, range=0..0.1))  # -> ReadMe, Units, CurveValues, RetentionCurve
#   port SoilIndex: Sets the retention curve for the ground. Should be an integer from 0-5 0 - Standard CMF Retention Curve 1 - Coarse Soil 2 - Medium Soil 3 - Medium Fine Soil 4 - Fine Soil 5 - Very Fine Soil Default is set to 0: Standard CMF Retention Curve
#   port K_sat: Saturated conductivity in m/day
#   port Phi: Porosity in m3/m3
#   port Alpha: Inverse of water entry potential in 1/cm
#   port N: Pore size distribution parameter is unitless
#   port M: Van Genuchten m (if negative, 1-1/n is used) is unitless
#   port L: Mualem tortoisivity is unitless
#   port ReadMe: In case of any errors, it will be shown here.
#   port Units: Shows the units of the curve values
#   port CurveValues: Chosen curve properties values
#   port RetentionCurve: Livestock Retention Curve
# ---------- cmf_retention_curve: Python ----------
from livestock.components.comp_cmf import CMFRetentionCurve

comp = CMFRetentionCurve(ghenv)
comp.config()
comp.run_checks(SoilIndex, K_sat, Phi, Alpha, N, M, L)
                
comp.run()

Units = comp.units.items()
CurveValues = comp.property.items()
RetentionCurve = comp.results
# ---------- end cmf_retention_curve ----------
cmf_ground_type = LivestockCMFGroundType(
    RetentionCurve=cmf_retention_curve.RetentionCurve,
    SurfaceCover=cmf_vegetation_properties.SurfaceProperties,
    SaturatedDepth=Slider(5, range=0..10))  # -> ReadMe, GroundTypeData, GroundType
#   port Optional: Below are the optional inputs to make this component work
#   port RetentionCurve: Sets the retention curve for the ground. Can either be an integer from 0-5 orthe output from CMF RetentionCurve. 0 - Standard CMF Retention Curve 1 - Coarse Soil 2 - Medium Soil 3 - Medium Fine Soil 4 - Fine Soil 5 - Very Fine Soil Default is set to 0: Standard CMF Retention Curve
#   port SurfaceCover: Sets the surface cover for the ground. Can either be an integer from 0-6 orthe output from CMF Surface Cover. 0 - Short Grass: 0.12m 1 - High Grass: 0.4m 2 - Wet Sand 3 - Yellow Sand 4 - White Sand 5 - Bare Moist Soil 6 - Bare Dry Soil 7 - Deciduous Tree(s) Default is set to 0: Short Grass: 0.12m
#   port Manning: Set Manning roughness. If not set CMF calculates it from the above given values.
#   port PuddleDepth: Set puddle depth. Puddle depth is the height were run-off begins. Default is set to 0.01m
#   port SaturatedDepth: Set the saturated depth. The saturated depth is where the ground water level is at. Default is set to 3m
#   port ReadMe: In case of any errors, it will be shown here.
#   port GroundTypeData: Livestock Ground Type Data
#   port GroundType: Livestock Ground Type Data Class
# ---------- cmf_ground_type: Python ----------
from livestock.components.comp_cmf import CMFGroundType

comp = CMFGroundType(ghenv)
comp.config()
comp.run_checks(RetentionCurve, SurfaceCover, Manning, PuddleDepth, SaturatedDepth)
                
comp.run()

GroundTypeData = comp.property.items()
GroundType = comp.results
# ---------- end cmf_ground_type ----------
series = Series(Start=Slider(0.1, range=0..1), Step=Slider(1, range=0..1), Count=Slider(1, range=0..10))
cmf_ground = LivestockCMFGround(
    MeshFaces=mesh_uv,
    Write=toggle,
    Layers=series,
    GroundType=cmf_ground_type.GroundType,
    SurfaceWater=Slider(1, range=0..2),
    ETMethod=Slider(1, range=0..2),
    SurfaceRunOffMethod=Slider(0, range=0..1))  # -> ReadMe, GroundData, Ground; inputs Layers: list
#   port Required: Below are the required inputs to make this component work
#   port MeshFaces: The mesh the where the ground properties should be applied.
#   port Write: Boolean to write the mesh to disk
#   port Optional: Below are the optional inputs to make this component work
#   port Layers: List of the depth of soil layers to add to the mesh in m. If the values 1 and 2 are given, two layers will be created. One from 0 to 1m and one from 1m to 2m. Default is 1m
#   port GroundType: Ground type to be applied. A number from 0-6 can be provided or the Livestock Ground Type component can be connected. 0 - Short grass with medium ground 1 - Gravel (light color and permeable) 2 - Pavement (dark color and non-permeable) Default is 0 - Short grass with medium ground
#   port SurfaceWater: Initial volume of surface water placed on each mesh face in m3. Default is set to 0m3
#   port ETMethod: Set method to calculate evapotranspiration. 0: No evapotranspiration 1: Penman-Monteith 2: Shuttleworth-Wallace Default is set to no evapotranspiratio.
#   port SurfaceRunOffMethod: Set the method for computing the surface run-off. 0 - Kinematic Wave. 1 - Diffusive Wave. Default is set 0 - Kinematic Wave.
#   port ReadMe: In case of any errors, it will be shown here.
#   port GroundData: Livestock Ground Data
#   port Ground: Livestock Ground Data Class
# ---------- cmf_ground: Python ----------
from livestock.components.comp_cmf import CMFGround

comp = CMFGround(ghenv)
comp.config()
comp.run_checks(MeshFaces, Write, Layers, GroundType, SurfaceWater, ETMethod,  
                SurfaceRunOffMethod)
                
comp.run(ghdoc)

GroundData = comp.ground_dict.items()
Ground = comp.results
# ---------- end cmf_ground ----------

# ----
# Preview
mjoin_2 = MeshJoin(Meshes=flatten([mesh_uv, mesh_uv_2]))
wires = BrepWireframe(Brep=move.Geometry, Density=-1)
facen_2 = FaceNormals(Mesh=mjoin_2)  # -> Centers, Normals
faceb_2 = FaceBoundaries(Mesh=mjoin_2)
previewlw = CustomPreviewLineweights(Geometry=wires, Shader=ColourSwatch(SwatchColor=RGB(31, 113, 0)), Thickness=Slider(4, range=0..5), Absolute=False)
points = PointList(Points=facen_2.Centers)
preview = CustomPreview(Geometry=faceb_2, Shader=ColourSwatch(SwatchColor=RGB(0, 0, 0)))

# ----
# Cull Trees
panel_8 = Panel("-1")
equals = Equality(FirstNumber=incurves.Index, SecondNumber=graft(panel_8))  # -> Equality, Inequality
cullf = CullFaces(Mesh=mjoin, Pattern=equals.Inequality)  # -> flatten(Mesh)

# ----
# Ground
number_slider_6 = Slider(6, range=0..7)
cmf_vegetation_properties_2 = LivestockCMFVegetationProperties(SurfaceCover=number_slider_6)  # -> ReadMe, Units, SurfaceValues, SurfaceProperties; same code as cmf_vegetation_properties
cmf_retention_curve_2 = LivestockCMFRetentionCurve(SoilIndex=Slider(3, range=0..5))  # -> ReadMe, Units, CurveValues, RetentionCurve; same code as cmf_retention_curve
cmf_ground_type_2 = LivestockCMFGroundType(RetentionCurve=cmf_retention_curve_2.RetentionCurve, SurfaceCover=cmf_vegetation_properties_2.SurfaceProperties)  # -> ReadMe, GroundTypeData, GroundType; same code as cmf_ground_type
series_2 = Series(Start=Slider(1, range=0..1), Step=Slider(1, range=0..1), Count=Slider(3, range=0..10))
cmf_ground_2 = LivestockCMFGround(
    MeshFaces=cullf,
    Write=toggle,
    Layers=series_2,
    GroundType=cmf_ground_type_2.GroundType,
    ETMethod=Slider(1, range=0..2),
    SurfaceRunOffMethod=Slider(0, range=0..1))  # -> ReadMe, GroundData, Ground; inputs Layers: list; same code as cmf_ground

# ----
# Cull Big Trees
panel_9 = Panel("""0
3
4""")
equals_2 = Equality(FirstNumber=incurves.Index, SecondNumber=graft(panel_9))  # -> Equality, Inequality
cullf_2 = CullFaces(Mesh=mjoin, Pattern=equals_2.Inequality)  # -> flatten(Mesh)

# ----
# Ground - Trees 5m
number_slider_7 = Slider(7, range=0..7)
cmf_vegetation_properties_3 = LivestockCMFVegetationProperties(SurfaceCover=number_slider_7, Height=Slider(5, range=2..7))  # -> ReadMe, Units, SurfaceValues, SurfaceProperties; same code as cmf_vegetation_properties
cmf_retention_curve_3 = LivestockCMFRetentionCurve(SoilIndex=Slider(3, range=0..5))  # -> ReadMe, Units, CurveValues, RetentionCurve; same code as cmf_retention_curve
cmf_ground_type_3 = LivestockCMFGroundType(RetentionCurve=cmf_retention_curve_3.RetentionCurve, SurfaceCover=cmf_vegetation_properties_3.SurfaceProperties)  # -> ReadMe, GroundTypeData, GroundType; same code as cmf_ground_type
series_3 = Series(Start=Slider(1, range=0..1), Step=Slider(1, range=0..1), Count=Slider(3, range=0..10))
cmf_ground_3 = LivestockCMFGround(
    MeshFaces=cullf_2,
    Write=toggle,
    Layers=series_3,
    GroundType=cmf_ground_type_3.GroundType,
    ETMethod=Slider(1, range=0..2),
    SurfaceRunOffMethod=Slider(0, range=0..1))  # -> ReadMe, GroundData, Ground; inputs Layers: list; same code as cmf_ground

# ----
# Cull Small Trees
panel_10 = Panel("""1
2""")
equals_3 = Equality(FirstNumber=incurves.Index, SecondNumber=graft(panel_10))  # -> Equality, Inequality
cullf_3 = CullFaces(Mesh=mjoin, Pattern=equals_3.Inequality)  # -> flatten(Mesh)

# ----
# Ground - Trees 3.5m
number_slider_8 = Slider(7, range=0..7)
cmf_vegetation_properties_4 = LivestockCMFVegetationProperties(SurfaceCover=number_slider_8, Height=Slider(3.5, range=2..7))  # -> ReadMe, Units, SurfaceValues, SurfaceProperties; same code as cmf_vegetation_properties
cmf_retention_curve_4 = LivestockCMFRetentionCurve(SoilIndex=Slider(3, range=0..5))  # -> ReadMe, Units, CurveValues, RetentionCurve; same code as cmf_retention_curve
cmf_ground_type_4 = LivestockCMFGroundType(RetentionCurve=cmf_retention_curve_4.RetentionCurve, SurfaceCover=cmf_vegetation_properties_4.SurfaceProperties)  # -> ReadMe, GroundTypeData, GroundType; same code as cmf_ground_type
series_4 = Series(Start=Slider(1, range=0..1), Step=Slider(1, range=0..1), Count=Slider(3, range=0..10))
cmf_ground_4 = LivestockCMFGround(
    MeshFaces=cullf_3,
    Write=toggle,
    Layers=series_4,
    GroundType=cmf_ground_type_4.GroundType,
    ETMethod=Slider(1, range=0..2),
    SurfaceRunOffMethod=Slider(0, range=0..1))  # -> ReadMe, GroundData, Ground; inputs Layers: list; same code as cmf_ground

# ----
# Solver
number_slider_9 = Slider(8760, range=1..8760)
cmf_solver_settings = LivestockCMFSolverSettings(AnalysisLength=number_slider_9, SolverTolerance="1e-5")  # -> ReadMe, ChosenSolverSettings, SolverSettings; inputs AnalysisLength: list, TimeStep: list, StartTime: list
#   port Optional: Below are the optional inputs to make this component work
#   port AnalysisLength: Total length of the simulation.The input should be a list with two values. The first value is the numerical length e.g. 24. Second value is the time unit e.g. h for hour. The second option is optional and if not giventhe time unit is set to hours. The time unit has to be one of the following values: y - year d - day h - hour m - minute s - second Default is set to 24 hours.
#   port TimeStep: Size of each simulation time step.The input should be a list with two values. The first value is the numerical length e.g. 24. Second value is the time unit e.g. h for hour. The second option is optional and if not giventhe time unit is set to hours. The time unit has to be one of the following values: y - year d - day h - hour m - minute s - second Default is 1 hour
#   port StartTime: Sets the start time for the simulation. The input should be a list with three values. The first value is the day. Second value is the month. Third value is the year. All values should be integers and they all start from 1. Default is 01-01-[current year]
#   port SolverTolerance: Solver tolerance Default is 1e-8
#   port ReadMe: In case of any errors, it will be shown here.
#   port ChosenSolverSettings: Shows the chosen solver settings
#   port SolverSettings: Livestock Solver Settings
# ---------- cmf_solver_settings: Python ----------
from livestock.components.comp_cmf import CMFSolverSettings

comp = CMFSolverSettings(ghenv)
comp.config()
comp.run_checks(AnalysisLength, TimeStep, StartTime, SolverTolerance)
comp.run()

ChosenSolverSettings = comp.settings_dict.items()
SolverSettings = comp.results
# ---------- end cmf_solver_settings ----------
cmf_outputs = LivestockCMFOutputs(Evapotranspiration=Toggle(True))  # -> ReadMe, ChosenOutputs, Outputs
#   port Optional: Below are the optional inputs to make this component work
#   port Evapotranspiration: Cell evaporation Default is set to False
#   port SurfaceWaterVolume: Cell surface water Default is set to True
#   port SurfaceWaterFlux: Cell surface water flux Default is set to False
#   port HeatFlux: Cell surface heat flux Default is set to False
#   port VolumetricFlux: Soil layer volumetric flux vectors Default is set to False
#   port Potential: Soil layer total potential (Psi_tot = Psi_M + Psi_G) Default is set to False
#   port Theta: Soil layer volumetric water content of the layer Default is set to False
#   port Volume: Soil layer volume of water in the layer Default is set to True
#   port Wetness: Soil layer wetness of the soil (V_volume/V_pores) Default is set to False
#   port ReadMe: In case of any errors, it will be shown here.
#   port ChosenOutputs: Shows the chosen outputs
#   port Outputs: Livestock Output Data
# ---------- cmf_outputs: Python ----------
from livestock.components.comp_cmf import CMFOutputs

comp = CMFOutputs(ghenv)
comp.config()
comp.run_checks(Evapotranspiration, SurfaceWaterVolume, SurfaceWaterFlux, 
                HeatFlux, VolumetricFlux, Potential, 
                Theta, Volume, Wetness)
comp.run()

ChosenOutputs = comp.output_dict.items()
Outputs = comp.results
# ---------- end cmf_outputs ----------
panel_11 = Panel(cmf_outputs.ChosenOutputs)
panel_12 = Panel(cmf_solver_settings.ChosenSolverSettings)
cmf_solve = LivestockCMFSolve(
    Ground=[cmf_ground_2.Ground, cmf_ground.Ground, cmf_ground_4.Ground, cmf_ground_3.Ground],
    Write=Toggle(False),
    Run=Toggle(False),
    SolverSettings=cmf_solver_settings.SolverSettings,
    Outputs=cmf_outputs.Outputs,
    CaseName="wadi")  # -> ReadMe, ResultPath; inputs Ground: list, BoundaryConditions: list
#   port Required: Below are the required inputs to make this component work
#   port Ground: Output from Livestock CMF Ground
#   port Write: Boolean to write files
#   port Run: Boolean to run analysis
#   port Optional: Below are the optional inputs to make this component work
#   port Weather: Input from Livestock CMF Weather
#   port BoundaryConditions: Input from Livestock CMF Boundary Condition
#   port SolverSettings: Input from Livestock CMF Solver Settings
#   port Outputs: Connect Livestock Outputs
#   port CaseName: Case name as string. Default is: unnamed_cmf_case
#   port Folder: Path to case folder. Default is C:/livestock/analyses
#   port SSH: If True the case will be computed through the SSH connection.To get the SSH connection to work; the Livestock SSH Component should be configured. If False; the case will be run locally. Default is set to False
#   port ReadMe: In case of any errors, it will be shown here.
#   port ResultPath: Path to result files
# ---------- cmf_solve: Python ----------
from livestock.components.comp_cmf import CMFSolve

comp = CMFSolve(ghenv)
comp.config()
comp.run_checks(Ground, Write, Run, Weather, BoundaryConditions, 
                SolverSettings, Outputs, CaseName, Folder, SSH)
comp.run(ghdoc)
ResultPath = comp.case_path
# ---------- end cmf_solve ----------
panel_13 = Panel([cmf_solve.ResultPath, cmf_solve.ReadMe])

# ----
# Weather
panel_14 = Panel("https://www.energyplus.net/weather-download/asia_wmo_region_2/ARE//ARE_Abu.Dhabi.412170_IWEC/all")
honeybee = Honeybee_Honeybee()  # -> Vviiiiiiiiiizzz; plug-in component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
ladybug = Ladybug_Ladybug()  # -> Vviiiiiiiiiizzz; plug-in component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
epw_stat = Ladybug_OpenEPWAndSTATWeatherFiles(weatherFileURL=panel_14, workingDir="C:\livestock\analyses\wadi\weather")  # -> epwFile, statFile; plug-in component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
faceb_3 = FaceBoundaries(Mesh=mjoin_2)
lng_3 = ListLength(List=faceb_3)

# ----
# Load EPW
importgroundtemp = Ladybug_ImportGroundTemp(epwFile=epw_stat.epwFile)  # -> readMe, groundtemp1st, groundtemp2nd, groundtemp3rd, profileCrvs, crvColors, graphAxes, graphtext, Legend; plug-in component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
importepw = Ladybug_ImportEpw(epwFile=epw_stat.epwFile)  # -> readMe, latitude, location, dryBulbTemperature, dewPointTemperature, relativeHumidity, windSpeed, windDirection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; plug-in component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
strnum = Ladybug_SeparateData(inputList=flatten(importgroundtemp.groundtemp1st))  # -> numbers, strings; plug-in component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
strnum_2 = Ladybug_SeparateData(inputList=flatten(importepw.totalSkyCover))  # -> numbers, strings; plug-in component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
strnum_3 = Ladybug_SeparateData(inputList=flatten(importepw.windSpeed))  # -> numbers, strings; plug-in component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
strnum_4 = Ladybug_SeparateData(inputList=flatten(importepw.relativeHumidity))  # -> numbers, strings; plug-in component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
strnum_5 = Ladybug_SeparateData(inputList=flatten(importepw.dryBulbTemperature))  # -> numbers, strings; plug-in component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
panel_15 = Panel("""744
672
696
744
720
744
720
744
744
744
744
744""")
division = Division(A=strnum_2.numbers, B=10)
dup_7 = DuplicateData(Data=graft(strnum.numbers), Number=graft(panel_15), Order=True)  # -> flatten(Data)

# ----
# No water for the rest
number_slider_10 = Slider(0, range=0..100)
dup_8 = DuplicateData(Data=number_slider_10, Number=2, Order=True)  # -> graft(Data)
dup_9 = DuplicateData(Data=dup_8, Number=lng_3, Order=True)
flip_4 = FlipMatrix(Data=dup_9)  # -> simplify(Data)
merge_2 = Merge(Data1=path_2, Data2=path)
split_2 = SplitTree(Data=flip_4, Masks=merge_2)  # -> Positive, Negative

cmf_weather = LivestockCMFWeather(
    Location=importepw.location,
    MeshFaceCount=lng_3,
    Temperature=strnum_5.numbers,
    WindSpeed=strnum_3.numbers,
    RelativeHumidity=strnum_4.numbers,
    CloudCover=division,
    GroundTemperature=dup_7)  # -> ReadMe, Weather; inputs Temperature: tree, WindSpeed: tree, RelativeHumidity: tree, CloudCover: tree, GlobalRadiation: tree, Rain: tree, GroundTemperature: tree
#   port Required: Below are the required inputs to make this component work
#   port Location: A Ladybug Tools Location
#   port MeshFaceCount: Number of faces in the ground mesh
#   port Optional: Below are the optional inputs to make this component work
#   port Temperature: Temperature in C. Either a list or a tree where the number of branches is equal to the number of mesh faces.
#   port WindSpeed: Wind speed in m/s. Either a list or a tree where the number of branches is equal to the number of mesh faces.
#   port RelativeHumidity: Relative humidity in %. Either a list or a tree where the number of branches is equal to the number of mesh faces.
#   port CloudCover: Cloud cover, unitless between 0 and 1. Either a list or a tree where the number of branches is equal to the number of mesh faces.
#   port GlobalRadiation: Global Radiation in W/m2. Either a list or a tree where the number of branches is equal to the number of mesh faces.
#   port Rain: Horizontal precipitation in mm/h. Either a list or a tree where the number of branches is equal to the number of mesh faces.
#   port GroundTemperature: Ground temperature in C. Either a list or a tree where the number of branches is equal to the number of mesh faces.
#   port ReadMe: In case of any errors, it will be shown here.
#   port Weather: Livestock Weather Data Class
# ---------- cmf_weather: Python ----------
from livestock.components.comp_cmf import CMFWeather
            
comp = CMFWeather(ghenv)
comp.config()
comp.run_checks(Location, MeshFaceCount, Temperature, WindSpeed, 
                RelativeHumidity, CloudCover, GlobalRadiation, Rain, 
                GroundTemperature)
comp.run()

Weather = comp.results
# ---------- end cmf_weather ----------
panel_16 = Panel(cmf_weather.ReadMe)

# ----
# Generate Rain
merge_3 = Merge(Data1=replace_2, Data2=split_2.Negative, Data3=replace)
path_mapper_4 = PathMapper(merge_3, source="{A}", target="{0;A}")

# ----
# Save Sprinkler file
panel_17 = Panel("\Wadi_Optimized_v")
flip_5 = FlipMatrix(Data=merge_3)
concat_4 = Concatenate(FragmentB=panel_17)
ma = MassAddition(Input=flip_5)  # -> flatten(Result), PartialResults
panel_18 = Panel(ma.Result)
concat_5 = Concatenate(FragmentA=concat_4, FragmentB="/WaterVolumes")
write = FileWrite(Path=concat_5, Name="sprinkler", Text=panel_18, Write=Button())  # inputs Text: list, Write: Boolean
# ---------- write: Python ----------
# File write(Write)

# @license GPL-3.0+ <http://spdx.org/licenses/GPL-3.0+>


"""
Write strings to into a file.
-
Made by Christian Kongsgaard. 

    
    Args:
        Path: Input string with disired file path.
        Name: Input string with disired file name.
        Text: Strings you wish to be written.
        Filetype: Suffix for the file. Default is txt.
        Write: Boolean. Set to 1 to write file.

"""

ghenv.Component.Name = "File write"
ghenv.Component.NickName = 'Write'
ghenv.Component.Message = 'VER 0.0.1\nApril_2016'
ghenv.Component.IconDisplayMode = ghenv.Component.IconDisplayMode.application
ghenv.Component.Category = "Christian"
ghenv.Component.SubCategory = "1 | Custom"

###

import os

if Filetype == None:
    Filetype = "txt"

if Write:
    
    # Make file path name with extension
    filePath = os.path.join(Path,Name + "."+str(Filetype))
    
    # Open file
    fileWrite = open(filePath,"w")
    
    # Write text data to file
    i = 0
    while i <len(Text):
        if i == len(Text)-1:
            fileWrite.write(Text[i])
        else:
            fileWrite.write(Text[i] + "\n")
        i +=1
    
    # Close file
    fileWrite.close()
# ---------- end write ----------
