# Grasshopper definition 2 - Ground Results.gh (Grasshopper 0.9.76)
# plug-ins: Python Interpreter, Human

# ----
# Load Results
number_slider = Slider(1, range=0..10)
python = PythonScript()  # -> out, DBpath
# ---------- python: Python ----------
import getpass

DBpath = 'C:/Users/' + getpass.getuser() + '/Dropbox'
# ---------- end python ----------
int = Integer(number_slider)
concat = Concatenate(FragmentA="Wadi_Optimized_v", FragmentB=int)
concat_2 = Concatenate(FragmentA=python.DBpath, FragmentB="\Uddannelse\DTU\Projekter\Speciale\Wadi")
panel = Panel(concat)
concat_3 = Concatenate(FragmentA=concat_2, FragmentB="\", FragmentC=panel)
concat_4 = Concatenate(FragmentA=concat_3, FragmentB="/CMF")
toggle = BooleanToggle(True)
cmf_results = LivestockCMFResults(ResultFolder=concat_4, FetchResult=Slider(1, range=0..10), Run=Toggle(True))  # -> readMe, Units, Values, CSVPath
#   port ResultFolder: Path to result folder. Accepts output from Livestock Solve
#   port FetchResult: Choose which result should be loaded: 0 - Evapotranspiration 1 - Surface water volume 2 - Surface water flux 3 - Heat flux 4 - Aerodynamic resistance 5 - Soil layer water flux 6 - Soil layer potential 7 - Soil layer theta 8 - Soil layer volume 9 - Soil layer wetness
#   port SaveCSV: Save the values as a csv file - Default is set to False
#   port Run: Run component
#   port readMe: In case of any errors, it will be shown here.
#   port Units: Shows the units of the results
#   port Values: List with chosen result values
#   port CSVPath: Path to csv file.
# ---------- cmf_results: Python ----------
from livestock.components.comp_cmf import CMFResults

comp = CMFResults(ghenv)
comp.config()
comp.run_checks(ResultFolder, FetchResult, SaveCSV, Run)
comp.run()

Units = comp.unit
Values = comp.results
# ---------- end cmf_results ----------
cmf_results_2 = LivestockCMFResults(ResultFolder=concat_4, FetchResult=Slider(9, range=0..10), SaveCSV=toggle, Run=Toggle(True))  # -> readMe, Units, simplify(Values), CSVPath; same code as cmf_results
cmf_results_3 = LivestockCMFResults(ResultFolder=concat_4, FetchResult=Slider(0, range=0..10), SaveCSV=toggle, Run=Toggle(True))  # -> readMe, Units, Values, CSVPath; same code as cmf_results
flip = FlipMatrix(Data=cmf_results.Values)
flip_2 = FlipMatrix(Data=cmf_results_3.Values)

panel_2 = Panel("C:\Users\ocni\AppData\Local\Continuum\anaconda3\envs\livestock_env\python.exe")
ladybug = Ladybug_Ladybug()  # -> Vviiiiiiiiiizzz; plug-in component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

# ----
# Livestock Setup
# Python and SSH
toggle_2 = BooleanToggle(True)
panel_3 = Panel("C:\Users\Christian\Anaconda3\envs\livestock_env\python.exe")
ssh_machine = PythonScript(x=toggle_2)  # -> out, a, b, c, d
# ---------- ssh_machine: Python ----------
machine = {0: {'name': 'Bash',
               'ip': '127.0.0.1',
               'port': 2222,
               'user': 'ocni',
               'pw': '4320lejre'
               },
           1: {'name': 'Livestock_Ubuntu',
               'ip': '10.61.0.238',
               'port': 22,
               'user': 'livestock',
               'pw': 'stable'
               }}
               
print(machine[x]['name'])
a = machine[x]['ip']
b = machine[x]['port']
c = machine[x]['user']
d = machine[x]['pw']
# ---------- end ssh_machine ----------
panel_4 = Panel(ssh_machine.out)
ssh_connection = LivestockSSHConnection(IP=ssh_machine.a, Port=ssh_machine.b, Username=ssh_machine.c, Password=ssh_machine.d)  # -> readMe
#   port IP: IP Address for SSH connection
#   port Port: Port for SSH connection
#   port Username: Username for SSH connection
#   port Password: Password for SSH connection
#   port readMe: In case of any errors, it will be shown here.
# ---------- ssh_connection: Python ----------
from livestock.components.misc import SSHConnection

comp = SSHConnection(ghenv)
comp.config()
comp.run_checks(str(IP), str(Port), str(Username), str(Password))
comp.run()
# ---------- end ssh_connection ----------
python_executor = LivestockPythonExecutor(PythonPath=panel_2)  # -> readMe
#   port PythonPath: Path to python.exe
#   port readMe: In case of any errors, it will be shown here.
# ---------- python_executor: Python ----------
from livestock.components.misc import PythonExecutor

comp = PythonExecutor(ghenv)
comp.config()
comp.run_checks(str(PythonPath))
comp.run()
# ---------- end python_executor ----------
panel_5 = Panel(ssh_connection)
panel_6 = Panel(python_executor)

# ----
# Geometry
wardi_curves = Curve([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])
ground_curves = Curve([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])
canopy_curves = Curve([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])
number_slider_2 = Slider(10, range=0..10)
boundary = BoundarySurfaces(Edges=wardi_curves)
bbox = BoundingBox(Content=canopy_curves, Plane=PlaneXY(0, 0, 0))  # -> Box, Box_2
drec = DeconstuctRectangle(Rectangle=bbox.Box)  # -> BasePlane, XInterval, YInterval
dedomain = DeconstructDomain(Domain=drec.XInterval)  # -> Start, End
boundary_2 = BoundarySurfaces(Edges=ground_curves)
subtraction = Subtraction(A=dedomain.End, B=dedomain.Start)
mesh_uv = MeshSurface(Surface=boundary_2, UCount=number_slider_2, VCount=5, Overhang=True, Equalize=False)
mesh_uv_2 = MeshSurface(Surface=boundary, UCount=number_slider_2, VCount=Slider(2, range=1..5), Overhang=True, Equalize=False)
Z = UnitZ(Factor=subtraction)
extr = Extrude(Base=bbox.Box, Direction=Z)
multiplication = Multiplication(A=Z, B=Slider(0.75, range=0..1))
mjoin = MeshJoin(Meshes=flatten([mesh_uv_2, mesh_uv]))
move = Move(Geometry=extr, Motion=multiplication)  # -> Geometry, Transform

split = SplitTree(Data=cmf_results_3.Values, Masks=flatten("{0;< 40}"))  # -> Positive, Negative
branch = TreeBranch(Tree=simplify(flip), Path=Slider(3000, range=0..8760), MaintainPaths=True)
faceb = FaceBoundaries(Mesh=mjoin)
cull_i = CullIndex(List=split.Positive, Indices=0, Wrap=True)
flip_3 = FlipMatrix(Data=cull_i)
area = Area(Geometry=faceb)  # -> Area, Centroid
division = Division(A=branch, B=area.Area)
ma = MassAddition(Input=flip_3)  # -> flatten(Result), PartialResults
Z_2 = UnitZ(Factor=division)
division_2 = Division(A=ma.Result, B=24)
extr_2 = Extrude(Base=faceb, Direction=Z_2)
graph = QuickGraph(division_2)

# ----
# Time
number_slider_3 = Slider(3636, range=0..8760)
python_2 = PythonScript(HOY=number_slider_3)  # -> out, Date
# ---------- python_2: Python ----------
import math

def hour2Date(hour, alternate = False):
    monthList = ['JAN', 'FEB', 'MAR', 'APR', 'MAY', 'JUN', 'JUL', 'AUG', 'SEP', 'OCT', 'NOV', 'DEC']
    numOfDays = [0, 31, 59, 90, 120, 151, 181, 212, 243, 273, 304, 334, 365]
    numOfHours = [24 * numOfDay for numOfDay in numOfDays]

    if hour%8760==0 and not alternate: return `31`+ ' ' + 'DEC' + ' 24:00'
    elif hour%8760==0: return 31, 11, 24

    for h in range(len(numOfHours)-1):
        if hour <= numOfHours[h+1]: month = monthList[h]; break
    try: month
    except: month = monthList[h] # for the last hour of the year

    if (hour)%24 == 0:
        day = int((hour - numOfHours[h]) / 24)
        time = `24` + ':00'
        hour = 24
    else:
        day = int((hour - numOfHours[h]) / 24) + 1
        minutes = `int(round((hour - math.floor(hour)) * 60))`
        if len(minutes) == 1: minutes = '0' + minutes
        time = `int(hour%24)` + ':' + minutes
    if alternate:
        time = hour%24
        if time == 0: time = 24
        month = self.monthList.index(month)
        return day, month, time
        
    return (`day` + ' ' + month + ' ' + time)

if HOY:
    Date = hour2Date(HOY)
# ---------- end python_2 ----------

panel_7 = Panel(division_2)
doy_hoy = Ladybug_DOY_HOY(days=1, months=Slider(10, range=0..10), hours=Slider(0, range=0..100))  # -> HOY, DOY, date; plug-in component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

# ----
# Preview
number_slider_4 = Slider(4, range=0..5)
wires = BrepWireframe(Brep=move.Geometry, Density=-1)
facen = FaceNormals(Mesh=mjoin)  # -> Centers, Normals
faceb_2 = FaceBoundaries(Mesh=mjoin)
previewlw = CustomPreviewLineweights(Geometry=wires, Shader=ColourSwatch(SwatchColor=RGB(31, 113, 0)), Thickness=number_slider_4, Absolute=False)
points = PointList(Points=facen.Centers)
preview = CustomPreview(Geometry=faceb_2, Shader=ColourSwatch(SwatchColor=RGB(0, 0, 0)))

panel_8 = Panel([doy_hoy.HOY, doy_hoy.date, doy_hoy.DOY])

# ----
# Evapotranspiration per hour
number_slider_5 = Slider(11, range=0..23)
X = UnitX(Factor=Slider(-45, range=-50..50))
gradientlibrary = Ladybug_GradientLibrary(gradIndex=number_slider_5)  # -> customColors; plug-in component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
move_2 = Move(Geometry=mjoin, Motion=X)  # -> Geometry, Transform
legendpar = Ladybug_LegendParameters(customColors=flatten(gradientlibrary), decimalPlaces=Slider(4, range=0..10))  # -> legendPar; plug-in component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
branch_2 = TreeBranch(Tree=simplify(flip), Path=number_slider_3, MaintainPaths=True)
concat_5 = Concatenate(FragmentA="Surface Water Volume", FragmentB=python_2.Date)
recolormesh = Ladybug_RecolorMesh(analysisResult=branch_2, inputMesh=move_2.Geometry, legendPar=legendpar, analysisTitle=concat_5, legendTitle="m3")  # -> readMe, newMesh, newLegend, legendBasePt, meshColors, legendColors; plug-in component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
preview_2 = CustomPreview(Geometry=[recolormesh.newMesh, recolormesh.newLegend], Shader=ColourSwatch(SwatchColor=RGB(13, 0, 0)))

button = Button()

# ----
# Surface Volume
number_slider_6 = Slider(8, range=0..10)
toggle_3 = BooleanToggle(True)
cmf_results_4 = LivestockCMFResults(ResultFolder=concat_4, FetchResult=number_slider_6, SaveCSV=toggle_3, Run=toggle_3)  # -> readMe, Units, Values, CSVPath; same code as cmf_results
cull_i_2 = CullIndex(List=cmf_results_4.Values, Indices=1, Wrap=True)  # -> simplify(List)
cull_i_3 = CullIndex(List=cmf_results_4.Values, Indices=1, Wrap=True)  # -> simplify(List)
cull_i_4 = CullIndex(List=cmf_results_4.Values, Indices=1, Wrap=True)  # -> simplify(List)
split_2 = SplitTree(Data=cull_i_2, Masks=flatten("{*;0}"))  # -> Positive, Negative
split_3 = SplitTree(Data=cull_i_3, Masks=flatten("{*;1}"))  # -> Positive, Negative
split_4 = SplitTree(Data=cull_i_4, Masks=flatten("{*;2}"))  # -> Positive, Negative
flip_4 = FlipMatrix(Data=split_2.Positive)  # -> simplify(Data)
flip_5 = FlipMatrix(Data=split_3.Positive)  # -> simplify(Data)
flip_6 = FlipMatrix(Data=split_4.Positive)  # -> simplify(Data)
ma_2 = MassAddition(Input=flip_4)  # -> flatten(Result), PartialResults
ma_3 = MassAddition(Input=flip_5)  # -> flatten(Result), PartialResults
ma_4 = MassAddition(Input=flip_6)  # -> flatten(Result), PartialResults
expression = Expression(x=ma_2.Result, Expression="Round(x,4)")
expression_2 = Expression(x=ma_3.Result, Expression="Round(x,4)")
expression_3 = Expression(x=ma_4.Result, Expression="Round(x,4)")
toggle_4 = BooleanToggle(False)
toggle_5 = BooleanToggle(False)
toggle_6 = BooleanToggle(False)
concat_6 = Concatenate(FragmentA=concat_3, FragmentB="/WaterVolumes")
concat_7 = Concatenate(FragmentA=concat_3, FragmentB="/WaterVolumes")
concat_8 = Concatenate(FragmentA=concat_3, FragmentB="/WaterVolumes")
write = FileWrite(Path=concat_6, Name="water_layer_0", Text=expression, Write=button)  # inputs Text: list, Write: Boolean
# ---------- write: Python ----------
# File write(Write)

# @license GPL-3.0+ <http://spdx.org/licenses/GPL-3.0+>


"""
Write strings to into a file.
-
Made by Christian Kongsgaard. 

    
    Args:
        Path: Input string with disired file path.
        Name: Input string with disired file name.
        Text: Strings you wish to be written.
        Filetype: Suffix for the file. Default is txt.
        Write: Boolean. Set to 1 to write file.

"""

ghenv.Component.Name = "File write"
ghenv.Component.NickName = 'Write'
ghenv.Component.Message = 'VER 0.0.1\nApril_2016'
ghenv.Component.IconDisplayMode = ghenv.Component.IconDisplayMode.application
ghenv.Component.Category = "Christian"
ghenv.Component.SubCategory = "1 | Custom"

###

import os

if Filetype == None:
    Filetype = "txt"

if Write:
    
    # Make file path name with extension
    filePath = os.path.join(Path,Name + "."+str(Filetype))
    
    # Open file
    fileWrite = open(filePath,"w")
    
    # Write text data to file
    i = 0
    while i <len(Text):
        if i == len(Text)-1:
            fileWrite.write(Text[i])
        else:
            fileWrite.write(Text[i] + "\n")
        i +=1
    
    # Close file
    fileWrite.close()
# ---------- end write ----------
write_2 = FileWrite(Path=concat_7, Name="water_layer_1", Text=expression_2, Write=button)  # inputs Text: list, Write: Boolean; same code as write
write_3 = FileWrite(Path=concat_8, Name="water_layer_2", Text=expression_3, Write=button)  # inputs Text: list, Write: Boolean; same code as write

# ----
# Surface Volume
number_slider_7 = Slider(1, range=0..10)
toggle_7 = BooleanToggle(True)
cmf_results_5 = LivestockCMFResults(ResultFolder=concat_4, FetchResult=number_slider_7, SaveCSV=toggle_7, Run=toggle_7)  # -> readMe, Units, Values, CSVPath; same code as cmf_results
cull_i_5 = CullIndex(List=cmf_results_5.Values, Indices=1, Wrap=True)
flip_7 = FlipMatrix(Data=cull_i_5)
ma_5 = MassAddition(Input=flip_7)  # -> flatten(Result), PartialResults
expression_4 = Expression(x=ma_5.Result, Expression="Round(x,4)")
toggle_8 = BooleanToggle(False)
concat_9 = Concatenate(FragmentA=concat_3, FragmentB="/WaterVolumes")
write_4 = FileWrite(Path=concat_9, Name="surface_water", Text=expression_4, Write=button)  # inputs Text: list, Write: Boolean; same code as write

# ----
# Evapotranspiration
panel_9 = Panel("evapotranspiration_water")
expression_5 = Expression(x=division_2, Expression="Round(x,4)")
toggle_9 = BooleanToggle(False)
concat_10 = Concatenate(FragmentA=concat_3, FragmentB="/WaterVolumes")
write_5 = FileWrite(Path=concat_10, Name=panel_9, Text=expression_5, Write=button)  # inputs Text: list, Write: Boolean; same code as write

# ----
# Surface Water over a year
number_slider_8 = Slider(40, range=0..100)
split_5 = SplitList(List=flip, Index=number_slider_8)  # -> simplify(ListA), ListB
ma_6 = MassAddition(Input=split_5.ListA)  # -> Result, PartialResults
division_3 = Division(A=ma_6.Result, B=number_slider_8)  # -> flatten(Result)
pt = ConstructPoint(XCoordinate=Slider(-50, range=-100..100), YCoordinate=Slider(30, range=0..50), ZCoordinate=0)
createheader = Ladybug_CreateLBHeader(
    location="Abu Dhabi",
    dataType="Average Surface Water Volume in Wardi",
    units="m3",
    timeStep="Hourly",
    rawData=division_3)  # -> flatten(LBHeader), dataWithHeader; plug-in component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

# ----
# Wetness
number_slider_9 = Slider(3, range=0..10)
number_slider_10 = Slider(-30, range=-30..0)
series = Series(Start=number_slider_10, Step=number_slider_10, Count=number_slider_9)
gradientlibrary_2 = Ladybug_GradientLibrary(gradIndex=Slider(12, range=0..23))  # -> customColors; plug-in component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
Y = UnitY(Factor=series)
split_6 = SplitTree(Data=cmf_results_2.Values, Masks=flatten("{*;2}"))  # -> Positive, Negative
split_7 = SplitTree(Data=cmf_results_2.Values, Masks=flatten("{*;1}"))  # -> Positive, Negative
split_8 = SplitTree(Data=cmf_results_2.Values, Masks=flatten("{*;0}"))  # -> Positive, Negative
move_3 = Move(Geometry=mjoin, Motion=Y)  # -> simplify(graft(Geometry)), Transform
flip_8 = FlipMatrix(Data=split_6.Positive)  # -> simplify(Data)
flip_9 = FlipMatrix(Data=split_7.Positive)  # -> simplify(Data)
flip_10 = FlipMatrix(Data=split_8.Positive)  # -> simplify(Data)
rev = ReverseList(List=gradientlibrary_2)
bang = ExplodeTree(Data=move_3.Geometry)  # -> Branch0, Branch1, Branch2
branch_3 = TreeBranch(Tree=flip_8, Path=number_slider_3, MaintainPaths=True)
legendpar_2 = Ladybug_LegendParameters(lowBound=Slider(0.15, range=0..1), highBound=Slider(1, range=0..1), customColors=flatten(rev))  # -> legendPar; plug-in component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
branch_4 = TreeBranch(Tree=flip_9, Path=number_slider_3, MaintainPaths=True)
branch_5 = TreeBranch(Tree=flip_10, Path=number_slider_3, MaintainPaths=True)
swatch = ColourSwatch(SwatchColor=RGB(0, 0, 0))

concat_11 = Concatenate(FragmentA="Wetness - Layer 3", FragmentB=python_2.Date)
concat_12 = Concatenate(FragmentA="Wetness - Layer 2", FragmentB=python_2.Date)
concat_13 = Concatenate(FragmentA="Wetness - Layer 1", FragmentB=python_2.Date)

recolormesh_2 = Ladybug_RecolorMesh(
    analysisResult=branch_5,
    inputMesh=bang.Branch0,
    legendPar=legendpar_2,
    analysisTitle=concat_13,
    legendTitle="-",
    bakeIt=Button(),
    layerName=python_2.Date)  # -> readMe, newMesh, newLegend, legendBasePt, meshColors, legendColors; plug-in component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
recolormesh_3 = Ladybug_RecolorMesh(analysisResult=branch_3, inputMesh=bang.Branch2, legendPar=legendpar_2, analysisTitle=concat_11, legendTitle="-")  # -> readMe, newMesh, newLegend, legendBasePt, meshColors, legendColors; plug-in component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
recolormesh_4 = Ladybug_RecolorMesh(analysisResult=branch_4, inputMesh=bang.Branch1, legendPar=legendpar_2, analysisTitle=concat_12, legendTitle="-")  # -> readMe, newMesh, newLegend, legendBasePt, meshColors, legendColors; plug-in component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
preview_3 = CustomPreview(Geometry=[recolormesh_2.newMesh, recolormesh_4.newMesh, recolormesh_3.newMesh], Shader=swatch)
preview_4 = CustomPreview(Geometry=[recolormesh_4.newLegend, recolormesh_3.newLegend, recolormesh_2.newLegend], Shader=swatch)

# ----
# Evapotranspiration per hour
number_slider_11 = Slider(11, range=0..23)
X_2 = UnitX(Factor=Slider(35, range=10..50))
gradientlibrary_3 = Ladybug_GradientLibrary(gradIndex=number_slider_11)  # -> customColors; plug-in component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
move_4 = Move(Geometry=mjoin, Motion=X_2)  # -> Geometry, Transform
legendpar_3 = Ladybug_LegendParameters(customColors=flatten(gradientlibrary_3), decimalPlaces=Slider(4, range=0..10))  # -> legendPar; plug-in component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
branch_6 = TreeBranch(Tree=simplify(flip_2), Path=number_slider_3, MaintainPaths=True)

legendpar_4 = Ladybug_LegendParameters(customColors=flatten(gradientlibrary_3), decimalPlaces=Slider(2, range=0..100))  # -> legendPar; plug-in component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
_3dchart = Ladybug_3DChart(
    inputData=flatten(createheader.dataWithHeader),
    basePoint=pt,
    xScale=Slider(0.01, range=0.001..0.01),
    yScale=Slider(0.1, range=0..1),
    zScale=Slider(0, range=0..100),
    legendPar=legendpar_4)  # -> readMe, graphMesh, graphCurves, legend, legendBasePts, title, titleBasePts, dataPts, conditionalHOY; plug-in component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
preview_5 = CustomPreview(
    Geometry=[_3dchart.graphMesh, _3dchart.legend, _3dchart.title, _3dchart.graphCurves],
    Shader=ColourSwatch(SwatchColor=RGB(13, 0, 0)))

division_4 = Division(A=branch_6, B=24)
concat_14 = Concatenate(FragmentA="Evapotranspiration", FragmentB=python_2.Date)

recolormesh_5 = Ladybug_RecolorMesh(analysisResult=division_4, inputMesh=move_4.Geometry, legendPar=legendpar_3, analysisTitle=concat_14, legendTitle="m3/h")  # -> readMe, newMesh, newLegend, legendBasePt, meshColors, legendColors; plug-in component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
preview_6 = CustomPreview(Geometry=[recolormesh_5.newMesh, recolormesh_5.newLegend], Shader=ColourSwatch(SwatchColor=RGB(13, 0, 0)))

# ----
# Evapotranspiration over a year
number_slider_12 = Slider(30, range=0..50)
ma_7 = MassAddition(Input=flip_2)  # -> Result, PartialResults
pt_2 = ConstructPoint(XCoordinate=number_slider_12, YCoordinate=Slider(30, range=0..50), ZCoordinate=0)
legendpar_5 = Ladybug_LegendParameters(customColors=flatten(gradientlibrary_3))  # -> legendPar; plug-in component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

division_5 = Division(A=ma_7.Result, B=24)  # -> flatten(Result)

createheader_2 = Ladybug_CreateLBHeader(location="Abu Dhabi", dataType="Evapotranspiration", units="m3/h", timeStep="Hourly", rawData=division_5)  # -> flatten(LBHeader), dataWithHeader; plug-in component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
_3dchart_2 = Ladybug_3DChart(
    inputData=flatten(createheader_2.dataWithHeader),
    basePoint=pt_2,
    xScale=Slider(0.01, range=0.001..0.01),
    yScale=Slider(0.1, range=0..1),
    zScale=Slider(0, range=0..100),
    legendPar=legendpar_5)  # -> readMe, graphMesh, graphCurves, legend, legendBasePts, title, titleBasePts, dataPts, conditionalHOY; plug-in component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
preview_7 = CustomPreview(
    Geometry=[_3dchart_2.graphMesh, _3dchart_2.legend, _3dchart_2.title, _3dchart_2.graphCurves],
    Shader=ColourSwatch(SwatchColor=RGB(13, 0, 0)))

# ----
# Evapotranspiration
cull_i_6 = CullIndex(List=division_5, Indices=1, Wrap=True)
expression_6 = Expression(x=cull_i_6, Expression="Round(x,4)")
toggle_10 = BooleanToggle(False)
concat_15 = Concatenate(FragmentA=concat_3, FragmentB="/WaterVolumes")
write_6 = FileWrite(Path=concat_15, Name="evapotranspiration", Text=expression_6, Write=button)  # inputs Text: list, Write: Boolean; same code as write
