# Grasshopper definition 3 - Air Analysis.gh (Grasshopper 0.9.76)
# plug-ins: Python Interpreter, Human

# ----
# Load Results
number_slider = Slider(1, range=0..10)
int = Integer(number_slider)
concat = Concatenate(FragmentA="Wadi_Optimized_v", FragmentB=int)
python = PythonScript()  # -> out, DBpath
# ---------- python: Python ----------
import getpass

DBpath = 'C:/Users/' + getpass.getuser() + '/Dropbox'
# ---------- end python ----------
panel = Panel(concat)
concat_2 = Concatenate(FragmentA=python.DBpath, FragmentB="\Uddannelse\DTU\Projekter\Speciale\Wadi")
concat_3 = Concatenate(FragmentA=concat_2, FragmentB="\", FragmentC=panel)
concat_4 = Concatenate(FragmentA=concat_3, FragmentB="/CMF")
cmf_results = LivestockCMFResults(ResultFolder=concat_4, FetchResult=Slider(0, range=0..10), SaveCSV=Toggle(True), Run=Toggle(True))  # -> readMe, Units, Values, CSVPath
#   port ResultFolder: Path to result folder. Accepts output from Livestock Solve
#   port FetchResult: Choose which result should be loaded: 0 - Evapotranspiration 1 - Surface water volume 2 - Surface water flux 3 - Heat flux 4 - Aerodynamic resistance 5 - Soil layer water flux 6 - Soil layer potential 7 - Soil layer theta 8 - Soil layer volume 9 - Soil layer wetness
#   port SaveCSV: Save the values as a csv file - Default is set to False
#   port Run: Run component
#   port readMe: In case of any errors, it will be shown here.
#   port Units: Shows the units of the results
#   port Values: List with chosen result values
#   port CSVPath: Path to csv file.
# ---------- cmf_results: Python ----------
from livestock.components.comp_cmf import CMFResults

comp = CMFResults(ghenv)
comp.config()
comp.run_checks(ResultFolder, FetchResult, SaveCSV, Run)
comp.run()

Units = comp.unit
Values = comp.results
# ---------- end cmf_results ----------
flip = FlipMatrix(Data=cmf_results.Values)

panel_2 = Panel("C:\Users\ocni\AppData\Local\Continuum\anaconda3\envs\livestock_env\python.exe")
panel_3 = Panel("C:\Users\ocni\Dropbox\Uddannelse\DTU\Diverse\EPW_WeatherData\Abu_Dhabi\ARE_Abu.Dhabi.412170_IWEC.epw")

# ----
# Weather
ladybug = Ladybug_Ladybug()  # -> Vviiiiiiiiiizzz; plug-in component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
importepw = Ladybug_ImportEpw(epwFile=panel_3)  # -> readMe, latitude, location, dryBulbTemperature, dewPointTemperature, relativeHumidity, windSpeed, windDirection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; plug-in component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
strnum = Ladybug_SeparateData(inputList=flatten(importepw.dryBulbTemperature))  # -> numbers, strings; plug-in component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
strnum_2 = Ladybug_SeparateData(inputList=flatten(importepw.relativeHumidity))  # -> numbers, strings; plug-in component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

# ----
# Livestock Setup
# Python and SSH
toggle = BooleanToggle(True)
panel_4 = Panel("C:\Users\Christian\Miniconda3\envs\livestock_dev\python.exe")
ssh_machine = PythonScript(x=toggle)  # -> out, a, b, c, d
# ---------- ssh_machine: Python ----------
machine = {0: {'name': 'Bash',
               'ip': '127.0.0.1',
               'port': 2222,
               'user': 'ocni',
               'pw': '4320lejre'
               },
           1: {'name': 'Livestock_Ubuntu',
               'ip': '10.61.0.238',
               'port': 22,
               'user': 'livestock',
               'pw': 'stable'
               }}
               
print(machine[x]['name'])
a = machine[x]['ip']
b = machine[x]['port']
c = machine[x]['user']
d = machine[x]['pw']
# ---------- end ssh_machine ----------
panel_5 = Panel(ssh_machine.out)
ssh_connection = LivestockSSHConnection(IP=ssh_machine.a, Port=ssh_machine.b, Username=ssh_machine.c, Password=ssh_machine.d)  # -> readMe
#   port IP: IP Address for SSH connection
#   port Port: Port for SSH connection
#   port Username: Username for SSH connection
#   port Password: Password for SSH connection
#   port readMe: In case of any errors, it will be shown here.
# ---------- ssh_connection: Python ----------
from livestock.components.misc import SSHConnection

comp = SSHConnection(ghenv)
comp.config()
comp.run_checks(str(IP), str(Port), str(Username), str(Password))
comp.run()
# ---------- end ssh_connection ----------
python_executor = LivestockPythonExecutor(PythonPath=panel_2)  # -> readMe
#   port PythonPath: Path to python.exe
#   port readMe: In case of any errors, it will be shown here.
# ---------- python_executor: Python ----------
from livestock.components.misc import PythonExecutor

comp = PythonExecutor(ghenv)
comp.config()
comp.run_checks(str(PythonPath))
comp.run()
# ---------- end python_executor ----------
panel_6 = Panel(ssh_connection)
panel_7 = Panel(python_executor)

# ----
# Geometry
wardi_curves = Curve([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])
ground_curves = Curve([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])
canopy_curves = Curve([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])
number_slider_2 = Slider(10, range=0..10)
boundary = BoundarySurfaces(Edges=wardi_curves)
bbox = BoundingBox(Content=canopy_curves, Plane=PlaneXY(0, 0, 0))  # -> Box, Box_2
drec = DeconstuctRectangle(Rectangle=bbox.Box)  # -> BasePlane, XInterval, YInterval
dedomain = DeconstructDomain(Domain=drec.XInterval)  # -> Start, End
boundary_2 = BoundarySurfaces(Edges=ground_curves)
subtraction = Subtraction(A=dedomain.End, B=dedomain.Start)
mesh_uv = MeshSurface(Surface=boundary_2, UCount=number_slider_2, VCount=5, Overhang=True, Equalize=False)
mesh_uv_2 = MeshSurface(Surface=boundary, UCount=number_slider_2, VCount=Slider(2, range=1..5), Overhang=True, Equalize=False)
Z = UnitZ(Factor=subtraction)
extr = Extrude(Base=bbox.Box, Direction=Z)
multiplication = Multiplication(A=Z, B=Slider(0.75, range=0..1))
mjoin = MeshJoin(Meshes=flatten([mesh_uv_2, mesh_uv]))
move = Move(Geometry=extr, Motion=multiplication)  # -> Geometry, Transform

strnum_3 = Ladybug_SeparateData(inputList=flatten(importepw.windSpeed))  # -> numbers, strings; plug-in component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
number_slider_3 = Slider(1, range=0..1)
dup = DuplicateData(Data=Slider(0.5, range=0..1), Number=Slider(8760, range=0..10000), Order=True)

# ----
# Preview
number_slider_4 = Slider(4, range=0..5)
wires = BrepWireframe(Brep=move.Geometry, Density=-1)
facen = FaceNormals(Mesh=mjoin)  # -> Centers, Normals
faceb = FaceBoundaries(Mesh=mjoin)
previewlw = CustomPreviewLineweights(Geometry=wires, Shader=ColourSwatch(SwatchColor=RGB(31, 113, 0)), Thickness=number_slider_4, Absolute=False)
points = PointList(Points=facen.Centers)
preview = CustomPreview(Geometry=faceb, Shader=ColourSwatch(SwatchColor=RGB(0, 0, 0)))

concat_5 = Concatenate(FragmentA=concat_3, FragmentB="\WindSpeeds")

# ----
# Compute New Air
number_slider_5 = Slider(21, range=0..100)
series = Series(Start=0, Step=Slider(0.5, range=0..1), Count=number_slider_5)
python_2 = PythonScript(Wind=strnum_3.numbers, heights=series)  # -> out, AverageSpeed; inputs heights: list
# ---------- python_2: Python ----------
def new_wind_speed(reference_speed, height):
    return reference_speed * (height/10)**(1/7)

speed = []
for i in heights:
    print(i)
    speed.append(new_wind_speed(Wind, i) )

#print(speed)
AverageSpeed = sum(speed)/len(speed)
# ---------- end python_2 ----------
int_2 = Integer(Slider(4, range=0..10))
new_air_conditions = LivestockNewAirConditions(
    Mesh=mjoin,
    Evapotranspiration=flip,
    AirTemperature=strnum.numbers,
    AirRelativeHumidity=strnum_2.numbers,
    WindSpeed=dup,
    AirBoundaryHeight=Slider(10, range=0..10),
    InvestigationHeight=Slider(1.1, range=0..10),
    CPUs=int_2,
    ResultFolder=concat_5,
    Run=Toggle(False))  # -> readMe, NewTemperature, NewRelativeHumidity, LatentHeatFlux, UsedVapourFlux; inputs Evapotranspiration: tree, AirTemperature: list, AirRelativeHumidity: list, WindSpeed: list
#   port Evapotranspiration: Evapotranspiration in m^3/day. Each tree branch should represent one time unit, with all the cell values to that time.
#   port AirTemperature: Air temperature in C
#   port AirRelativeHumidity: Relative Humidity in %
#   port WindSpeed: Wind speed in m/s
#   port AirBoundaryHeight: Top of the air column in m. Default is set to 10m
#   port InvestigationHeight: Height at which the new air temperature and relative humidity should be calculated. Default is set to 1.1m
#   port CPUs: Number of cpus to perform the computation on. Default is set to 2
#   port ResultFolder: Folder where the result files should be saved
#   port Run: Run the component
#   port readMe: In case of any errors, it will be shown here.
#   port NewTemperature: New temperature in C.
#   port NewRelativeHumidity: New relative humidity in %.
#   port LatentHeatFlux: Computed latent heat flux in J/h.
#   port UsedVapourFlux: Vapour flux used to alter the temperature and relative humidity in kg/h.
# ---------- new_air_conditions: Python ----------
from livestock.components.air import NewAirConditions

comp = NewAirConditions(ghenv)
comp.config()
comp.run_checks(Mesh, Evapotranspiration, AirTemperature, 
                AirRelativeHumidity, WindSpeed,
                AirBoundaryHeight, InvestigationHeight,
                CPUs, ResultFolder, Run)
comp.run()

NewTemperature = comp.results['temperature']
NewRelativeHumidity = comp.results['relative_humidity']
# ---------- end new_air_conditions ----------
panel_8 = Panel(new_air_conditions.readMe)
