# Grasshopper definition 4 - Comfort Analysis.gh (Grasshopper 0.9.76)
# plug-ins: Python Interpreter, Human

ladybug = Ladybug_Ladybug()  # -> Vviiiiiiiiiizzz; plug-in component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
honeybee = Honeybee_Honeybee()  # -> Vviiiiiiiiiizzz; plug-in component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

# ----
# Weather
path = FilePath("C:\Users\ocni\Dropbox\Uddannelse\DTU\Diverse\EPW_WeatherData\Abu_Dhabi\ARE_Abu.Dhabi.412170_IWEC.epw")
importepw = Ladybug_ImportEpw(epwFile=path)  # -> readMe, latitude, location, dryBulbTemperature, dewPointTemperature, relativeHumidity, windSpeed, windDirection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; plug-in component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
strnum = Ladybug_SeparateData(inputList=flatten(importepw.dryBulbTemperature))  # -> numbers, strings; plug-in component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
strnum_2 = Ladybug_SeparateData(inputList=flatten(importepw.windSpeed))  # -> numbers, strings; plug-in component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

number_slider = Slider(10, range=0..10)

# ----
# Geometry
wardi_curves = Curve([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])
canopy_curves = Curve([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])
ground_curves = Curve([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])
boundary = BoundarySurfaces(Edges=wardi_curves)
bbox = BoundingBox(Content=canopy_curves, Plane=PlaneXY(0, 0, 0))  # -> Box, Box_2
drec = DeconstuctRectangle(Rectangle=bbox.Box)  # -> BasePlane, XInterval, YInterval
dedomain = DeconstructDomain(Domain=drec.XInterval)  # -> Start, End
boundary_2 = BoundarySurfaces(Edges=ground_curves)
subtraction = Subtraction(A=dedomain.End, B=dedomain.Start)
mesh_uv = MeshSurface(Surface=boundary_2, UCount=number_slider, VCount=5, Overhang=True, Equalize=False)
mesh_uv_2 = MeshSurface(Surface=boundary, UCount=number_slider, VCount=Slider(2, range=1..5), Overhang=True, Equalize=False)
Z = UnitZ(Factor=subtraction)
extr = Extrude(Base=bbox.Box, Direction=Z)
multiplication = Multiplication(A=Z, B=Slider(0.75, range=0..1))
mjoin = MeshJoin(Meshes=flatten([mesh_uv_2, mesh_uv]))
move = Move(Geometry=extr, Motion=multiplication)  # -> Geometry, Transform

# ----
# Create Honeybee Zone
faceb = FaceBoundaries(Mesh=mjoin)
boundary_3 = BoundarySurfaces(Edges=faceb)
join = BrepJoin(Breps=flatten(boundary_3))  # -> Breps, Closed
Z_2 = UnitZ(Factor=-1)
extr_2 = Extrude(Base=join.Breps, Direction=Z_2)
mass2zone = Honeybee_Masses2Zones(zoneMasses=flatten(extr_2), isConditioned=True, maxRoofAngle=Slider(60, range=0..100), createHBZones=Toggle(True))  # -> readMe, HBZones; plug-in component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
hb_epcontextsrf = HoneybeeEPContextSurfaces(shdSurfaces=flatten(move.Geometry))  # -> HBContext; inputs shdSurfaces: list of Brep, justBoundingBox: Boolean
# ---------- hb_epcontextsrf: Python ----------
"""
prepare shading/context geometries

    Args:
        northVectorOrRotation: A vector that shows North or a number that shows
                               the rotation of the North from the Y axis
        bldgMasses: List of closed Breps as thermal zones.
    Returns:
        report: ...
        thermalZones: Thermal zone's geometries for visualiza
"""

ghenv.Component.Name = 'Honeybee EP context Surfaces'
ghenv.Component.NickName = 'HB_EPContextSrf'
ghenv.Component.Message = 'VER 0.0.61\nFEB_05_2017'
ghenv.Component.IconDisplayMode = ghenv.Component.IconDisplayMode.application
ghenv.Component.Category = "Honeybee"
ghenv.Component.SubCategory = "10 | Energy | Energy"
#compatibleHBVersion = VER 0.0.57\nNOV_04_2016
#compatibleLBVersion = VER 0.0.59\nFEB_01_2015
ghenv.Component.AdditionalHelpFromDocStrings = "2"

import rhinoscriptsyntax as rs
import Rhino as rc
import scriptcontext as sc
import os
import System
import Grasshopper.Kernel as gh
import uuid

tolerance = sc.doc.ModelAbsoluteTolerance
import math


def main(shdSurfaces, EPTransSchedule, meshingSettings, justBoundingBox):
    
    # import the classes
    if sc.sticky.has_key('honeybee_release'):

        try:
            if not sc.sticky['honeybee_release'].isCompatible(ghenv.Component): return -1
            if sc.sticky['honeybee_release'].isInputMissing(ghenv.Component): return -1
        except:
            warning = "You need a newer version of Honeybee to use this compoent." + \
            " Use updateHoneybee component to update userObjects.\n" + \
            "If you have already updated userObjects drag Honeybee_Honeybee component " + \
            "into canvas and try again."
            w = gh.GH_RuntimeMessageLevel.Warning
            ghenv.Component.AddRuntimeMessage(w, warning)
            return -1
        
        # don't customize this part
        hb_EPSrf = sc.sticky["honeybee_EPSurface"]
        hb_EPSHDSurface = sc.sticky["honeybee_EPShdSurface"]
        hb_RADMaterialAUX = sc.sticky["honeybee_RADMaterialAUX"]
        hb_EPObjectsAux = sc.sticky["honeybee_EPObjectsAUX"]()
        HBScheduleList = sc.sticky["honeybee_ScheduleLib"].keys()

        ########################################################################
        #----------------------------------------------------------------------#
        shdBreps = []
        # create bounding box of shading geometries
        if justBoundingBox:
            for brep in shdSurfaces:
                if brep.Faces.Count>1 or not brep.Faces[0].IsPlanar(sc.doc.ModelAbsoluteTolerance):
                    shdBreps.append(brep.GetBoundingBox(True).ToBrep())
                else:
                    shdBreps.append(brep)
        else:
            shdBreps = shdSurfaces
        
        shadingClasses = []
        shadingMeshPreview = []
        
        if meshingSettings == None:
            mp = rc.Geometry.MeshingParameters.Minimal
            mp.SimplePlanes = True
        else:
            mp = meshingSettings
        
        def getRadMaterialName(radMaterial):
            nameStr = radMaterial.split(" ")[2]
            name =  nameStr.split("\n")[0]
            return name
        
        for brepCount, brep in enumerate(shdBreps):
            if brep != None:
                isPlanar = True
                # check planarity
                for face in brep.Faces:
                    if not face.IsPlanar(tolerance):
                        isPlanar = False
                        break
                
                shadingBreps = []
                if not isPlanar:
                    meshArray = rc.Geometry.Mesh.CreateFromBrep(brep, mp)
                    for mesh in meshArray:
                        for meshFace in range(mesh.Faces.Count):
                            vertices = list(mesh.Faces.GetFaceVertices(meshFace))[1:]
                            vertices = vertices + [sc.doc.ModelAbsoluteTolerance]
                            # create the brep from mesh
                            shdBrep = rc.Geometry.Brep.CreateFromCornerPoints(*vertices)
                            shadingBreps.append(shdBrep)
                else:
                    for face in brep.Faces:
                        shadingBreps.append(face.DuplicateFace(False))
                
                for faceCount, shdBrep in enumerate(shadingBreps):
                        thisShading = hb_EPSHDSurface(shdBrep, 1000*brepCount + faceCount, 'shdSrf_' + `brepCount` + '_' + `faceCount` + "_" + str(uuid.uuid4()))
                        
                        # add transmittance schedule if any
                        if EPTransSchedule!=None:
                            schedule= EPTransSchedule.upper()
                            if schedule!=None and not schedule.lower().endswith(".csv") and schedule not in HBScheduleList:
                                msg = "Cannot find " + schedule + " in Honeybee schedule library."
                                print msg
                                ghenv.Component.AddRuntimeMessage(gh.GH_RuntimeMessageLevel.Warning, msg)
                                return -1
                            elif schedule!=None and schedule.lower().endswith(".csv"):
                                # check if csv file is existed
                                if not os.path.isfile(schedule):
                                    msg = "Cannot find the shchedule file: " + schedule
                                    print msg
                                    ghenv.Component.AddRuntimeMessage(gh.GH_RuntimeMessageLevel.Warning, msg)
                                    return -1
                            
                            thisShading.TransmittanceSCH = schedule
                        
                        # add the Rad Material if any
                        if RADMaterial!=None:
                            # if it is just the name of the material make sure it is already defined
                            if len(RADMaterial.split(" ")) == 1:
                                # if the material is not in the library add it to the library
                                if not hb_RADMaterialAUX.isMatrialExistInLibrary(RADMaterial):
                                    warningMsg = "Can't find " + RADMaterial + " in RAD Material Library.\n" + \
                                                "Add the material to the library and try again."
                                    ghenv.Component.AddRuntimeMessage(gh.GH_RuntimeMessageLevel.Warning, warningMsg)
                                    return
                                
                                try:
                                    thisShading.setRADMaterial(RADMaterial)
                                except Exception, e:
                                    print e
                                    warningMsg = "You are using an old version of Honeybee_Honeybee! Update your files and try again."
                                    print warningMsg
                                    ghenv.Component.AddRuntimeMessage(gh.GH_RuntimeMessageLevel.Warning, warningMsg)
                                    return
                                
                                addedToLib = True
                            else:
                                
                                # try to add the material to the library
                                addedToLib, thisShading.RadMaterial = hb_RADMaterialAUX.analyseRadMaterials(RADMaterial, True)
                                
                            if addedToLib==False:
                                warningMsg = "Failed to add " + RADMaterial + " to the Library."
                                ghenv.Component.AddRuntimeMessage(gh.GH_RuntimeMessageLevel.Warning, warningMsg)
                                return
                        
                        # add shading to the list
                        shadingClasses.append(thisShading)
                
        # add to the hive
        hb_hive = sc.sticky["honeybee_Hive"]()
        HBContext  = hb_hive.addToHoneybeeHive(shadingClasses, ghenv.Component)
        return HBContext
        ################################################################################################
    else:
        print "You should first let Honeybee to fly..."
        w = gh.GH_RuntimeMessageLevel.Warning
        ghenv.Component.AddRuntimeMessage(w, "You should first let Honeybee to fly...")
        return -1
        

if _shdSurfaces and _shdSurfaces[0]!=None:
    # add cleaning function
    result= main(_shdSurfaces, EPTransSchedule_, meshingSettings_, justBoundingBox_)
    
    if result != -1: HBContext = result
# ---------- end hb_epcontextsrf ----------
createepground = Honeybee_CreateEPGround(HBZones=mass2zone.HBZones, soilTypeOrMat=Slider(0, range=0..6))  # -> HBGrndZones; plug-in component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

# ----
# Preview
number_slider_2 = Slider(4, range=0..10)
wires = BrepWireframe(Brep=move.Geometry, Density=-1)
facen = FaceNormals(Mesh=mjoin)  # -> Centers, Normals
faceb_2 = FaceBoundaries(Mesh=mjoin)
previewlw = CustomPreviewLineweights(Geometry=wires, Shader=ColourSwatch(SwatchColor=RGB(31, 113, 0)), Thickness=number_slider_2, Absolute=False)
points = PointList(Points=facen.Centers)
preview = CustomPreview(Geometry=faceb_2, Shader=ColourSwatch(SwatchColor=RGB(0, 0, 0)))

# ----
# Compute View Factors
number_slider_3 = Slider(1.1, range=0..10)
faceb_3 = FaceBoundaries(Mesh=mjoin)
debrep = DeconstructBrep(Brep=move.Geometry)  # -> Faces, Edges, Vertices
genmesh = Ladybug_GenerateMesh(testGeometry=mjoin, distBaseSrf=number_slider_3, moveTestMesh=True)  # -> readMe, simplify(testPoints), simplify(ptsVectors), simplify(facesArea), simplify(mesh); plug-in component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
debrep_2 = DeconstructBrep(Brep=faceb_3)  # -> Faces, Edges, Vertices
merge = Merge(Data1=flatten(debrep_2.Faces), Data2=flatten(debrep.Faces))
srfviewfactors = Ladybug_SurfaceViewAnalysis(testPtsOrPlanes=flatten(genmesh.testPoints), testSrfs=merge, parallel=Toggle(True), runIt=Toggle(False))  # -> readMe, srfViewFactors, viewVecSrfIndex, viewVectors, viewPatches, viewPatchBasePt; plug-in component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

panel = Panel("\NewAir")

# ----
# Run
number_slider_4 = Slider(1, range=0..10)
panel_2 = Panel("""OutputControl:Table:Style,Comma;
Output:Variable,*,Surface Outside Face Temperature, hourly;""")
int = Integer(number_slider_4)
concat = Concatenate(FragmentA="Wadi_Optimized_v", FragmentB=int)
panel_3 = Panel("C:\Users\ocni\Dropbox\Uddannelse\DTU\Projekter\Speciale\Wadi")
panel_4 = Panel(concat)
exporttoopenstudio = Honeybee_ExportToOpenStudio(
    epwWeatherFile=path,
    HBZones=flatten(createepground),
    HBContext=flatten(hb_epcontextsrf),
    simulationOutputs=flatten(panel_2),
    writeOSM=Toggle(False),
    runSimulation=Toggle(False),
    fileName=panel_4,
    workingDir=panel_3)  # -> readMe, osmFileAddress, idfFileAddress, resultFileAddress, eioFileAddress, rddFileAddress, htmlReport, studyFolder; disabled; plug-in component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

# ----
# Look up results
panel_5 = Panel("\")
concat_2 = Concatenate(FragmentA=panel_3, FragmentB=panel_5, FragmentC=panel_4)
lookupfolder_energyplus = Honeybee_LookupEnergyPlusFolder(studyFolder=concat_2, refresh=Button())  # -> readMe, idfFiles, osmFiles, resultFileAddress, scheduleCsvFiles, rddFiles, errFiles, eioFiles, esoFiles, sqlFiles; disabled; plug-in component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
readepsrfresult = Honeybee_ReadEPSurfaceResult(resultFileAddress=lookupfolder_energyplus.resultFileAddress)  # -> surfaceIndoorTemp, surfaceOutdoorTemp, surfaceEnergyFlow, opaqueEnergyFlow, glazEnergyFlow, windowTotalSolarEnergy, windowBeamEnergy, windowDiffEnergy, windowTransmissivity, otherSurfaceData; plug-in component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

# ----
# Load Modified Air Conditions
panel_6 = Panel("\WindSpeeds\NewAir_0ms")
concat_3 = Concatenate(FragmentA=concat_2, FragmentB=panel_6)
load_air_result = LivestockLoadAirResult(ResultFolder=concat_3, LoadResult=Toggle(False))  # -> readMe, NewTemperature, NewRelativeHumidity, Latent_Heat_Flux
#   port ResultFolder: Path to result folder.
#   port LoadResult: Run component
#   port readMe: In case of any errors, it will be shown here.
#   port NewTemperature: New temperature in C.
#   port NewRelativeHumidity: New relative humidity in %.
#   port Latent_Heat_Flux: Latent Heat Flux in J/h
# ---------- load_air_result: Python ----------
from livestock.components.air import LoadAirResult

comp = LoadAirResult(ghenv)
comp.config()
comp.run_checks(ResultFolder, LoadResult)
comp.run()

NewTemperature = comp.results['temperature']
NewRelativeHumidity = comp.results['relative_humidity']
# ---------- end load_air_result ----------
number_slider_5 = Slider(0, range=0..100)
split = SplitList(List=load_air_result.NewTemperature, Index=number_slider_5)  # -> ListA, simplify(ListB)
split_2 = SplitList(List=load_air_result.NewRelativeHumidity, Index=number_slider_5)  # -> ListA, simplify(ListB)

# ----
# Find Correct Surfaces
importidf = Honeybee_ImportIdf(idfFile=lookupfolder_energyplus.idfFiles)  # -> readMe, HBZones, shadings; plug-in component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
colorsurfaces = Honeybee_ColorSurfacesByEPResult(srfData=readepsrfresult.surfaceOutdoorTemp, HBZones=flatten(importidf.HBZones), runIt=Toggle(True))  # -> readMe, srfColoredMesh, zoneWireFrame, legend, legendBasePt, analysisTitle, srfBreps, srfColors, srfValues, normalizedSrfData; plug-in component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
python = PythonScript(OriginalMesh=mjoin, HBMesh=colorsurfaces.srfColoredMesh)  # -> out, MapFrom, MapTo; inputs OriginalMesh: list, HBMesh: list
# ---------- python: Python ----------
import rhinoscriptsyntax as rs

ori_centers = rs.MeshFaceCenters(OriginalMesh)
MapFrom = []
MapTo = []

for i in xrange(0, len(ori_centers)):
    for j in xrange(0, len(HBMesh)):
        oc = ori_centers[i]
        for hbc in rs.MeshFaceCenters(HBMesh[j]):
            if oc[0] == hbc[0] and oc[1] == hbc[1] and oc[2] == hbc[2]:
                MapTo.append(i)
                MapFrom.append(j)
# ---------- end python ----------
path_2 = ConstructPath(Indices=graft(python.MapFrom))  # -> flatten(Branch)
path_3 = ConstructPath(Indices=graft(python.MapTo))  # -> flatten(Branch)
split_3 = SplitTree(Data=simplify(readepsrfresult.surfaceOutdoorTemp), Masks=flatten(path_2))  # -> Positive, Negative
panel_7 = Panel("""0
1
2
3
4
5
6""")
replace = ReplacePaths(Data=simplify(split_3.Positive), Search=path_2, Replace=path_3)
cull_i = CullIndex(List=replace, Indices=panel_7, Wrap=True)
flip = FlipMatrix(Data=cull_i)  # -> simplify(Data)

timer = Timer(TimerInterval=20, Target=fly)  # disabled
panel_8 = Panel("/Comfort_0ms")

# ----
# Combine Surface Temperatures
panel_9 = Panel("""45
46
47
50
51
52
55
56
57
71
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""")
lng = ListLength(List=flatten(debrep.Faces))

# ----
# Compute MRT
number_slider_6 = Slider(0, range=0..100)
solaradjusttemperature = Ladybug_OutdoorSolarTemperatureAdjustor(
    location=importepw.location,
    cumSkyMtxOrDirNormRad=importepw.directNormalRadiation,
    diffuseHorizRad=importepw.diffuseHorizontalRadiation,
    baseTemperature=strnum.numbers,
    horizInfraredRad=importepw.horizontalInfraredRadiation,
    bodyPosture=number_slider_6,
    bodyLocation=flatten(genmesh.testPoints),
    contextShading=move.Geometry,
    parallel=Toggle(True),
    runIt=Toggle(False))  # -> readMe, port, effectiveRadiantField, MRTDelta, solarAdjustedMRT, port_2, mannequinMesh, port_3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; plug-in component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
strnum_3 = Ladybug_SeparateData(inputList=flatten(solaradjusttemperature.MRTDelta))  # -> numbers, strings; plug-in component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

flip_2 = FlipMatrix(Data=strnum_3.numbers)

# ----
# Save MRT Results
panel_10 = Panel("/MRT")
concat_4 = Concatenate(FragmentA=concat_2, FragmentB="/MRT_0ms")

# ----
# Compute Comfort
toggle = BooleanToggle(False)

# ----
# Visualize Results
number_slider_7 = Slider(9, range=1..12)
doy_hoy = Ladybug_DOY_HOY(days=Slider(15, range=1..31), months=number_slider_7, hours=Slider(10, range=1..24))  # -> HOY, DOY, date; plug-in component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
concat_5 = Concatenate(FragmentA="Abu Dhabi UTCI", FragmentB=doy_hoy.date)
legendpar = Ladybug_LegendParameters()  # -> legendPar; plug-in component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

# ----
# Save Results
number_slider_8 = Slider(1, range=1..8760)
fly = Ladybug_fly(inputSliders=number_slider_8, fly=Toggle(False))  # -> Vviiiiiiiiiizzz; plug-in component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
concat_6 = Concatenate(FragmentA=concat_2, FragmentB="/Comfort")

subtraction_2 = Subtraction(A=number_slider_8, B=1)

item = TreeItem(Tree=split.ListB, Path=subtraction_2, Index=panel_9, Wrap=True)
avr = Average(Input=item)
dup = DuplicateData(Data=graft(avr), Number=lng, Order=True)  # -> simplify(Data)

dup_2 = DuplicateData(Data=graft(dup), Number=Slider(8760, range=0..10000), Order=True)
flip_3 = FlipMatrix(Data=dup_2)  # -> simplify(Data)

merge_2 = Merge(Data1=flip, Data2=flip_3)

branch = TreeBranch(Tree=merge_2, Path=subtraction_2, MaintainPaths=True)
mrt = Ladybug_MRTCalculator(temperatures=branch, viewFactors=srfviewfactors.srfViewFactors)  # -> MRT; plug-in component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
branch_2 = TreeBranch(Tree=flip_2, Path=subtraction_2, MaintainPaths=True)
addition = Addition(A=flatten(mrt), B=branch_2)

item_2 = ListItem(List=strnum_2.numbers, Index=subtraction_2, Wrap=True)
branch_3 = TreeBranch(Tree=split.ListB, Path=subtraction_2, MaintainPaths=True)
branch_4 = TreeBranch(Tree=split_2.ListB, Path=subtraction_2, MaintainPaths=True)
outdoorcomfortcalculator = Ladybug_OutdoorComfortCalculator(
    dryBulbTemperature=branch_3,
    meanRadiantTemperature=addition,
    windSpeed_tenMeters=item_2,
    relativeHumidity=branch_4,
    runIt=toggle)  # -> readMe, port, universalThermalClimateIndex, comfortableOrNot, thermalStress, conditionOfPerson, port_2, percentOfTimeComfortable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; plug-in component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

expression = Expression(x=addition, Expression="Round(x, 2)")
int_2 = Integer(subtraction_2)
concat_7 = Concatenate(FragmentA="MRT_", FragmentB=int_2)
write = FileWrite(Path=concat_4, Name=concat_7, Text=expression, Write=Toggle(False))  # inputs Text: list, Write: Boolean
# ---------- write: Python ----------
# File write(Write)

# @license GPL-3.0+ <http://spdx.org/licenses/GPL-3.0+>


"""
Write strings to into a file.
-
Made by Christian Kongsgaard. 

    
    Args:
        Path: Input string with disired file path.
        Name: Input string with disired file name.
        Text: Strings you wish to be written.
        Filetype: Suffix for the file. Default is txt.
        Write: Boolean. Set to 1 to write file.

"""

ghenv.Component.Name = "File write"
ghenv.Component.NickName = 'Write'
ghenv.Component.Message = 'VER 0.0.1\nApril_2016'
ghenv.Component.IconDisplayMode = ghenv.Component.IconDisplayMode.application
ghenv.Component.Category = "Christian"
ghenv.Component.SubCategory = "1 | Custom"

###

import os

if Filetype == None:
    Filetype = "txt"

if Write:
    
    # Make file path name with extension
    filePath = os.path.join(Path,Name + "."+str(Filetype))
    
    # Open file
    fileWrite = open(filePath,"w")
    
    # Write text data to file
    i = 0
    while i <len(Text):
        if i == len(Text)-1:
            fileWrite.write(Text[i])
        else:
            fileWrite.write(Text[i] + "\n")
        i +=1
    
    # Close file
    fileWrite.close()
# ---------- end write ----------

expression_2 = Expression(x=outdoorcomfortcalculator.universalThermalClimateIndex, Expression="Round(x, 4)")

int_3 = Integer(subtraction_2)
concat_8 = Concatenate(FragmentA="UTCI_", FragmentB=int_3)
write_2 = FileWrite(Path=concat_6, Name=concat_8, Text=expression_2, Write=Toggle(False))  # inputs Text: list, Write: Boolean; same code as write

recolormesh = Ladybug_RecolorMesh(
    analysisResult=outdoorcomfortcalculator.universalThermalClimateIndex,
    inputMesh=mjoin,
    legendPar=legendpar,
    analysisTitle=concat_5,
    legendTitle="C")  # -> readMe, newMesh, newLegend, legendBasePt, meshColors, legendColors; disabled; plug-in component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
