# Grasshopper definition 5 - Comfort Results.gh (Grasshopper 0.9.76)
# plug-ins: Python Interpreter, Human

ladybug = Ladybug_Ladybug()  # -> Vviiiiiiiiiizzz; plug-in component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

# ----
# Geometry
wardi_curves = Curve([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])
ground_curves = Curve([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])
canopy_curves = Curve([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])
number_slider = Slider(10, range=0..10)
boundary = BoundarySurfaces(Edges=wardi_curves)
bbox = BoundingBox(Content=canopy_curves, Plane=PlaneXY(0, 0, 0))  # -> Box, Box_2
drec = DeconstuctRectangle(Rectangle=bbox.Box)  # -> BasePlane, XInterval, YInterval
dedomain = DeconstructDomain(Domain=drec.XInterval)  # -> Start, End
boundary_2 = BoundarySurfaces(Edges=ground_curves)
subtraction = Subtraction(A=dedomain.End, B=dedomain.Start)
mesh_uv = MeshSurface(Surface=boundary_2, UCount=number_slider, VCount=5, Overhang=True, Equalize=False)
mesh_uv_2 = MeshSurface(Surface=boundary, UCount=number_slider, VCount=Slider(2, range=1..5), Overhang=True, Equalize=False)
Z = UnitZ(Factor=subtraction)
extr = Extrude(Base=bbox.Box, Direction=Z)
multiplication = Multiplication(A=Z, B=Slider(0.75, range=0..1))
mjoin = MeshJoin(Meshes=flatten([mesh_uv_2, mesh_uv]))
mjoin_2 = MeshJoin(Meshes=mesh_uv)
move = Move(Geometry=extr, Motion=multiplication)  # -> Geometry, Transform

# ----
# File
number_slider_2 = Slider(1, range=0..10)
int = Integer(number_slider_2)
concat = Concatenate(FragmentA="Wadi_Optimized_v", FragmentB=int)
python = PythonScript()  # -> out, DBpath
# ---------- python: Python ----------
import getpass

DBpath = 'C:/Users/' + getpass.getuser() + '/Dropbox'
# ---------- end python ----------
panel = Panel(concat)
concat_2 = Concatenate(FragmentA=python.DBpath, FragmentB="\Uddannelse\DTU\Projekter\Speciale\Wadi")
concat_3 = Concatenate(FragmentA=concat_2, FragmentB="\", FragmentC=panel)

# ----
# Date
number_slider_3 = Slider(1, range=1..31)
doy_hoy = Ladybug_DOY_HOY(days=number_slider_3, months=Slider(1, range=1..12), hours=Slider(12, range=1..24))  # -> HOY, DOY, date; plug-in component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
data = Data(doy_hoy.HOY)

honeybee = Honeybee_Honeybee()  # -> Vviiiiiiiiiizzz; plug-in component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
addition = Addition(A=Slider(11, range=0..8760), B=1)
day_month_hour_calculator = Ladybug_Day_Month_Hour(HOY=addition)  # -> day, month, hour, date; plug-in component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
panel_2 = Panel("""0
1
2
3""")
project = Project(Geometry=extr, Plane=PlaneXY(0, 0, 0))  # -> Geometry, Transform
edges = BrepEdges(Brep=project.Geometry)  # -> Naked, Interior, NonManifold
item = ListItem(List=edges.Interior, Index=panel_2, Wrap=True)

# ----
# Preview
number_slider_4 = Slider(4, range=0..5)
wires = BrepWireframe(Brep=move.Geometry, Density=-1)
facen = FaceNormals(Mesh=mjoin)  # -> Centers, Normals
faceb = FaceBoundaries(Mesh=mjoin_2)
previewlw = CustomPreviewLineweights(Geometry=wires, Shader=ColourSwatch(SwatchColor=RGB(31, 113, 0)), Thickness=number_slider_4, Absolute=False)
points = PointList(Points=facen.Centers)
preview = CustomPreview(Geometry=faceb, Shader=ColourSwatch(SwatchColor=RGB(0, 0, 0)))

join = JoinCurves(Curves=item, Preserve=False)

# ----
# Look up Ground Temperature Results
button = Button()
lookupfolder_energyplus = Honeybee_LookupEnergyPlusFolder(studyFolder=concat_3, refresh=button)  # -> readMe, idfFiles, osmFiles, resultFileAddress, scheduleCsvFiles, rddFiles, errFiles, eioFiles, esoFiles, sqlFiles; disabled; plug-in component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
readepsrfresult = Honeybee_ReadEPSurfaceResult(resultFileAddress=lookupfolder_energyplus.resultFileAddress)  # -> surfaceIndoorTemp, surfaceOutdoorTemp, surfaceEnergyFlow, opaqueEnergyFlow, glazEnergyFlow, windowTotalSolarEnergy, windowBeamEnergy, windowDiffEnergy, windowTransmissivity, otherSurfaceData; plug-in component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

panel_3 = Panel("""18
54""")

# ----
# Low & High Bounds
bnd = Bounds(Numbers=flatten(panel_3))
dedomain_2 = DeconstructDomain(Domain=bnd)  # -> Start, End

importidf = Honeybee_ImportIdf(idfFile=lookupfolder_energyplus.idfFiles)  # -> readMe, HBZones, shadings; plug-in component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
colorsurfaces = Honeybee_ColorSurfacesByEPResult(
    srfData=readepsrfresult.surfaceOutdoorTemp,
    HBZones=flatten(importidf.HBZones),
    stepOfSimulation=data,
    runIt=Toggle(False))  # -> readMe, srfColoredMesh, zoneWireFrame, legend, legendBasePt, analysisTitle, srfBreps, srfColors, srfValues, normalizedSrfData; plug-in component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

# ----
# Comfort
number_slider_5 = Slider(1, range=0..23)
gradientlibrary = Ladybug_GradientLibrary(gradIndex=number_slider_5)  # -> customColors; plug-in component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
concat_4 = Concatenate(FragmentA=concat_3, FragmentB="\Comfort\UTCI_")
int_2 = Integer(data)
panel_4 = Panel("""Thermal Comfort with Evapotranspiration
Abu Dhabi - """)
legendpar = Ladybug_LegendParameters(
    lowBound=dedomain_2.Start,
    highBound=dedomain_2.End,
    numSegments=Slider(25, range=11..31),
    customColors=flatten(gradientlibrary),
    legendScale=Slider(0.4, range=0..1),
    font="Arial",
    fontSize=Slider(0.75, range=0..1),
    decimalPlaces=Slider(1, range=0..1))  # -> legendPar; plug-in component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
panel_5 = Panel("""Universal Thermal 
Climate Index - °C""")
concat_5 = Concatenate(FragmentA=concat_4, FragmentB=int_2, FragmentC=".txt")
file = ReadFile(File=concat_5, PerLineParse=True)
concat_6 = Concatenate(FragmentA=panel_4, FragmentB=doy_hoy.date)
recolormesh = Ladybug_RecolorMesh(
    analysisResult=file,
    inputMesh=mjoin,
    legendPar=legendpar,
    analysisTitle=concat_6,
    legendTitle=panel_5,
    bakeIt=Button(),
    layerName=doy_hoy.date)  # -> readMe, newMesh, newLegend, legendBasePt, meshColors, legendColors; plug-in component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
swatch = ColourSwatch(SwatchColor=RGB(0, 0, 0))
preview_2 = CustomPreview(Geometry=recolormesh.newMesh, Shader=swatch)
preview_3 = CustomPreview(Geometry=recolormesh.newLegend, Shader=swatch)

python_2 = PythonScript(OriginalMesh=mjoin, HBMesh=colorsurfaces.srfColoredMesh)  # -> out, MapFrom, MapTo; inputs OriginalMesh: list, HBMesh: list; disabled
# ---------- python_2: Python ----------
import rhinoscriptsyntax as rs

ori_centers = rs.MeshFaceCenters(OriginalMesh)
MapFrom = []
MapTo = []

for i in xrange(0, len(ori_centers)):
    for j in xrange(0, len(HBMesh)):
        oc = ori_centers[i]
        for hbc in rs.MeshFaceCenters(HBMesh[j]):
            if oc[0] == hbc[0] and oc[1] == hbc[1] and oc[2] == hbc[2]:
                MapTo.append(i)
                MapFrom.append(j)
# ---------- end python_2 ----------
path = ConstructPath(Indices=graft(python_2.MapFrom))  # -> flatten(Branch)
path_2 = ConstructPath(Indices=graft(python_2.MapTo))  # -> flatten(Branch)
split = SplitTree(Data=simplify(readepsrfresult.surfaceOutdoorTemp), Masks=flatten(path))  # -> Positive, Negative
panel_6 = Panel("""0
1
2
3
4
5
6""")
replace = ReplacePaths(Data=simplify(split.Positive), Search=path, Replace=path_2)
cull_i = CullIndex(List=replace, Indices=panel_6, Wrap=True)
flip = FlipMatrix(Data=cull_i)  # -> simplify(Data)
gradientlibrary_2 = Ladybug_GradientLibrary(gradIndex=Slider(1, range=0..23))  # -> customColors; plug-in component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

# ----
# Ground Temperature
number_slider_6 = Slider(75, range=0..100)
panel_7 = Panel("""Ground Temperature
Abu Dhabi - """)
legendpar_2 = Ladybug_LegendParameters(
    lowBound=Slider(20, range=0..100),
    highBound=number_slider_6,
    numSegments=Slider(23, range=11..31),
    customColors=flatten(gradientlibrary_2),
    legendScale=Slider(0.435, range=0..1),
    font="Arial",
    fontSize=Slider(0.75, range=0..1),
    decimalPlaces=Slider(1, range=0..1))  # -> legendPar; plug-in component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
branch = TreeBranch(Tree=simplify(flip), Path=data, MaintainPaths=True)
concat_7 = Concatenate(FragmentA=panel_7, FragmentB=doy_hoy.date)
recolormesh_2 = Ladybug_RecolorMesh(
    analysisResult=branch,
    inputMesh=mjoin,
    legendPar=legendpar_2,
    analysisTitle=concat_7,
    legendTitle="°C",
    bakeIt=Button(),
    layerName=doy_hoy.date)  # -> readMe, newMesh, newLegend, legendBasePt, meshColors, legendColors; disabled; plug-in component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
swatch_2 = ColourSwatch(SwatchColor=RGB(0, 0, 0))
preview_4 = CustomPreview(Geometry=recolormesh_2.newMesh, Shader=swatch_2)
preview_5 = CustomPreview(Geometry=recolormesh_2.newLegend, Shader=swatch_2)
