# Grasshopper definition Comfort Comparison - 0ms.gh (Grasshopper 0.9.76)
# plug-ins: Python Interpreter, Human

# ----
# Geometry
wardi_curves = Curve([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])
ground_curves = Curve([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])
canopy_curves = Curve([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])
number_slider = Slider(10, range=0..10)
boundary = BoundarySurfaces(Edges=wardi_curves)
bbox = BoundingBox(Content=canopy_curves, Plane=PlaneXY(0, 0, 0))  # -> Box, Box_2
drec = DeconstuctRectangle(Rectangle=bbox.Box)  # -> BasePlane, XInterval, YInterval
dedomain = DeconstructDomain(Domain=drec.XInterval)  # -> Start, End
boundary_2 = BoundarySurfaces(Edges=ground_curves)
subtraction = Subtraction(A=dedomain.End, B=dedomain.Start)
mesh_uv = MeshSurface(Surface=boundary_2, UCount=number_slider, VCount=5, Overhang=True, Equalize=False)
mesh_uv_2 = MeshSurface(Surface=boundary, UCount=number_slider, VCount=Slider(2, range=1..5), Overhang=True, Equalize=False)
Z = UnitZ(Factor=subtraction)
extr = Extrude(Base=bbox.Box, Direction=Z)
multiplication = Multiplication(A=Z, B=Slider(0.75, range=0..1))
mjoin = MeshJoin(Meshes=flatten([mesh_uv_2, mesh_uv]))
mjoin_2 = MeshJoin(Meshes=mesh_uv)
move = Move(Geometry=extr, Motion=multiplication)  # -> Geometry, Transform

# ----
# Date
number_slider_2 = Slider(1, range=1..31)
doy_hoy = Ladybug_DOY_HOY(days=number_slider_2, months=Slider(1, range=1..12), hours=Slider(12, range=1..24))  # -> HOY, DOY, date; plug-in component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
subtraction_2 = Subtraction(A=Slider(2337, range=0..8760), B=1)
data = Data(doy_hoy.HOY)

# ----
# Copy Meshes
number_slider_3 = Slider(7, range=0..30, expression="x*5")
neg = Negative(Value=number_slider_3)
neg_2 = Negative(Value=number_slider_3)
X = UnitX(Factor=number_slider_3)
X_2 = UnitX(Factor=[number_slider_3, neg])
X_3 = UnitX(Factor=neg_2)
move_2 = Move(Geometry=move.Geometry, Motion=graft(X_2))  # -> Geometry, Transform
move_3 = Move(Geometry=mjoin, Motion=X_3)  # -> Geometry, Transform
move_4 = Move(Geometry=mjoin, Motion=X)  # -> Geometry, Transform

ladybug = Ladybug_Ladybug()  # -> Vviiiiiiiiiizzz; plug-in component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
panel = Panel("""0
1
2
3""")
project = Project(Geometry=[extr, move_2.Geometry], Plane=PlaneXY(0, 0, 0))  # -> Geometry, Transform
edges = BrepEdges(Brep=project.Geometry)  # -> Naked, Interior, NonManifold

# ----
# Preview
number_slider_4 = Slider(4, range=0..5)
wires = BrepWireframe(Brep=move.Geometry, Density=-1)
facen = FaceNormals(Mesh=mjoin)  # -> Centers, Normals
faceb = FaceBoundaries(Mesh=mjoin)
previewlw = CustomPreviewLineweights(Geometry=wires, Shader=ColourSwatch(SwatchColor=RGB(31, 113, 0)), Thickness=number_slider_4, Absolute=False)
points = PointList(Points=facen.Centers)
preview = CustomPreview(Geometry=faceb, Shader=ColourSwatch(SwatchColor=RGB(0, 0, 0)))

item = ListItem(List=edges.Interior, Index=panel, Wrap=True)

# ----
# Preview
number_slider_5 = Slider(4, range=0..5)
wires_2 = BrepWireframe(Brep=move_2.Geometry, Density=-1)
faceb_2 = FaceBoundaries(Mesh=[move_4.Geometry, move_3.Geometry])
previewlw_2 = CustomPreviewLineweights(Geometry=wires_2, Shader=ColourSwatch(SwatchColor=RGB(31, 113, 0)), Thickness=number_slider_5, Absolute=False)
preview_2 = CustomPreview(Geometry=faceb_2, Shader=ColourSwatch(SwatchColor=RGB(0, 0, 0)))

join = JoinCurves(Curves=item, Preserve=False)

python = PythonScript()  # -> out, DBpath
# ---------- python: Python ----------
import getpass

DBpath = 'C:/Users/' + getpass.getuser() + '/Dropbox'
# ---------- end python ----------
concat = Concatenate(FragmentA=python.DBpath, FragmentB="\Uddannelse\DTU\Projekter\Speciale\Wadi\")

panel_2 = Panel("""20
55""")
button = Button()

# ----
# Low & High Bounds
bnd = Bounds(Numbers=flatten(panel_2))
dedomain_2 = DeconstructDomain(Domain=bnd)  # -> Start, End

number_slider_6 = Slider(15, range=11..30)
number_slider_7 = Slider(0.67, range=0..1)
number_slider_8 = Slider(0.75, range=0..1)
gradientlibrary = Ladybug_GradientLibrary(gradIndex=Slider(1, range=0..1))  # -> customColors; plug-in component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
concat_2 = Concatenate(FragmentA="without ", FragmentB=doy_hoy.date)
concat_3 = Concatenate(FragmentA="difference ", FragmentB=doy_hoy.date)
concat_4 = Concatenate(FragmentA="with ", FragmentB=doy_hoy.date)

# ----
# Without Vapour
panel_3 = Panel("Wadi_No_CMF\Wadi_v1\Comfort\UTCI_")
int = Integer(data)
concat_5 = Concatenate(FragmentA=concat, FragmentB=panel_3)
legendpar = Ladybug_LegendParameters(
    lowBound=dedomain_2.Start,
    highBound=dedomain_2.End,
    numSegments=number_slider_6,
    customColors=flatten(gradientlibrary),
    legendScale=number_slider_7,
    font="Arial",
    fontSize=number_slider_8,
    decimalPlaces=Slider(1, range=0..1))  # -> legendPar; plug-in component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
panel_4 = Panel("""Universal Thermal 
Climate Index - °C""")
swatch = ColourSwatch(SwatchColor=RGB(0, 0, 0))

python_2 = PythonScript(x=int)  # -> out, a
# ---------- python_2: Python ----------
x_str = str(x)

if len(x_str) == 1:
    a = '000' + x_str
elif len(x_str) == 2:
    a = '00' + x_str
elif len(x_str) == 3:
    a = '0' + x_str
else:
    a = x_str
# ---------- end python_2 ----------
concat_6 = Concatenate(FragmentA="Without Evapotranspiration", FragmentB=doy_hoy.date)

concat_7 = Concatenate(FragmentA=concat_5, FragmentB=python_2.a, FragmentC=".txt")
file = ReadFile(File=concat_7, PerLineParse=True)
recolormesh = Ladybug_RecolorMesh(
    analysisResult=file,
    inputMesh=move_3.Geometry,
    legendPar=legendpar,
    analysisTitle=concat_6,
    legendTitle=panel_4,
    bakeIt=button,
    layerName=concat_2)  # -> readMe, newMesh, newLegend, legendBasePt, meshColors, legendColors; plug-in component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
preview_3 = CustomPreview(Geometry=recolormesh.newMesh, Shader=swatch)
preview_4 = CustomPreview(Geometry=recolormesh.newLegend, Shader=swatch)

# ----
# Difference
number_slider_9 = Slider(5, range=0..23)
gradientlibrary_2 = Ladybug_GradientLibrary(gradIndex=number_slider_9)  # -> customColors; plug-in component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
legendpar_2 = Ladybug_LegendParameters(
    lowBound=Slider(0, range=0..100),
    highBound=Slider(15, range=0..100),
    numSegments=Slider(16, range=0..100),
    customColors=flatten(gradientlibrary_2),
    legendScale=Slider(0.625, range=0..1),
    font="Arial",
    fontSize=number_slider_8,
    decimalPlaces=Slider(1, range=0..3))  # -> legendPar; plug-in component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
swatch_2 = ColourSwatch(SwatchColor=RGB(0, 0, 0))

concat_8 = Concatenate(FragmentA="Thermal Comfort - Difference", FragmentB=doy_hoy.date)

# ----
# With Vapour
panel_5 = Panel("Wadi_Optimized_v1\Comfort_0ms\UTCI_")
int_2 = Integer(data)
concat_9 = Concatenate(FragmentA=concat, FragmentB=panel_5)
legendpar_3 = Ladybug_LegendParameters(
    lowBound=dedomain_2.Start,
    highBound=dedomain_2.End,
    numSegments=number_slider_6,
    customColors=flatten(gradientlibrary),
    legendScale=number_slider_7,
    font="Arial",
    fontSize=number_slider_8,
    decimalPlaces=Slider(1, range=0..1))  # -> legendPar; plug-in component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
panel_6 = Panel("""Universal Thermal 
Climate Index - °C""")
swatch_3 = ColourSwatch(SwatchColor=RGB(0, 0, 0))

python_3 = PythonScript(x=int_2)  # -> out, a; same code as python_2
concat_10 = Concatenate(FragmentA="With Evapotranspiration", FragmentB=doy_hoy.date)

concat_11 = Concatenate(FragmentA=concat_9, FragmentB=python_3.a, FragmentC=".txt")
file_2 = ReadFile(File=concat_11, PerLineParse=True)
recolormesh_2 = Ladybug_RecolorMesh(
    analysisResult=file_2,
    inputMesh=mjoin,
    legendPar=legendpar_3,
    analysisTitle=concat_10,
    legendTitle=panel_6,
    bakeIt=button,
    layerName=concat_4)  # -> readMe, newMesh, newLegend, legendBasePt, meshColors, legendColors; plug-in component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
preview_5 = CustomPreview(Geometry=recolormesh_2.newMesh, Shader=swatch_3)
preview_6 = CustomPreview(Geometry=recolormesh_2.newLegend, Shader=swatch_3)

subtraction_3 = Subtraction(A=file, B=file_2)
recolormesh_3 = Ladybug_RecolorMesh(
    analysisResult=subtraction_3,
    inputMesh=move_4.Geometry,
    legendPar=legendpar_2,
    analysisTitle=concat_8,
    legendTitle="°C",
    bakeIt=button,
    layerName=concat_3)  # -> readMe, newMesh, newLegend, legendBasePt, meshColors, legendColors; plug-in component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
preview_7 = CustomPreview(Geometry=recolormesh_3.newMesh, Shader=swatch_2)
preview_8 = CustomPreview(Geometry=recolormesh_3.newLegend, Shader=swatch_2)
